# Grasshopper definition Rush_workFlow.gh (Grasshopper 1.0.7)
# plug-ins: DotsProj

path = FilePath("C:\nir_dev\MegaSavageLevel\DotsProjRh6\DotsProj\DotsProj\SourceCode\test_scripts\dots_workflow\inputs\sample1.csv")
crv = Curve(<curve referenced from the Rhino model>)
curve_skeleton = CrvSkeleton(
    InpFilePath=path,
    InpSiteCurve=crv,
    FromSiteOuterCirculationDepth=Slider(5, range=0..20),
    FromOuterCirculationBayDepth=Slider(43, range=0..50),
    FromBayDepthInnerCirculationDepth=Slider(9, range=0..20),
    SensitivityX100=Slider(5, range=0..5),
    OptimizationItrs=Slider(445, range=0..500))  # -> OuterOffsetCrv, InnerOffsetCrv, RESULTSegGeom
geo = Geometry(curve_skeleton.OuterOffsetCrv)
geo_2 = Geometry(curve_skeleton.InnerOffsetCrv)
geo_3 = Geometry(curve_skeleton.RESULTSegGeom)
randomize = BooleanToggle(False)
geo_4 = Geometry(geo_2)
path_2 = FilePath("C:\nir_dev\MegaSavageLevel\DotsProjRh6\DotsProj\DotsProj\SourceCode\test_scripts\dots_workflow\inputs\sample2.csv")
cbsp_site = CbspSite(
    InputFilesCsv=path_2,
    InputSiteCrv=geo_4,
    RotationInDegrees=Slider(0, range=0..360),
    RandomizedGenerations=randomize,
    NumberOfOptimizationLoops=Slider(1, range=1..100))  # -> SpatialCrv, CirculationLines
geo_5 = Geometry(cbsp_site.SpatialCrv)
geo_6 = Geometry(cbsp_site.CirculationLines)
circulation = GenerateCirculation(SiteCrvOuterBoundary=geo_4, CbspCrvs=geo_5, PartitionLines=geo_6, CirculationDepth=Slider(3.36, range=0..10))  # -> _0PartitionLines, _1CirculationPoly, _2ResultantCbspCrv
Z = UnitZ(Factor=Slider(12.876, range=0..20))
crv_2 = Curve(circulation._2ResultantCbspCrv)
extr = Extrude(Base=crv_2, Direction=Z)
