# Grasshopper definition flr_plan_gen.gh (Grasshopper 1.0.7)
# plug-ins: DotsProj

randomize = BooleanToggle(False)
path = FilePath("C:\nir_dev\MegaSavageLevel\DotsProjRh6\DotsProj\DotsProj\SourceCode\TEST_SCRIPTS\dots_workflow\DOTS_workflow_test\inputs\sample1.csv")
path_2 = FilePath("C:\nir_dev\MegaSavageLevel\DotsProjRh6\DotsProj\DotsProj\SourceCode\TEST_SCRIPTS\dots_workflow\DOTS_workflow_test\inputs\sample1.csv")
crv = Curve(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)
path_3 = FilePath("C:\nir_dev\MegaSavageLevel\DotsProjRh6\DotsProj\DotsProj\SourceCode\TEST_SCRIPTS\dots_workflow\DOTS_workflow_test\inputs\sample1.csv")
geo = Geometry(<curve referenced from the Rhino model>)
cbsp = CbspIndependent(
    InputFilesCsv=path,
    RotationInDegrees=Slider(0, range=0..360),
    RatioLengthWidth=Slider(0.659, range=0..2),
    RandomizedGenerations=Toggle(False),
    NumberOfOptimizationLoops=Slider(262, range=0..360))  # -> OuterBoundary, BspOutputCurves, PartitionLines; disabled
path_4 = FilePath("C:\nir_dev\MegaSavageLevel\DotsProjRh6\DotsProj\DotsProj\SourceCode\TEST_SCRIPTS\dots_workflow\DOTS_workflow_test\rush\inputsToDots\rushCoreZones.csv")
crv_2 = Curve(<curve referenced from the Rhino model>)
curve_skeleton = CrvSkeleton(
    InpFilePath=path_2,
    InpSiteCurve=crv,
    FromSiteOuterCirculationDepth=Slider(2, range=0..20),
    FromOuterCirculationBayDepth=Slider(7, range=0..50),
    FromBayDepthInnerCirculationDepth=Slider(2, range=0..20),
    SensitivityX100=Slider(5, range=0..5),
    OptimizationItrs=Slider(0, range=0..500))  # -> OuterOffsetCrv, InnerOffsetCrv, RESULTSegGeom, DebugString; disabled
path_5 = FilePath("C:\nir_dev\MegaSavageLevel\DotsProjRh6\DotsProj\DotsProj\SourceCode\TEST_SCRIPTS\dots_workflow\DOTS_workflow_test\inputs\sample1.csv")
cbsp_site = CbspSite(
    InputFilesCsv=path_3,
    InputSiteCrv=geo,
    RotationInDegrees=Slider(0, range=0..360),
    RandomizedGenerations=randomize,
    NumberOfOptimizationLoops=Slider(1, range=1..100))  # -> SpatialCrv, CirculationLines, DebugText; disabled
exploratory_mcmc = EMcMC(InpFilePath=path_5, SensitivityNumIterations=Slider(3, range=0..10), Rotation=Slider(0, range=0..360))  # disabled
radial_zone_core = RadialZoneCore(
    InputFilesCsv=path_4,
    InputSiteCrv=crv_2,
    CoreArea=Slider(652.497, range=0..1000),
    MoveCoreHorizontal=Slider(1, range=0..100),
    MoveCoreVertical=Slider(1, range=0..100),
    CoreAspectRatio=Slider(1, range=0..1),
    RotationInDegrees=Slider(0, range=0..360))  # -> CoreCrv, ZoneCrvsRad
geo_2 = Geometry(cbsp.OuterBoundary)
geo_3 = Geometry(cbsp.BspOutputCurves)
geo_4 = Geometry(cbsp.PartitionLines)
geo_5 = Geometry(cbsp_site.CirculationLines)
geo_6 = Geometry(cbsp_site.SpatialCrv)
Z = UnitZ(Factor=Slider(80, range=0..500))
crv_3 = Curve(exploratory_mcmc)
geo_7 = Geometry(curve_skeleton.OuterOffsetCrv)
geo_8 = Geometry(curve_skeleton.InnerOffsetCrv)
geo_9 = Geometry(curve_skeleton.RESULTSegGeom)
circulation = GenerateCirculation(SiteCrvOuterBoundary=geo_2, CbspCrvs=geo_3, PartitionLines=geo_4, CirculationDepth=Slider(2, range=0..2))  # -> _0PartitionLines, _1CirculationPoly, _2ResultantCbspCrv; disabled
circulation_2 = GenerateCirculation(SiteCrvOuterBoundary=geo, CbspCrvs=geo_6, PartitionLines=geo_5, CirculationDepth=Slider(2.64, range=0..10))  # -> _0PartitionLines, _1CirculationPoly, _2ResultantCbspCrv; disabled
panel = Panel(cbsp_site.DebugText)
block = MassingExtrudeBlock(
    SiteCurve=crv_3,
    Setback=Slider(3, range=0..5),
    FsrFar=Slider(2, range=0..20),
    FLRHT=Slider(5, range=0..5),
    MinCrvArea=Slider(13, range=0..20))  # -> OutputExtrudedMass, FloorCurves; disabled
Z_2 = UnitZ(Factor=Slider(20, range=0..20))
extr = Extrude(Base=[geo_9, geo_8, geo_7], Direction=Z)  # disabled
crv_4 = Curve(geo_6)
extr_2 = Extrude(Base=crv_4, Direction=Z_2)
geo_10 = Geometry(circulation._2ResultantCbspCrv)
geo_11 = Geometry(circulation._0PartitionLines)
geo_12 = Geometry(circulation._1CirculationPoly)
geo_13 = Geometry(circulation_2._2ResultantCbspCrv)
geo_14 = Geometry(circulation_2._0PartitionLines)
Z_3 = UnitZ(Factor=Slider(20, range=0..20))
extr_3 = Extrude(Base=[geo_2, geo_10], Direction=Z_3)
