# Grasshopper definition networks.gh (Grasshopper 1.0.7)
# plug-ins: DotsProj

path = FilePath("C:\nir_dev\MegaSavageLevel\DotsProjRh6\DotsProj\DotsProj\SourceCode\test_scripts\dots_workflow\DOTS_workflow_test\inputs\network_SA.csv")
node_edge_allocation = NodeEdgeAllocation(InpFilePath=path)  # -> Debug, NodeObjects, CostObjects; disabled
panel = Panel(node_edge_allocation.CostObjects)
panel_2 = Panel(node_edge_allocation.Debug)
panel_3 = Panel(node_edge_allocation.NodeObjects)
geo = Geometry(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)
mixednet = MixedSysMain(
    NodesFromParser=node_edge_allocation.NodeObjects,
    CostFromParser=node_edge_allocation.CostObjects,
    SiteCurve=geo,
    NumberXAxis=Slider(5, range=0..20),
    NumberYAxis=Slider(5, range=0..20),
    CirculationDepth=Slider(0.91, range=0..5),
    NumberOfIterations=Slider(100, range=0..100),
    MinimumAreaOfCurve=Slider(67, range=0..150))  # -> DebugText, NodeGeometryOutput, Curve; disabled
geo_2 = Geometry(mixednet.Curve)
panel_4 = Panel(mixednet.NodeGeometryOutput)
panel_5 = Panel(mixednet.DebugText)
number_slider = Slider(0, range=0..150)
block = MassingExtrudeBlock(
    SiteCurve=geo_2,
    Setback=Slider(0.607, range=0..5),
    FsrFar=panel_4,
    FLRHT=Slider(4.715, range=0..5),
    MinCrvArea=Slider(0, range=0..150))  # -> OutputMassingBreps, OutputFloorCurves; disabled
staggered_courtyard_interp = StaggeredCourtyardInterpolated(
    Site=geo_2,
    Setback=Slider(0.607, range=0..5),
    BaseDepthOffset=Slider(2.299, range=0..5),
    NumOfTowerFootprintsBaseCrvSubdiv=Slider(5, range=0..5),
    NumberOfTowers=Slider(2, range=0..5),
    FloorFloorHeight=Slider(1.015, range=0..5),
    BaseFSRFAR=panel_4,
    TowerFSRFAR=panel_4,
    MinimumAreaSiteCrv=number_slider,
    MinimumAreaTowerCrv=number_slider)  # -> OffsetCurve, BaseFloorCurves, TowerFloorCurves, PolyFromSubDivOfCrvs, FinalBoundaryRepresentation; disabled
courtyard_mass = CourtyardMassing(
    SiteCurve=geo_2,
    FSRFAR=panel_4,
    FloorHeight=Slider(0.607, range=0..5),
    Setback=Slider(0.607, range=0..5),
    BayDepth=Slider(1.015, range=0..5),
    MinFloorArea=Slider(0, range=0..150))  # -> OutputFloorCurves, OutputMassingBreps; disabled
staggered_mass = StaggeredMassing(
    SiteCurve=geo_2,
    FloorHeightRequired=panel_4,
    SetbackStepbacksForMassing="0.5,0.7",
    HeightsCorrespondingToStepbacks="1,3",
    MinArea=Slider(0, range=0..150))  # -> OutputFloorCurves, OutputMassingBreps, OutputTextPanelTotalFSRGFAAchieved, NumberOfFloors; disabled
geo_3 = Geometry(block.OutputMassingBreps)
geo_4 = Geometry(<curve referenced from the Rhino model>)  # disabled
geo_5 = Geometry([<curve referenced from the Rhino model> x3])  # disabled
site_partition_circulation = SitePartitionCirculation(
    SiteCurve=geo_4,
    CirculationCurve=geo_5,
    CirculationDepth=Slider(1.695, range=0..5),
    MinimumAreaPartition=Slider(4.311, range=0..100))  # -> DebugText, CirculationCurves, PartitionCurves; disabled
geo_6 = Geometry(site_partition_circulation.PartitionCurves)
geo_7 = Geometry(site_partition_circulation.CirculationCurves)
number_slider_2 = Slider(0, range=0..5)
number_slider_3 = Slider(0, range=0..5)
staggered_courtyard_interp_2 = StaggeredCourtyardInterpolated(
    Site=geo_6,
    Setback=Slider(1.882, range=0..5),
    BaseDepthOffset=Slider(5, range=0..5),
    NumOfTowerFootprintsBaseCrvSubdiv=Slider(16, range=0..25),
    NumberOfTowers=Slider(3, range=0..5),
    FloorFloorHeight=Slider(2.808, range=0..5),
    BaseFSRFAR=Slider(0.372, range=0..5),
    TowerFSRFAR=Slider(3.88, range=0..5),
    MinimumAreaSiteCrv=number_slider_2,
    MinimumAreaTowerCrv=number_slider_2)  # -> OffsetCurve, BaseFloorCurves, TowerFloorCurves, PolyFromSubDivOfCrvs, FinalBoundaryRepresentation; disabled
staggered_courtyard_normal = StaggeredCourtyardNormal(
    Site=geo_6,
    Setback=Slider(3.226, range=0..5),
    BaseDepthOffset=Slider(5, range=0..5),
    NumOfTowerFootprintsBaseCrvSubdiv=Slider(5, range=0..25),
    NumberOfTowers=Slider(2, range=0..5),
    FloorFloorHeight=Slider(2.877, range=0..5),
    BaseFSRFAR=Slider(1.42, range=0..5),
    TowerFSRFAR=Slider(2.205, range=0..5),
    MinimumAreaSiteCrv=number_slider_3,
    MinimumAreaTowerCrv=number_slider_3)  # -> OffsetCurve, BaseFloorCurves, TowerFloorCurves, PolyFromSubDivOfCrvs, FinalBoundaryRepresentation; disabled
block_2 = MassingExtrudeBlock(
    SiteCurve=geo_6,
    Setback=Slider(0.539, range=0..5),
    FsrFar=Slider(3.264, range=0..5),
    FLRHT=Slider(3.182, range=0..5),
    MinCrvArea=Slider(45.709, range=0..100))  # -> OutputMassingBreps, OutputFloorCurves; disabled
staggered_mass_2 = StaggeredMassing(
    SiteCurve=geo_6,
    FloorHeightRequired=Slider(5, range=0..5),
    SetbackStepbacksForMassing="2,4",
    HeightsCorrespondingToStepbacks="13,15",
    MinArea=Slider(4.406, range=0..5))  # -> OutputFloorCurves, OutputMassingBreps, OutputTextPanelTotalFSRGFAAchieved, NumberOfFloors; disabled
courtyard_mass_2 = CourtyardMassing(
    SiteCurve=geo_6,
    FSRFAR=Slider(1.063, range=0..5),
    FloorHeight=Slider(5, range=0..5),
    Setback=Slider(0.319, range=0..5),
    BayDepth=Slider(3.575, range=0..5),
    MinFloorArea=Slider(1, range=0..1))  # -> OutputFloorCurves, OutputMassingBreps; disabled
geo_8 = Geometry(block_2.OutputMassingBreps)
geo_9 = Geometry(block_2.OutputFloorCurves)

crv = Curve(<curve referenced from the Rhino model>)
pt = Point([Point(17.29777822, -150.3862014, 0), Point(87.24063131, 102.1835567, 0), Point(-141.4480143, 76.26838676, 0)])  # disabled
grid_gen = SpaceGenerator(
    InputCurve=crv,
    OriginPoints=pt,
    SegmentLength=Slider(14, range=0..35),
    IterationNumber=Slider(50000, range=0..50000),
    RndAngleRadians=Slider(0, range=0..6.28))  # -> DebugText, SpaceCurves; disabled
crv_2 = Curve(grid_gen.SpaceCurves)
Z = UnitZ(Factor=Slider(6.28, range=0..6.28))
extr = Extrude(Base=crv_2, Direction=Z)
gen_2_parcels = Generator2Parcels(
    SpaceCurveSegements=crv_2,
    Setback=Slider(0.732, range=0..6.28),
    BayDepth=Slider(4.112, range=0..6.28),
    GenerateIndividualParcels=Toggle(True),
    ParcelWidth=Slider(6.183, range=0..20))  # -> DebugText, CirculationPath, ParcelCurves, ParcelRegion, DebugCrv; disabled
item = ListItem(List=crv_2, Index=Slider(3, range=0..35), Wrap=True)
geo_10 = Geometry(gen_2_parcels.DebugCrv)  # disabled
crv_3 = Curve(gen_2_parcels.ParcelCurves)
crv_4 = Curve(gen_2_parcels.ParcelRegion)
crv_5 = Curve(gen_2_parcels.CirculationPath)

block_3 = MassingExtrudeBlock(
    SiteCurve=crv_3,
    Setback=Slider(0.167, range=0..6.28),
    FsrFar=Slider(2.65, range=0..6.28),
    FLRHT=Slider(2.578, range=0..6.28),
    MinCrvArea=Slider(0, range=0..6.28))  # -> OutputMassingBreps, OutputFloorCurves
