# Grasshopper definition openCrvTest.gh (Grasshopper 1.0.7)
# plug-ins: DotsProj

geo = Geometry([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])
geo_2 = Geometry([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])
sel_sides = SelectSidesFromPolyline(InputPolyline=geo_2, OffsetIndexStart=Slider(0, range=0..10), NumOfSides=Slider(4, range=0..10))
sel_crv_seg = SelectPartialCurve(
    InputCrv=geo,
    TotalNumberOfParts=Slider(10, range=0..10),
    StartingPoint=Slider(0, range=0..10),
    NumParts=Slider(6, range=0..10))
Z = UnitZ(Factor=Slider(4, range=0..10))
geo_3 = Geometry([<curve referenced from the Rhino model> x2])
geo_4 = Geometry(sel_crv_seg)
extr = Extrude(Base=geo_3, Direction=Z)
Z_2 = UnitZ(Factor=Slider(4, range=0..10))
extr_2 = Extrude(Base=geo_4, Direction=Z_2)
geo_5 = Geometry(<curve referenced from the Rhino model>)
path = FilePath("C:\nir_dev\MegaSavageLevel\DotsProjRh6\DotsProj\DotsProj\SourceCode\TEST_SCRIPTS\dots_workflow\DOTS_workflow_test\inputs\sample1.csv")
path_2 = FilePath("C:\nir_dev\MegaSavageLevel\DotsProjRh6\DotsProj\DotsProj\SourceCode\TEST_SCRIPTS\dots_workflow\DOTS_workflow_test\inputs\sample1.csv")
geo_6 = Geometry(<curve referenced from the Rhino model>)
oc_linear = OpenCurveLinear(InpFilePath=path, BayDepth=Slider(30, range=0..30), BaseCurve=geo_5, NumberIterations=Slider(100, range=0..100))  # -> DebugText, SpacesGeom, DistributedPts, SpacesCrvs
oc_double = OpenCurveDouble(
    InpFilePath=path_2,
    BayDepth=Slider(29.379, range=0..30),
    CorridorDepth=Slider(14.316, range=0..30),
    BaseCurve=geo_6,
    NumberOfIterations=Slider(0, range=0..400))  # -> DebugText, SpacesGeom, CellsPoly, SpacesCrvs; disabled
crv = Curve(oc_linear.SpacesGeom)
Z_3 = UnitZ(Factor=Slider(30, range=0..30))
extr_3 = Extrude(Base=crv, Direction=Z_3)
geo_7 = Geometry(oc_double.SpacesCrvs)
Z_4 = UnitZ(Factor=Slider(30, range=0..30))
extr_4 = Extrude(Base=geo_7, Direction=Z_4)
panel = Panel(oc_double.DebugText)
