# Grasshopper definition masing.gh (Grasshopper 1.0.7)
# plug-ins: DotsProj

crv = Curve(<curve referenced from the Rhino model>)  # disabled
crv_2 = Curve(<curve referenced from the Rhino model>)  # disabled
crv_3 = Curve([<curve referenced from the Rhino model> x8])  # disabled
crv_4 = Curve(<curve referenced from the Rhino model>)  # disabled
crv_5 = Curve([<curve referenced from the Rhino model> x9])  # disabled
block = MassingExtrudeBlock(
    SiteCurve=crv,
    Setback=Slider(8.042, range=0..10),
    FsrFar=Slider(5, range=0..5),
    FLRHT=Slider(5, range=0..5),
    MinCrvArea=Slider(5, range=0..5))  # -> OutputMassingBreps, OutputFloorCurves
staggered_courtyard_normal = StaggeredCourtyardNormal(
    Site=crv_3,
    Setback=Slider(5.729, range=0..10),
    BaseDepthOffset=Slider(24.542, range=0..50),
    NumOfTowerFootprintsBaseCrvSubdiv=Slider(16, range=0..25),
    NumberOfTowers=Slider(6, range=0..10),
    FloorFloorHeight=Slider(3, range=0..10),
    BaseFSRFAR=Slider(2.185, range=0..10),
    TowerFSRFAR=Slider(5.356, range=0..10),
    MinimumAreaSiteCrv=Slider(0, range=0..5),
    MinimumAreaTowerCrv=Slider(5, range=0..5))  # -> OffsetCurve, BaseFloorCurves, TowerFloorCurves, PolyFromSubDivOfCrvs, FinalBoundaryRepresentation
courtyard_mass = CourtyardMassing(
    SiteCurve=crv_2,
    FSRFAR=Slider(2.143, range=0..10),
    FloorHeight=Slider(3.034, range=0..5),
    Setback=Slider(5, range=0..5),
    BayDepth=Slider(25, range=0..25),
    MinFloorArea=Slider(0, range=0..5))  # -> OutputFloorCurves, OutputMassingBreps
staggered_mass = StaggeredMassing(
    SiteCurve=crv_4,
    FloorHeightRequired=Slider(3.857, range=0..10),
    SetbackStepbacksForMassing="10.0,25,15,35",
    HeightsCorrespondingToStepbacks="50,75,10,100",
    MinArea=Slider(4.592, range=0..10))  # -> OutputFloorCurves, OutputMassingBreps, OutputTextPanelTotalFSRGFAAchieved, NumberOfFloors
staggered_courtyard_interp = StaggeredCourtyardInterpolated(
    Site=crv_5,
    Setback=Slider(3.696, range=0..10),
    BaseDepthOffset=Slider(12.61, range=0..15),
    NumOfTowerFootprintsBaseCrvSubdiv=Slider(10, range=0..10),
    NumberOfTowers=Slider(3, range=0..10),
    FloorFloorHeight=Slider(3, range=0..10),
    BaseFSRFAR=Slider(1.561, range=0..10),
    TowerFSRFAR=Slider(1.63, range=0..10),
    MinimumAreaSiteCrv=Slider(2.718, range=0..5),
    MinimumAreaTowerCrv=Slider(4.49, range=0..5))  # -> OffsetCurve, BaseFloorCurves, TowerFloorCurves, PolyFromSubDivOfCrvs, FinalBoundaryRepresentation
crv_6 = Curve(courtyard_mass.OutputFloorCurves)
geo = Geometry(courtyard_mass.OutputMassingBreps)
panel = Panel(staggered_mass.OutputTextPanelTotalFSRGFAAchieved)
panel_2 = Panel(staggered_mass.NumberOfFloors)
geo_2 = Geometry(staggered_mass.OutputFloorCurves)
geo_3 = Geometry(block.OutputMassingBreps)
crv_7 = Curve(block.OutputFloorCurves)
geo_4 = Geometry(staggered_mass.OutputMassingBreps)
crv_8 = Curve(staggered_courtyard_normal.OffsetCurve)
crv_9 = Curve(staggered_courtyard_normal.BaseFloorCurves)
crv_10 = Curve(staggered_courtyard_normal.TowerFloorCurves)
crv_11 = Curve(staggered_courtyard_normal.PolyFromSubDivOfCrvs)
geo_5 = Geometry(staggered_courtyard_normal.FinalBoundaryRepresentation)
geo_6 = Geometry()
crv_12 = Curve()
crv_13 = Curve()
crv_14 = Curve()
crv_15 = Curve()
