# Grasshopper definition Rush_workFlow.gh (Grasshopper 1.0.7)
# plug-ins: DotsProj

# ----
# file_paths_(inputs)
# space_allocation
peripheral_zone = FilePath("C:\nir_dev\MegaSavageLevel\DotsProjRh6\DotsProj\DotsProj\SourceCode\TEST_SCRIPTS\dots_workflow\DOTS_workflow_test\rush\inputsToDots\rushPeripheralInput.csv")
bottom_zone_2 = FilePath("C:\nir_dev\MegaSavageLevel\DotsProjRh6\DotsProj\DotsProj\SourceCode\TEST_SCRIPTS\dots_workflow\rush\inputsToDots\rush_z2_BottomInput.csv")
top_zone_3 = FilePath("C:\nir_dev\MegaSavageLevel\DotsProjRh6\DotsProj\DotsProj\SourceCode\TEST_SCRIPTS\dots_workflow\rush\inputsToDots\rush_z3_TopInput.csv")
top_zone_4 = FilePath("C:\nir_dev\MegaSavageLevel\DotsProjRh6\DotsProj\DotsProj\SourceCode\TEST_SCRIPTS\dots_workflow\rush\inputsToDots\rush_z4_TopInput.csv")
corner_zone_1 = FilePath("C:\nir_dev\MegaSavageLevel\DotsProjRh6\DotsProj\DotsProj\SourceCode\TEST_SCRIPTS\dots_workflow\DOTS_workflow_test\inputs\sample1.csv")
core_zones = FilePath("C:\nir_dev\MegaSavageLevel\DotsProjRh6\DotsProj\DotsProj\SourceCode\TEST_SCRIPTS\dots_workflow\rush\inputsToDots\rushCoreInput.csv")
internal_curve_core_zone_splits = FilePath("C:\nir_dev\MegaSavageLevel\DotsProjRh6\DotsProj\DotsProj\SourceCode\TEST_SCRIPTS\dots_workflow\DOTS_workflow_test\rush\inputsToDots\rushIntermediateZoneInput.csv")

# ----
# peripheral_zone
number_slider = Slider(2, range=0..10)
geo = Geometry(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)
curve_skeleton = CrvSkeleton(
    InpFilePath=peripheral_zone,
    InpSiteCurve=geo,
    FromSiteOuterCirculationDepth=Slider(5.624, range=0..25),
    FromOuterCirculationBayDepth=Slider(28.291, range=0..45),
    FromBayDepthInnerCirculationDepth=Slider(5, range=0..25),
    SensitivityX100=number_slider,
    OptimizationItrs=Slider(1, range=0..100))  # -> OuterOffsetCrv, InnerOffsetCrv, RESULTSegGeom, DebugString
crv = Curve(curve_skeleton.RESULTSegGeom)

# ----
# get_corner_zone_curves
number_slider_2 = Slider(0, range=-25..25.001)
radial_zone_core = RadialZoneCore(
    InputFilesCsv=internal_curve_core_zone_splits,
    InputSiteCrv=curve_skeleton.InnerOffsetCrv,
    CoreArea=Slider(12440.624, range=0..20000),
    MoveCoreHorizontal=number_slider_2,
    MoveCoreVertical=Slider(-25, range=-25..25),
    CoreAspectRatio=Slider(1.784, range=0.01..2),
    RotationInDegrees=Slider(0, range=0..360))  # -> CoreCrv, ZoneCrvsRad
item = ListItem(List=radial_zone_core.ZoneCrvsRad, Index=Slider(3, range=0..10), Wrap=True)
item_2 = ListItem(List=radial_zone_core.ZoneCrvsRad, Index=Slider(2, range=0..10), Wrap=True)
item_3 = ListItem(List=radial_zone_core.ZoneCrvsRad, Index=Slider(1, range=0..10), Wrap=True)
item_4 = ListItem(List=radial_zone_core.ZoneCrvsRad, Index=Slider(0, range=0..10), Wrap=True)
crv_2 = Curve(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)
crv_3 = Curve(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)
crv_4 = Curve(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)
site_partition_circulation = SitePartitionCirculation(
    SiteCurve=item,
    CirculationCurve=crv_2,
    CirculationDepth=Slider(2.5, range=0..10),
    MinimumAreaPartition=Slider(0, range=0..10))  # -> DebugText, CirculationCurves, PartitionCurves
crv_5 = Curve(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)
site_partition_circulation_2 = SitePartitionCirculation(
    SiteCurve=item_2,
    CirculationCurve=crv_3,
    CirculationDepth=Slider(2.5, range=0..10),
    MinimumAreaPartition=Slider(0, range=0..10))  # -> DebugText, CirculationCurves, PartitionCurves
site_partition_circulation_3 = SitePartitionCirculation(
    SiteCurve=item_3,
    CirculationCurve=crv_4,
    CirculationDepth=Slider(2.5, range=0..10),
    MinimumAreaPartition=Slider(0, range=0..10))  # -> DebugText, CirculationCurves, PartitionCurves
site_partition_circulation_4 = SitePartitionCirculation(
    SiteCurve=item_4,
    CirculationCurve=crv_5,
    CirculationDepth=Slider(2.5, range=0..10),
    MinimumAreaPartition=Slider(0, range=0..10))  # -> DebugText, CirculationCurves, PartitionCurves
item_5 = ListItem(List=site_partition_circulation.PartitionCurves, Index=Slider(1, range=0..10), Wrap=True)
item_6 = ListItem(List=site_partition_circulation.PartitionCurves, Index=Slider(0, range=0..10), Wrap=True)
item_7 = ListItem(List=site_partition_circulation_2.PartitionCurves, Index=Slider(1, range=0..10), Wrap=True)
item_8 = ListItem(List=site_partition_circulation_2.PartitionCurves, Index=Slider(0, range=0..10), Wrap=True)
item_9 = ListItem(List=site_partition_circulation_3.PartitionCurves, Index=Slider(1, range=0..10), Wrap=True)
item_10 = ListItem(List=site_partition_circulation_3.PartitionCurves, Index=Slider(0, range=0..10), Wrap=True)
item_11 = ListItem(List=site_partition_circulation_4.PartitionCurves, Index=Slider(1, range=0..10), Wrap=True)
item_12 = ListItem(List=site_partition_circulation_4.PartitionCurves, Index=Slider(0, range=0..10), Wrap=True)
crv_6 = Curve(item_6)
crv_7 = Curve(item_5)
crv_8 = Curve(item_7)
crv_9 = Curve(item_8)
crv_10 = Curve(item_9)
crv_11 = Curve(item_10)
crv_12 = Curve(item_11)
crv_13 = Curve(item_12)

# ----
# core_curves
number_slider_3 = Slider(6, range=0..10)
cbsp_site = CbspSite(
    InputFilesCsv=core_zones,
    InputSiteCrv=radial_zone_core.CoreCrv,
    RotationInDegrees=Slider(0, range=0..360),
    RandomizedGenerations=Toggle(False),
    NumberOfOptimizationLoops=number_slider_3)  # -> SpatialCrv, CirculationLines, DebugText

# ----
# get the bottom zone curve
crv_union = Union(InputListOfCurvesA=[crv_11, crv_8])
item_13 = ListItem(List=crv_union, Index=Slider(0, range=0..2), Wrap=True)
item_14 = ListItem(List=crv_union, Index=Slider(0, range=0..2), Wrap=True)
crv_14 = Curve(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)
crv_15 = Curve(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)
site_partition_circulation_5 = SitePartitionCirculation(
    SiteCurve=item_13,
    CirculationCurve=crv_14,
    CirculationDepth=Slider(2.5, range=0..10),
    MinimumAreaPartition=Slider(0, range=0..10))  # -> DebugText, CirculationCurves, PartitionCurves
site_partition_circulation_6 = SitePartitionCirculation(
    SiteCurve=item_14,
    CirculationCurve=crv_15,
    CirculationDepth=Slider(2.5, range=0..10),
    MinimumAreaPartition=Slider(0, range=0..10))  # -> DebugText, CirculationCurves, PartitionCurves
item_15 = ListItem(List=site_partition_circulation_5.PartitionCurves, Index=Slider(0, range=0..2), Wrap=True)
item_16 = ListItem(List=site_partition_circulation_6.PartitionCurves, Index=Slider(0, range=0..2), Wrap=True)

# ----
# Get the top zone_3, 4 curves
number_slider_4 = Slider(0, range=0..10)
crv_union_2 = Union(InputListOfCurvesA=[crv_13, crv_6])
crv_16 = Curve([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])
site_partition_circulation_7 = SitePartitionCirculation(
    SiteCurve=crv_union_2,
    CirculationCurve=crv_16,
    CirculationDepth=Slider(5, range=0..10),
    MinimumAreaPartition=number_slider_4)  # -> DebugText, CirculationCurves, PartitionCurves
item_17 = ListItem(List=site_partition_circulation_7.PartitionCurves, Index=Slider(1, range=0..2), Wrap=True)
item_18 = ListItem(List=site_partition_circulation_7.PartitionCurves, Index=Slider(0, range=0..2), Wrap=True)
item_19 = ListItem(List=site_partition_circulation_7.PartitionCurves, Index=Slider(2, range=0..2), Wrap=True)

# ----
# Corner Zone 1
number_slider_5 = Slider(1, range=0..10)
cbsp_site_2 = CbspSite(
    InputFilesCsv=corner_zone_1,
    InputSiteCrv=crv_10,
    RotationInDegrees=Slider(9, range=0..360),
    RandomizedGenerations=Toggle(False),
    NumberOfOptimizationLoops=Slider(1, range=0..10))  # -> SpatialCrv, CirculationLines, DebugText
cbsp_site_3 = CbspSite(
    InputFilesCsv=corner_zone_1,
    InputSiteCrv=crv_12,
    RotationInDegrees=Slider(177, range=0..360),
    RandomizedGenerations=Toggle(False),
    NumberOfOptimizationLoops=number_slider_5)  # -> SpatialCrv, CirculationLines, DebugText
cbsp_site_4 = CbspSite(
    InputFilesCsv=corner_zone_1,
    InputSiteCrv=crv_9,
    RotationInDegrees=Slider(135, range=0..360),
    RandomizedGenerations=Toggle(False),
    NumberOfOptimizationLoops=Slider(1, range=0..10))  # -> SpatialCrv, CirculationLines, DebugText
cbsp_site_5 = CbspSite(
    InputFilesCsv=corner_zone_1,
    InputSiteCrv=crv_7,
    RotationInDegrees=Slider(236, range=0..360),
    RandomizedGenerations=Toggle(False),
    NumberOfOptimizationLoops=Slider(1, range=0..10))  # -> SpatialCrv, CirculationLines, DebugText
crv_17 = Curve(cbsp_site_2.SpatialCrv)
crv_18 = Curve(cbsp_site_3.SpatialCrv)
crv_19 = Curve(cbsp_site_4.SpatialCrv)
crv_20 = Curve(cbsp_site_5.SpatialCrv)

# ----
# Top_zone_3_4
number_slider_6 = Slider(1, range=0..10)
cbsp_site_6 = CbspSite(
    InputFilesCsv=top_zone_4,
    InputSiteCrv=item_19,
    RotationInDegrees=Slider(0, range=0..360),
    RandomizedGenerations=Toggle(False),
    NumberOfOptimizationLoops=number_slider_6)  # -> SpatialCrv, CirculationLines, DebugText
cbsp_site_7 = CbspSite(
    InputFilesCsv=top_zone_3,
    InputSiteCrv=item_17,
    RotationInDegrees=Slider(0, range=0..360),
    RandomizedGenerations=Toggle(False),
    NumberOfOptimizationLoops=Slider(1, range=0..10))  # -> SpatialCrv, CirculationLines, DebugText
cbsp_site_8 = CbspSite(
    InputFilesCsv=top_zone_3,
    InputSiteCrv=item_18,
    RotationInDegrees=Slider(0, range=0..360),
    RandomizedGenerations=Toggle(False),
    NumberOfOptimizationLoops=Slider(1, range=0..10))  # -> SpatialCrv, CirculationLines, DebugText
crv_21 = Curve(cbsp_site_6.SpatialCrv)
crv_22 = Curve(cbsp_site_7.SpatialCrv)
crv_23 = Curve(cbsp_site_8.SpatialCrv)

# ----
# Top_zone_3_4
number_slider_7 = Slider(1, range=0..10)
cbsp_site_9 = CbspSite(
    InputFilesCsv=bottom_zone_2,
    InputSiteCrv=item_16,
    RotationInDegrees=Slider(0, range=0..360),
    RandomizedGenerations=Toggle(False),
    NumberOfOptimizationLoops=number_slider_7)  # -> SpatialCrv, CirculationLines, DebugText
cbsp_site_10 = CbspSite(
    InputFilesCsv=top_zone_4,
    InputSiteCrv=item_15,
    RotationInDegrees=Slider(0, range=0..360),
    RandomizedGenerations=Toggle(False),
    NumberOfOptimizationLoops=Slider(1, range=0..10))  # -> SpatialCrv, CirculationLines, DebugText
crv_24 = Curve(cbsp_site_9.SpatialCrv)
crv_25 = Curve(cbsp_site_10.SpatialCrv)
