# Grasshopper definition sample_workflow.gh (Grasshopper 1.0.7)
# plug-ins: DotsProj

path = FilePath("C:\nir_dev\MegaSavageLevel\DotsProjRh6\DotsProj\DotsProj\bin\DOTS_workflow_test\inputs\sample1.csv")
crv = Curve(<curve referenced from the Rhino model>)
curve_skeleton = CrvSkeleton(
    InpFilePath=path,
    InpSiteCurve=crv,
    FromSiteOuterCirculationDepth=Slider(3, range=0..20),
    FromOuterCirculationBayDepth=Slider(43, range=0..50),
    FromBayDepthInnerCirculationDepth=Slider(8, range=0..20),
    SensitivityX100=Slider(5, range=0..5),
    OptimizationItrs=Slider(445, range=0..500))  # -> OuterOffsetCrv, InnerOffsetCrv, RESULTSegGeom
geo = Geometry(curve_skeleton.OuterOffsetCrv)
geo_2 = Geometry(curve_skeleton.InnerOffsetCrv)
geo_3 = Geometry(curve_skeleton.RESULTSegGeom)
randomize = BooleanToggle(False)
path_2 = FilePath("C:\nir_dev\MegaSavageLevel\DotsProjRh6\DotsProj\DotsProj\SourceCode\test_scripts\dots_workflow\DOTS_workflow_test\inputs\sample1.csv")
geo_4 = Geometry(geo_2)
cbsp_site = CbspSite(
    InputFilesCsv=path_2,
    InputSiteCrv=geo_4,
    RotationInDegrees=Slider(0, range=0..360),
    RandomizedGenerations=randomize,
    NumberOfOptimizationLoops=Slider(23, range=1..100))  # -> SpatialCrv, CirculationLines
geo_5 = Geometry(cbsp_site.SpatialCrv)
geo_6 = Geometry(cbsp_site.CirculationLines)
circulation = GenerateCirculation(SiteCrvOuterBoundary=geo_4, CbspCrvs=geo_5, PartitionLines=geo_6, CirculationDepth=Slider(3.705, range=0..10))  # -> _0PartitionLines, _1CirculationPoly, _2ResultantCbspCrv
Z = UnitZ(Factor=Slider(3.866, range=0..20))
crv_2 = Curve(circulation._2ResultantCbspCrv)
extr = Extrude(Base=crv_2, Direction=Z)
block = MassingExtrudeBlock(
    SiteCurve=crv_2,
    Setback=Slider(5.501, range=0..20),
    FsrFar=Slider(1.266, range=0..20),
    FLRHT=Slider(20, range=0..20),
    MinCrvArea=Slider(4.68, range=0..20))  # -> OutputMassingBreps, OutputFloorCurves
geo_7 = Geometry(block.OutputFloorCurves)
geo_8 = Geometry(block.OutputMassingBreps)
item = ListItem(List=geo_7, Index=Slider(9, range=0..12), Wrap=True)
crv_3 = Curve(item)
path_3 = FilePath("C:\nir_dev\MegaSavageLevel\DotsProjRh6\DotsProj\DotsProj\bin\DOTS_workflow_test\inputs\sample1.csv")
curve_skeleton_2 = CrvSkeleton(
    InpFilePath=path_3,
    InpSiteCurve=crv_3,
    FromSiteOuterCirculationDepth=Slider(3.835, range=0..20),
    FromOuterCirculationBayDepth=Slider(9.999, range=0..20),
    FromBayDepthInnerCirculationDepth=Slider(1.501, range=0..20),
    SensitivityX100=Slider(10, range=0..10),
    OptimizationItrs=Slider(1, range=0..10))  # -> OuterOffsetCrv, InnerOffsetCrv, RESULTSegGeom
Z_2 = UnitZ(Factor=Slider(3.081, range=0..10))
extr_2 = Extrude(Base=curve_skeleton_2.RESULTSegGeom, Direction=Z_2)
path_4 = FilePath("C:\nir_dev\MegaSavageLevel\DotsProjRh6\DotsProj\DotsProj\bin\DOTS_workflow_test\inputs\sample1.csv")
randomize_2 = BooleanToggle(False)
cbsp_site_2 = CbspSite(
    InputFilesCsv=path_4,
    InputSiteCrv=curve_skeleton_2.InnerOffsetCrv,
    RotationInDegrees=Slider(0, range=0..360),
    RandomizedGenerations=randomize_2,
    NumberOfOptimizationLoops=Slider(1, range=1..100))  # -> SpatialCrv, CirculationLines
crv_4 = Curve(cbsp_site_2.SpatialCrv)
crv_5 = Curve(cbsp_site_2.CirculationLines)
circulation_2 = GenerateCirculation(SiteCrvOuterBoundary=crv_3, CbspCrvs=crv_4, PartitionLines=crv_5, CirculationDepth=Slider(1.523, range=0..20))  # -> _0PartitionLines, _1CirculationPoly, _2ResultantCbspCrv
Z_3 = UnitZ(Factor=Slider(3.081, range=0..10))
crv_6 = Curve(circulation_2._2ResultantCbspCrv)
extr_3 = Extrude(Base=circulation_2._2ResultantCbspCrv, Direction=Z_3)
