# Grasshopper definition urban_plan_gen.gh (Grasshopper 1.0.7)
# plug-ins: DotsProj

crv = Curve(<curve referenced from the Rhino model>)
timer = Timer(TimerInterval=1000, Target=parcel_subdiv)
parcel_subdiv = ParcelsBySubdivision(
    InputSite=crv,
    NumOfParcels=Slider(64, range=0..100),
    DevMean01=Slider(0.121, range=0..1),
    AngleAlignmentDegrees0360=Slider(360, range=0..360),
    ShowThisIterations=Slider(0, range=0..33),
    ResetAllValues=Toggle(True),
    Generate=Toggle(True))  # -> LowestDeviationOfParcelSolution, StreetCenterLines, OutputParcelFromRequiredIteration, OutputStreetFromRequiredIteration, NumberOfResults
crv_2 = Curve(parcel_subdiv.StreetCenterLines)
crv_3 = Curve(parcel_subdiv.OutputParcelFromRequiredIteration)
crv_4 = Curve(parcel_subdiv.LowestDeviationOfParcelSolution)
crv_5 = Curve(parcel_subdiv.OutputStreetFromRequiredIteration)
panel = Panel(parcel_subdiv.NumberOfResults)
circulation = GenerateCirculation(SiteCrvOuterBoundary=crv, CbspCrvs=crv_4, PartitionLines=crv_2, CirculationDepth=Slider(9, range=0..100))  # -> _0PartitionLines, _1CirculationPoly, _2ResultantCbspCrv
crv_6 = Curve(crv_4)
geo = Geometry(circulation._2ResultantCbspCrv)
select = Select(
    InputSiteCrv=crv,
    Parcels=circulation._2ResultantCbspCrv,
    CentralizeOrDisperse=Toggle(False),
    OpenSpaceRequirement=Slider(7.964, range=0..100))  # -> OutputBuildableParcels, OutputOpenSpaceParcels
crv_7 = Curve(select.OutputBuildableParcels)
crv_8 = Curve(select.OutputOpenSpaceParcels)
block = ExtrudeBlock(
    SiteCurve=crv_7,
    Setback=Slider(7.987, range=0..20),
    FsrFar=Slider(2.427, range=0..20),
    FLRHT=Slider(3.029, range=0..20),
    MinCrvArea=Slider(97.433, range=0..1500))  # -> OutputExtrudedMass, FloorCurves
courtyard_mass = CourtyardMassing(
    SiteCurve=crv_7,
    FSRFAR=Slider(7.987, range=0..20),
    FloorHeight=Slider(20, range=0..20),
    Setback=Slider(1.64, range=0..20),
    BayDepth=Slider(44.308, range=0..100),
    MinFloorArea=Slider(0, range=0..1500))  # -> OutputFloorCurves, OutputMassingBreps
geo_2 = Geometry(block.FloorCurves)
geo_3 = Geometry(block.OutputExtrudedMass)
geo_4 = Geometry(courtyard_mass.OutputMassingBreps)

crv_9 = Curve(<curve referenced from the Rhino model>)  # disabled
crv_10 = Curve(<curve referenced from the Rhino model>)  # disabled
timer_2 = Timer(TimerInterval=1000)  # disabled
parcel_subdiv_diff = ParcelsBySubdivisionWithSubtraction(
    InputSite=crv_10,
    InternalCrv=crv_9,
    NumOfParcels=Slider(20, range=0..20),
    DevMean01=Slider(0, range=0..1),
    AngleAlignmentDegrees0360=Slider(0, range=0..360),
    ShowThisIterations=Slider(1, range=0..20),
    ResetAllValues=Toggle(True),
    Generate=Toggle(True))  # -> LowestDeviationOfParcelSolution, StreetCenterLines, OutputParcelFromRequiredIteration, OutputStreetFromRequiredIteration, NumberOfResults; disabled
crv_11 = Curve(parcel_subdiv_diff.LowestDeviationOfParcelSolution)
panel_2 = Panel(parcel_subdiv_diff.NumberOfResults)
crv_12 = Curve(parcel_subdiv_diff.StreetCenterLines)
crv_13 = Curve(parcel_subdiv_diff.OutputParcelFromRequiredIteration)
crv_14 = Curve(parcel_subdiv_diff.OutputStreetFromRequiredIteration)
circulation_2 = GenerateCirculation(SiteCrvOuterBoundary=crv_10, CbspCrvs=crv_11, PartitionLines=crv_12, CirculationDepth=Slider(15.502, range=0..20))  # -> _0PartitionLines, _1CirculationPoly, _2ResultantCbspCrv; disabled
crv_15 = Curve(circulation_2._0PartitionLines)
crv_16 = Curve(circulation_2._2ResultantCbspCrv)
block_2 = ExtrudeBlock(
    SiteCurve=crv_16,
    Setback=Slider(6.66, range=0..20),
    FsrFar=Slider(20, range=0..20),
    FLRHT=Slider(0.715, range=0..20),
    MinCrvArea=Slider(100, range=0..100))  # -> OutputExtrudedMass, FloorCurves
geo_5 = Geometry(block_2.FloorCurves)
geo_6 = Geometry(block_2.OutputExtrudedMass)

crv_17 = Curve(<curve referenced from the Rhino model>)  # disabled
crv_18 = Curve(<curve referenced from the Rhino model>)  # disabled
parcel_int_poly = ParcelsFromInternalPoly(InputSiteCurve=crv_18, InternalPolyine=crv_17)  # -> OutputParcels, OutputStreets; disabled
crv_19 = Curve(parcel_int_poly.OutputStreets)
crv_20 = Curve(parcel_int_poly.OutputParcels)
circulation_3 = GenerateCirculation(SiteCrvOuterBoundary=crv_18, CbspCrvs=crv_20, PartitionLines=crv_19, CirculationDepth=Slider(4.972, range=0..10))  # -> _0PartitionLines, _1CirculationPoly, _2ResultantCbspCrv
crv_21 = Curve(circulation_3._0PartitionLines)
crv_22 = Curve(circulation_3._2ResultantCbspCrv)
block_3 = ExtrudeBlock(
    SiteCurve=crv_22,
    Setback=Slider(1.416, range=0..20),
    FsrFar=Slider(1.811, range=0..20),
    FLRHT=Slider(3.819, range=0..20),
    MinCrvArea=Slider(106.409, range=0..200))  # -> OutputExtrudedMass, FloorCurves
geo_7 = Geometry(block_3.FloorCurves)
geo_8 = Geometry(block_3.OutputExtrudedMass)

crv_23 = Curve([<curve referenced from the Rhino model> x295])
ext_setbacks = UrbanMassingFromSiteFsrSetbacksStreets(
    InputSiteCurves=crv_23,
    StreetLayerNames="streeta, streetb",
    CorrespondingStreetSetbacks="5.5, 15.0",
    InputFSR=Slider(15, range=0..15))  # -> OutputSolidGeometry, OutputSITENumbers
geo_9 = Geometry(ext_setbacks.OutputSolidGeometry)
panel_3 = Panel(ext_setbacks.OutputSITENumbers)

crv_24 = Curve([<curve referenced from the Rhino model> x2])
peripheral_subdiv_parcel = PeripheralSubdivisionParcels(
    SiteCurve=crv_24,
    SetbackDimensionFromSite=Slider(1.561, range=0..20),
    BayDepthFromSetback=Slider(4.332, range=0..10),
    InnerCrv0ffsetFromBay=Slider(2.463, range=0..10),
    NumDiv=Slider(40, range=0..100))  # -> Setback, Bay, InnerCrv, ParcelCrv
crv_25 = Curve(peripheral_subdiv_parcel.Setback)
crv_26 = Curve(peripheral_subdiv_parcel.Bay)
crv_27 = Curve(peripheral_subdiv_parcel.InnerCrv)
crv_28 = Curve(peripheral_subdiv_parcel.ParcelCrv)

crv_29 = Curve(<curve referenced from the Rhino model>)  # disabled
peripheral_subdiv_parcel_2 = PeripheralSubdivisionParcels(
    SiteCurve=crv_29,
    SetbackDimensionFromSite=Slider(3, range=0..10),
    BayDepthFromSetback=Slider(47.407, range=0..50),
    InnerCrv0ffsetFromBay=Slider(1.573, range=0..10),
    NumDiv=Slider(15, range=0..100))  # -> Setback, Bay, InnerCrv, ParcelCrv; disabled
crv_30 = Curve(peripheral_subdiv_parcel_2.Setback)
crv_31 = Curve(peripheral_subdiv_parcel_2.Bay)
crv_32 = Curve(peripheral_subdiv_parcel_2.InnerCrv)
crv_33 = Curve(peripheral_subdiv_parcel_2.ParcelCrv)
crv_34 = Curve(crv_33)
courtyard_mass_2 = CourtyardMassing(
    SiteCurve=crv_34,
    FSRFAR=Slider(2.198, range=0.5..3),
    FloorHeight=Slider(3, range=0..10),
    Setback=Slider(2.957, range=0..25),
    BayDepth=Slider(8, range=0..20),
    MaxHtFloorArea=Slider(0, range=0..20))  # -> OutputFloorCurves, OutputMassingBreps

crv_35 = Curve(<curve referenced from the Rhino model>)  # disabled
peripheral_subdiv_parcel_3 = PeripheralSubdivisionParcels(
    SiteCurve=crv_35,
    SetbackDimensionFromSite=Slider(9, range=0..20),
    BayDepthFromSetback=Slider(103, range=0..300),
    InnerCrv0ffsetFromBay=Slider(15, range=0..20),
    NumDiv=Slider(9, range=0..20))  # -> Setback, Bay, InnerCrv, ParcelCrv; disabled
number_slider = Slider(0, range=0..1)
crv_36 = Curve(peripheral_subdiv_parcel_3.ParcelCrv)
block_4 = ExtrudeBlock(
    SiteCurve=crv_36,
    Setback=Slider(15.316, range=0..20),
    FsrFar=Slider(20, range=0..20),
    FLRHT=Slider(5.827, range=0..20),
    MinCrvArea=Slider(0, range=0..20000))  # -> OutputExtrudedMass, FloorCurves
geo_10 = Geometry(block_4.OutputExtrudedMass)
geo_11 = Geometry(block_4.FloorCurves)  # disabled

number_slider_2 = Slider(0, range=0..1)
crv_37 = Curve(crv_28)  # disabled
block_5 = ExtrudeBlock(
    SiteCurve=crv_37,
    Setback=Slider(1.156, range=0..20),
    FsrFar=Slider(7.892, range=0..20),
    FLRHT=Slider(0.608, range=0..20),
    MinCrvArea=Slider(0, range=0..20000))  # -> OutputExtrudedMass, FloorCurves; disabled
geo_12 = Geometry(block_5.OutputExtrudedMass)
geo_13 = Geometry(block_5.FloorCurves)

crv_38 = Curve(<curve referenced from the Rhino model>)  # disabled
peripheral_subdiv_parcel_4 = PeripheralSubdivisionParcels(
    SiteCurve=crv_38,
    SetbackDimensionFromSite=Slider(3, range=0..10),
    BayDepthFromSetback=Slider(47.407, range=0..50),
    InnerCrv0ffsetFromBay=Slider(1.573, range=0..10),
    NumDiv=Slider(15, range=0..100))  # -> Setback, Bay, InnerCrv, ParcelCrv; disabled
number_slider_3 = Slider(0, range=0..20)
crv_39 = Curve(peripheral_subdiv_parcel_4.Setback)
crv_40 = Curve(peripheral_subdiv_parcel_4.Bay)
crv_41 = Curve(peripheral_subdiv_parcel_4.InnerCrv)
crv_42 = Curve(peripheral_subdiv_parcel_4.ParcelCrv)
number_slider_4 = Slider(20, range=0..20)
number_slider_5 = Slider(4, range=0..20)
number_slider_6 = Slider(2.198, range=0.5..3)
number_slider_7 = Slider(9.613, range=0..25)
number_slider_8 = Slider(3, range=0..10)
number_slider_9 = Slider(0.149, range=0..10)
number_slider_10 = Slider(0.726, range=0..5)
crv_43 = Curve(crv_42)
staggered_courtyard_normal = StaggeredCourtyardNormal(
    Site=crv_43,
    Setback=number_slider_10,
    BaseDepthOffset=number_slider_7,
    NumOfTowerFootprintsBaseCrvSubdiv=number_slider_4,
    NumberOfTowers=number_slider_5,
    FloorFloorHeight=number_slider_8,
    BaseFSRFAR=number_slider_6,
    TowerFSRFAR=number_slider_9,
    MinimumAreaSiteCrv=number_slider_3,
    MinimumAreaTowerCrv=number_slider_3)  # -> OffsetCurve, BaseFloorCurves, TowerFloorCurves, PolyFromSubDivOfCrvs, FinalBoundaryRepresentation; disabled
staggered_courtyard_interp = StaggeredCourtyardInterpolated(
    Site=crv_43,
    Setback=number_slider_10,
    BaseDepthOffset=number_slider_7,
    BaseDepthOffset_2=number_slider_4,
    NumberOfTowers=number_slider_5,
    FloorFloorHeight=number_slider_8,
    BaseFSRFAR=number_slider_6,
    TowerFSRFAR=number_slider_9,
    MinimumAreaSiteCrv=number_slider_3,
    MinimumAreaTowerCrv=number_slider_3)  # -> OffsetCurve, BaseFloorCurves, TowerFloorCurves, PolyFromSubDivOfCrvs, FinalBoundaryRepresentation; disabled
geo_14 = Geometry(staggered_courtyard_normal.FinalBoundaryRepresentation)
geo_15 = Geometry(staggered_courtyard_interp.FinalBoundaryRepresentation)

geo_16 = Geometry([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])  # disabled
geo_17 = Geometry(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)  # disabled
site_partition_circulation = SitePartitionCirculation(
    SiteCurve=geo_17,
    CirculationCurve=geo_16,
    CirculationDepth=Slider(2.337, range=0..10),
    MinimumAreaPartition=Slider(106.142, range=0..1000))  # -> DebugText, CirculationCurves, PartitionCurves; disabled
number_slider_11 = Slider(2.208, range=0..5)
crv_44 = Curve(site_partition_circulation.CirculationCurves)
crv_45 = Curve(site_partition_circulation.PartitionCurves)
panel_4 = Panel(site_partition_circulation.DebugText)
block_6 = MassingExtrudeBlock(
    SiteCurve=crv_45,
    Setback=Slider(1.604, range=0..5),
    FsrFar=Slider(3.23, range=0..5),
    FLRHT=Slider(2.099, range=0..5),
    MinCrvArea=Slider(4.46, range=0..5))  # -> OutputMassingBreps, OutputFloorCurves
courtyard_mass_3 = CourtyardMassing(
    SiteCurve=crv_45,
    FSRFAR=Slider(1.604, range=0..5),
    FloorHeight=Slider(3.23, range=0..5),
    Setback=Slider(2.099, range=0..5),
    BayDepth=Slider(4.46, range=0..5),
    MinFloorArea=Slider(2.208, range=0..5))  # -> OutputFloorCurves, OutputMassingBreps; disabled
staggered_courtyard_normal_2 = StaggeredCourtyardNormal(
    Site=crv_45,
    Setback=Slider(1.604, range=0..5),
    BaseDepthOffset=Slider(3.23, range=0..5),
    NumOfTowerFootprintsBaseCrvSubdiv=Slider(10, range=0..10),
    NumberOfTowers=Slider(2, range=0..10),
    FloorFloorHeight=Slider(4.46, range=0..5),
    BaseFSRFAR=Slider(2.208, range=0..5),
    TowerFSRFAR=Slider(1.236, range=0..5),
    MinimumAreaSiteCrv=number_slider_11,
    MinimumAreaTowerCrv=number_slider_11)  # -> OffsetCurve, BaseFloorCurves, TowerFloorCurves, PolyFromSubDivOfCrvs, FinalBoundaryRepresentation; disabled
staggered_mass = StaggeredMassing(
    SiteCurve=crv_45,
    FloorHeightRequired=Slider(1.604, range=0..5),
    SetbackStepbacksForMassing="3,5,7",
    HeightsCorrespondingToStepbacks="3,5,7",
    MinArea=Slider(4.46, range=0..5))  # -> OutputFloorCurves, OutputMassingBreps, OutputTextPanelTotalFSRGFAAchieved, NumberOfFloors; disabled
