# Grasshopper definition flr_plan_gen.gh (Grasshopper 1.0.7)
# plug-ins: DotsProj

path = FilePath("C:\nir_dev\MegaSavageLevel\DotsProjRh6\DotsProj\DotsProj\SourceCode\TEST_SCRIPTS\dots_workflow\DOTS_workflow_test\inputs\sample1.csv")
crv = Curve(<curve referenced from the Rhino model>)  # disabled
radial_zone_core = RadialZoneCore(
    InputFilePath=path,
    InputSiteCrv=crv,
    CoreArea=Slider(1000, range=0..1000),
    MoveCoreHorizontal=Slider(0, range=0..100),
    MoveCoreVertical=Slider(0, range=0..100),
    CoreAspectRatio=Slider(0.869, range=0..1),
    RotationInDegrees=Slider(0, range=0..360))  # -> CoreCrv, ZoneCrvsRad, CrvNamesColor; disabled
crv_2 = Curve(radial_zone_core.CoreCrv)
path_2 = FilePath("C:\nir_dev\MegaSavageLevel\DotsProjRh6\DotsProj\DotsProj\SourceCode\TEST_SCRIPTS\dots_workflow\DOTS_workflow_test\inputs\colors.csv")
color_input = ColorInput(InpFilePath=path_2, ListSpaceKeys=radial_zone_core.CrvNamesColor, ListSpaceCrvs=radial_zone_core.ZoneCrvsRad)  # -> BrepFromCrvs, ColorStr
custom_preview = CustomPreview(Geometry=color_input.BrepFromCrvs, Material=color_input.ColorStr)

randomize = BooleanToggle(False)
path_3 = FilePath("C:\nir_dev\MegaSavageLevel\DotsProjRh6\DotsProj\DotsProj\SourceCode\TEST_SCRIPTS\dots_workflow\DOTS_workflow_test\inputs\sample1.csv")
geo = Geometry(<curve referenced from the Rhino model>)
cbsp_site = CbspSite(
    InputFilePath=path_3,
    InputSiteCrv=geo,
    RotationInDegrees=Slider(0, range=0..360),
    RandomizedGenerations=randomize,
    NumberOfOptimizationLoops=Slider(94, range=1..100))  # -> SpatialCrv, CirculationLines, CrvNamesColor; disabled
panel = Panel(cbsp_site.CrvNamesColor)
geo_2 = Geometry(cbsp_site.SpatialCrv)
geo_3 = Geometry(cbsp_site.CirculationLines)
circulation = GenerateCirculation(SiteCrvOuterBoundary=geo, CbspCrvs=geo_2, PartitionLines=geo_3, CirculationDepth=Slider(19.328, range=0..25))  # -> _0PartitionLines, _1CirculationPoly, _2ResultantCbspCrv
path_4 = FilePath("C:\nir_dev\MegaSavageLevel\DotsProjRh6\DotsProj\DotsProj\SourceCode\TEST_SCRIPTS\dots_workflow\DOTS_workflow_test\inputs\colors.csv")
geo_4 = Geometry(circulation._2ResultantCbspCrv)
color_input_2 = ColorInput(InpFilePath=path_4, ListSpaceKeys=cbsp_site.CrvNamesColor, ListSpaceCrvs=geo_4)  # -> BrepFromCrvs, ColorStr
geo_5 = Geometry(circulation._0PartitionLines)
custom_preview_2 = CustomPreview(Geometry=color_input_2.BrepFromCrvs, Material=color_input_2.ColorStr)

path_5 = FilePath("C:\nir_dev\MegaSavageLevel\DotsProjRh6\DotsProj\DotsProj\SourceCode\TEST_SCRIPTS\dots_workflow\DOTS_workflow_test\inputs\sample1.csv")
cbsp = CbspIndependent(
    InputFilesCsv=path_5,
    RotationInDegrees=Slider(0, range=0..360),
    RatioLengthWidth=Slider(0.659, range=0..2),
    RandomizedGenerations=Toggle(False),
    NumberOfOptimizationLoops=Slider(360, range=0..360))  # -> OuterBoundary, BspOutputCurves, PartitionLines, CrvNamesColor; disabled
geo_6 = Geometry(cbsp.OuterBoundary)
geo_7 = Geometry(cbsp.BspOutputCurves)
geo_8 = Geometry(cbsp.PartitionLines)
path_6 = FilePath("C:\nir_dev\MegaSavageLevel\DotsProjRh6\DotsProj\DotsProj\SourceCode\TEST_SCRIPTS\dots_workflow\DOTS_workflow_test\inputs\colors.csv")
circulation_2 = GenerateCirculation(SiteCrvOuterBoundary=geo_6, CbspCrvs=geo_7, PartitionLines=geo_8, CirculationDepth=Slider(2, range=0..2))  # -> _0PartitionLines, _1CirculationPoly, _2ResultantCbspCrv; disabled
color_input_3 = ColorInput(InpFilePath=path_6, ListSpaceKeys=cbsp.CrvNamesColor, ListSpaceCrvs=geo_7)  # -> BrepFromCrvs, ColorStr
geo_9 = Geometry(circulation_2._2ResultantCbspCrv)
geo_10 = Geometry(circulation_2._0PartitionLines)
geo_11 = Geometry(circulation_2._1CirculationPoly)
custom_preview_3 = CustomPreview(Geometry=color_input_3.BrepFromCrvs, Material=color_input_3.ColorStr)
Z = UnitZ(Factor=Slider(1.504, range=0..20))
extr = Extrude(Direction=Z)

pt = Point(Point(162.2521564, 9.998312688, 0))  # disabled
path_7 = FilePath("C:\nir_dev\MegaSavageLevel\DotsProjRh6\DotsProj\DotsProj\SourceCode\TEST_SCRIPTS\dots_workflow\DOTS_workflow_test\inputs\sample1.csv")
emcmc = EMcMC(
    InpFilePath=path_7,
    InitialPoint=pt,
    SensitivityNumIterations=Slider(7, range=0..10),
    Rotation=Slider(84.49, range=0..360))  # -> CrvNamesColor, SpatialCrvs; disabled
path_8 = FilePath("C:\nir_dev\MegaSavageLevel\DotsProjRh6\DotsProj\DotsProj\SourceCode\TEST_SCRIPTS\dots_workflow\DOTS_workflow_test\inputs\colors.csv")
color_input_4 = ColorInput(InpFilePath=path_8, ListSpaceKeys=emcmc.CrvNamesColor, ListSpaceCrvs=emcmc.SpatialCrvs)  # -> BrepFromCrvs, ColorStr
sel_sides = SelectSidesFromPolyline(OffsetIndexStart=Slider(0, range=0..10), NumOfSides=Slider(3, range=0..10))
Z_2 = UnitZ(Factor=Slider(3, range=0..10))
crv_3 = Curve(sel_sides)
custom_preview_4 = CustomPreview(Geometry=color_input_4.BrepFromCrvs, Material=color_input_4.ColorStr)
extr_2 = Extrude(Direction=Z_2)

path_9 = FilePath("C:\nir_dev\MegaSavageLevel\DotsProjRh6\DotsProj\DotsProj\SourceCode\TEST_SCRIPTS\dots_workflow\DOTS_workflow_test\inputs\sample1.csv")
crv_4 = Curve(<curve referenced from the Rhino model>)
crv_skeleton = CrvSkeleton(
    InpFilePath=path_9,
    InpSiteCurve=crv_4,
    FromSiteOuterCirculationDepth=Slider(9, range=0..20),
    FromOuterCirculationBayDepth=Slider(40, range=0..75),
    FromBayDepthInnerCirculationDepth=Slider(5, range=0..20),
    SensitivityX100=Slider(5, range=0..5),
    OptimizationItrs=Slider(500, range=0..500))  # -> OuterOffsetCrv, InnerOffsetCrv, RESULTSegGeom, CrvNamesColor
geo_12 = Geometry(crv_skeleton.OuterOffsetCrv)
geo_13 = Geometry(crv_skeleton.InnerOffsetCrv)
geo_14 = Geometry(crv_skeleton.RESULTSegGeom)
randomize_2 = BooleanToggle(False)
path_10 = FilePath("C:\nir_dev\MegaSavageLevel\DotsProjRh6\DotsProj\DotsProj\SourceCode\TEST_SCRIPTS\dots_workflow\DOTS_workflow_test\inputs\sample2.csv")
cbsp_site_2 = CbspSite(
    InputFilePath=path_10,
    InputSiteCrv=geo_13,
    RotationInDegrees=Slider(0, range=0..360),
    RandomizedGenerations=randomize_2,
    NumberOfOptimizationLoops=Slider(100, range=1..100))  # -> SpatialCrv, CirculationLines, CrvNamesColor; disabled
path_11 = FilePath("C:\nir_dev\MegaSavageLevel\DotsProjRh6\DotsProj\DotsProj\SourceCode\TEST_SCRIPTS\dots_workflow\DOTS_workflow_test\inputs\colors.csv")
color_input_5 = ColorInput(InpFilePath=path_11, ListSpaceKeys=crv_skeleton.CrvNamesColor, ListSpaceCrvs=geo_14)  # -> BrepFromCrvs, ColorStr
geo_15 = Geometry(cbsp_site_2.CirculationLines)
geo_16 = Geometry(cbsp_site_2.SpatialCrv)
custom_preview_5 = CustomPreview(Geometry=color_input_5.BrepFromCrvs, Material=color_input_5.ColorStr)
circulation_3 = GenerateCirculation(SiteCrvOuterBoundary=geo_13, CbspCrvs=geo_16, PartitionLines=geo_15, CirculationDepth=Slider(5.069, range=0..10))  # -> _0PartitionLines, _1CirculationPoly, _2ResultantCbspCrv
geo_17 = Geometry(circulation_3._0PartitionLines)
geo_18 = Geometry(circulation_3._2ResultantCbspCrv)
path_12 = FilePath("C:\nir_dev\MegaSavageLevel\DotsProjRh6\DotsProj\DotsProj\SourceCode\TEST_SCRIPTS\dots_workflow\DOTS_workflow_test\inputs\colors.csv")
color_input_6 = ColorInput(InpFilePath=path_12, ListSpaceKeys=cbsp_site_2.CrvNamesColor, ListSpaceCrvs=geo_18)  # -> BrepFromCrvs, ColorStr
panel_2 = Panel(cbsp_site_2.CrvNamesColor)
panel_3 = Panel(color_input_6.ColorStr)
custom_preview_6 = CustomPreview(Geometry=color_input_6.BrepFromCrvs, Material=color_input_6.ColorStr)
