# Grasshopper definition networks.gh (Grasshopper 1.0.7)
# plug-ins: DotsProj

geo = Geometry(<curve referenced from the Rhino model>)
path = FilePath("C:\nir_dev\MegaSavageLevel\DotsProjRh6\DotsProj\DotsProj\SourceCode\test_scripts\dots_workflow\DOTS_workflow_test\inputs\network_SA.csv")
grid_allocation_solver = GridAllocationSolver(
    InpFilePath=path,
    SiteCurve=geo,
    NumberXAxis=Slider(5, range=0..20),
    NumberYAxis=Slider(5, range=0..20),
    CirculationDepth=Slider(0.91, range=0..5),
    NumberOfIterations=Slider(100, range=0..100),
    MinimumAreaOfCurve=Slider(0, range=0..150))  # -> CrvNamesColor, ListOfFsr, Curve
geo_2 = Geometry()
file_path = FilePath("C:\nir_dev\MegaSavageLevel\DotsProjRh6\DotsProj\DotsProj\SourceCode\TEST_SCRIPTS\dots_workflow\DOTS_workflow_test\inputs\colors.csv")
color_input = ColorInput(
    InpFilePath=file_path,
    ListSpaceKeysNames=grid_allocation_solver.CrvNamesColor,
    ListSpaceCrvs=grid_allocation_solver.Curve)  # -> BrepFromCrvs, ColorStr
number_slider = Slider(0, range=0..150)
custom_preview = CustomPreview(Geometry=color_input.BrepFromCrvs, Material=color_input.ColorStr)
custom_preview_2 = CustomPreview(Material={diffuse=RGB(221, 160, 221), emission=RGB(66, 48, 66), shine=0.5, specular=RGB(255, 255, 255), transparency=0})
block = MassingExtrudeBlock(SiteCurve=geo_2, Setback=Slider(0.607, range=0..5), FLRHT=Slider(4.715, range=0..5), MinCrvArea=Slider(0, range=0..150))  # -> OutputMassingBreps, OutputFloorCurves; disabled
staggered_courtyard_interp = StaggeredCourtyardInterpolated(
    Site=geo_2,
    Setback=Slider(0.607, range=0..5),
    BaseDepthOffset=Slider(2.299, range=0..5),
    NumOfTowerFootprintsBaseCrvSubdiv=Slider(5, range=0..5),
    NumberOfTowers=Slider(2, range=0..5),
    FloorFloorHeight=Slider(1.015, range=0..5),
    MinimumAreaSiteCrv=number_slider,
    MinimumAreaTowerCrv=number_slider)  # -> OffsetCurve, BaseFloorCurves, TowerFloorCurves, PolyFromSubDivOfCrvs, FinalBoundaryRepresentation; disabled
courtyard_mass = CourtyardMassing(
    SiteCurve=geo_2,
    FloorHeight=Slider(0.607, range=0..5),
    Setback=Slider(0.607, range=0..5),
    BayDepth=Slider(1.015, range=0..5),
    MinFloorArea=Slider(0, range=0..150))  # -> OutputFloorCurves, OutputMassingBreps; disabled
staggered_mass = StaggeredMassing(
    SiteCurve=geo_2,
    SetbackStepbacksForMassing="0.5,0.7",
    HeightsCorrespondingToStepbacks="1,3",
    MinArea=Slider(0, range=0..150))  # -> OutputFloorCurves, OutputMassingBreps, OutputTextPanelTotalFSRGFAAchieved, NumberOfFloors; disabled
geo_3 = Geometry(block.OutputMassingBreps)
geo_4 = Geometry(<curve referenced from the Rhino model>)  # disabled
geo_5 = Geometry([<curve referenced from the Rhino model> x3])  # disabled
site_partition_circulation = SitePartitionCirculation(
    SiteCurve=geo_4,
    CirculationCurve=geo_5,
    CirculationDepth=Slider(1.695, range=0..5),
    MinimumAreaPartition=Slider(4.311, range=0..100))  # -> DebugText, CirculationCurves, PartitionCurves; disabled
geo_6 = Geometry(site_partition_circulation.PartitionCurves)
geo_7 = Geometry(site_partition_circulation.CirculationCurves)
number_slider_2 = Slider(0, range=0..5)
number_slider_3 = Slider(0, range=0..5)
staggered_courtyard_interp_2 = StaggeredCourtyardInterpolated(
    Site=geo_6,
    Setback=Slider(1.882, range=0..5),
    BaseDepthOffset=Slider(5, range=0..5),
    NumOfTowerFootprintsBaseCrvSubdiv=Slider(16, range=0..25),
    NumberOfTowers=Slider(3, range=0..5),
    FloorFloorHeight=Slider(2.808, range=0..5),
    BaseFSRFAR=Slider(0.372, range=0..5),
    TowerFSRFAR=Slider(3.88, range=0..5),
    MinimumAreaSiteCrv=number_slider_2,
    MinimumAreaTowerCrv=number_slider_2)  # -> OffsetCurve, BaseFloorCurves, TowerFloorCurves, PolyFromSubDivOfCrvs, FinalBoundaryRepresentation; disabled
staggered_courtyard_normal = StaggeredCourtyardNormal(
    Site=geo_6,
    Setback=Slider(3.226, range=0..5),
    BaseDepthOffset=Slider(5, range=0..5),
    NumOfTowerFootprintsBaseCrvSubdiv=Slider(5, range=0..25),
    NumberOfTowers=Slider(2, range=0..5),
    FloorFloorHeight=Slider(2.877, range=0..5),
    BaseFSRFAR=Slider(1.42, range=0..5),
    TowerFSRFAR=Slider(2.205, range=0..5),
    MinimumAreaSiteCrv=number_slider_3,
    MinimumAreaTowerCrv=number_slider_3)  # -> OffsetCurve, BaseFloorCurves, TowerFloorCurves, PolyFromSubDivOfCrvs, FinalBoundaryRepresentation; disabled
block_2 = MassingExtrudeBlock(
    SiteCurve=geo_6,
    Setback=Slider(0.539, range=0..5),
    FsrFar=Slider(3.264, range=0..5),
    FLRHT=Slider(3.182, range=0..5),
    MinCrvArea=Slider(45.709, range=0..100))  # -> OutputMassingBreps, OutputFloorCurves; disabled
staggered_mass_2 = StaggeredMassing(
    SiteCurve=geo_6,
    FloorHeightRequired=Slider(5, range=0..5),
    SetbackStepbacksForMassing="2,4",
    HeightsCorrespondingToStepbacks="13,15",
    MinArea=Slider(4.406, range=0..5))  # -> OutputFloorCurves, OutputMassingBreps, OutputTextPanelTotalFSRGFAAchieved, NumberOfFloors; disabled
courtyard_mass_2 = CourtyardMassing(
    SiteCurve=geo_6,
    FSRFAR=Slider(1.063, range=0..5),
    FloorHeight=Slider(5, range=0..5),
    Setback=Slider(0.319, range=0..5),
    BayDepth=Slider(3.575, range=0..5),
    MinFloorArea=Slider(1, range=0..1))  # -> OutputFloorCurves, OutputMassingBreps; disabled
geo_8 = Geometry(block_2.OutputMassingBreps)
geo_9 = Geometry(block_2.OutputFloorCurves)
pt = Point([Point(17.29777822, -150.3862014, 0), Point(87.24063131, 102.1835567, 0), Point(-141.4480143, 76.26838676, 0)])
crv = Curve(<curve referenced from the Rhino model>)
grid_gen = SpaceGenerator(
    InputCurve=crv,
    OriginPoints=pt,
    SegmentLength=Slider(28, range=0..35),
    IterationNumber=Slider(6517, range=0..50000),
    RndAngleRadians=Slider(0, range=0..6.28))  # -> DebugText, SpaceCurves
crv_2 = Curve(grid_gen.SpaceCurves)
Z = UnitZ(Factor=Slider(6.28, range=0..6.28))
extr = Extrude(Base=crv_2, Direction=Z)
gen_2_parcels = Generator2Parcels(
    SpaceCurveSegements=crv_2,
    Setback=Slider(3.74, range=0..6.28),
    BayDepth=Slider(4.305, range=0..6.28),
    GenerateIndividualParcels=Toggle(True),
    ParcelWidth=Slider(6.183, range=0..20))  # -> DebugText, CirculationPath, ParcelCurves, ParcelRegion, DebugCrv
python = GhPythonScript(Crvs=gen_2_parcels.ParcelCurves, Pts=pt)  # -> out, a; inputs Crvs: list of Polyline, Pts: list of Point3d
# ---------- python: Python ----------
__author__ = "Nirvik Saha"
__version__ = "2020.01.08"

import rhinoscriptsyntax as rs

def gen(crvs, pts):
    srfLi=[]
    for c in crvs:
        try:
            cen=rs.CurveAreaCentroid(c)[0]
            srfLi.append(cen)
            P=None
            D=10000
            for p in pts:
                d=rs.Distance(cen, p)
                if(d<D):
                    P=p
            d=rs.Distance(cen, P)
            ht=1000/(d+10)
            v=rs.AddLine([0,0,0], [0,0,ht])
            srf=rs.ExtrudeCurve(c, v)
            #srfLi.append(srf)
        except:
            print("error")
    return srfLi

#Crvs=rs.GetObjects("pick curves")
#Pts=rs.GetObjects("pick points")
a=gen(Crvs, Pts)
# ---------- end python ----------
geo_10 = Geometry(gen_2_parcels.DebugCrv)  # disabled
crv_3 = Curve(gen_2_parcels.ParcelCurves)
crv_4 = Curve(gen_2_parcels.ParcelRegion)
crv_5 = Curve(gen_2_parcels.CirculationPath)
item = ListItem(List=crv_2, Index=Slider(3, range=0..35), Wrap=True)
block_3 = MassingExtrudeBlock(
    SiteCurve=crv_3,
    Setback=Slider(0.167, range=0..6.28),
    FsrFar=Slider(2.65, range=0..6.28),
    FLRHT=Slider(2.578, range=0..6.28),
    MinCrvArea=Slider(0, range=0..6.28))  # -> OutputMassingBreps, OutputFloorCurves; disabled
python_2 = GhPythonScript(Crvs=crv_3, Pts=pt)  # -> out, a, b; inputs Crvs: list of Curve, Pts: list of Point3d
# ---------- python_2: Python ----------
__author__ = "Nirvik Saha"
__version__ = "2020.01.08"

import rhinoscriptsyntax as rs

def genSrf(crvs, pts): 
    srf_li=[]
    pt_li=[]
    line_li=[]
    for c in crvs:
        cen=rs.CurveAreaCentroid(c)[0]
        if(pts and len(pts)>0):
            min_di=rs.Distance(cen, pts[0]);
            for p in pts:
                di=rs.Distance(cen, p)
                if(di<min_di):
                    min_di=di
            L=rs.AddLine([cen[0], cen[1], cen[2]], [cen[0], cen[1], cen[2]+1000/min_di])
            srf=rs.ExtrudeCurve(c, L)
            line_li.append(srf)
    return line_li

def checkPts(pts):
    cir_li=[]
    for p in pts:
        c=rs.AddCircle(p, 100)
        cir_li.append(c)
    return cir_li

a=genSrf(Crvs, Pts)
b=checkPts(Pts)
# ---------- end python_2 ----------
crv_6 = Curve(python_2.b)
brep = Brep()
