# Grasshopper definition urban_plan_gen.gh (Grasshopper 1.0.7)
# plug-ins: DotsProj

crv = Curve(<curve referenced from the Rhino model>)  # disabled
parcel_subdiv = ParcelsBySubdivision(
    InputSite=crv,
    NumOfParcels=Slider(64, range=0..100),
    DevMean01=Slider(0.121, range=0..1),
    AngleAlignmentDegrees0360=Slider(360, range=0..360),
    ShowThisIterations=Slider(0, range=0..33),
    ResetAllValues=Toggle(True),
    Generate=Toggle(True))  # -> LowestDeviationOfParcelSolution, StreetCenterLines, OutputParcelFromRequiredIteration, OutputStreetFromRequiredIteration, NumberOfResults; disabled
crv_2 = Curve(parcel_subdiv.StreetCenterLines)
crv_3 = Curve(parcel_subdiv.OutputParcelFromRequiredIteration)
crv_4 = Curve(parcel_subdiv.LowestDeviationOfParcelSolution)
crv_5 = Curve(parcel_subdiv.OutputStreetFromRequiredIteration)
panel = Panel(parcel_subdiv.NumberOfResults)
circulation = GenerateCirculation(SiteCrvOuterBoundary=crv, CbspCrvs=crv_4, PartitionLines=crv_2, CirculationDepth=Slider(9, range=0..100))  # -> _0PartitionLines, _1CirculationPoly, _2ResultantCbspCrv; disabled
geo = Geometry(circulation._2ResultantCbspCrv)  # disabled
brep = Brep()
Z = UnitZ(Factor=1)
courtyard_mass = CourtyardMassing(
    SiteCurve=geo,
    FSRFAR=Slider(3, range=0..20),
    FloorHeight=Slider(3, range=0..20),
    Setback=Slider(0.975, range=0..20),
    BayDepth=Slider(6.974, range=0..100),
    MinFloorArea=Slider(0, range=0..1500))  # -> OutputFloorCurves, OutputMassingBreps; disabled
extr = Extrude(Base=brep, Direction=Z)
geo_2 = Geometry(courtyard_mass.OutputFloorCurves)
geo_3 = Geometry(courtyard_mass.OutputMassingBreps)

crv_6 = Curve(<curve referenced from the Rhino model>)  # disabled
peripheral_subdiv_parcel = PeripheralSubdivisionParcels(
    SiteCurve=crv_6,
    SetbackDimensionFromSite=Slider(9, range=0..20),
    BayDepthFromSetback=Slider(103, range=0..300),
    InnerCrv0ffsetFromBay=Slider(15, range=0..20),
    NumDiv=Slider(9, range=0..20))  # -> Setback, Bay, InnerCrv, ParcelCrv; disabled
number_slider = Slider(0, range=0..1)
crv_7 = Curve(peripheral_subdiv_parcel.ParcelCrv)
block = ExtrudeBlock(
    SiteCurve=crv_7,
    Setback=Slider(15.316, range=0..20),
    FsrFar=Slider(20, range=0..20),
    FLRHT=Slider(5.827, range=0..20),
    MinCrvArea=Slider(0, range=0..20000))  # -> OutputExtrudedMass, FloorCurves
geo_4 = Geometry(block.OutputExtrudedMass)
geo_5 = Geometry(block.FloorCurves)  # disabled

crv_8 = Curve(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)
crv_9 = Curve(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)
Z_2 = UnitZ(Factor=Slider(20, range=0..20))
extr_2 = Extrude(Base=crv_8, Direction=Z_2)
parcel_int_poly = ParcelsFromInternalPoly(InputSiteCurve=crv_9, InternalPolyine=crv_8)  # -> OutputParcels, OutputStreets
crv_10 = Curve(parcel_int_poly.OutputStreets)  # disabled
crv_11 = Curve(parcel_int_poly.OutputParcels)
circulation_2 = GenerateCirculation(SiteCrvOuterBoundary=crv_9, CbspCrvs=crv_11, PartitionLines=crv_10, CirculationDepth=Slider(4.972, range=0..10))  # -> _0PartitionLines, _1CirculationPoly, _2ResultantCbspCrv; disabled
block_2 = ExtrudeBlock(
    SiteCurve=crv_11,
    Setback=Slider(10.996, range=0..20),
    FsrFar=Slider(3.596, range=0..20),
    FLRHT=Slider(3.364, range=0..20),
    MinCrvArea=Slider(106.409, range=0..200))  # -> OutputExtrudedMass, FloorCurves; disabled
crv_12 = Curve(circulation_2._0PartitionLines)
crv_13 = Curve(circulation_2._2ResultantCbspCrv)
geo_6 = Geometry(block_2.FloorCurves)
geo_7 = Geometry(block_2.OutputExtrudedMass)

crv_14 = Curve(<curve referenced from the Rhino model>)  # disabled
parcel_subdiv_2 = ParcelsBySubdivision(
    InputSite=crv_14,
    NumOfParcels=Slider(64, range=0..100),
    DevMean01=Slider(0.121, range=0..1),
    AngleAlignmentDegrees0360=Slider(360, range=0..360),
    ShowThisIterations=Slider(0, range=0..33),
    ResetAllValues=Toggle(True),
    Generate=Toggle(True))  # -> LowestDeviationOfParcelSolution, StreetCenterLines, OutputParcelFromRequiredIteration, OutputStreetFromRequiredIteration, NumberOfResults; disabled
crv_15 = Curve(parcel_subdiv_2.StreetCenterLines)
crv_16 = Curve(parcel_subdiv_2.OutputParcelFromRequiredIteration)
crv_17 = Curve(parcel_subdiv_2.LowestDeviationOfParcelSolution)
crv_18 = Curve(parcel_subdiv_2.OutputStreetFromRequiredIteration)
panel_2 = Panel(parcel_subdiv_2.NumberOfResults)
circulation_3 = GenerateCirculation(SiteCrvOuterBoundary=crv_14, CbspCrvs=crv_17, PartitionLines=crv_15, CirculationDepth=Slider(9, range=0..100))  # -> _0PartitionLines, _1CirculationPoly, _2ResultantCbspCrv
crv_19 = Curve(crv_17)
geo_8 = Geometry(circulation_3._2ResultantCbspCrv)
select = Select(
    InputSiteCrv=crv_14,
    Parcels=circulation_3._2ResultantCbspCrv,
    CentralizeOrDisperse=Toggle(False),
    OpenSpaceRequirement=Slider(26.756, range=0..100))  # -> OutputBuildableParcels, OutputOpenSpaceParcels
crv_20 = Curve(select.OutputBuildableParcels)
crv_21 = Curve(select.OutputOpenSpaceParcels)
block_3 = ExtrudeBlock(
    SiteCurve=crv_20,
    Setback=Slider(3.31, range=0..20),
    FsrFar=Slider(2.427, range=0..20),
    FLRHT=Slider(3.029, range=0..20),
    MinCrvArea=Slider(97.433, range=0..1500))  # -> OutputExtrudedMass, FloorCurves; disabled
courtyard_mass_2 = CourtyardMassing(
    SiteCurve=crv_21,
    FSRFAR=Slider(0.863, range=0..20),
    FloorHeight=Slider(20, range=0..20),
    Setback=Slider(1.64, range=0..20),
    BayDepth=Slider(10.019, range=0..100),
    MinFloorArea=Slider(0, range=0..1500))  # -> OutputFloorCurves, OutputMassingBreps; disabled
geo_9 = Geometry(block_3.FloorCurves)
geo_10 = Geometry(block_3.OutputExtrudedMass)
geo_11 = Geometry(courtyard_mass_2.OutputMassingBreps)

crv_22 = Curve(<curve referenced from the Rhino model>)  # disabled
crv_23 = Curve(<curve referenced from the Rhino model>)  # disabled
parcel_subdiv_diff = ParcelsBySubdivisionWithSubtraction(
    InputSite=crv_23,
    InternalCrv=crv_22,
    NumOfParcels=Slider(20, range=0..20),
    DevMean01=Slider(0, range=0..1),
    AngleAlignmentDegrees0360=Slider(0, range=0..360),
    ShowThisIterations=Slider(1, range=0..20),
    ResetAllValues=Toggle(True),
    Generate=Toggle(True))  # -> LowestDeviationOfParcelSolution, StreetCenterLines, OutputParcelFromRequiredIteration, OutputStreetFromRequiredIteration, NumberOfResults; disabled
crv_24 = Curve(parcel_subdiv_diff.LowestDeviationOfParcelSolution)
panel_3 = Panel(parcel_subdiv_diff.NumberOfResults)
crv_25 = Curve(parcel_subdiv_diff.StreetCenterLines)
crv_26 = Curve(parcel_subdiv_diff.OutputParcelFromRequiredIteration)
crv_27 = Curve(parcel_subdiv_diff.OutputStreetFromRequiredIteration)
circulation_4 = GenerateCirculation(SiteCrvOuterBoundary=crv_23, CbspCrvs=crv_24, PartitionLines=crv_25, CirculationDepth=Slider(15.502, range=0..20))  # -> _0PartitionLines, _1CirculationPoly, _2ResultantCbspCrv; disabled
crv_28 = Curve(circulation_4._0PartitionLines)
crv_29 = Curve(circulation_4._2ResultantCbspCrv)
staggered_mass = StaggeredMassing(
    SiteCurve=crv_24,
    FloorHeightRequired=Slider(1.604, range=0..5),
    SetbackStepbacksForMassing="7,12",
    HeightsCorrespondingToStepbacks="20,50",
    MinArea=Slider(4.46, range=0..5))  # -> OutputFloorCurves, OutputMassingBreps, OutputTextPanelTotalFSRGFAAchieved, NumberOfFloors; disabled
geo_12 = Geometry(staggered_mass.OutputMassingBreps)

crv_30 = Curve([<curve referenced from the Rhino model> x351])  # disabled
ext_setbacks = UrbanMassingFromSiteFsrSetbacksStreets(
    InputSiteCurves=crv_30,
    StreetLayerNames="streeta, streetb",
    CorrespondingStreetSetbacks="5.5, 7.0",
    InputFSR=Slider(15, range=0..15))  # -> OutputSolidGeometry, OutputSITENumbers; disabled
geo_13 = Geometry(ext_setbacks.OutputSolidGeometry)
panel_4 = Panel(ext_setbacks.OutputSITENumbers)

crv_31 = Curve(<curve referenced from the Rhino model>)  # disabled
peripheral_subdiv_parcel_2 = PeripheralSubdivisionParcels(
    SiteCurve=crv_31,
    SetbackDimensionFromSite=Slider(20, range=0..20),
    BayDepthFromSetback=Slider(34.534, range=0..50),
    InnerCrv0ffsetFromBay=Slider(10, range=0..10),
    NumDiv=Slider(40, range=0..100))  # -> Setback, Bay, InnerCrv, ParcelCrv; disabled
crv_32 = Curve(peripheral_subdiv_parcel_2.Setback)
crv_33 = Curve(peripheral_subdiv_parcel_2.Bay)
crv_34 = Curve(peripheral_subdiv_parcel_2.InnerCrv)
crv_35 = Curve(peripheral_subdiv_parcel_2.ParcelCrv)

crv_36 = Curve(<curve referenced from the Rhino model>)  # disabled
peripheral_subdiv_parcel_3 = PeripheralSubdivisionParcels(
    SiteCurve=crv_36,
    SetbackDimensionFromSite=Slider(3, range=0..10),
    BayDepthFromSetback=Slider(47.407, range=0..50),
    InnerCrv0ffsetFromBay=Slider(1.573, range=0..10),
    NumDiv=Slider(15, range=0..100))  # -> Setback, Bay, InnerCrv, ParcelCrv; disabled
crv_37 = Curve(peripheral_subdiv_parcel_3.Setback)
crv_38 = Curve(peripheral_subdiv_parcel_3.Bay)
crv_39 = Curve(peripheral_subdiv_parcel_3.InnerCrv)
crv_40 = Curve(peripheral_subdiv_parcel_3.ParcelCrv)
crv_41 = Curve(crv_40)
courtyard_mass_3 = CourtyardMassing(
    SiteCurve=crv_41,
    FSRFAR=Slider(2.198, range=0.5..3),
    FloorHeight=Slider(3, range=0..10),
    Setback=Slider(2.957, range=0..25),
    BayDepth=Slider(8, range=0..20),
    MaxHtFloorArea=Slider(0, range=0..20))  # -> OutputFloorCurves, OutputMassingBreps

brep_2 = Brep()
brep_3 = Brep(crv_21)
Z_3 = UnitZ(Factor=1)

number_slider_2 = Slider(0, range=0..1)
crv_42 = Curve(crv_35)  # disabled
block_4 = ExtrudeBlock(
    SiteCurve=crv_42,
    Setback=Slider(4.617, range=0..20),
    FsrFar=Slider(6.806, range=0..20),
    FLRHT=Slider(3, range=0..3),
    MinCrvArea=Slider(0, range=0..20000))  # -> OutputExtrudedMass, FloorCurves; disabled
geo_14 = Geometry(block_4.OutputExtrudedMass)
geo_15 = Geometry(block_4.FloorCurves)

extr_3 = Extrude(Base=brep_3, Direction=Z_3)

crv_43 = Curve(<curve referenced from the Rhino model>)  # disabled
peripheral_subdiv_parcel_4 = PeripheralSubdivisionParcels(
    SiteCurve=crv_43,
    SetbackDimensionFromSite=Slider(3, range=0..10),
    BayDepthFromSetback=Slider(47.407, range=0..50),
    InnerCrv0ffsetFromBay=Slider(1.573, range=0..10),
    NumDiv=Slider(15, range=0..100))  # -> Setback, Bay, InnerCrv, ParcelCrv; disabled
number_slider_3 = Slider(0, range=0..20)
crv_44 = Curve(peripheral_subdiv_parcel_4.Setback)
crv_45 = Curve(peripheral_subdiv_parcel_4.Bay)
crv_46 = Curve(peripheral_subdiv_parcel_4.InnerCrv)
crv_47 = Curve(peripheral_subdiv_parcel_4.ParcelCrv)
number_slider_4 = Slider(20, range=0..20)
number_slider_5 = Slider(4, range=0..20)
number_slider_6 = Slider(2.198, range=0.5..3)
number_slider_7 = Slider(9.613, range=0..25)
number_slider_8 = Slider(3, range=0..10)
number_slider_9 = Slider(0.149, range=0..10)
number_slider_10 = Slider(0.726, range=0..5)
crv_48 = Curve(crv_47)
staggered_courtyard_normal = StaggeredCourtyardNormal(
    Site=crv_48,
    Setback=number_slider_10,
    BaseDepthOffset=number_slider_7,
    NumOfTowerFootprintsBaseCrvSubdiv=number_slider_4,
    NumberOfTowers=number_slider_5,
    FloorFloorHeight=number_slider_8,
    BaseFSRFAR=number_slider_6,
    TowerFSRFAR=number_slider_9,
    MinimumAreaSiteCrv=number_slider_3,
    MinimumAreaTowerCrv=number_slider_3)  # -> OffsetCurve, BaseFloorCurves, TowerFloorCurves, PolyFromSubDivOfCrvs, FinalBoundaryRepresentation; disabled
staggered_courtyard_interp = StaggeredCourtyardInterpolated(
    Site=crv_48,
    Setback=number_slider_10,
    BaseDepthOffset=number_slider_7,
    BaseDepthOffset_2=number_slider_4,
    NumberOfTowers=number_slider_5,
    FloorFloorHeight=number_slider_8,
    BaseFSRFAR=number_slider_6,
    TowerFSRFAR=number_slider_9,
    MinimumAreaSiteCrv=number_slider_3,
    MinimumAreaTowerCrv=number_slider_3)  # -> OffsetCurve, BaseFloorCurves, TowerFloorCurves, PolyFromSubDivOfCrvs, FinalBoundaryRepresentation; disabled
geo_16 = Geometry(staggered_courtyard_normal.FinalBoundaryRepresentation)
geo_17 = Geometry(staggered_courtyard_interp.FinalBoundaryRepresentation)

geo_18 = Geometry([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])
geo_19 = Geometry(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)  # disabled
site_partition_circulation = SitePartitionCirculation(
    SiteCurve=geo_19,
    CirculationCurve=geo_18,
    CirculationDepth=Slider(2.337, range=0..10),
    MinimumAreaPartition=Slider(106.142, range=0..1000))  # -> DebugText, CirculationCurves, PartitionCurves; disabled
number_slider_11 = Slider(2.208, range=0..5)
crv_49 = Curve(site_partition_circulation.CirculationCurves)
crv_50 = Curve(site_partition_circulation.PartitionCurves)
panel_5 = Panel(site_partition_circulation.DebugText)
block_5 = MassingExtrudeBlock(
    SiteCurve=crv_50,
    Setback=Slider(1.604, range=0..5),
    FsrFar=Slider(3.23, range=0..5),
    FLRHT=Slider(2.099, range=0..5),
    MinCrvArea=Slider(4.46, range=0..5))  # -> OutputMassingBreps, OutputFloorCurves; disabled
courtyard_mass_4 = CourtyardMassing(
    SiteCurve=crv_50,
    FSRFAR=Slider(1.604, range=0..5),
    FloorHeight=Slider(3.23, range=0..5),
    Setback=Slider(1.179, range=0..5),
    BayDepth=Slider(5, range=0..5),
    MinFloorArea=Slider(2.208, range=0..5))  # -> OutputFloorCurves, OutputMassingBreps; disabled
staggered_courtyard_normal_2 = StaggeredCourtyardNormal(
    Site=crv_50,
    Setback=Slider(1.604, range=0..5),
    BaseDepthOffset=Slider(3.23, range=0..5),
    NumOfTowerFootprintsBaseCrvSubdiv=Slider(10, range=0..10),
    NumberOfTowers=Slider(2, range=0..10),
    FloorFloorHeight=Slider(4.46, range=0..5),
    BaseFSRFAR=Slider(2.208, range=0..5),
    TowerFSRFAR=Slider(1.236, range=0..5),
    MinimumAreaSiteCrv=number_slider_11,
    MinimumAreaTowerCrv=number_slider_11)  # -> OffsetCurve, BaseFloorCurves, TowerFloorCurves, PolyFromSubDivOfCrvs, FinalBoundaryRepresentation; disabled

staggered_mass_2 = StaggeredMassing(
    SiteCurve=crv_50,
    FloorHeightRequired=Slider(1.604, range=0..5),
    SetbackStepbacksForMassing="3,5,7",
    HeightsCorrespondingToStepbacks="3,5,7",
    MinArea=Slider(4.46, range=0..5))  # -> OutputFloorCurves, OutputMassingBreps, OutputTextPanelTotalFSRGFAAchieved, NumberOfFloors; disabled
