# Grasshopper definition dotsTest.gh (Grasshopper 1.0.7)
# plug-ins: DotsProj

crv = Curve(<curve referenced from the Rhino model>)  # disabled
crv_2 = Curve(<curve referenced from the Rhino model>)  # disabled
crv_3 = Curve(<curve referenced from the Rhino model>)  # disabled
crv_4 = Curve(<curve referenced from the Rhino model>)
crv_5 = Curve(<curve referenced from the Rhino model>)
timer = Timer(TimerInterval=50, Target=parcel_subdiv)  # disabled
parcel_subdiv = ParcelsBySubdivision(
    InputSite=crv_3,
    NumOfParcels=Slider(8, range=0..20),
    DevMean01=Slider(0.24, range=0..1),
    AngleAlignmentDegrees0360=Slider(0, range=0..360),
    ShowThisIterations=Slider(0, range=0..33),
    ResetAllValues=Toggle(False),
    Generate=Toggle(False))  # -> LowestDeviationSolution, OutputFromRequiredIteration, NumberOfResults; disabled
parcel_subdiv_diff = ParcelsBySubdivisionWithSubtraction(
    InputSite=crv,
    InternalCrv=crv_2,
    NumOfParcels=Slider(13, range=0..20),
    DevMean01=Slider(0, range=0..1),
    AngleAlignmentDegrees0360=Slider(0, range=0..360),
    ShowThisIterations=Slider(0, range=0..20),
    ResetAllValues=Toggle(False),
    Generate=Toggle(True))  # -> LowestDeviationSolution, OutputFromRequiredIteration, NumberOfResults; disabled
parcel_int_poly = ParcelsFromInternalPoly(InputSiteCurve=crv_4, InternalPolyine=crv_5)  # disabled
crv_6 = Curve(parcel_int_poly)
crv_7 = Curve(parcel_subdiv.LowestDeviationSolution)
panel = Panel(parcel_subdiv.NumberOfResults)
crv_8 = Curve(parcel_subdiv.OutputFromRequiredIteration)
crv_9 = Curve(parcel_subdiv_diff.LowestDeviationSolution)
crv_10 = Curve(parcel_subdiv_diff.OutputFromRequiredIteration)
panel_2 = Panel(parcel_subdiv_diff.NumberOfResults)
crv_11 = Curve([<curve referenced from the Rhino model> x351])
crv_12 = Curve(<curve referenced from the Rhino model>)  # disabled
crv_13 = Curve(<curve referenced from the Rhino model>)
crv_14 = Curve(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)  # disabled
crv_15 = Curve(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)  # disabled
crv_16 = Curve(<curve referenced from the Rhino model>)
ext_setbacks = UrbanMassingFromSiteFsrSetbacksStreets(
    InputSiteCurves=crv_11,
    StreetLayerNames="streeta, streetb",
    CorrespondingStreetSetbacks="10.5, 15.0",
    InputFSR=Slider(4.09, range=0..15))  # -> OutputSolidGeometry, OutputSITENumbers; disabled
staggered_courtyard_interp = StaggeredCourtyardInterpolated(
    Site=crv_12,
    Setback=Slider(13.684, range=0..20),
    BaseDepthOffset=Slider(16.892, range=0..200),
    BaseDepthOffset_2=Slider(7.2, range=0..150),
    NumberOfTowers=Slider(3.037, range=0..20),
    FloorFloorHeight=Slider(3.41, range=0..20),
    BaseFSRFAR=Slider(2.613, range=0..20),
    TowerFSRFAR=Slider(2.338, range=0..20),
    MinimumAreaSiteCrv=Slider(2000, range=0..2000),
    MinimumAreaTowerCrv=Slider(92.158, range=0..2000))  # -> OffsetCurve, BaseFloorCurves, TowerFloorCurves, PolyFromSubDivOfCrvs, FinalBoundaryRepresentation; disabled
staggered_courtyard_normal = StaggeredCourtyardNormal(
    Site=crv_13,
    Setback=Slider(16.313, range=0..20),
    BaseDepthOffset=Slider(18.182, range=0..200),
    NumOfTowerFootprintsBaseCrvSubdiv=Slider(11.105, range=0..150),
    NumberOfTowers=Slider(6.646, range=0..20),
    FloorFloorHeight=Slider(3.213, range=0..20),
    BaseFSRFAR=Slider(1.661, range=0..20),
    TowerFSRFAR=Slider(4.509, range=0..20),
    MinimumAreaSiteCrv=Slider(0, range=0..2000),
    MinimumAreaTowerCrv=Slider(92.158, range=0..2000))  # -> OffsetCurve, BaseFloorCurves, TowerFloorCurves, PolyFromSubDivOfCrvs, FinalBoundaryRepresentation; disabled
stagerred_mass = StagerredMassing(
    SiteCurve=crv_15,
    FloorHeightRequired=Slider(3.023, range=0..20),
    SetbackStepbacksForMassing="10,20,30,45",
    HeightsCorrespondingToStepbacks="10,20,30,45",
    MinArea=Slider(0, range=0..20000))  # -> OutputFloorCurves, OutputMassingBreps, OutputTextPanelTotalFSRGFAAchieved, DebugText; disabled
block = ExtrudeBlock(
    SiteCurve=crv_14,
    Setback=Slider(14.714, range=0..20),
    FsrFar=Slider(11.857, range=0..20),
    FLRHT=Slider(3.183, range=0..20),
    MinCrvArea=Slider(0, range=0..20000),
    HtArea1Flr=Slider(0, range=0..1))  # -> OutputExtrudedMass, FloorCurves; disabled
courtyard_mass = CourtyardMassing(
    SiteCurve=crv_16,
    FSRFAR=Slider(3.023, range=0..20),
    FloorHeight=Slider(6.223, range=0..20),
    Setback=Slider(20, range=0..20),
    BayDepth=Slider(20, range=0..20),
    MaxHtFloorArea=Slider(0, range=0..20000))  # -> OutputFloorCurves, OutputMassingBreps; disabled
geo = Geometry(ext_setbacks.OutputSolidGeometry)
panel_3 = Panel(ext_setbacks.OutputSITENumbers)
geo_2 = Geometry(stagerred_mass.OutputFloorCurves)
geo_3 = Geometry(stagerred_mass.OutputMassingBreps)
geo_4 = Geometry(block.OutputExtrudedMass)
geo_5 = Geometry(block.FloorCurves)
geo_6 = Geometry(courtyard_mass.OutputFloorCurves)
geo_7 = Geometry(courtyard_mass.OutputMassingBreps)
geo_8 = Geometry(staggered_courtyard_interp.BaseFloorCurves)
geo_9 = Geometry(staggered_courtyard_interp.PolyFromSubDivOfCrvs)
geo_10 = Geometry(staggered_courtyard_interp.TowerFloorCurves)
geo_11 = Geometry(staggered_courtyard_interp.OffsetCurve)
geo_12 = Geometry(staggered_courtyard_interp.FinalBoundaryRepresentation)
geo_13 = Geometry(staggered_courtyard_normal.FinalBoundaryRepresentation)
geo_14 = Geometry(staggered_courtyard_normal.TowerFloorCurves)
geo_15 = Geometry(staggered_courtyard_normal.PolyFromSubDivOfCrvs)
geo_16 = Geometry(staggered_courtyard_normal.BaseFloorCurves)
geo_17 = Geometry(staggered_courtyard_normal.OffsetCurve)
randomize = BooleanToggle(False)
path = FilePath("C:\nir_dev\MegaSavageLevel\DotsProjRh6\DotsProj\DotsProj\SourceCode\test_scripts\sample2.csv")  # disabled
cbsp = CbspIndependent(
    InputFilesCsv=path,
    RotationInDegrees=Slider(0, range=0..360),
    RatioLengthWidth=Slider(1.7, range=0.5..5),
    RandomizedGenerations=randomize,
    NumberOfOptimizationLoops=Slider(202, range=0..1000))  # -> OuterBoundary, BspOutputCurves, PartitionLines; disabled
crv_17 = Curve(cbsp.OuterBoundary)
crv_18 = Curve(cbsp.BspOutputCurves)
crv_19 = Curve(cbsp.PartitionLines)

circulation = GenerateCirculation(CirculationDepth=Slider(1.156, range=0..15))  # -> _0PartitionLines, _1CirculationPoly, _2ResultantCbspCrv
geo_18 = Geometry(circulation._2ResultantCbspCrv)
Z = UnitZ(Factor=Slider(4.186, range=0..10))
extr = Extrude(Base=geo_18, Direction=Z)
geo_19 = Geometry(circulation._1CirculationPoly)
Z_2 = UnitZ(Factor=Slider(12.515, range=0..100))
extr_2 = Extrude(Base=crv_18, Direction=Z_2)  # disabled
