# Grasshopper definition openCrvTest.gh (Grasshopper 1.0.7)
# plug-ins: DotsProj

geo = Geometry(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)
path = FilePath("C:\nir_dev\MegaSavageLevel\DotsProjRh6\DotsProj\DotsProj\SourceCode\test_scripts\dots_workflow\DOTS_workflow_test\inputs\sample1.csv")
path_2 = FilePath("C:\nir_dev\MegaSavageLevel\DotsProjRh6\DotsProj\DotsProj\SourceCode\test_scripts\dots_workflow\DOTS_workflow_test\inputs\sample1.csv")
geo_2 = Geometry(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)
oc_linear = OpenCurveLinear(InpFilePath=path, BayDepth=Slider(10.508, range=0..30), BaseCurve=geo, NumberIterations=Slider(100, range=0..100))  # -> DebugText, SpacesGeom, DistributedPts, SpacesCrvs
oc_double = OpenCurveDouble(
    InpFilePath=path_2,
    BayDepth=Slider(30, range=0..30),
    CorridorDepth=Slider(3.169, range=0..30),
    BaseCurve=geo_2,
    NumberOfIterations=Slider(100, range=0..100))  # -> DebugText, SpacesGeom, CellsPoly, SpacesCrvs
crv = Curve(oc_linear.SpacesGeom)
geo_3 = Geometry(oc_double.SpacesCrvs)
