# Grasshopper definition sample_workflow.gh (Grasshopper 1.0.7)
# plug-ins: DOTS

# ----
# CBSP INDEPENDENT
number_slider = Slider(0, range=0..360)
path = FilePath("C:\Users\saha_admin\Documents\MegaSavageLevel\Dots\DotsProj\DotsProj\SourceCode\test_scripts\dots_workflow\sample1.csv")
cbsp = CbspIndependent(
    InputFilesCsv=path,
    RotationInDegrees=number_slider,
    RatioLengthWidth=Slider(1, range=0..3),
    RandomizedGenerations=Toggle(False),
    NumberOfOptimizationLoops=Slider(21, range=0..50))  # -> OuterBoundary, BspOutputCurves, PartitionLines
crv = Curve(cbsp.BspOutputCurves)
crv_2 = Curve(cbsp.PartitionLines)
crv_3 = Curve(cbsp.OuterBoundary)

# ----
# SPACE PARTITION
number_slider_2 = Slider(10, range=0..360)
crv_4 = Curve(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)
timer = Timer(TimerInterval=200, Target=parcel_subdiv)  # disabled
parcel_subdiv = ParcelsBySubdivision(
    InputSite=crv_4,
    NumOfParcels=number_slider_2,
    DevMean01=Slider(0.187, range=0..1),
    AngleAlignmentDegrees0360=Slider(41, range=0..360),
    ShowThisIterations=Slider(10, range=0..10),
    ResetAllValues=Toggle(False),
    Generate=Toggle(True))  # -> LowestDeviationOfParcelSolution, StreetCenterLines, OutputParcelFromRequiredIteration, OutputStreetFromRequiredIteration, NumberOfResults
panel = Panel(parcel_subdiv.NumberOfResults)
crv_5 = Curve(parcel_subdiv.OutputStreetFromRequiredIteration)
crv_6 = Curve(parcel_subdiv.OutputParcelFromRequiredIteration)

crv_7 = Curve(crv)
crv_8 = Curve(crv_2)
circulation = GenerateCirculation(SiteCrvOuterBoundary=crv_3, CbspCrvs=crv_7, PartitionLines=crv_8, CirculationDepth=Slider(3.246, range=0..10))  # -> _0PartitionLines, _1CirculationPoly, _2ResultantCbspCrv
Z = UnitZ(Factor=Slider(1.296, range=0..10))
extr = Extrude(Base=circulation._1CirculationPoly, Direction=Z)

circulation_2 = GenerateCirculation(SiteCrvOuterBoundary=crv_4, CbspCrvs=crv_6, PartitionLines=crv_5, CirculationDepth=Slider(3.246, range=0..10))  # -> _0PartitionLines, _1CirculationPoly, _2ResultantCbspCrv
Z_2 = UnitZ(Factor=Slider(1.296, range=0..10))
extr_2 = Extrude(Base=circulation_2._1CirculationPoly, Direction=Z_2)

crv_9 = Curve(circulation._2ResultantCbspCrv)
block = MassingExtrudeBlock(
    SiteCurve=crv_9,
    Setback=Slider(3.174, range=0..10),
    FsrFar=Slider(3.246, range=0..10),
    FLRHT=Slider(3.246, range=0..10),
    MinCrvArea=Slider(3.246, range=0..10))  # -> OutputMassingBreps, OutputFloorCurves

crv_10 = Curve(circulation_2._2ResultantCbspCrv)
block_2 = MassingExtrudeBlock(
    SiteCurve=crv_10,
    Setback=Slider(3.174, range=0..10),
    FsrFar=Slider(3.246, range=0..10),
    FLRHT=Slider(3.246, range=0..10),
    MinCrvArea=Slider(3.246, range=0..10))  # -> OutputMassingBreps, OutputFloorCurves
