# Grasshopper definition urban_plan_gen.gh (Grasshopper 1.0.7)
# plug-ins: DotsProj

crv = Curve(<curve referenced from the Rhino model>)
crv_2 = Curve(<curve referenced from the Rhino model>)
parcel_int_poly = ParcelsFromInternalPoly(InputSiteCurve=crv, InternalPolyine=crv_2)  # -> OutputParcels, OutputStreets
crv_3 = Curve(<curve referenced from the Rhino model>)  # disabled
crv_4 = Curve(<curve referenced from the Rhino model>)  # disabled
crv_5 = Curve(<curve referenced from the Rhino model>)  # disabled
crv_6 = Curve([<curve referenced from the Rhino model> x351])  # disabled
timer = Timer(TimerInterval=1000)  # disabled
timer_2 = Timer(TimerInterval=50)  # disabled
parcel_subdiv = ParcelsBySubdivision(
    InputSite=crv_3,
    NumOfParcels=Slider(39, range=0..100),
    DevMean01=Slider(0.047, range=0..1),
    AngleAlignmentDegrees0360=Slider(144, range=0..360),
    ShowThisIterations=Slider(7, range=0..33),
    ResetAllValues=Toggle(True),
    Generate=Toggle(True))  # -> LowestDeviationOfParcelSolution, StreetCenterLines, OutputParcelFromRequiredIteration, OutputStreetFromRequiredIteration, NumberOfResults; disabled
parcel_subdiv_diff = ParcelsBySubdivisionWithSubtraction(
    InputSite=crv_4,
    InternalCrv=crv_5,
    NumOfParcels=Slider(20, range=0..20),
    DevMean01=Slider(0, range=0..1),
    AngleAlignmentDegrees0360=Slider(0, range=0..360),
    ShowThisIterations=Slider(1, range=0..20),
    ResetAllValues=Toggle(True),
    Generate=Toggle(True))  # -> LowestDeviationOfParcelSolution, StreetCenterLines, OutputParcelFromRequiredIteration, OutputStreetFromRequiredIteration, NumberOfResults; disabled
crv_7 = Curve(parcel_int_poly.OutputParcels)
crv_8 = Curve(parcel_int_poly.OutputStreets)
ext_setbacks = UrbanMassingFromSiteFsrSetbacksStreets(
    InputSiteCurves=crv_6,
    StreetLayerNames="streeta, streetb",
    CorrespondingStreetSetbacks="10.5, 15.0",
    InputFSR=Slider(4.09, range=0..15))  # -> OutputSolidGeometry, OutputSITENumbers; disabled
number_slider = Slider(0, range=0..20)
crv_9 = Curve(<curve referenced from the Rhino model>)
crv_10 = Curve(<curve referenced from the Rhino model>)
circulation = GenerateCirculation(SiteCrvOuterBoundary=crv, CbspCrvs=crv_7, PartitionLines=crv_8, CirculationDepth=Slider(4.972, range=0..10))  # -> _0PartitionLines, _1CirculationPoly, _2ResultantCbspCrv
number_slider_2 = Slider(0, range=0..20)
crv_11 = Curve([<curve referenced from the Rhino model> x2])  # disabled

crv_12 = Curve([<curve referenced from the Rhino model> x2])
peripheral_subdiv_parcel = PeripheralSubdivisionParcels(
    SiteCurve=crv_12,
    SetbackDimensionFromSite=Slider(1.561, range=0..20),
    BayDepthFromSetback=Slider(4.332, range=0..10),
    InnerCrv0ffsetFromBay=Slider(2.463, range=0..10),
    NumDiv=Slider(40, range=0..100))  # -> Setback, Bay, InnerCrv, ParcelCrv
crv_13 = Curve(peripheral_subdiv_parcel.Setback)
crv_14 = Curve(peripheral_subdiv_parcel.Bay)
crv_15 = Curve(peripheral_subdiv_parcel.InnerCrv)
crv_16 = Curve(peripheral_subdiv_parcel.ParcelCrv)

crv_17 = Curve(<curve referenced from the Rhino model>)  # disabled
peripheral_subdiv_parcel_2 = PeripheralSubdivisionParcels(
    SiteCurve=crv_17,
    SetbackDimensionFromSite=Slider(3, range=0..10),
    BayDepthFromSetback=Slider(47.407, range=0..50),
    InnerCrv0ffsetFromBay=Slider(1.573, range=0..10),
    NumDiv=Slider(15, range=0..100))  # -> Setback, Bay, InnerCrv, ParcelCrv; disabled
crv_18 = Curve(peripheral_subdiv_parcel_2.Setback)
crv_19 = Curve(peripheral_subdiv_parcel_2.Bay)
crv_20 = Curve(peripheral_subdiv_parcel_2.InnerCrv)
crv_21 = Curve(peripheral_subdiv_parcel_2.ParcelCrv)
crv_22 = Curve(crv_21)
courtyard_mass = CourtyardMassing(
    SiteCurve=crv_22,
    FSRFAR=Slider(2.198, range=0.5..3),
    FloorHeight=Slider(3, range=0..10),
    Setback=Slider(2.957, range=0..25),
    BayDepth=Slider(8, range=0..20),
    MaxHtFloorArea=Slider(0, range=0..20))  # -> OutputFloorCurves, OutputMassingBreps

crv_23 = Curve(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)  # disabled
parcel_int_poly_2 = ParcelsFromInternalPoly(InputSiteCurve=crv_10, InternalPolyine=crv_9)  # -> OutputParcels, OutputStreets
peripheral_subdiv_parcel_3 = PeripheralSubdivisionParcels(
    SiteCurve=crv_11,
    SetbackDimensionFromSite=Slider(9, range=0..20),
    BayDepthFromSetback=Slider(103, range=0..300),
    InnerCrv0ffsetFromBay=Slider(15, range=0..20),
    NumDiv=Slider(9, range=0..20))  # -> Setback, Bay, InnerCrv, ParcelCrv; disabled
crv_24 = Curve(parcel_subdiv.StreetCenterLines)
crv_25 = Curve(parcel_subdiv.OutputParcelFromRequiredIteration)
crv_26 = Curve(parcel_subdiv.LowestDeviationOfParcelSolution)
crv_27 = Curve(parcel_subdiv.OutputStreetFromRequiredIteration)
panel = Panel(parcel_subdiv.NumberOfResults)
crv_28 = Curve(parcel_subdiv_diff.LowestDeviationOfParcelSolution)
panel_2 = Panel(parcel_subdiv_diff.NumberOfResults)
crv_29 = Curve(parcel_subdiv_diff.StreetCenterLines)
crv_30 = Curve(parcel_subdiv_diff.OutputParcelFromRequiredIteration)
crv_31 = Curve(parcel_subdiv_diff.OutputStreetFromRequiredIteration)
geo = Geometry(ext_setbacks.OutputSolidGeometry)
panel_3 = Panel(ext_setbacks.OutputSITENumbers)
crv_32 = Curve(circulation._0PartitionLines)
crv_33 = Curve(circulation._2ResultantCbspCrv)
staggered_courtyard_normal = StaggeredCourtyardNormal(
    Site=crv_23,
    Setback=Slider(1.492, range=0..20),
    BaseDepthOffset=Slider(89, range=0..300),
    NumOfTowerFootprintsBaseCrvSubdiv=Slider(11, range=0..20),
    NumberOfTowers=Slider(10, range=0..20),
    FloorFloorHeight=Slider(9, range=0..10),
    BaseFSRFAR=Slider(1, range=0.5..3),
    TowerFSRFAR=Slider(6.029, range=0.5..10),
    MinimumAreaSiteCrv=number_slider,
    MinimumAreaTowerCrv=number_slider)  # -> OffsetCurve, BaseFloorCurves, TowerFloorCurves, PolyFromSubDivOfCrvs, FinalBoundaryRepresentation; disabled
block = ExtrudeBlock(
    SiteCurve=crv_33,
    Setback=Slider(1.416, range=0..20),
    FsrFar=Slider(1.811, range=0..20),
    FLRHT=Slider(3.819, range=0..20),
    MinCrvArea=Slider(106.409, range=0..200))  # -> OutputExtrudedMass, FloorCurves; disabled
staggered_courtyard_normal_2 = StaggeredCourtyardNormal(
    Site=parcel_int_poly_2.OutputParcels,
    Setback=Slider(1.492, range=0..20),
    BaseDepthOffset=Slider(75, range=0..100),
    NumOfTowerFootprintsBaseCrvSubdiv=Slider(15, range=0..20),
    NumberOfTowers=Slider(5, range=0..20),
    FloorFloorHeight=Slider(9, range=0..10),
    BaseFSRFAR=Slider(1, range=0.5..3),
    TowerFSRFAR=Slider(6.029, range=0.5..10),
    MinimumAreaSiteCrv=number_slider_2,
    MinimumAreaTowerCrv=number_slider_2)  # -> OffsetCurve, BaseFloorCurves, TowerFloorCurves, PolyFromSubDivOfCrvs, FinalBoundaryRepresentation
number_slider_3 = Slider(0, range=0..1)
crv_34 = Curve(peripheral_subdiv_parcel_3.ParcelCrv)
circulation_2 = GenerateCirculation(SiteCrvOuterBoundary=crv_4, CbspCrvs=crv_28, PartitionLines=crv_29, CirculationDepth=Slider(5.981, range=0..7))  # -> _0PartitionLines, _1CirculationPoly, _2ResultantCbspCrv; disabled
geo_2 = Geometry(block.FloorCurves)
geo_3 = Geometry(block.OutputExtrudedMass)
geo_4 = Geometry(staggered_courtyard_normal.FinalBoundaryRepresentation)
crv_35 = Curve(<curve referenced from the Rhino model>)
block_2 = ExtrudeBlock(
    SiteCurve=crv_34,
    Setback=Slider(15.316, range=0..20),
    FsrFar=Slider(20, range=0..20),
    FLRHT=Slider(5.827, range=0..20),
    MinCrvArea=Slider(0, range=0..20000))  # -> OutputExtrudedMass, FloorCurves; disabled
geo_5 = Geometry(staggered_courtyard_normal_2.FinalBoundaryRepresentation)
select = Select(Parcels=crv_35, CentralizeOrDisperse=Toggle(True), OpenSpaceRequirement=Slider(26.922, range=0..100))  # -> OutputBuildableParcels, OutputOpenSpaceParcels
crv_36 = Curve(circulation_2._0PartitionLines)
crv_37 = Curve(circulation_2._2ResultantCbspCrv)
geo_6 = Geometry(block_2.OutputExtrudedMass)
geo_7 = Geometry(block_2.FloorCurves)  # disabled
block_3 = ExtrudeBlock(
    SiteCurve=crv_37,
    Setback=Slider(0.765, range=0..20),
    FsrFar=Slider(20, range=0..20),
    FLRHT=Slider(0.715, range=0..20),
    MinCrvArea=Slider(100, range=0..100))  # -> OutputExtrudedMass, FloorCurves

number_slider_4 = Slider(0, range=0..1)
crv_38 = Curve(crv_16)  # disabled
block_4 = ExtrudeBlock(
    SiteCurve=crv_38,
    Setback=Slider(1.156, range=0..20),
    FsrFar=Slider(7.892, range=0..20),
    FLRHT=Slider(0.608, range=0..20),
    MinCrvArea=Slider(0, range=0..20000))  # -> OutputExtrudedMass, FloorCurves; disabled
geo_8 = Geometry(block_4.OutputExtrudedMass)
geo_9 = Geometry(block_4.FloorCurves)

crv_39 = Curve(select.OutputBuildableParcels)
crv_40 = Curve(select.OutputOpenSpaceParcels)
geo_10 = Geometry(block_3.FloorCurves)
geo_11 = Geometry(block_3.OutputExtrudedMass)

crv_41 = Curve(<curve referenced from the Rhino model>)  # disabled
peripheral_subdiv_parcel_4 = PeripheralSubdivisionParcels(
    SiteCurve=crv_41,
    SetbackDimensionFromSite=Slider(3, range=0..10),
    BayDepthFromSetback=Slider(47.407, range=0..50),
    InnerCrv0ffsetFromBay=Slider(1.573, range=0..10),
    NumDiv=Slider(15, range=0..100))  # -> Setback, Bay, InnerCrv, ParcelCrv; disabled
number_slider_5 = Slider(0, range=0..20)
crv_42 = Curve(peripheral_subdiv_parcel_4.Setback)
crv_43 = Curve(peripheral_subdiv_parcel_4.Bay)
crv_44 = Curve(peripheral_subdiv_parcel_4.InnerCrv)
crv_45 = Curve(peripheral_subdiv_parcel_4.ParcelCrv)
number_slider_6 = Slider(20, range=0..20)
number_slider_7 = Slider(4, range=0..20)
number_slider_8 = Slider(2.198, range=0.5..3)
number_slider_9 = Slider(9.613, range=0..25)
number_slider_10 = Slider(3, range=0..10)
number_slider_11 = Slider(0.149, range=0..10)
number_slider_12 = Slider(0.726, range=0..5)
crv_46 = Curve(crv_45)
staggered_courtyard_normal_3 = StaggeredCourtyardNormal(
    Site=crv_46,
    Setback=number_slider_12,
    BaseDepthOffset=number_slider_9,
    NumOfTowerFootprintsBaseCrvSubdiv=number_slider_6,
    NumberOfTowers=number_slider_7,
    FloorFloorHeight=number_slider_10,
    BaseFSRFAR=number_slider_8,
    TowerFSRFAR=number_slider_11,
    MinimumAreaSiteCrv=number_slider_5,
    MinimumAreaTowerCrv=number_slider_5)  # -> OffsetCurve, BaseFloorCurves, TowerFloorCurves, PolyFromSubDivOfCrvs, FinalBoundaryRepresentation; disabled
staggered_courtyard_interp = StaggeredCourtyardInterpolated(
    Site=crv_46,
    Setback=number_slider_12,
    BaseDepthOffset=number_slider_9,
    BaseDepthOffset_2=number_slider_6,
    NumberOfTowers=number_slider_7,
    FloorFloorHeight=number_slider_10,
    BaseFSRFAR=number_slider_8,
    TowerFSRFAR=number_slider_11,
    MinimumAreaSiteCrv=number_slider_5,
    MinimumAreaTowerCrv=number_slider_5)  # -> OffsetCurve, BaseFloorCurves, TowerFloorCurves, PolyFromSubDivOfCrvs, FinalBoundaryRepresentation; disabled
geo_12 = Geometry(staggered_courtyard_normal_3.FinalBoundaryRepresentation)
geo_13 = Geometry(staggered_courtyard_interp.FinalBoundaryRepresentation)
