# Grasshopper definition new_bsptest.gh (Grasshopper 1.0.7)
# plug-ins: DotsProj

path = FilePath("C:\nir_dev\MegaSavageLevel\DotsProjRh6\DotsProj\DotsProj\SourceCode\TEST_SCRIPTS\dots_workflow\coreInputs\GeomSample.csv")
path_2 = FilePath("C:\nir_dev\MegaSavageLevel\DotsProjRh6\DotsProj\DotsProj\SourceCode\TEST_SCRIPTS\dots_workflow\coreInputs\AdjSample.csv")
crv = Curve(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)
bsp_solver = BSPSolver(
    InputADJACENCYFilePath=path_2,
    InputGEOMETRYFilePath=path,
    Site=crv,
    Sensitivity=Slider(25, range=3..100),
    RotationInDegrees=Slider(57, range=0..360),
    NumberOfIterations=Slider(21, range=0..100),
    ClearAllValues=Toggle(False))  # -> DebugStr, Curves, CrvNames, Pts
crv_2 = Curve(bsp_solver.Curves)
panel = Panel(bsp_solver.CrvNames)
addtextdot = GhPythonScript(x=crv_2, y=panel)  # -> out, a; inputs x: list of Curve, y: list; disabled
# ---------- addtextdot: Python ----------
__author__ = "Nirvik Saha"
__version__ = "2020.01.20"

import rhinoscriptsyntax as rs
import Rhino
import scriptcontext
import math

scriptcontext.doc=Rhino.RhinoDoc.ActiveDoc
k=0;
li=[]
for i in x:
    p=rs.CurveAreaCentroid(i)[0]
    ar=rs.CurveArea(i)[0]
    ar2=math.floor(ar)
    s= str(k)+y[k]+"-"+str(ar2)
    t=rs.AddTextDot(s,p)
    li.append(t)
    k+=1
    
scriptcontext.doc=ghdoc

a=t
# ---------- end addtextdot ----------
path_3 = FilePath("C:\nir_dev\MegaSavageLevel\DotsProjRh6\DotsProj\DotsProj\SourceCode\TEST_SCRIPTS\dots_workflow\coreInputs\colors2.csv")
color_input_parser = ColorInput(InpFilePath=path_3, ListSpaceKeysNames=panel, ListSpaceCrvs=crv_2)  # -> BrepFromCrvs, ColorStr
panel_2 = Panel(bsp_solver.DebugStr)
preview = CustomPreview(Geometry=color_input_parser.BrepFromCrvs, Material=color_input_parser.ColorStr)
