# Grasshopper definition adjSolver.gh (Grasshopper 1.0.7)
# plug-ins: DotsProj

number_slider = Slider(10.003, range=0..25)
number_slider_2 = Slider(62.312, range=0..125)
number_slider_3 = Slider(21.628, range=0..25)
# boundary space allocation
crv = Curve(<curve referenced from the Rhino model>)
space_allocation_file_path = FilePath("C:\nir_dev\MegaSavageLevel\DotsProjRh6\DotsProj\DotsProj\SourceCode\TEST_SCRIPTS\dots_workflow\inputs\sample3.csv")
# boundary space allocation
crv_2 = Curve(<curve referenced from the Rhino model>)
space_allocation_file_path_2 = FilePath("C:\nir_dev\MegaSavageLevel\DotsProjRh6\DotsProj\DotsProj\SourceCode\TEST_SCRIPTS\dots_workflow\inputs\sample1.csv")
crv_boundary = CrvBoundary(
    InpFilePath=space_allocation_file_path,
    InpSiteCurve=crv,
    FromSiteOuterCirculationDepth=number_slider_3,
    FromOuterCirculationBayDepth=number_slider_2,
    FromBayDepthInnerCirculationDepth=number_slider,
    SensitivityX100=Slider(15.964, range=0..25),
    OptimizationItrs=Slider(0, range=0..25))  # -> OuterOffsetCrv, InnerOffsetCrv, RESULTSegGeom, CrvNamesColor; disabled
crv_boundary_2 = CrvBoundary(
    InpFilePath=space_allocation_file_path_2,
    InpSiteCurve=crv_2,
    FromSiteOuterCirculationDepth=Slider(8.186, range=0..25),
    FromOuterCirculationBayDepth=Slider(62.312, range=0..125),
    FromBayDepthInnerCirculationDepth=Slider(5, range=0..25),
    SensitivityX100=Slider(15.964, range=0..25),
    OptimizationItrs=Slider(0, range=0..25))  # -> OuterOffsetCrv, InnerOffsetCrv, RESULTSegGeom, CrvNamesColor
path = FilePath("C:\nir_dev\MegaSavageLevel\DotsProjRh6\DotsProj\DotsProj\SourceCode\TEST_SCRIPTS\dots_workflow\inputs\gridSA.csv")
crv_3 = Curve(crv_boundary.OuterOffsetCrv)
crv_4 = Curve(crv_boundary.InnerOffsetCrv)
crv_5 = Curve(crv_boundary.RESULTSegGeom)
crv_6 = Curve(crv_boundary_2.OuterOffsetCrv)
crv_7 = Curve(crv_boundary_2.InnerOffsetCrv)
crv_8 = Curve(crv_boundary_2.RESULTSegGeom)
grid_solver = GridAllocationSolver(
    InpFilePath=path,
    SiteCurve=crv_7,
    NumberXAxis=Slider(4, range=0..7),
    NumberYAxis=Slider(2, range=0..7),
    CirculationDepth=Slider(2, range=0..7),
    NumberOfIterations=Slider(1, range=0..7),
    MinimumAreaOfCurve=Slider(665.747, range=0..1500))  # -> CrvNamesColor, ListOfFsr, Curve
adjacency_file_path = FilePath("C:\nir_dev\MegaSavageLevel\DotsProjRh6\DotsProj\DotsProj\SourceCode\TEST_SCRIPTS\dots_workflow\coreInputs\AdjSample.csv")
geometry_specification_filepath = FilePath("C:\nir_dev\MegaSavageLevel\DotsProjRh6\DotsProj\DotsProj\SourceCode\TEST_SCRIPTS\dots_workflow\coreInputs\GeomSample.csv")
adj_solver = AdjSolver(
    InputAdjacencyFilePath=adjacency_file_path,
    ExistingCrvList=crv_5,
    CorrespondingNameList=crv_boundary.CrvNamesColor,
    NumberOfIterations=Slider(20, range=0..50),
    ClearPreviousValues=Toggle(True))  # -> OutputCurves, OutputNames, MsgNumItrs
crv_9 = Curve(crv)
color_file_path = FilePath("C:\nir_dev\MegaSavageLevel\DotsProjRh6\DotsProj\DotsProj\SourceCode\TEST_SCRIPTS\dots_workflow\coreInputs\colors2.csv")
python = GhPythonScript(x=crv_8, y=grid_solver.Curve)  # -> out, a; inputs x: list, y: list
# ---------- python: Python ----------
__author__ = "Nirvik Saha"
__version__ = "2020.01.17"

import rhinoscriptsyntax as rs

li=[]

for i in x:
    li.append(i)

for i in y:
    li.append(i)

a=li
# ---------- end python ----------
python_2 = GhPythonScript(x=crv_boundary_2.CrvNamesColor, y=grid_solver.CrvNamesColor)  # -> out, a; inputs x: list, y: list; same code as python
geom_solver_p = GeometrySolverPeripheral(
    InputGeometryFilePath=geometry_specification_filepath,
    InputSiteCurve=crv_9,
    CorrespondingNameList=adj_solver.OutputNames,
    FromSiteCurveOuterCirculationDepth=number_slider_3,
    FromOuterCirculationBayDepth=number_slider_2,
    FromBayDepthInnerCirculationDepth=number_slider,
    Sensitivity=Slider(500, range=0..1000))  # -> OutputCurves, OutputNames, DebugStr, DebugOuter, DebugInner; disabled
panel = Panel(adj_solver.OutputNames)
color_input_parser = ColorInput(InpFilePath=color_file_path, ListSpaceKeysNames=adj_solver.OutputNames, ListSpaceCrvs=adj_solver.OutputCurves)  # -> BrepFromCrvs, ColorStr
panel_2 = Panel(python_2.a)
crv_10 = Curve(python.a)
crv_11 = Curve(geom_solver_p.OutputCurves)
crv_12 = Curve(geom_solver_p.DebugOuter)
crv_13 = Curve(geom_solver_p.DebugInner)
preview = CustomPreview(Geometry=color_input_parser.BrepFromCrvs, Material=color_input_parser.ColorStr)
panel_3 = Panel(geom_solver_p.DebugStr)
adjacency_file_path_2 = FilePath("C:\nir_dev\MegaSavageLevel\DotsProjRh6\DotsProj\DotsProj\SourceCode\TEST_SCRIPTS\dots_workflow\coreInputs\AdjSample.csv")
Z = UnitZ(Factor=Slider(8, range=0..150))
color_input_parser_2 = ColorInput(InpFilePath=color_file_path, ListSpaceKeysNames=geom_solver_p.OutputNames, ListSpaceCrvs=crv_11)  # -> BrepFromCrvs, ColorStr
Z_2 = UnitZ(Factor=Slider(8, range=0..150))
timer = Timer(TimerInterval=5000)  # disabled
extr = Extrude(Base=adj_solver.OutputCurves, Direction=Z)
adj_solver_2 = AdjSolver(
    InputAdjacencyFilePath=adjacency_file_path_2,
    ExistingCrvList=crv_10,
    CorrespondingNameList=panel_2,
    NumberOfIterations=Slider(20, range=0..50),
    ClearPreviousValues=Toggle(True),
    RandomizeAdjRels=Toggle(True),
    RunSolver=Toggle(True))  # -> OutputCurves, OutputNames, MsgNumItrs
extr_2 = Extrude(Base=crv_11, Direction=Z_2)
color_file_path_2 = FilePath("C:\nir_dev\MegaSavageLevel\DotsProjRh6\DotsProj\DotsProj\SourceCode\TEST_SCRIPTS\dots_workflow\coreInputs\colors2.csv")
preview_2 = CustomPreview(Geometry=color_input_parser_2.BrepFromCrvs, Material=color_input_parser_2.ColorStr)
preview_3 = CustomPreview(Geometry=extr, Material=ColourSwatch(SwatchColor=RGB(0, 0, 0)))
preview_4 = CustomPreview(Geometry=extr_2, Material=ColourSwatch(SwatchColor=RGB(0, 0, 0)))
panel_4 = Panel(adj_solver_2.MsgNumItrs)
color_input_parser_3 = ColorInput(InpFilePath=color_file_path_2, ListSpaceKeysNames=adj_solver_2.OutputNames, ListSpaceCrvs=adj_solver_2.OutputCurves)  # -> BrepFromCrvs, ColorStr
preview_5 = CustomPreview(Geometry=color_input_parser_3.BrepFromCrvs, Material=color_input_parser_3.ColorStr)
Z_3 = UnitZ(Factor=Slider(2, range=0..15))
extr_3 = Extrude(Direction=Z_3)
preview_6 = CustomPreview(Geometry=extr_3, Material=ColourSwatch(SwatchColor=RGB(0, 0, 0)))
