# Grasshopper definition flr_plan_gen.gh (Grasshopper 1.0.7)
# plug-ins: DotsProj

path = FilePath("C:\nir_dev\MegaSavageLevel\DotsProjRh6\DotsProj\DotsProj\SourceCode\TEST_SCRIPTS\dots_workflow\inputs\sample1.csv")
crv = Curve(<curve referenced from the Rhino model>)
crv_skeleton = CrvSkeleton(
    InpFilePath=path,
    InpSiteCurve=crv,
    FromSiteOuterCirculationDepth=Slider(9, range=0..20),
    FromOuterCirculationBayDepth=Slider(40, range=0..75),
    FromBayDepthInnerCirculationDepth=Slider(7, range=0..20),
    SensitivityX100=Slider(5, range=0..5),
    OptimizationItrs=Slider(500, range=0..500))  # -> OuterOffsetCrv, InnerOffsetCrv, RESULTSegGeom, CrvNamesColor; disabled
geo = Geometry(crv_skeleton.OuterOffsetCrv)
geo_2 = Geometry(crv_skeleton.InnerOffsetCrv)
geo_3 = Geometry(crv_skeleton.RESULTSegGeom)
randomize = BooleanToggle(False)
path_2 = FilePath("C:\nir_dev\MegaSavageLevel\DotsProjRh6\DotsProj\DotsProj\SourceCode\TEST_SCRIPTS\dots_workflow\inputs\sample1.csv")
cbsp_site = CbspSite(
    InputFilePath=path_2,
    InputSiteCrv=geo_2,
    RotationInDegrees=Slider(0, range=0..360),
    RandomizedGenerations=randomize,
    NumberOfOptimizationLoops=Slider(100, range=1..100))  # -> SpatialCrv, CirculationLines, CrvNamesColor
path_3 = FilePath("C:\nir_dev\MegaSavageLevel\DotsProjRh6\DotsProj\DotsProj\SourceCode\TEST_SCRIPTS\dots_workflow\inputs\colors.csv")
color_input = ColorInput(InpFilePath=path_3, ListSpaceKeys=crv_skeleton.CrvNamesColor, ListSpaceCrvs=geo_3)  # -> BrepFromCrvs, ColorStr
geo_4 = Geometry(cbsp_site.CirculationLines)
geo_5 = Geometry(cbsp_site.SpatialCrv)
custom_preview = CustomPreview(Geometry=color_input.BrepFromCrvs, Material=color_input.ColorStr)
circulation = GenerateCirculation(SiteCrvOuterBoundary=geo_2, CbspCrvs=geo_5, PartitionLines=geo_4, CirculationDepth=Slider(5.069, range=0..10))  # -> _0PartitionLines, _1CirculationPoly, _2ResultantCbspCrv
geo_6 = Geometry(circulation._0PartitionLines)
geo_7 = Geometry(circulation._2ResultantCbspCrv)
path_4 = FilePath("C:\nir_dev\MegaSavageLevel\DotsProjRh6\DotsProj\DotsProj\SourceCode\TEST_SCRIPTS\dots_workflow\inputs\colors.csv")
color_input_2 = ColorInput(InpFilePath=path_4, ListSpaceKeys=cbsp_site.CrvNamesColor, ListSpaceCrvs=geo_7)  # -> BrepFromCrvs, ColorStr
panel = Panel(cbsp_site.CrvNamesColor)
panel_2 = Panel(color_input_2.ColorStr)
custom_preview_2 = CustomPreview(Geometry=color_input_2.BrepFromCrvs, Material=color_input_2.ColorStr)

randomize_2 = BooleanToggle(False)
path_5 = FilePath("C:\nir_dev\MegaSavageLevel\DotsProjRh6\DotsProj\DotsProj\SourceCode\TEST_SCRIPTS\dots_workflow\inputs\sample1.csv")
geo_8 = Geometry(<curve referenced from the Rhino model>)
cbsp_site_2 = CbspSite(
    InputFilePath=path_5,
    InputSiteCrv=geo_8,
    RotationInDegrees=Slider(0, range=0..360),
    RandomizedGenerations=randomize_2,
    NumberOfOptimizationLoops=Slider(94, range=1..100))  # -> SpatialCrv, CirculationLines, CrvNamesColor; disabled
panel_3 = Panel(cbsp_site_2.CrvNamesColor)
geo_9 = Geometry(cbsp_site_2.SpatialCrv)
geo_10 = Geometry(cbsp_site_2.CirculationLines)
circulation_2 = GenerateCirculation(SiteCrvOuterBoundary=geo_8, CbspCrvs=geo_9, PartitionLines=geo_10, CirculationDepth=Slider(19.328, range=0..25))  # -> _0PartitionLines, _1CirculationPoly, _2ResultantCbspCrv; disabled
path_6 = FilePath("C:\nir_dev\MegaSavageLevel\DotsProjRh6\DotsProj\DotsProj\SourceCode\TEST_SCRIPTS\dots_workflow\inputs\colors.csv")
geo_11 = Geometry(circulation_2._2ResultantCbspCrv)
color_input_3 = ColorInput(InpFilePath=path_6, ListSpaceKeys=cbsp_site_2.CrvNamesColor, ListSpaceCrvs=geo_11)  # -> BrepFromCrvs, ColorStr; disabled
geo_12 = Geometry(circulation_2._0PartitionLines)
custom_preview_3 = CustomPreview(Geometry=color_input_3.BrepFromCrvs, Material=color_input_3.ColorStr)

path_7 = FilePath("C:\nir_dev\MegaSavageLevel\DotsProjRh6\DotsProj\DotsProj\SourceCode\TEST_SCRIPTS\dots_workflow\inputs\sample1.csv")
cbsp = CbspIndependent(
    InputFilesCsv=path_7,
    RotationInDegrees=Slider(0, range=0..360),
    RatioLengthWidth=Slider(0.659, range=0..2),
    RandomizedGenerations=Toggle(False),
    NumberOfOptimizationLoops=Slider(360, range=0..360))  # -> OuterBoundary, BspOutputCurves, PartitionLines, CrvNamesColor; disabled
geo_13 = Geometry(cbsp.OuterBoundary)
geo_14 = Geometry(cbsp.BspOutputCurves)
geo_15 = Geometry(cbsp.PartitionLines)
path_8 = FilePath("C:\nir_dev\MegaSavageLevel\DotsProjRh6\DotsProj\DotsProj\SourceCode\TEST_SCRIPTS\dots_workflow\inputs\colors.csv")
circulation_3 = GenerateCirculation(SiteCrvOuterBoundary=geo_13, CbspCrvs=geo_14, PartitionLines=geo_15, CirculationDepth=Slider(2, range=0..2))  # -> _0PartitionLines, _1CirculationPoly, _2ResultantCbspCrv; disabled
geo_16 = Geometry(circulation_3._2ResultantCbspCrv)
color_input_4 = ColorInput(InpFilePath=path_8, ListSpaceKeys=cbsp.CrvNamesColor, ListSpaceCrvs=geo_16)  # -> BrepFromCrvs, ColorStr; disabled
geo_17 = Geometry(circulation_3._0PartitionLines)
geo_18 = Geometry(circulation_3._1CirculationPoly)
custom_preview_4 = CustomPreview(Geometry=color_input_4.BrepFromCrvs, Material=color_input_4.ColorStr)
Z = UnitZ(Factor=Slider(1.504, range=0..20))
extr = Extrude(Direction=Z)

pt = Point(Point(162.2521564, 9.998312688, 0))  # disabled
path_9 = FilePath("C:\nir_dev\MegaSavageLevel\DotsProjRh6\DotsProj\DotsProj\SourceCode\TEST_SCRIPTS\dots_workflow\DOTS_workflow_test\inputs\sample1.csv")
emcmc = EMcMC(
    InpFilePath=path_9,
    InitialPoint=pt,
    SensitivityNumIterations=Slider(7, range=0..10),
    Rotation=Slider(84.49, range=0..360))  # -> CrvNamesColor, SpatialCrvs; disabled
path_10 = FilePath("C:\nir_dev\MegaSavageLevel\DotsProjRh6\DotsProj\DotsProj\SourceCode\TEST_SCRIPTS\dots_workflow\DOTS_workflow_test\inputs\colors.csv")
color_input_5 = ColorInput(InpFilePath=path_10, ListSpaceKeys=emcmc.CrvNamesColor, ListSpaceCrvs=emcmc.SpatialCrvs)  # -> BrepFromCrvs, ColorStr
sel_sides = SelectSidesFromPolyline(OffsetIndexStart=Slider(0, range=0..10), NumOfSides=Slider(3, range=0..10))
Z_2 = UnitZ(Factor=Slider(3, range=0..10))
crv_2 = Curve(sel_sides)
custom_preview_5 = CustomPreview(Geometry=color_input_5.BrepFromCrvs, Material=color_input_5.ColorStr)
extr_2 = Extrude(Direction=Z_2)

path_11 = FilePath("C:\nir_dev\MegaSavageLevel\DotsProjRh6\DotsProj\DotsProj\SourceCode\TEST_SCRIPTS\dots_workflow\inputs\sample1.csv")
crv_3 = Curve(<curve referenced from the Rhino model>)
crv_skeleton_2 = CrvSkeleton(
    InpFilePath=path_11,
    InpSiteCurve=crv_3,
    FromSiteOuterCirculationDepth=Slider(3, range=0..20),
    FromOuterCirculationBayDepth=Slider(20, range=0..75),
    FromBayDepthInnerCirculationDepth=Slider(5, range=0..20),
    SensitivityX100=Slider(5, range=0..5),
    OptimizationItrs=Slider(500, range=0..500))  # -> OuterOffsetCrv, InnerOffsetCrv, RESULTSegGeom, CrvNamesColor; disabled
geo_19 = Geometry(crv_skeleton_2.OuterOffsetCrv)
geo_20 = Geometry(crv_skeleton_2.InnerOffsetCrv)
geo_21 = Geometry(crv_skeleton_2.RESULTSegGeom)
randomize_3 = BooleanToggle(False)
path_12 = FilePath("C:\nir_dev\MegaSavageLevel\DotsProjRh6\DotsProj\DotsProj\SourceCode\TEST_SCRIPTS\dots_workflow\inputs\sample2.csv")
path_13 = FilePath("C:\nir_dev\MegaSavageLevel\DotsProjRh6\DotsProj\DotsProj\SourceCode\TEST_SCRIPTS\rush\inputsToDots\rushIntermediateZoneInput.csv")
crv_4 = Curve(geo_20)
radial_zone_core = RadialZoneCore(
    InputFilePath=path_13,
    InputSiteCrv=crv_4,
    CoreArea=Slider(10000, range=0..10000),
    MoveCoreHorizontal=Slider(0, range=0..100),
    MoveCoreVertical=Slider(0, range=0..100),
    CoreAspectRatio=Slider(0.869, range=0..1),
    RotationInDegrees=Slider(0, range=0..360))  # -> CoreCrv, ZoneCrvsRad, CrvNamesColor
crv_5 = Curve(radial_zone_core.CoreCrv)
cbsp_site_3 = CbspSite(
    InputFilePath=path_12,
    InputSiteCrv=crv_5,
    RotationInDegrees=Slider(0, range=0..360),
    RandomizedGenerations=randomize_3,
    NumberOfOptimizationLoops=Slider(94, range=1..100))  # -> SpatialCrv, CirculationLines, CrvNamesColor
panel_4 = Panel(cbsp_site_3.CrvNamesColor)
geo_22 = Geometry(cbsp_site_3.CirculationLines)
geo_23 = Geometry(cbsp_site_3.SpatialCrv)
circulation_4 = GenerateCirculation(SiteCrvOuterBoundary=crv_5, CbspCrvs=geo_23, PartitionLines=geo_22, CirculationDepth=Slider(1.569, range=0..25))  # -> _0PartitionLines, _1CirculationPoly, _2ResultantCbspCrv
path_14 = FilePath("C:\nir_dev\MegaSavageLevel\DotsProjRh6\DotsProj\DotsProj\SourceCode\TEST_SCRIPTS\dots_workflow\inputs\colors.csv")
path_15 = FilePath("C:\nir_dev\MegaSavageLevel\DotsProjRh6\DotsProj\DotsProj\SourceCode\TEST_SCRIPTS\dots_workflow\inputs\colors.csv")
geo_24 = Geometry(circulation_4._2ResultantCbspCrv)
color_input_6 = ColorInput(InpFilePath=path_14, ListSpaceKeys=cbsp_site_3.CrvNamesColor, ListSpaceCrvs=geo_24)  # -> BrepFromCrvs, ColorStr
geo_25 = Geometry(circulation_4._0PartitionLines)
color_input_7 = ColorInput(InpFilePath=path_15, ListSpaceKeys=crv_skeleton_2.CrvNamesColor, ListSpaceCrvs=geo_21)  # -> BrepFromCrvs, ColorStr
custom_preview_6 = CustomPreview(Geometry=color_input_7.BrepFromCrvs, Material=color_input_7.ColorStr)
list_item = ListItem(List=radial_zone_core.ZoneCrvsRad, Index=Slider(2, range=0..4), Wrap=True)
list_item_2 = ListItem(List=radial_zone_core.ZoneCrvsRad, Index=Slider(3, range=0..4), Wrap=True)
list_item_3 = ListItem(List=radial_zone_core.ZoneCrvsRad, Index=Slider(0, range=0..4), Wrap=True)
list_item_4 = ListItem(List=radial_zone_core.ZoneCrvsRad, Index=Slider(1, range=0..4), Wrap=True)
randomize_4 = BooleanToggle(False)
randomize_5 = BooleanToggle(False)
path_16 = FilePath("C:\nir_dev\MegaSavageLevel\DotsProjRh6\DotsProj\DotsProj\SourceCode\TEST_SCRIPTS\dots_workflow\inputs\sample2.csv")
path_17 = FilePath("C:\nir_dev\MegaSavageLevel\DotsProjRh6\DotsProj\DotsProj\SourceCode\TEST_SCRIPTS\dots_workflow\inputs\sample3.csv")
randomize_6 = BooleanToggle(False)
randomize_7 = BooleanToggle(False)
path_18 = FilePath("C:\nir_dev\MegaSavageLevel\DotsProjRh6\DotsProj\DotsProj\SourceCode\TEST_SCRIPTS\dots_workflow\inputs\sample2.csv")
cbsp_site_4 = CbspSite(
    InputFilePath=path_16,
    InputSiteCrv=list_item,
    RotationInDegrees=Slider(0, range=0..360),
    RandomizedGenerations=randomize_4,
    NumberOfOptimizationLoops=Slider(1, range=1..100))  # -> SpatialCrv, CirculationLines, CrvNamesColor
path_19 = FilePath("C:\nir_dev\MegaSavageLevel\DotsProjRh6\DotsProj\DotsProj\SourceCode\TEST_SCRIPTS\dots_workflow\inputs\sample2.csv")
cbsp_site_5 = CbspSite(
    InputFilePath=path_17,
    InputSiteCrv=list_item_2,
    RotationInDegrees=Slider(0, range=0..360),
    RandomizedGenerations=randomize_5,
    NumberOfOptimizationLoops=Slider(1, range=1..100))  # -> SpatialCrv, CirculationLines, CrvNamesColor
cbsp_site_6 = CbspSite(
    InputFilePath=path_18,
    InputSiteCrv=list_item_4,
    RotationInDegrees=Slider(0, range=0..360),
    RandomizedGenerations=randomize_6,
    NumberOfOptimizationLoops=Slider(1, range=1..100))  # -> SpatialCrv, CirculationLines, CrvNamesColor
cbsp_site_7 = CbspSite(
    InputFilePath=path_19,
    InputSiteCrv=list_item_3,
    RotationInDegrees=Slider(0, range=0..360),
    RandomizedGenerations=randomize_7,
    NumberOfOptimizationLoops=Slider(1, range=1..100))  # -> SpatialCrv, CirculationLines, CrvNamesColor
path_20 = FilePath("C:\nir_dev\MegaSavageLevel\DotsProjRh6\DotsProj\DotsProj\SourceCode\TEST_SCRIPTS\dots_workflow\inputs\colors.csv")
geo_26 = Geometry(cbsp_site_4.CirculationLines)
geo_27 = Geometry(cbsp_site_4.SpatialCrv)
geo_28 = Geometry(cbsp_site_5.CirculationLines)
geo_29 = Geometry(cbsp_site_5.SpatialCrv)
circulation_5 = GenerateCirculation(SiteCrvOuterBoundary=list_item, CbspCrvs=geo_27, PartitionLines=geo_26, CirculationDepth=Slider(4.453, range=0..25))  # -> _0PartitionLines, _1CirculationPoly, _2ResultantCbspCrv
geo_30 = Geometry(cbsp_site_6.CirculationLines)
geo_31 = Geometry(cbsp_site_6.SpatialCrv)
geo_32 = Geometry(cbsp_site_7.SpatialCrv)
geo_33 = Geometry(cbsp_site_7.CirculationLines)
circulation_6 = GenerateCirculation(SiteCrvOuterBoundary=list_item_2, CbspCrvs=geo_29, PartitionLines=geo_28, CirculationDepth=Slider(4.453, range=0..25))  # -> _0PartitionLines, _1CirculationPoly, _2ResultantCbspCrv
panel_5 = Panel(cbsp_site_4.CrvNamesColor)
panel_6 = Panel(cbsp_site_5.CrvNamesColor)
circulation_7 = GenerateCirculation(SiteCrvOuterBoundary=list_item_4, CbspCrvs=geo_31, PartitionLines=geo_30, CirculationDepth=Slider(4.453, range=0..25))  # -> _0PartitionLines, _1CirculationPoly, _2ResultantCbspCrv
circulation_8 = GenerateCirculation(SiteCrvOuterBoundary=list_item_3, CbspCrvs=geo_32, PartitionLines=geo_33, CirculationDepth=Slider(1.087, range=0..25))  # -> _0PartitionLines, _1CirculationPoly, _2ResultantCbspCrv
panel_7 = Panel(cbsp_site_6.CrvNamesColor)
panel_8 = Panel(cbsp_site_7.CrvNamesColor)
path_21 = FilePath("C:\nir_dev\MegaSavageLevel\DotsProjRh6\DotsProj\DotsProj\SourceCode\TEST_SCRIPTS\dots_workflow\inputs\colors.csv")
geo_34 = Geometry(circulation_5._2ResultantCbspCrv)
geo_35 = Geometry(circulation_5._0PartitionLines)
geo_36 = Geometry(circulation_6._2ResultantCbspCrv)
geo_37 = Geometry(circulation_6._0PartitionLines)
path_22 = FilePath("C:\nir_dev\MegaSavageLevel\DotsProjRh6\DotsProj\DotsProj\SourceCode\TEST_SCRIPTS\dots_workflow\inputs\colors.csv")
path_23 = FilePath("C:\nir_dev\MegaSavageLevel\DotsProjRh6\DotsProj\DotsProj\SourceCode\TEST_SCRIPTS\dots_workflow\inputs\colors.csv")
color_input_8 = ColorInput(InpFilePath=path_20, ListSpaceKeys=cbsp_site_4.CrvNamesColor, ListSpaceCrvs=geo_34)  # -> BrepFromCrvs, ColorStr
color_input_9 = ColorInput(InpFilePath=path_21, ListSpaceKeys=cbsp_site_5.CrvNamesColor, ListSpaceCrvs=geo_36)  # -> BrepFromCrvs, ColorStr
geo_38 = Geometry(circulation_7._2ResultantCbspCrv)
geo_39 = Geometry(circulation_7._0PartitionLines)
geo_40 = Geometry(circulation_8._2ResultantCbspCrv)
geo_41 = Geometry(circulation_8._0PartitionLines)
color_input_10 = ColorInput(InpFilePath=path_22, ListSpaceKeys=cbsp_site_6.CrvNamesColor, ListSpaceCrvs=geo_38)  # -> BrepFromCrvs, ColorStr
color_input_11 = ColorInput(InpFilePath=path_23, ListSpaceKeys=cbsp_site_7.CrvNamesColor, ListSpaceCrvs=geo_40)  # -> BrepFromCrvs, ColorStr
custom_preview_7 = CustomPreview(Geometry=color_input_8.BrepFromCrvs, Material=color_input_8.ColorStr)
custom_preview_8 = CustomPreview(Geometry=color_input_9.BrepFromCrvs, Material=color_input_9.ColorStr)
custom_preview_9 = CustomPreview(Geometry=color_input_10.BrepFromCrvs, Material=color_input_10.ColorStr)
custom_preview_10 = CustomPreview(Geometry=color_input_11.BrepFromCrvs, Material=color_input_11.ColorStr)

custom_preview_11 = CustomPreview(Geometry=color_input_6.BrepFromCrvs, Material=color_input_6.ColorStr)
