# Grasshopper definition masing.gh (Grasshopper 1.0.7)
# plug-ins: DotsProj

crv = Curve(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)
crv_2 = Curve(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)
crv_3 = Curve(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)
crv_4 = Curve(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)
crv_5 = Curve(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)
block = MassingExtrudeBlock(
    SiteCurve=crv,
    Setback=Slider(13.04, range=0..255),
    FsrFar=Slider(3.888, range=0..25),
    FLRHT=Slider(2.442, range=0..25),
    MinCrvArea=Slider(5, range=0..5),
    NameOptional="a")  # -> OutputMassingBreps, OutputFloorCurves, Name
staggered_courtyard_normal = StaggeredCourtyardNormal(
    Site=crv_3,
    Setback=Slider(1.822, range=0..10),
    BaseDepthOffset=Slider(17.23, range=0..150),
    NumOfTowerFootprintsBaseCrvSubdiv=Slider(5, range=0..25),
    NumberOfTowers=Slider(2, range=0..10),
    FloorFloorHeight=Slider(2.203, range=0..10),
    BaseFSRFAR=Slider(2.396, range=0..10),
    TowerFSRFAR=Slider(1.84, range=0..10),
    MinimumAreaSiteCrv=Slider(0, range=0..5),
    MinimumAreaTowerCrv=Slider(0.053, range=0..5),
    NameOptional="a")  # -> OffsetCurve, BaseFloorCurves, TowerFloorCurves, PolyFromSubDivOfCrvs, FinalBoundaryRepresentation, FsrVals, Name
courtyard_mass = CourtyardMassing(
    SiteCurve=crv_2,
    FSRFAR=Slider(2.537, range=0..10),
    FloorHeight=Slider(3.17, range=0..25),
    Setback=Slider(1.335, range=0..25),
    BayDepth=Slider(22.155, range=0..100),
    MinFloorArea=Slider(0, range=0..5),
    NameOptional="a")  # -> OutputFloorCurves, OutputMassingBreps, ExcludedCrv, Name
staggered_mass = StaggeredMassing(
    SiteCurve=crv_4,
    FloorHeightRequired=Slider(5, range=0..10),
    SetbackStepbacksForMassing="10.0,15,17.5,21",
    HeightsCorrespondingToStepbacks="15, 20, 25, 30",
    MinArea=Slider(4.592, range=0..10),
    NameOptional="a")  # -> OutputFloorCurves, OutputMassingBreps, OutputTextPanelTotalFSRGFAAchieved, NumberOfFloors, ExcludedCrv, Name
staggered_courtyard_interp = StaggeredCourtyardInterpolated(
    Site=crv_5,
    Setback=Slider(2.832, range=0..10),
    BaseDepthOffset=Slider(10.097, range=0..100),
    NumOfTowerFootprintsBaseCrvSubdiv=Slider(6.09, range=0..10),
    NumberOfTowers=Slider(3, range=0..10),
    FloorFloorHeight=Slider(3, range=0..10),
    BaseFSRFAR=Slider(1.561, range=0..10),
    TowerFSRFAR=Slider(1.63, range=0..10),
    MinimumAreaSiteCrv=Slider(2.718, range=0..5),
    MinimumAreaTowerCrv=Slider(4.49, range=0..5),
    NameOptional="a")  # -> OffsetCurve, BaseFloorCurves, TowerFloorCurves, PolyFromSubDivOfCrvs, FinalBoundaryRepresentation, Name
crv_6 = Curve(courtyard_mass.OutputFloorCurves)
geo = Geometry(courtyard_mass.OutputMassingBreps)
panel = Panel(staggered_mass.OutputTextPanelTotalFSRGFAAchieved)
panel_2 = Panel(staggered_mass.NumberOfFloors)
geo_2 = Geometry(staggered_mass.OutputFloorCurves)
geo_3 = Geometry(block.OutputMassingBreps)
panel_3 = Panel(block.Name)
geo_4 = Geometry(staggered_mass.OutputMassingBreps)
crv_7 = Curve(block.OutputFloorCurves)
panel_4 = Panel(staggered_mass.Name)
panel_5 = Panel(courtyard_mass.Name)
crv_8 = Curve(staggered_courtyard_normal.OffsetCurve)
crv_9 = Curve(staggered_courtyard_normal.BaseFloorCurves)
crv_10 = Curve(staggered_courtyard_normal.TowerFloorCurves)
crv_11 = Curve(staggered_courtyard_normal.PolyFromSubDivOfCrvs)
panel_6 = Panel(staggered_courtyard_normal.Name)
geo_5 = Geometry(staggered_courtyard_normal.FinalBoundaryRepresentation)
geo_6 = Geometry(staggered_courtyard_interp.FinalBoundaryRepresentation)
crv_12 = Curve(staggered_courtyard_interp.BaseFloorCurves)
crv_13 = Curve(staggered_courtyard_interp.OffsetCurve)
crv_14 = Curve(staggered_courtyard_interp.PolyFromSubDivOfCrvs)
crv_15 = Curve(staggered_courtyard_interp.TowerFloorCurves)
panel_7 = Panel(staggered_courtyard_interp.Name)
crv_16 = Curve(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)
staggered_courtyard_normal_2 = StaggeredCourtyardNormal(
    Site=crv_16,
    Setback=Slider(1.822, range=0..10),
    BaseDepthOffset=Slider(17.23, range=0..150),
    NumOfTowerFootprintsBaseCrvSubdiv=Slider(25, range=0..25),
    NumberOfTowers=Slider(8, range=0..10),
    FloorFloorHeight=Slider(2.203, range=0..10),
    BaseFSRFAR=Slider(2.396, range=0..10),
    TowerFSRFAR=Slider(1.84, range=0..10),
    MinimumAreaSiteCrv=Slider(0, range=0..5),
    MinimumAreaTowerCrv=Slider(0.053, range=0..5),
    NameOptional="a")  # -> OffsetCurve, BaseFloorCurves, TowerFloorCurves, PolyFromSubDivOfCrvs, FinalBoundaryRepresentation, FsrVals, Name
crv_17 = Curve(staggered_courtyard_normal_2.OffsetCurve)
panel_8 = Panel(staggered_courtyard_normal_2.Name)
crv_18 = Curve(staggered_courtyard_normal_2.BaseFloorCurves)
crv_19 = Curve(staggered_courtyard_normal_2.TowerFloorCurves)
crv_20 = Curve(staggered_courtyard_normal_2.PolyFromSubDivOfCrvs)
geo_7 = Geometry(staggered_courtyard_normal_2.FinalBoundaryRepresentation)
