# Grasshopper definition networks.gh (Grasshopper 1.0.7)
# plug-ins: DotsProj

crv = Curve(<curve referenced from the Rhino model>)  # disabled
crv_2 = Curve([<curve referenced from the Rhino model> x15])  # disabled
crv_3 = Curve([<curve referenced from the Rhino model> x2])
c_script = CSharpScript(CRV=crv, CRVLI=crv_2)  # -> out, A, L, B; inputs CRV: Curve, CRVLI: list of Curve; disabled
# ---------- c_script: C# ----------
    List<Point3d> ptLi = new List<Point3d>();
    List<LineCurve> lineLi = new List<LineCurve>();
    List<Brep> brepLi = new List<Brep>();
    double tol = Rhino.RhinoDoc.ActiveDoc.ModelAbsoluteTolerance;
    for(int i = 0; i < CRVLI.Count; i++){
      Curve crv = CRVLI[i];
      Point3d p = AreaMassProperties.Compute(CRVLI[i]).Centroid;
      double t = double.NaN;
      bool t0 = CRV.ClosestPoint(p, out t);
      Point3d q = CRV.PointAt(t);
      ptLi.Add(q);
      double d = p.DistanceTo(q);
      LineCurve l = new LineCurve(p, q);
      lineLi.Add(l);
      Curve crv2 = crv.DuplicateCurve();
      List<Curve> crvLi = new List<Curve>{crv, crv2};
      Transform xform = Rhino.Geometry.Transform.Translation(0, 0, d);
      crv2.Transform(xform);
      Brep brep = Rhino.Geometry.Brep.CreateFromLoft(crvLi, Point3d.Unset, Point3d.Unset, LoftType.Straight, false)[0];
      brepLi.Add(brep);
    }
    A = ptLi;
    L = lineLi;
    B = brepLi;
# ---------- end c_script ----------
c_script_2 = CSharpScript(x=crv_3, ht=Slider(100, range=0..100))  # -> out, A; inputs x: Curve, ht: Double; disabled
# ---------- c_script_2: C# ----------
    Curve crv = x.DuplicateCurve();
    Curve crv2 = x.DuplicateCurve();
    
    Point3d p = AreaMassProperties.Compute(crv).Centroid;
    Point3d q = new Point3d(p.X, p.Y, p.Z + ht);
    Vector3d v = new Vector3d(0, 0, ht);
    
    List<Curve> crvLi = new List<Curve>();
    crvLi.Add(crv);
    crvLi.Add(crv2);
    
    Transform xform = Transform.Translation(v);
    crv2.Transform(xform);
    Brep b=Brep.CreateFromLoft(crvLi, Point3d.Unset, Point3d.Unset, LoftType.Tight, false)[0];
    Brep c = b.CapPlanarHoles(0.01);
    A = c;
# ---------- end c_script_2 ----------
brep = Brep(c_script_2.A)

geo = Geometry()
number_slider = Slider(0, range=0..150)
block = MassingExtrudeBlock(SiteCurve=geo, Setback=Slider(0.607, range=0..5), FLRHT=Slider(4.715, range=0..5), MinCrvArea=Slider(0, range=0..150))  # -> OutputMassingBreps, OutputFloorCurves, Name; disabled
staggered_courtyard_interp = StaggeredCourtyardInterpolated(
    Site=geo,
    Setback=Slider(0.607, range=0..5),
    BaseDepthOffset=Slider(2.299, range=0..5),
    NumOfTowerFootprintsBaseCrvSubdiv=Slider(5, range=0..5),
    NumberOfTowers=Slider(2, range=0..5),
    FloorFloorHeight=Slider(1.015, range=0..5),
    MinimumAreaSiteCrv=number_slider,
    MinimumAreaTowerCrv=number_slider)  # -> OffsetCurve, BaseFloorCurves, TowerFloorCurves, PolyFromSubDivOfCrvs, FinalBoundaryRepresentation, Name; disabled
courtyard_mass = CourtyardMassing(
    SiteCurve=geo,
    FloorHeight=Slider(0.607, range=0..5),
    Setback=Slider(0.607, range=0..5),
    BayDepth=Slider(1.015, range=0..5),
    MinFloorArea=Slider(0, range=0..150))  # -> OutputFloorCurves, OutputMassingBreps, ExcludedCrv, Name; disabled
staggered_mass = StaggeredMassing(
    SiteCurve=geo,
    SetbackStepbacksForMassing="0.5,0.7",
    HeightsCorrespondingToStepbacks="1,3",
    MinArea=Slider(0, range=0..150))  # -> OutputFloorCurves, OutputMassingBreps, OutputTextPanelTotalFSRGFAAchieved, NumberOfFloors, ExcludedCrv, Dots_comp; disabled
geo_2 = Geometry(block.OutputMassingBreps)

geo_3 = Geometry(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)
geo_4 = Geometry([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])
number_slider_2 = Slider(0, range=0..5)
site_partition_circulation = SitePartitionCirculation(
    SiteCurve=geo_3,
    CirculationCurve=geo_4,
    CirculationDepth=Slider(1.695, range=0..5),
    MinimumAreaPartition=Slider(4.311, range=0..100))  # -> DebugText, CirculationCurves, PartitionCurves; disabled
geo_5 = Geometry(site_partition_circulation.PartitionCurves)
geo_6 = Geometry(site_partition_circulation.CirculationCurves)
staggered_courtyard_normal = StaggeredCourtyardNormal(
    Site=geo_5,
    Setback=Slider(3.226, range=0..5),
    BaseDepthOffset=Slider(5, range=0..5),
    NumOfTowerFootprintsBaseCrvSubdiv=Slider(5, range=0..25),
    NumberOfTowers=Slider(2, range=0..5),
    FloorFloorHeight=Slider(2.877, range=0..5),
    BaseFSRFAR=Slider(1.42, range=0..5),
    TowerFSRFAR=Slider(2.205, range=0..5),
    MinimumAreaSiteCrv=number_slider_2,
    MinimumAreaTowerCrv=number_slider_2)  # -> OffsetCurve, BaseFloorCurves, TowerFloorCurves, PolyFromSubDivOfCrvs, FinalBoundaryRepresentation, FsrVals, Name; disabled
number_slider_3 = Slider(0, range=0..5)
staggered_courtyard_interp_2 = StaggeredCourtyardInterpolated(
    Site=geo_5,
    Setback=Slider(1.882, range=0..5),
    BaseDepthOffset=Slider(5, range=0..5),
    NumOfTowerFootprintsBaseCrvSubdiv=Slider(16, range=0..25),
    NumberOfTowers=Slider(3, range=0..5),
    FloorFloorHeight=Slider(2.808, range=0..5),
    BaseFSRFAR=Slider(0.372, range=0..5),
    TowerFSRFAR=Slider(3.88, range=0..5),
    MinimumAreaSiteCrv=number_slider_3,
    MinimumAreaTowerCrv=number_slider_3)  # -> OffsetCurve, BaseFloorCurves, TowerFloorCurves, PolyFromSubDivOfCrvs, FinalBoundaryRepresentation, Name; disabled
staggered_mass_2 = StaggeredMassing(
    SiteCurve=geo_5,
    FloorHeightRequired=Slider(5, range=0..5),
    SetbackStepbacksForMassing="2,4",
    HeightsCorrespondingToStepbacks="13,15",
    MinArea=Slider(4.406, range=0..5))  # -> OutputFloorCurves, OutputMassingBreps, OutputTextPanelTotalFSRGFAAchieved, NumberOfFloors, ExcludedCrv, Dots_comp; disabled
block_2 = MassingExtrudeBlock(
    SiteCurve=geo_5,
    Setback=Slider(13.998, range=0..25),
    FsrFar=Slider(3.264, range=0..5),
    FLRHT=Slider(3.182, range=0..5),
    MinCrvArea=Slider(45.709, range=0..100))  # -> OutputMassingBreps, OutputFloorCurves, Name
courtyard_mass_2 = CourtyardMassing(
    SiteCurve=geo_5,
    FSRFAR=Slider(1.063, range=0..5),
    FloorHeight=Slider(5, range=0..5),
    Setback=Slider(0.319, range=0..5),
    BayDepth=Slider(3.575, range=0..5),
    MinFloorArea=Slider(1, range=0..1))  # -> OutputFloorCurves, OutputMassingBreps, ExcludedCrv, Name; disabled
geo_7 = Geometry(block_2.OutputMassingBreps)
geo_8 = Geometry(block_2.OutputFloorCurves)
preview = CustomPreview(Geometry=geo_7, Material="0,255,125")

crv_4 = Curve(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)
pt = Point([Point(17.29777822, -180.1240034, 0), Point(87.24063131, 148.5659664, 0), Point(-208.447629, -14.6232026, 0)])
grid_gen = SpaceGenerator(
    InputCurve=crv_4,
    OriginPoints=pt,
    SegmentLength=Slider(17, range=0..35),
    IterationNumber=Slider(50000, range=0..50000),
    RndAngleRadians=Slider(0, range=0..6.28))  # -> DebugText, SpaceCurves; disabled
Z = UnitZ(Factor=Slider(37.681, range=0..100))
cir = Circle(Plane=pt, Radius=Slider(35, range=0..35))
brep_2 = Brep(cir)
crv_5 = Curve(grid_gen.SpaceCurves)
gen_2_parcels = Generator2Parcels(
    SpaceCurveSegements=crv_5,
    Setback=Slider(0.758, range=0..6.28),
    BayDepth=Slider(4.041, range=0..6.28),
    GenerateIndividualParcels=Toggle(True),
    ParcelWidth=Slider(6.183, range=0..20))  # -> DebugText, CirculationPath, ParcelCurves, ParcelRegion, DebugCrv; disabled
extr = Extrude(Base=crv_5, Direction=Z)
geo_9 = Geometry(gen_2_parcels.DebugCrv)  # disabled
crv_6 = Curve(gen_2_parcels.ParcelCurves)
crv_7 = Curve(gen_2_parcels.ParcelRegion)
crv_8 = Curve(gen_2_parcels.CirculationPath)
brep_3 = Brep(crv_6)
brep_4 = Brep(crv_8)
crv_9 = Curve([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])
hts_crv = GenHtsFromCrv(
    InputParcelList=crv_6,
    InputCrvList=crv_9,
    MultiplierCoefficient=Slider(49.84, range=0..100),
    OPT0Constant1HighIfClose2LowIfClose=Slider(2, range=0..2),
    MinHtOfAllMasses=Slider(5.938, range=0..100),
    MaxHtOfAllMasses=Slider(66.986, range=0..100))  # -> DebugTxt, MinHt, MaxHt, HtLi, BaseBreps, MassBreps; disabled
hts_pts = GenHtsFromPts(
    InputParcelList=crv_6,
    InputPointList=pt,
    MultiplierCoefficient=Slider(1.972, range=0..5),
    OPT0Constant1HighIfClose2LowIfClose=Slider(1, range=0..2),
    MinHtOfAllMasses=Slider(5.938, range=0..100),
    MaxHtOfAllMasses=Slider(100, range=0..100))  # -> DebugTxt, MinHt, MaxHt, HtLi, BaseBreps, MassBreps; disabled
panel = Panel(hts_crv.HtLi)
gradient = Gradient(
    LowerLimit=hts_crv.MaxHt,
    UpperLimit=hts_crv.MinHt,
    Parameter=hts_crv.HtLi,
    stops=[0: RGB(243, 57, 0), 0.1: RGB(236, 27, 60), 0.2: RGB(210, 0, 118), 0.3: RGB(103, 0, 120), 0.4: RGB(39, 72, 161), 0.5: RGB(1, 192, 229), 0.6: RGB(18, 178, 90), 0.7: RGB(79, 186, 8), 0.8: RGB(220, 237, 32), 0.9: RGB(247, 159, 20), 1: RGB(243, 57, 0)])
gradient_2 = Gradient(
    LowerLimit=hts_pts.MinHt,
    UpperLimit=hts_pts.MaxHt,
    Parameter=hts_pts.HtLi,
    stops=[0: RGB(243, 57, 0), 0.1: RGB(236, 27, 60), 0.2: RGB(210, 0, 118), 0.3: RGB(103, 0, 120), 0.4: RGB(39, 72, 161), 0.5: RGB(1, 192, 229), 0.6: RGB(18, 178, 90), 0.7: RGB(79, 186, 8), 0.8: RGB(220, 237, 32), 0.9: RGB(247, 159, 20), 1: RGB(243, 57, 0)])
preview_2 = CustomPreview(Geometry=hts_crv.MassBreps, Material=gradient)
preview_3 = CustomPreview(Geometry=hts_pts.BaseBreps, Material=gradient_2)
