# Grasshopper definition networks2.gh (Grasshopper 1.0.7)
# plug-ins: DotsProj

crv = Curve(<curve referenced from the Rhino model>)
path = FilePath("C:\nir_dev\MegaSavageLevel\DotsProjRh6\DotsProj\DotsProj\SourceCode\TEST_SCRIPTS\dots_workflow\inputs\gridSA.csv")
grid_solver = GridAllocationSolver(
    InpFilePath=path,
    SiteCurve=crv,
    NumberXAxis=Slider(7, range=0..10),
    NumberYAxis=Slider(7, range=0..10),
    CirculationDepth=Slider(0.428, range=0..2),
    NumberOfIterations=Slider(16, range=0..400),
    MinimumAreaOfCurve=Slider(0, range=0..2))  # -> CrvNamesColor, ListOfFsr, Curve
path_2 = FilePath("C:\nir_dev\MegaSavageLevel\DotsProjRh6\DotsProj\DotsProj\SourceCode\TEST_SCRIPTS\dots_workflow\inputs\colors.csv")
color_input_parser = ColorInput(InpFilePath=path_2, ListSpaceKeysNames=grid_solver.CrvNamesColor, ListSpaceCrvs=grid_solver.Curve)  # -> BrepFromCrvs, ColorStr
preview = CustomPreview(Geometry=color_input_parser.BrepFromCrvs, Material=color_input_parser.ColorStr)
