# Grasshopper definition new_bsptest.gh (Grasshopper 1.0.7)
# plug-ins: DotsProj

path = FilePath("C:\nir_dev\MegaSavageLevel\DotsProjRh6\DotsProj\DotsProj\SourceCode\TEST_SCRIPTS\dots_workflow\coreInputs\GeomSample.csv")
path_2 = FilePath("C:\nir_dev\MegaSavageLevel\DotsProjRh6\DotsProj\DotsProj\SourceCode\TEST_SCRIPTS\dots_workflow\coreInputs\GeomSample.csv")  # disabled
path_3 = FilePath("C:\nir_dev\MegaSavageLevel\DotsProjRh6\DotsProj\DotsProj\SourceCode\TEST_SCRIPTS\dots_workflow\coreInputs\AdjSample.csv")  # disabled
crv = Curve(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)  # disabled
path_4 = FilePath("C:\nir_dev\MegaSavageLevel\DotsProjRh6\DotsProj\DotsProj\SourceCode\TEST_SCRIPTS\dots_workflow\coreInputs\GeomSample.csv")
crv_2 = Curve(<curve referenced from the Rhino model>)
timer = Timer(TimerInterval=5000)  # disabled
gen_spaces_p = GenerateEqualPeripheralSpaces(
    InputGeometryFilePath=path_4,
    InputSiteCurve=crv_2,
    FromSiteCurveOuterCirculationDepth=Slider(3, range=3..100),
    FromOuterCirculationBayDepth=Slider(18, range=3..20),
    FromBayDepthInnerCirculationDepth=Slider(5, range=3..8))  # -> OutputCurves, OutputNames, DebugStr, OuterBayCrv, InnerBayCrv, InnerCirculationCrv
bsp_solver = BSPSolver(
    InputADJACENCYFilePath=path_3,
    InputGEOMETRYFilePath=path_2,
    Site=crv,
    Sensitivity=Slider(3, range=3..100),
    RotationInDegrees=Slider(145, range=0..360),
    NumberOfIterations=Slider(15, range=0..100),
    ClearAllValues=Toggle(False),
    RandomizeAdjRels=Toggle(False),
    RunSolver=Toggle(True))  # -> DebugStr, Curves, CrvNames, PartitionLines; disabled
path_5 = FilePath("C:\nir_dev\MegaSavageLevel\DotsProjRh6\DotsProj\DotsProj\SourceCode\TEST_SCRIPTS\dots_workflow\coreInputs\GeomSample.csv")
path_6 = FilePath("C:\nir_dev\MegaSavageLevel\DotsProjRh6\DotsProj\DotsProj\SourceCode\TEST_SCRIPTS\dots_workflow\coreInputs\GeomSample.csv")
crv_3 = Curve(<curve referenced from the Rhino model>)
panel = Panel(bsp_solver.CrvNames)
crv_4 = Curve(bsp_solver.PartitionLines)
path_7 = FilePath("C:\nir_dev\MegaSavageLevel\DotsProjRh6\DotsProj\DotsProj\SourceCode\TEST_SCRIPTS\dots_workflow\coreInputs\AdjSample.csv")
crv_5 = Curve(gen_spaces_p.OutputCurves)
adj_solver = AdjSolver(
    InputAdjacencyFilePath=path_7,
    ExistingCrvList=gen_spaces_p.OutputCurves,
    CorrespondingNameList=gen_spaces_p.OutputNames,
    NumberOfIterations=Slider(18, range=3..20),
    ClearPreviousValues=Toggle(False),
    RandomizeAdjRels=Toggle(False),
    RunSolver=Toggle(True))  # -> OutputCurves, OutputNames, MsgNumItrs
geom_solver_p = GeometrySolverPeripheral(
    InputGeometryFilePath=path_6,
    InputSiteCurve=crv_3,
    CorrespondingNameList=adj_solver.OutputNames,
    FromSiteCurveOuterCirculationDepth=Slider(3, range=3..100),
    FromOuterCirculationBayDepth=Slider(18, range=3..20),
    FromBayDepthInnerCirculationDepth=Slider(5, range=3..8),
    Sensitivity=Slider(1231, range=3..1231))  # -> OutputCurves, OutputNames, DebugStr, DebugOuter, DebugInner
path_8 = FilePath("C:\nir_dev\MegaSavageLevel\DotsProjRh6\DotsProj\DotsProj\SourceCode\TEST_SCRIPTS\dots_workflow\coreInputs\colors2.csv")
path_9 = FilePath("C:\nir_dev\MegaSavageLevel\DotsProjRh6\DotsProj\DotsProj\SourceCode\TEST_SCRIPTS\dots_workflow\coreInputs\colors2.csv")
Z = UnitZ(Factor=Slider(1.162, range=0..2))
panel_2 = Panel(adj_solver.OutputNames)
color_input_parser = ColorInput(InpFilePath=path_8, ListSpaceKeysNames=bsp_solver.CrvNames, ListSpaceCrvs=bsp_solver.Curves)  # -> BrepFromCrvs, ColorStr
color_input_parser_2 = ColorInput(InpFilePath=path_9, ListSpaceKeysNames=gen_spaces_p.OutputNames, ListSpaceCrvs=crv_5)  # -> BrepFromCrvs, ColorStr
extr = Extrude(Base=crv_5, Direction=Z)  # disabled
crv_6 = Curve(geom_solver_p.OutputCurves)
preview = CustomPreview(Geometry=extr, Material=ColourSwatch(SwatchColor=RGB(0, 0, 0)))  # disabled
path_10 = FilePath("C:\nir_dev\MegaSavageLevel\DotsProjRh6\DotsProj\DotsProj\SourceCode\TEST_SCRIPTS\dots_workflow\coreInputs\colors2.csv")
preview_2 = CustomPreview(Geometry=color_input_parser.BrepFromCrvs, Material=color_input_parser.ColorStr)
preview_3 = CustomPreview(Geometry=color_input_parser_2.BrepFromCrvs, Material=color_input_parser_2.ColorStr)  # disabled
Z_2 = UnitZ(Factor=Slider(1.162, range=0..2))
color_input_parser_3 = ColorInput(InpFilePath=path_10, ListSpaceKeysNames=geom_solver_p.OutputNames, ListSpaceCrvs=crv_6)  # -> BrepFromCrvs, ColorStr
extr_2 = Extrude(Base=crv_6, Direction=Z_2)
preview_4 = CustomPreview(Geometry=extr_2, Material=ColourSwatch(SwatchColor=RGB(0, 0, 0)))
preview_5 = CustomPreview(Geometry=color_input_parser_3.BrepFromCrvs, Material=color_input_parser_3.ColorStr)
