# Grasshopper definition openCrvTest.gh (Grasshopper 1.0.7)
# plug-ins: DotsProj

geo = Geometry([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])
geo_2 = Geometry([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])
sel_crv_seg = SelectPartialCurve(
    InputCrv=geo,
    TotalNumberOfParts=Slider(10, range=0..10),
    StartingPoint=Slider(0, range=0..10),
    NumParts=Slider(6, range=0..10))  # disabled
sel_sides = SelectSidesFromPolyline(InputPolyline=geo_2, OffsetIndexStart=Slider(0, range=0..10), NumOfSides=Slider(4, range=0..10))  # disabled
Z = UnitZ(Factor=Slider(4, range=0..10))
geo_3 = Geometry(sel_sides)
geo_4 = Geometry(sel_crv_seg)

crv = Curve(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)
sel_sides_2 = SelectSidesFromPolyline(InputPolyline=crv, OffsetIndexStart=Slider(0, range=0..100), NumOfSides=Slider(3, range=0..4))
crv_2 = Curve(sel_sides_2)

extr = Extrude(Base=geo_3, Direction=Z)

path = FilePath("C:\nir_dev\MegaSavageLevel\DotsProjRh6\DotsProj\DotsProj\SourceCode\TEST_SCRIPTS\dots_workflow\DOTS_workflow_test\inputs\sample1.csv")
geo_5 = Geometry(<curve referenced from the Rhino model>)
open_curve_double = OpenCurveDouble(
    InpFilePath=path,
    BayDepth=Slider(35, range=0..35),
    CorridorDepth=Slider(14.316, range=0..30),
    BaseCurve=geo_5,
    NumberOfIterations=Slider(400, range=0..400))  # -> CrvNamesColor, SpacesGeom, CellsPoly, SpacesCrvs; disabled
path_2 = FilePath("C:\nir_dev\MegaSavageLevel\DotsProjRh6\DotsProj\DotsProj\SourceCode\TEST_SCRIPTS\dots_workflow\DOTS_workflow_test\inputs\colors.csv")
color_input = ColorInput(InpFilePath=path_2, ListSpaceKeys=open_curve_double.CrvNamesColor, ListSpaceCrvs=open_curve_double.SpacesCrvs)  # -> BrepFromCrvs, ColorStr
custom_preview = CustomPreview(Geometry=color_input.BrepFromCrvs, Material=color_input.ColorStr)

geo_6 = Geometry(crv_2)
path_3 = FilePath("C:\nir_dev\MegaSavageLevel\DotsProjRh6\DotsProj\DotsProj\SourceCode\TEST_SCRIPTS\dots_workflow\inputs\sample1.csv")
open_curve_linear = OpenCurveLinear(
    InpFilePath=path_3,
    BayDepth=Slider(41.21, range=0..50),
    BaseCurve=geo_6,
    NumberIterations=Slider(2, range=0..100),
    CenterSide1Side2=Slider(1, range=0..2),
    Sensitivity_AreaX100=Slider(2.413, range=0..10))  # -> CrvNamesColor, SpacesGeom
crv_3 = Curve(open_curve_linear.SpacesGeom)
path_4 = FilePath("C:\nir_dev\MegaSavageLevel\DotsProjRh6\DotsProj\DotsProj\SourceCode\TEST_SCRIPTS\dots_workflow\inputs\colors.csv")
color_input_2 = ColorInput(InpFilePath=path_4, ListSpaceKeys=open_curve_linear.CrvNamesColor, ListSpaceCrvs=crv_3)  # -> BrepFromCrvs, ColorStr
custom_preview_2 = CustomPreview(Geometry=color_input_2.BrepFromCrvs, Material=color_input_2.ColorStr)

panel = Panel(path)
