# Grasshopper definition sample_workflow.gh (Grasshopper 1.0.7)
# plug-ins: DotsProj

path = FilePath("C:\nir_dev\MegaSavageLevel\DotsProjRh6\DotsProj\DotsProj\bin\DOTS_workflow_test\inputs\sample2.csv")
crv = Curve(<curve referenced from the Rhino model>)

# ----
# CBSP INDEPENDENT
number_slider = Slider(0, range=0..360)
path_2 = FilePath("C:\nir_dev\MegaSavageLevel\DotsProjRh6\DotsProj\DotsProj\SourceCode\test_scripts\dots_workflow\inputs\sample2.csv")  # disabled
cbsp = CbspIndependent(
    InputFilesCsv=path_2,
    RotationInDegrees=number_slider,
    RatioLengthWidth=Slider(1, range=0..3),
    RandomizedGenerations=Toggle(False),
    NumberOfOptimizationLoops=Slider(21, range=0..50))  # -> OuterBoundary, BspOutputCurves, PartitionLines; disabled
crv_2 = Curve(cbsp.BspOutputCurves)
crv_3 = Curve(cbsp.PartitionLines)
crv_4 = Curve(cbsp.OuterBoundary)

curve_skeleton = CrvSkeleton(
    InpFilePath=path,
    InpSiteCurve=crv,
    FromSiteOuterCirculationDepth=Slider(12, range=0..20),
    FromOuterCirculationBayDepth=Slider(50, range=0..50),
    FromBayDepthInnerCirculationDepth=Slider(9, range=0..20),
    SensitivityX100=Slider(5, range=0..5),
    OptimizationItrs=Slider(445, range=0..500))  # -> OuterOffsetCrv, InnerOffsetCrv, RESULTSegGeom; disabled

# ----
# SPACE PARTITION
number_slider_2 = Slider(14, range=0..50)
crv_5 = Curve(<curve referenced from the Rhino model>)
timer = Timer(TimerInterval=200, Target=parcel_subdiv)  # disabled
parcel_subdiv = ParcelsBySubdivision(
    InputSite=crv_5,
    NumOfParcels=number_slider_2,
    DevMean01=Slider(0.045, range=0..1),
    AngleAlignmentDegrees0360=Slider(0, range=0..360),
    ShowThisIterations=Slider(1, range=0..10),
    ResetAllValues=Toggle(True),
    Generate=Toggle(True))  # -> LowestDeviationOfParcelSolution, StreetCenterLines, OutputParcelFromRequiredIteration, OutputStreetFromRequiredIteration, NumberOfResults; disabled
panel = Panel(parcel_subdiv.NumberOfResults)
crv_6 = Curve(parcel_subdiv.StreetCenterLines)
crv_7 = Curve(parcel_subdiv.LowestDeviationOfParcelSolution)

geo = Geometry(curve_skeleton.OuterOffsetCrv)
geo_2 = Geometry(curve_skeleton.InnerOffsetCrv)
geo_3 = Geometry(curve_skeleton.RESULTSegGeom)
randomize = BooleanToggle(False)

crv_8 = Curve(crv_2)
crv_9 = Curve(crv_3)
circulation = GenerateCirculation(SiteCrvOuterBoundary=crv_4, CbspCrvs=crv_8, PartitionLines=crv_9, CirculationDepth=Slider(3.246, range=0..10))  # -> _0PartitionLines, _1CirculationPoly, _2ResultantCbspCrv
Z = UnitZ(Factor=Slider(1.296, range=0..10))
extr = Extrude(Base=circulation._1CirculationPoly, Direction=Z)

path_3 = FilePath("C:\nir_dev\MegaSavageLevel\DotsProjRh6\DotsProj\DotsProj\bin\DOTS_workflow_test\inputs\sample2.csv")
# CONJUNCTION BETWEEN MODULES
geo_4 = Geometry(geo_2)
cbsp_site = CbspSite(
    InputFilesCsv=path_3,
    InputSiteCrv=geo_4,
    RotationInDegrees=Slider(0, range=0..360),
    RandomizedGenerations=randomize,
    NumberOfOptimizationLoops=Slider(23, range=1..100))  # -> SpatialCrv, CirculationLines, DebugText; disabled

circulation_2 = GenerateCirculation(SiteCrvOuterBoundary=crv_5, CbspCrvs=crv_7, PartitionLines=crv_6, CirculationDepth=Slider(4.539, range=0..10))  # -> _0PartitionLines, _1CirculationPoly, _2ResultantCbspCrv
Z_2 = UnitZ(Factor=Slider(1.296, range=0..10))
extr_2 = Extrude(Base=circulation_2._1CirculationPoly, Direction=Z_2)

geo_5 = Geometry(cbsp_site.SpatialCrv)
geo_6 = Geometry(cbsp_site.CirculationLines)
circulation_3 = GenerateCirculation(SiteCrvOuterBoundary=geo_4, CbspCrvs=geo_5, PartitionLines=geo_6, CirculationDepth=Slider(3.705, range=0..10))  # -> _0PartitionLines, _1CirculationPoly, _2ResultantCbspCrv; disabled

crv_10 = Curve(circulation._2ResultantCbspCrv)
block = MassingExtrudeBlock(
    SiteCurve=crv_10,
    Setback=Slider(3.174, range=0..10),
    FsrFar=Slider(3.246, range=0..10),
    FLRHT=Slider(3.246, range=0..10),
    MinCrvArea=Slider(3.246, range=0..10))  # -> OutputMassingBreps, OutputFloorCurves
geo_7 = Geometry(block.OutputMassingBreps)
crv_11 = Curve(block.OutputFloorCurves)

Z_3 = UnitZ(Factor=Slider(3.866, range=0..20))
crv_12 = Curve(circulation_3._2ResultantCbspCrv)
extr_3 = Extrude(Base=crv_12, Direction=Z_3)

crv_13 = Curve(circulation_2._2ResultantCbspCrv)
block_2 = MassingExtrudeBlock(
    SiteCurve=crv_13,
    Setback=Slider(8.745, range=0..10),
    FsrFar=Slider(6.388, range=0..10),
    FLRHT=Slider(5.43, range=0..10),
    MinCrvArea=Slider(32.547, range=0..500))  # -> OutputMassingBreps, OutputFloorCurves
geo_8 = Geometry(block_2.OutputMassingBreps)
crv_14 = Curve(block_2.OutputFloorCurves)

block_3 = MassingExtrudeBlock(
    SiteCurve=crv_12,
    Setback=Slider(11.274, range=0..20),
    FsrFar=Slider(3.314, range=0..20),
    FLRHT=Slider(13.203, range=0..20),
    MinCrvArea=Slider(373.234, range=0..500))  # -> OutputMassingBreps, OutputFloorCurves; disabled
geo_9 = Geometry(block_3.OutputFloorCurves)
geo_10 = Geometry(block_3.OutputMassingBreps)
item = ListItem(List=geo_9, Index=Slider(91, range=0..200), Wrap=True)
crv_15 = Curve(item)
path_4 = FilePath("C:\nir_dev\MegaSavageLevel\DotsProjRh6\DotsProj\DotsProj\SourceCode\test_scripts\dots_workflow\DOTS_workflow_test\inputs\sample1.csv")
curve_skeleton_2 = CrvSkeleton(
    InpFilePath=path_4,
    InpSiteCurve=crv_15,
    FromSiteOuterCirculationDepth=Slider(1.875, range=0..20),
    FromOuterCirculationBayDepth=Slider(7.068, range=0..20),
    FromBayDepthInnerCirculationDepth=Slider(2.413, range=0..20),
    SensitivityX100=Slider(10, range=0..10),
    OptimizationItrs=Slider(1, range=0..10))  # -> OuterOffsetCrv, InnerOffsetCrv, RESULTSegGeom; disabled
Z_4 = UnitZ(Factor=Slider(3.081, range=0..10))
extr_4 = Extrude(Base=curve_skeleton_2.RESULTSegGeom, Direction=Z_4)
path_5 = FilePath("C:\nir_dev\MegaSavageLevel\DotsProjRh6\DotsProj\DotsProj\SourceCode\test_scripts\dots_workflow\DOTS_workflow_test\inputs\sample1.csv")
randomize_2 = BooleanToggle(False)
cbsp_site_2 = CbspSite(
    InputFilesCsv=path_5,
    InputSiteCrv=curve_skeleton_2.InnerOffsetCrv,
    RotationInDegrees=Slider(0, range=0..360),
    RandomizedGenerations=randomize_2,
    NumberOfOptimizationLoops=Slider(1, range=1..100))  # -> SpatialCrv, CirculationLines, DebugText; disabled
crv_16 = Curve(cbsp_site_2.CirculationLines)
crv_17 = Curve(cbsp_site_2.SpatialCrv)
circulation_4 = GenerateCirculation(SiteCrvOuterBoundary=crv_15, CbspCrvs=crv_17, PartitionLines=crv_16, CirculationDepth=Slider(2.203, range=0..20))  # -> _0PartitionLines, _1CirculationPoly, _2ResultantCbspCrv
Z_5 = UnitZ(Factor=Slider(3.081, range=0..10))
crv_18 = Curve(circulation_4._2ResultantCbspCrv)
extr_5 = Extrude(Base=circulation_4._2ResultantCbspCrv, Direction=Z_5)
