# Grasshopper definition unnamed.gh (Grasshopper 1.0.7)

curve = Curve(<curve referenced from the Rhino model>)
c_script = CSharpScript(crv=curve, h=Slider(31.553, range=0..100))  # -> out, A, brep_crv; inputs crv: Curve, h: Double
# ---------- c_script: C# ----------
    double tol = Rhino.RhinoDoc.ActiveDoc.ModelAbsoluteTolerance;
    Brep b = Rhino.Geometry.Brep.CreatePlanarBreps(crv, tol)[0];
    Extrusion ext = Extrusion.Create(crv, h, true);
    A = ext;
    brep_crv = b;
# ---------- end c_script ----------
