# Grasshopper definition urban_plan_gen.gh (Grasshopper 1.0.7)
# plug-ins: DotsProj

crv = Curve(<curve referenced from the Rhino model>)
parcel_subdiv = ParcelsBySubdivision(
    InputSite=crv,
    NumOfParcels=Slider(64, range=0..100),
    DevMean01=Slider(0.121, range=0..1),
    AngleAlignmentDegrees0360=Slider(360, range=0..360),
    ShowThisIterations=Slider(0, range=0..33),
    ResetAllValues=Toggle(True),
    Generate=Toggle(True))  # -> LowestDeviationOfParcelSolution, StreetCenterLines, OutputParcelFromRequiredIteration, OutputStreetFromRequiredIteration, NumberOfResults; disabled
crv_2 = Curve(parcel_subdiv.StreetCenterLines)
crv_3 = Curve(parcel_subdiv.OutputParcelFromRequiredIteration)
crv_4 = Curve(parcel_subdiv.LowestDeviationOfParcelSolution)
crv_5 = Curve(parcel_subdiv.OutputStreetFromRequiredIteration)
panel = Panel(parcel_subdiv.NumberOfResults)
circulation = GenerateCirculation(SiteCrvOuterBoundary=crv, CbspCrvs=crv_4, PartitionLines=crv_2, CirculationDepth=Slider(9, range=0..100))  # -> _0PartitionLines, _1CirculationPoly, _2ResultantCbspCrv; disabled
Z = UnitZ(Factor=Slider(0.397, range=0..10))
geo = Geometry(circulation._2ResultantCbspCrv)
brep = Brep(circulation._1CirculationPoly)
extr = Extrude(Base=geo, Direction=Z)
select = Select(
    InputSiteCrv=crv,
    Parcels=circulation._2ResultantCbspCrv,
    CentralizeOrDisperse=Toggle(False),
    OpenSpaceRequirement=Slider(34.299, range=0..100))  # -> OutputBuildableParcels, OutputOpenSpaceParcels; disabled
python = GhPythonScript(crvs=select.OutputBuildableParcels, min_ar=Slider(1500, range=0..1500))  # -> out, site_crvs, excluded_crvs; inputs crvs: list of Curve; disabled
# ---------- python: Python ----------
__author__ = "Nirvik Saha"
__version__ = "2020.01.24"

import rhinoscriptsyntax as rs

used_li=[]
excluded_li=[]

for c in crvs:
    ar=rs.CurveArea(c)[0]
    if(ar<min_ar):
        excluded_li.append(c)
    else:
        used_li.append(c)

site_crvs=used_li
excluded_crvs=excluded_li
# ---------- end python ----------
preview = CustomPreview(Geometry=brep, Material=ColourSwatch(SwatchColor=RGB(0, 0, 0)))
crv_6 = Curve(select.OutputOpenSpaceParcels)
courtyard_mass = CourtyardMassing(
    SiteCurve=crv_6,
    FSRFAR=Slider(0.937, range=0..4),
    FloorHeight=Slider(20, range=0..20),
    Setback=Slider(5.269, range=0..20),
    BayDepth=Slider(10.019, range=0..100),
    MinFloorArea=Slider(0, range=0..1500))  # -> OutputFloorCurves, OutputMassingBreps, ExcludedCrv; disabled
brep_2 = Brep([crv_6, select.OutputBuildableParcels])
staggered_mass = StaggeredMassing(
    SiteCurve=python.site_crvs,
    FloorHeightRequired=Slider(6.71, range=0..20),
    SetbackStepbacksForMassing="7,12,15",
    HeightsCorrespondingToStepbacks="50,75, 25",
    MinArea=Slider(1500, range=0..1500))  # -> OutputFloorCurves, OutputMassingBreps, OutputTextPanelTotalFSRGFAAchieved, NumberOfFloors, ExcludedCrv
Z_2 = UnitZ(Factor=1)
geo_2 = Geometry(courtyard_mass.OutputMassingBreps)
extr_2 = Extrude(Base=brep_2, Direction=Z_2)
geo_3 = Geometry(staggered_mass.OutputMassingBreps)
brep_3 = Brep(extr_2)
block = ExtrudeBlock(
    SiteCurve=python.excluded_crvs,
    Setback=Slider(1.27, range=0..20),
    FsrFar=Slider(5.541, range=0..20),
    FLRHT=Slider(3.029, range=0..20),
    MinCrvArea=Slider(252.7, range=0..1500))  # -> OutputExtrudedMass, FloorCurves
brep_4 = Brep(geo_2)
brep_5 = Brep(geo_3)
preview_2 = CustomPreview(Geometry=brep_3, Material=ColourSwatch(SwatchColor=RGB(0, 67, 17)))
preview_3 = CustomPreview(Geometry=brep_5, Material=ColourSwatch(SwatchColor=RGB(249, 150, 0)))
preview_4 = CustomPreview(Geometry=brep_4, Material=ColourSwatch(SwatchColor=RGB(0, 242, 242)))
geo_4 = Geometry(block.FloorCurves)
geo_5 = Geometry(block.OutputExtrudedMass)
brep_6 = Brep(geo_5)
preview_5 = CustomPreview(Geometry=brep_6, Material=ColourSwatch(SwatchColor=RGB(255, 4, 6)))

crv_7 = Curve(<curve referenced from the Rhino model>)  # disabled
parcel_subdiv_2 = ParcelsBySubdivision(
    InputSite=crv_7,
    NumOfParcels=Slider(64, range=0..100),
    DevMean01=Slider(0.121, range=0..1),
    AngleAlignmentDegrees0360=Slider(360, range=0..360),
    ShowThisIterations=Slider(0, range=0..33),
    ResetAllValues=Toggle(True),
    Generate=Toggle(True))  # -> LowestDeviationOfParcelSolution, StreetCenterLines, OutputParcelFromRequiredIteration, OutputStreetFromRequiredIteration, NumberOfResults; disabled
crv_8 = Curve(parcel_subdiv_2.StreetCenterLines)
crv_9 = Curve(parcel_subdiv_2.OutputParcelFromRequiredIteration)
crv_10 = Curve(parcel_subdiv_2.OutputStreetFromRequiredIteration)
crv_11 = Curve(parcel_subdiv_2.LowestDeviationOfParcelSolution)
panel_2 = Panel(parcel_subdiv_2.NumberOfResults)
circulation_2 = GenerateCirculation(SiteCrvOuterBoundary=crv_7, CbspCrvs=crv_11, PartitionLines=crv_8, CirculationDepth=Slider(9, range=0..100))  # -> _0PartitionLines, _1CirculationPoly, _2ResultantCbspCrv; disabled
geo_6 = Geometry(circulation_2._2ResultantCbspCrv)  # disabled
brep_7 = Brep()
Z_3 = UnitZ(Factor=1)
courtyard_mass_2 = CourtyardMassing(
    SiteCurve=geo_6,
    FSRFAR=Slider(3, range=0..20),
    FloorHeight=Slider(3, range=0..20),
    Setback=Slider(0.975, range=0..20),
    BayDepth=Slider(6.974, range=0..100),
    MinFloorArea=Slider(0, range=0..1500))  # -> OutputFloorCurves, OutputMassingBreps, ExcludedCrv; disabled
extr_3 = Extrude(Base=brep_7, Direction=Z_3)
geo_7 = Geometry(courtyard_mass_2.OutputFloorCurves)
geo_8 = Geometry(courtyard_mass_2.OutputMassingBreps)

crv_12 = Curve(<curve referenced from the Rhino model>)
crv_13 = Curve(<curve referenced from the Rhino model>)
parcel_subdiv_diff = ParcelsBySubdivisionWithSubtraction(
    InputSite=crv_13,
    InternalCrv=crv_12,
    NumOfParcels=Slider(20, range=0..20),
    DevMean01=Slider(0, range=0..1),
    AngleAlignmentDegrees0360=Slider(0, range=0..360),
    ShowThisIterations=Slider(1, range=0..20),
    ResetAllValues=Toggle(True),
    Generate=Toggle(True))  # -> LowestDeviationOfParcelSolution, StreetCenterLines, OutputParcelFromRequiredIteration, OutputStreetFromRequiredIteration, NumberOfResults; disabled
crv_14 = Curve(parcel_subdiv_diff.LowestDeviationOfParcelSolution)
panel_3 = Panel(parcel_subdiv_diff.NumberOfResults)
crv_15 = Curve(parcel_subdiv_diff.OutputParcelFromRequiredIteration)
crv_16 = Curve(parcel_subdiv_diff.OutputStreetFromRequiredIteration)
crv_17 = Curve(parcel_subdiv_diff.StreetCenterLines)
Z_4 = UnitZ(Factor=Slider(4.209, range=0..10))
extr_4 = Extrude(Base=crv_14, Direction=Z_4)
brep_8 = Brep(crv_12)
brep_9 = Brep(extr_4)
circulation_3 = GenerateCirculation(SiteCrvOuterBoundary=crv_13, CbspCrvs=crv_14, PartitionLines=crv_17, CirculationDepth=Slider(15.502, range=0..20))  # -> _0PartitionLines, _1CirculationPoly, _2ResultantCbspCrv; disabled
preview_6 = CustomPreview(Geometry=brep_8, Material=ColourSwatch(SwatchColor=RGB(235, 7, 7)))
preview_7 = CustomPreview(Geometry=brep_9, Material=ColourSwatch(SwatchColor=RGB(0, 0, 0)))
brep_10 = Brep()
crv_18 = Curve(circulation_3._0PartitionLines)
crv_19 = Curve(circulation_3._2ResultantCbspCrv)
preview_8 = CustomPreview(Geometry=brep_10, Material=ColourSwatch(SwatchColor=RGB(196, 162, 98)))
staggered_mass_2 = StaggeredMassing(
    SiteCurve=crv_14,
    FloorHeightRequired=Slider(1.604, range=0..5),
    SetbackStepbacksForMassing="7,12",
    HeightsCorrespondingToStepbacks="20,50",
    MinArea=Slider(4.46, range=0..5))  # -> OutputFloorCurves, OutputMassingBreps, OutputTextPanelTotalFSRGFAAchieved, NumberOfFloors, ExcludedCrv; disabled
geo_9 = Geometry(staggered_mass_2.OutputMassingBreps)

crv_20 = Curve(<curve referenced from the Rhino model>)  # disabled
peripheral_subdiv_parcel = PeripheralSubdivisionParcels(
    SiteCurve=crv_20,
    SetbackDimensionFromSite=Slider(9, range=0..20),
    BayDepthFromSetback=Slider(103, range=0..300),
    InnerCrv0ffsetFromBay=Slider(15, range=0..20),
    NumDiv=Slider(9, range=0..20))  # -> Setback, Bay, InnerCrv, ParcelCrv; disabled
number_slider = Slider(0, range=0..1)
crv_21 = Curve(peripheral_subdiv_parcel.ParcelCrv)
block_2 = ExtrudeBlock(
    SiteCurve=crv_21,
    Setback=Slider(15.316, range=0..20),
    FsrFar=Slider(20, range=0..20),
    FLRHT=Slider(5.827, range=0..20),
    MinCrvArea=Slider(0, range=0..20000))  # -> OutputExtrudedMass, FloorCurves
geo_10 = Geometry(block_2.OutputExtrudedMass)
geo_11 = Geometry(block_2.FloorCurves)  # disabled

crv_22 = Curve(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)  # disabled
crv_23 = Curve(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)  # disabled
Z_5 = UnitZ(Factor=Slider(20, range=0..20))
extr_5 = Extrude(Base=crv_22, Direction=Z_5)
parcel_int_poly = ParcelsFromInternalPoly(InputSiteCurve=crv_23, InternalPolyine=crv_22)  # -> OutputParcels, OutputStreets; disabled
Z_6 = UnitZ(Factor=Slider(4.209, range=0..10))
crv_24 = Curve(parcel_int_poly.OutputParcels)
crv_25 = Curve(parcel_int_poly.OutputStreets)
extr_6 = Extrude(Base=crv_24, Direction=Z_6)
brep_11 = Brep(extr_5)
brep_12 = Brep(extr_6)
preview_9 = CustomPreview(Geometry=brep_11, Material=ColourSwatch(SwatchColor=RGB(235, 7, 7)))
circulation_4 = GenerateCirculation(SiteCrvOuterBoundary=crv_23, CbspCrvs=crv_24, PartitionLines=crv_25, CirculationDepth=Slider(4.972, range=0..10))  # -> _0PartitionLines, _1CirculationPoly, _2ResultantCbspCrv; disabled
preview_10 = CustomPreview(Geometry=brep_12, Material=ColourSwatch(SwatchColor=RGB(0, 0, 0)))
brep_13 = Brep(crv_22)
block_3 = ExtrudeBlock(
    SiteCurve=crv_24,
    Setback=Slider(10.996, range=0..20),
    FsrFar=Slider(3.596, range=0..20),
    FLRHT=Slider(3.364, range=0..20),
    MinCrvArea=Slider(106.409, range=0..200))  # -> OutputExtrudedMass, FloorCurves; disabled
crv_26 = Curve(circulation_4._0PartitionLines)
crv_27 = Curve(circulation_4._2ResultantCbspCrv)
preview_11 = CustomPreview(Geometry=brep_13, Material=ColourSwatch(SwatchColor=RGB(196, 162, 98)))
geo_12 = Geometry(block_3.FloorCurves)
geo_13 = Geometry(block_3.OutputExtrudedMass)

crv_28 = Curve(<curve referenced from the Rhino model>)  # disabled
peripheral_subdiv_parcel_2 = PeripheralSubdivisionParcels(
    SiteCurve=crv_28,
    SetbackDimensionFromSite=Slider(6.685, range=0..10),
    BayDepthFromSetback=Slider(27.703, range=0..50),
    InnerCrv0ffsetFromBay=Slider(8.163, range=0..10),
    NumDiv=Slider(42, range=0..100))  # -> Setback, Bay, InnerCrv, ParcelCrv; disabled
Z_7 = UnitZ(Factor=Slider(4.209, range=0..10))
crv_29 = Curve(peripheral_subdiv_parcel_2.Setback)
crv_30 = Curve(peripheral_subdiv_parcel_2.Bay)
crv_31 = Curve(peripheral_subdiv_parcel_2.InnerCrv)
crv_32 = Curve(peripheral_subdiv_parcel_2.ParcelCrv)
extr_7 = Extrude(Base=crv_32, Direction=Z_7)
brep_14 = Brep(crv_32)
brep_15 = Brep(extr_7)
preview_12 = CustomPreview(Geometry=brep_14, Material=ColourSwatch(SwatchColor=RGB(202, 230, 220)))
preview_13 = CustomPreview(Geometry=brep_15, Material=ColourSwatch(SwatchColor=RGB(0, 0, 0)))
crv_33 = Curve(crv_32)
brep_16 = Brep(crv_31)
courtyard_mass_3 = CourtyardMassing(
    SiteCurve=crv_33,
    FSRFAR=Slider(2.198, range=0.5..3),
    FloorHeight=Slider(3, range=0..10),
    Setback=Slider(2.957, range=0..25),
    BayDepth=Slider(8, range=0..20),
    MaxHtFloorArea=Slider(0, range=0..20))  # -> OutputFloorCurves, OutputMassingBreps, ExcludedCrv
preview_14 = CustomPreview(Geometry=brep_16, Material=ColourSwatch(SwatchColor=RGB(196, 162, 98)))

crv_34 = Curve(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)  # disabled
peripheral_subdiv_parcel_3 = PeripheralSubdivisionParcels(
    SiteCurve=crv_34,
    SetbackDimensionFromSite=Slider(3.816, range=0..20),
    BayDepthFromSetback=Slider(28.032, range=0..50),
    InnerCrv0ffsetFromBay=Slider(10, range=0..10),
    NumDiv=Slider(40, range=0..100))  # -> Setback, Bay, InnerCrv, ParcelCrv; disabled
crv_35 = Curve(peripheral_subdiv_parcel_3.Setback)
crv_36 = Curve(peripheral_subdiv_parcel_3.Bay)
crv_37 = Curve(peripheral_subdiv_parcel_3.InnerCrv)
crv_38 = Curve(peripheral_subdiv_parcel_3.ParcelCrv)

Z_8 = UnitZ(Factor=Slider(0.478, range=0..20))
extr_8 = Extrude(Base=crv_38, Direction=Z_8)

number_slider_2 = Slider(0, range=0..1)
crv_39 = Curve(crv_38)  # disabled
block_4 = ExtrudeBlock(
    SiteCurve=crv_39,
    Setback=Slider(4.617, range=0..20),
    FsrFar=Slider(6.806, range=0..20),
    FLRHT=Slider(3, range=0..3),
    MinCrvArea=Slider(0, range=0..20000))  # -> OutputExtrudedMass, FloorCurves; disabled
geo_14 = Geometry(block_4.OutputExtrudedMass)
geo_15 = Geometry(block_4.FloorCurves)

preview_15 = CustomPreview(Geometry=extr_8, Material=ColourSwatch(SwatchColor=RGB(0, 0, 0)))

crv_40 = Curve([<curve referenced from the Rhino model> x351])  # disabled
ext_setbacks = UrbanMassingFromSiteFsrSetbacksStreets(
    InputSiteCurves=crv_40,
    StreetLayerNames="streeta, streetb",
    CorrespondingStreetSetbacks="5.5, 7.0",
    InputFSR=Slider(15, range=0..15))  # -> OutputSolidGeometry, OutputSITENumbers; disabled
geo_16 = Geometry(ext_setbacks.OutputSolidGeometry)
panel_4 = Panel(ext_setbacks.OutputSITENumbers)

crv_41 = Curve(<curve referenced from the Rhino model>)  # disabled
peripheral_subdiv_parcel_4 = PeripheralSubdivisionParcels(
    SiteCurve=crv_41,
    SetbackDimensionFromSite=Slider(3, range=0..10),
    BayDepthFromSetback=Slider(47.407, range=0..50),
    InnerCrv0ffsetFromBay=Slider(1.573, range=0..10),
    NumDiv=Slider(15, range=0..100))  # -> Setback, Bay, InnerCrv, ParcelCrv; disabled
number_slider_3 = Slider(0, range=0..20)
crv_42 = Curve(peripheral_subdiv_parcel_4.Setback)
crv_43 = Curve(peripheral_subdiv_parcel_4.Bay)
crv_44 = Curve(peripheral_subdiv_parcel_4.InnerCrv)
crv_45 = Curve(peripheral_subdiv_parcel_4.ParcelCrv)
number_slider_4 = Slider(20, range=0..20)
number_slider_5 = Slider(4, range=0..20)
number_slider_6 = Slider(2.198, range=0.5..3)
number_slider_7 = Slider(9.613, range=0..25)
number_slider_8 = Slider(3, range=0..10)
number_slider_9 = Slider(0.149, range=0..10)
number_slider_10 = Slider(0.726, range=0..5)
crv_46 = Curve(crv_45)
staggered_courtyard_normal = StaggeredCourtyardNormal(
    Site=crv_46,
    Setback=number_slider_10,
    BaseDepthOffset=number_slider_7,
    NumOfTowerFootprintsBaseCrvSubdiv=number_slider_4,
    NumberOfTowers=number_slider_5,
    FloorFloorHeight=number_slider_8,
    BaseFSRFAR=number_slider_6,
    TowerFSRFAR=number_slider_9,
    MinimumAreaSiteCrv=number_slider_3,
    MinimumAreaTowerCrv=number_slider_3)  # -> OffsetCurve, BaseFloorCurves, TowerFloorCurves, PolyFromSubDivOfCrvs, FinalBoundaryRepresentation, FsrVals; disabled
staggered_courtyard_interp = StaggeredCourtyardInterpolated(
    Site=crv_46,
    Setback=number_slider_10,
    BaseDepthOffset=number_slider_7,
    BaseDepthOffset_2=number_slider_4,
    NumberOfTowers=number_slider_5,
    FloorFloorHeight=number_slider_8,
    BaseFSRFAR=number_slider_6,
    TowerFSRFAR=number_slider_9,
    MinimumAreaSiteCrv=number_slider_3,
    MinimumAreaTowerCrv=number_slider_3)  # -> OffsetCurve, BaseFloorCurves, TowerFloorCurves, PolyFromSubDivOfCrvs, FinalBoundaryRepresentation; disabled
geo_17 = Geometry(staggered_courtyard_normal.FinalBoundaryRepresentation)
geo_18 = Geometry(staggered_courtyard_interp.FinalBoundaryRepresentation)

geo_19 = Geometry([<curve referenced from the Rhino model> x3])
geo_20 = Geometry(<curve referenced from the Rhino model>)
site_partition_circulation = SitePartitionCirculation(
    SiteCurve=geo_20,
    CirculationCurve=geo_19,
    CirculationDepth=Slider(5.685, range=0..10),
    MinimumAreaPartition=Slider(106.142, range=0..1000))  # -> DebugText, CirculationCurves, PartitionCurves
number_slider_11 = Slider(2.208, range=0..5)
crv_47 = Curve(site_partition_circulation.CirculationCurves)
crv_48 = Curve(site_partition_circulation.PartitionCurves)  # disabled
panel_5 = Panel(site_partition_circulation.DebugText)
block_5 = MassingExtrudeBlock(
    SiteCurve=crv_48,
    Setback=Slider(1.604, range=0..5),
    FsrFar=Slider(3.23, range=0..5),
    FLRHT=Slider(2.099, range=0..5),
    MinCrvArea=Slider(4.46, range=0..5))  # -> OutputMassingBreps, OutputFloorCurves; disabled
courtyard_mass_4 = CourtyardMassing(
    SiteCurve=crv_48,
    FSRFAR=Slider(1.604, range=0..5),
    FloorHeight=Slider(3.23, range=0..5),
    Setback=Slider(1.179, range=0..5),
    BayDepth=Slider(4.998, range=0..12),
    MinFloorArea=Slider(2.208, range=0..5))  # -> OutputFloorCurves, OutputMassingBreps, ExcludedCrv; disabled
staggered_courtyard_normal_2 = StaggeredCourtyardNormal(
    Site=crv_48,
    Setback=Slider(0.014, range=0..5),
    BaseDepthOffset=Slider(5.504, range=0..25),
    NumOfTowerFootprintsBaseCrvSubdiv=Slider(7, range=0..10),
    NumberOfTowers=Slider(3, range=0..10),
    FloorFloorHeight=Slider(3.269, range=0..5),
    BaseFSRFAR=Slider(1.871, range=0..5),
    TowerFSRFAR=Slider(2.345, range=0..5),
    MinimumAreaSiteCrv=number_slider_11,
    MinimumAreaTowerCrv=number_slider_11)  # -> OffsetCurve, BaseFloorCurves, TowerFloorCurves, PolyFromSubDivOfCrvs, FinalBoundaryRepresentation, FsrVals

Z_9 = UnitZ(Factor=Slider(1.164, range=0..10))
brep_17 = Brep(site_partition_circulation.PartitionCurves)

staggered_mass_3 = StaggeredMassing(
    SiteCurve=crv_48,
    FloorHeightRequired=Slider(1.604, range=0..5),
    SetbackStepbacksForMassing="3,5,7",
    HeightsCorrespondingToStepbacks="3,5,7",
    MinArea=Slider(4.46, range=0..5))  # -> OutputFloorCurves, OutputMassingBreps, OutputTextPanelTotalFSRGFAAchieved, NumberOfFloors, ExcludedCrv; disabled

extr_9 = Extrude(Base=site_partition_circulation.PartitionCurves, Direction=Z_9)
preview_16 = CustomPreview(Geometry=brep_17, Material=ColourSwatch(SwatchColor=RGB(0, 242, 242)))
brep_18 = Brep(extr_9)
preview_17 = CustomPreview(Geometry=brep_18, Material=ColourSwatch(SwatchColor=RGB(0, 0, 0)))
geo_21 = Geometry(courtyard_mass_4.OutputMassingBreps)
geo_22 = Geometry(block_5.OutputMassingBreps)
brep_19 = Brep(geo_22)
brep_20 = Brep(geo_21)
geo_23 = Geometry(staggered_courtyard_normal_2.FinalBoundaryRepresentation)
swatch = ColourSwatch(SwatchColor=RGB(0, 242, 242))
brep_21 = Brep(geo_23)
preview_18 = CustomPreview(Geometry=brep_19, Material=ColourSwatch(SwatchColor=RGB(0, 242, 242)))
preview_19 = CustomPreview(Geometry=brep_20, Material=ColourSwatch(SwatchColor=RGB(0, 242, 242)))
preview_20 = CustomPreview(Geometry=brep_21, Material=ColourSwatch(SwatchColor=RGB(232, 138, 23)))
timer = Timer(TimerInterval=1000, Target=python_2)  # disabled
python_2 = GhPythonScript()  # -> out, num; disabled
# ---------- python_2: Python ----------
__author__ = "Nirvik Saha"
__version__ = "2020.01.26"

import rhinoscriptsyntax as rs
import random

num=random.randint(25,75)
# ---------- end python_2 ----------
number_slider_12 = Slider(64, range=0..100)
crv_49 = Curve(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)  # disabled

timer_2 = Timer(TimerInterval=1000)  # disabled
python_3 = GhPythonScript()  # -> out, num_x, num_y; disabled
# ---------- python_3: Python ----------
__author__ = "Nirvik Saha"
__version__ = "2020.01.25"

import rhinoscriptsyntax as rs
import random

num_x=random.randint(3,7)
num_y=random.randint(3,7)
# ---------- end python_3 ----------
crv_50 = Curve(<curve referenced from the Rhino model>)  # disabled
number_slider_13 = Slider(3, range=2..10)
number_slider_14 = Slider(3, range=2..10)
path = FilePath("C:\nir_dev\MegaSavageLevel\DotsProjRh6\DotsProj\DotsProj\SourceCode\TEST_SCRIPTS\dots_workflow\inputs\gridSA.csv")
grid_solver = GridAllocationSolver(
    InpFilePath=path,
    SiteCurve=crv_50,
    NumberXAxis=python_3.num_x,
    NumberYAxis=python_3.num_y,
    CirculationDepth=Slider(2, range=0..50),
    NumberOfIterations=Slider(2, range=0..50),
    MinimumAreaOfCurve=Slider(32, range=0..50))  # -> CrvNamesColor, ListOfFsr, Curve; disabled
python_nums = GhPythonScript()  # -> out, a, b
# ---------- python_nums: Python ----------
__author__ = "Nirvik Saha"
__version__ = "2020.01.25"

import rhinoscriptsyntax as rs
import random

a=random.randint(5,10)
b=random.randint(5,a)

print(a,b)
# ---------- end python_nums ----------
Z_10 = UnitZ(Factor=Slider(0.999, range=0.999..1))
brep_22 = Brep(grid_solver.Curve)
python_fsr = GhPythonScript()  # -> out, base_fsr, tower_fsr
# ---------- python_fsr: Python ----------
__author__ = "Nirvik Saha"
__version__ = "2020.01.25"

import rhinoscriptsyntax as rs
import random

base_fsr=random.random()*3+1.5
tower_fsr=random.random()*2+1.5
# ---------- end python_fsr ----------
python_4 = GhPythonScript(crv=crv_50, setback=Slider(2.461, range=0..5))  # -> out, setback, base_depth; inputs crv: Curve
# ---------- python_4: Python ----------
__author__ = "Nirvik Saha"
__version__ = "2020.01.25"

import rhinoscriptsyntax as rs
import random
rs.EnableRedraw(False)
p=rs.CurveAreaCentroid(crv)[0]
b=rs.BoundingBox(crv)
li=[b[0],b[1],b[2],b[3],b[0]]
poly=rs.AddPolyline(li)
A=rs.Distance(b[0],b[1])
B=rs.Distance(b[1],b[2])
dx=(random.random()*A/7)+A/10
dy=(random.random()*B/7)+B/10
base_depth=min(dx,dy)/5
rs.DeleteObject(poly)
rs.EnableRedraw(True)
print(base_depth)
# ---------- end python_4 ----------
extr_10 = Extrude(Base=brep_22, Direction=Z_10)
preview_21 = CustomPreview(Geometry=extr_10, Material=ColourSwatch(SwatchColor=RGB(126, 126, 126)))
staggered_courtyard_normal_3 = StaggeredCourtyardNormal(
    Site=grid_solver.Curve,
    Setback=Slider(6.794, range=0..10),
    BaseDepthOffset=python_4.base_depth,
    NumOfTowerFootprintsBaseCrvSubdiv=python_nums.a,
    NumberOfTowers=python_nums.b,
    FloorFloorHeight=Slider(3, range=0..20),
    BaseFSRFAR=python_fsr.base_fsr,
    TowerFSRFAR=python_fsr.tower_fsr,
    MinimumAreaSiteCrv=Slider(0, range=0..1500),
    MinimumCourtyardArea=Slider(79.444, range=0..350))  # -> OffsetCurve, BaseFloorCurves, TowerFloorCurves, PolyFromSubDivOfCrvs, FinalBoundaryRepresentation, FsrVals
geo_24 = Geometry(staggered_courtyard_normal_3.BaseFloorCurves)
panel_6 = Panel(staggered_courtyard_normal_3.FsrVals)
preview_22 = CustomPreview(Geometry=staggered_courtyard_normal_3.FinalBoundaryRepresentation, Material=ColourSwatch(SwatchColor=RGB(239, 101, 0)))
brep_23 = Brep(staggered_courtyard_normal_3.OffsetCurve)
Z_11 = UnitZ(Factor=Slider(2, range=2..10))
python_5 = GhPythonScript(fsr_li=staggered_courtyard_normal_3.FsrVals, site=crv_50)  # -> out, mean_fsr; inputs fsr_li: list, site: Curve; disabled
# ---------- python_5: Python ----------
__author__ = "Nirvik Saha"
__version__ = "2020.01.25"

import rhinoscriptsyntax as rs
import Rhino
import scriptcontext

scriptcontext.doc=Rhino.RhinoDoc.ActiveDoc

sum_fsr=0
num_dev=0

for i in fsr_li:
    try:
        sum_fsr+=i
        num_dev+=1
    except:
        pass

mean_fsr=sum_fsr/num_dev
r="fsr : " +str(mean_fsr)

i=0
b=rs.BoundingBox(site)
p=[(b[0][0] + b[3][0])*0.5 - 150, (b[0][1]+b[3][1])/2, 0]
rs.AddTextDot(r, p)

scriptcontext.doc=ghdoc
# ---------- end python_5 ----------
extr_11 = Extrude(Base=brep_23, Direction=Z_11)
preview_23 = CustomPreview(Geometry=extr_11, Material=ColourSwatch(SwatchColor=RGB(0, 249, 0)))

crv_51 = Curve(<curve referenced from the Rhino model>)  # disabled
python_6 = GhPythonScript()  # -> out, num_x, num_y; disabled
# ---------- python_6: Python ----------
__author__ = "Nirvik Saha"
__version__ = "2020.01.25"

import rhinoscriptsyntax as rs
import random

num_x=random.randint(3,7)
num_y=random.randint(5,10)
# ---------- end python_6 ----------
crv_52 = Curve([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])
timer_3 = Timer(TimerInterval=1000)  # disabled
site_partition_circulation_2 = SitePartitionCirculation(
    SiteCurve=crv_51,
    CirculationCurve=crv_52,
    CirculationDepth=Slider(13.065, range=0..15),
    MinimumAreaPartition=Slider(0, range=0..350))  # -> DebugText, CirculationCurves, PartitionCurves; disabled
path_2 = FilePath("C:\nir_dev\MegaSavageLevel\DotsProjRh6\DotsProj\DotsProj\SourceCode\TEST_SCRIPTS\dots_workflow\inputs\gridSA.csv")
python_nums_2 = GhPythonScript()  # -> out, a, b; same code as python_nums
Z_12 = UnitZ(Factor=Slider(0.999, range=0.999..1))
brep_24 = Brep()
python_fsr_2 = GhPythonScript()  # -> out, base_fsr, tower_fsr; same code as python_fsr
python_7 = GhPythonScript(crv=crv_51, setback=Slider(2.461, range=0..5))  # -> out, setback, base_depth; inputs crv: Curve
# ---------- python_7: Python ----------
__author__ = "Nirvik Saha"
__version__ = "2020.01.25"

import rhinoscriptsyntax as rs
import random

p=rs.CurveAreaCentroid(crv)[0]
b=rs.BoundingBox(crv)
li=[b[0],b[1],b[2],b[3],b[0]]
poly=rs.AddPolyline(li)
A=rs.Distance(b[0],b[1])
B=rs.Distance(b[1],b[2])
dx=(random.random()*A/7)+A/10
dy=(random.random()*B/7)+B/10
base_depth=min(dx,dy)/3
print(base_depth)
# ---------- end python_7 ----------
extr_12 = Extrude(Base=brep_24, Direction=Z_12)
preview_24 = CustomPreview(Geometry=extr_12, Material=ColourSwatch(SwatchColor=RGB(54, 110, 255)))
staggered_courtyard_normal_4 = StaggeredCourtyardNormal(
    Site=site_partition_circulation_2.PartitionCurves,
    Setback=Slider(6.794, range=0..10),
    BaseDepthOffset=python_7.base_depth,
    NumOfTowerFootprintsBaseCrvSubdiv=python_nums_2.a,
    NumberOfTowers=python_nums_2.b,
    FloorFloorHeight=Slider(3, range=0..20),
    BaseFSRFAR=python_fsr_2.base_fsr,
    TowerFSRFAR=python_fsr_2.tower_fsr,
    MinimumAreaSiteCrv=Slider(0, range=0..1500),
    MinimumCourtyardArea=Slider(350, range=0..350))  # -> OffsetCurve, BaseFloorCurves, TowerFloorCurves, PolyFromSubDivOfCrvs, FinalBoundaryRepresentation, FsrVals
panel_7 = Panel(staggered_courtyard_normal_4.FsrVals)
geo_25 = Geometry(staggered_courtyard_normal_4.BaseFloorCurves)
preview_25 = CustomPreview(Geometry=staggered_courtyard_normal_4.FinalBoundaryRepresentation, Material=ColourSwatch(SwatchColor=RGB(239, 101, 0)))
brep_25 = Brep(staggered_courtyard_normal_4.OffsetCurve)
Z_13 = UnitZ(Factor=Slider(2, range=2..10))
python_8 = GhPythonScript(fsr_li=staggered_courtyard_normal_4.FsrVals, site=crv_51)  # -> out, mean_fsr; inputs fsr_li: list, site: Curve; disabled
# ---------- python_8: Python ----------
__author__ = "Nirvik Saha"
__version__ = "2020.01.25"

import rhinoscriptsyntax as rs
import Rhino
import scriptcontext

scriptcontext.doc=Rhino.RhinoDoc.ActiveDoc

sum_fsr=0
num_dev=0

for i in fsr_li:
    try:
        sum_fsr+=i
        num_dev+=1
    except:
        pass

mean_fsr=sum_fsr/num_dev
r="fsr : " +str(mean_fsr)

i=3
b=rs.BoundingBox(site)
p=[b[i][0], b[i][1], 0]
rs.AddTextDot(r, p)

scriptcontext.doc=ghdoc
# ---------- end python_8 ----------
extr_13 = Extrude(Base=brep_25, Direction=Z_13)
preview_26 = CustomPreview(Geometry=extr_13, Material=ColourSwatch(SwatchColor=RGB(0, 249, 0)))

parcel_subdiv_3 = ParcelsBySubdivision(
    InputSite=crv_49,
    NumOfParcels=python_2.num,
    DevMean01=Slider(0.121, range=0..1),
    AngleAlignmentDegrees0360=Slider(360, range=0..360),
    ShowThisIterations=Slider(0, range=0..33),
    ResetAllValues=Toggle(True),
    Generate=Toggle(True))  # -> LowestDeviationOfParcelSolution, StreetCenterLines, OutputParcelFromRequiredIteration, OutputStreetFromRequiredIteration, NumberOfResults
crv_53 = Curve(parcel_subdiv_3.StreetCenterLines)
crv_54 = Curve(parcel_subdiv_3.OutputParcelFromRequiredIteration)
crv_55 = Curve(parcel_subdiv_3.LowestDeviationOfParcelSolution)
crv_56 = Curve(parcel_subdiv_3.OutputStreetFromRequiredIteration)
panel_8 = Panel(parcel_subdiv_3.NumberOfResults)
circulation_5 = GenerateCirculation(SiteCrvOuterBoundary=crv_49, CbspCrvs=crv_55, PartitionLines=crv_53, CirculationDepth=Slider(9, range=0..100))  # -> _0PartitionLines, _1CirculationPoly, _2ResultantCbspCrv
crv_union = Union(InputListOfCurvesA=circulation_5._1CirculationPoly)
Z_14 = UnitZ(Factor=Slider(0.397, range=0..10))
geo_26 = Geometry(circulation_5._2ResultantCbspCrv)
brep_26 = Brep(crv_union)
extr_14 = Extrude(Base=geo_26, Direction=Z_14)
preview_27 = CustomPreview(Geometry=brep_26, Material=ColourSwatch(SwatchColor=RGB(0, 0, 0)))
select_2 = Select(
    InputSiteCrv=crv_49,
    Parcels=circulation_5._2ResultantCbspCrv,
    CentralizeOrDisperse=Toggle(False),
    OpenSpaceRequirement=Slider(34.299, range=0..100))  # -> OutputBuildableParcels, OutputOpenSpaceParcels
area = Area(Geometry=select_2.OutputBuildableParcels)  # -> Area, Centroid
python_nums_3 = GhPythonScript()  # -> out, a, b
# ---------- python_nums_3: Python ----------
__author__ = "Nirvik Saha"
__version__ = "2020.01.25"

import rhinoscriptsyntax as rs
import random

a=random.randint(5,8)
b=random.randint(2,a-2)

print(a,b)
# ---------- end python_nums_3 ----------
panel_9 = Panel(area.Area)
python_fsr_3 = GhPythonScript()  # -> out, base_fsr, tower_fsr
# ---------- python_fsr_3: Python ----------
__author__ = "Nirvik Saha"
__version__ = "2020.01.25"

import rhinoscriptsyntax as rs
import random

base_fsr=random.random()*1.5+3.5
tower_fsr=random.random()*2+2.5
# ---------- end python_fsr_3 ----------
python_9 = GhPythonScript(crvs=select_2.OutputBuildableParcels, min_ar=Slider(1201.86, range=0..1500), max_ar=Slider(4422.949, range=0..5000))  # -> out, site_crvs, excluded_crvs, big_site_crvs; inputs crvs: list of Curve
# ---------- python_9: Python ----------
__author__ = "Nirvik Saha"
__version__ = "2020.01.24"

import rhinoscriptsyntax as rs
big_crv_li=[]
used_li=[]
excluded_li=[]

for c in crvs:
    ar=rs.CurveArea(c)[0]
    if(ar>max_ar):
        big_crv_li.append(c)
    else:
        if(ar<min_ar):
            excluded_li.append(c)
        else:
            used_li.append(c)

site_crvs=used_li
excluded_crvs=excluded_li
big_site_crvs=big_crv_li
# ---------- end python_9 ----------
python_10 = GhPythonScript(crv=python_9.big_site_crvs, setback=Slider(2.461, range=0..5))  # -> out, setback, base_depth; inputs crv: Curve
# ---------- python_10: Python ----------
__author__ = "Nirvik Saha"
__version__ = "2020.01.25"

import rhinoscriptsyntax as rs
import random
p=rs.CurveAreaCentroid(crv)[0]
b=rs.BoundingBox(crv)
li=[b[0],b[1],b[2],b[3],b[0]]
A=rs.Distance(b[0],b[1])
B=rs.Distance(b[1],b[2])
dx=(random.random()*A/7)+A/4
dy=(random.random()*B/7)+B/4
base_depth=min(dx,dy)/2
# ---------- end python_10 ----------
crv_57 = Curve(select_2.OutputOpenSpaceParcels)
python_11 = GhPythonScript(crvs=select_2.OutputOpenSpaceParcels, min_ar=Slider(1201.86, range=0..1500))  # -> out, site_crvs, excluded_crvs; inputs crvs: list of Curve
# ---------- python_11: Python ----------
__author__ = "Nirvik Saha"
__version__ = "2020.01.24"

import rhinoscriptsyntax as rs
used_li=[]
excluded_li=[]

for c in crvs:
    ar=rs.CurveArea(c)[0]
    if(ar<min_ar):
        excluded_li.append(c)
    else:
        used_li.append(c)

site_crvs=used_li
excluded_crvs=excluded_li
# ---------- end python_11 ----------
brep_27 = Brep([crv_57, select_2.OutputBuildableParcels])
Z_15 = UnitZ(Factor=1)
courtyard_mass_5 = CourtyardMassing(
    SiteCurve=python_11.site_crvs,
    FSRFAR=Slider(0.937, range=0..4),
    FloorHeight=Slider(9.057, range=0..20),
    Setback=Slider(5.269, range=0..20),
    BayDepth=Slider(7.844, range=0..100),
    MinFloorArea=Slider(0, range=0..1500))  # -> OutputFloorCurves, OutputMassingBreps, ExcludedCrv
staggered_courtyard_normal_5 = StaggeredCourtyardNormal(
    Site=python_9.big_site_crvs,
    Setback=Slider(6.794, range=0..10),
    BaseDepthOffset=python_10.base_depth,
    NumOfTowerFootprintsBaseCrvSubdiv=python_nums_3.a,
    NumberOfTowers=python_nums_3.b,
    FloorFloorHeight=Slider(3, range=0..20),
    BaseFSRFAR=python_fsr_3.base_fsr,
    TowerFSRFAR=python_fsr_3.tower_fsr,
    MinimumAreaSiteCrv=Slider(0, range=0..1500),
    MinimumCourtyardArea=Slider(0, range=0..350))  # -> OffsetCurve, BaseFloorCurves, TowerFloorCurves, PolyFromSubDivOfCrvs, FinalBoundaryRepresentation, FsrVals
extr_15 = Extrude(Base=brep_27, Direction=Z_15)
brep_28 = Brep(extr_15)
geo_27 = Geometry(courtyard_mass_5.OutputMassingBreps)
geo_28 = Geometry(staggered_courtyard_normal_5.BaseFloorCurves)
preview_28 = CustomPreview(Geometry=brep_28, Material=ColourSwatch(SwatchColor=RGB(0, 67, 17)))
panel_10 = Panel(staggered_courtyard_normal_5.FsrVals)
brep_29 = Brep(geo_27)
block_6 = ExtrudeBlock(
    SiteCurve=[python_11.excluded_crvs, courtyard_mass_5.ExcludedCrv],
    Setback=Slider(1.27, range=0..20),
    FsrFar=Slider(5.541, range=0..20),
    FLRHT=Slider(3.029, range=0..20),
    MinCrvArea=Slider(252.7, range=0..1500))  # -> OutputExtrudedMass, FloorCurves
brep_30 = Brep(staggered_courtyard_normal_5.OffsetCurve)
preview_29 = CustomPreview(Geometry=staggered_courtyard_normal_5.FinalBoundaryRepresentation, Material=ColourSwatch(SwatchColor=RGB(239, 101, 0)))
Z_16 = UnitZ(Factor=Slider(2, range=2..10))
block_7 = ExtrudeBlock(
    SiteCurve=python_9.excluded_crvs,
    Setback=Slider(1.27, range=0..20),
    FsrFar=Slider(5.541, range=0..20),
    FLRHT=Slider(3.029, range=0..20),
    MinCrvArea=Slider(252.7, range=0..1500))  # -> OutputExtrudedMass, FloorCurves
preview_30 = CustomPreview(Geometry=brep_29, Material=ColourSwatch(SwatchColor=RGB(0, 242, 242)))
extr_16 = Extrude(Base=brep_30, Direction=Z_16)
geo_29 = Geometry(block_6.FloorCurves)
geo_30 = Geometry(block_6.OutputExtrudedMass)
preview_31 = CustomPreview(Geometry=extr_16, Material=ColourSwatch(SwatchColor=RGB(0, 249, 0)))
geo_31 = Geometry(block_7.FloorCurves)
geo_32 = Geometry(block_7.OutputExtrudedMass)
brep_31 = Brep(geo_30)
brep_32 = Brep(geo_32)
preview_32 = CustomPreview(Geometry=brep_31, Material=ColourSwatch(SwatchColor=RGB(255, 4, 6)))
staggered_mass_4 = StaggeredMassing(
    SiteCurve=python_9.site_crvs,
    FloorHeightRequired=Slider(6.71, range=0..20),
    SetbackStepbacksForMassing="7,12,15",
    HeightsCorrespondingToStepbacks="25,15,27",
    MinArea=Slider(1500, range=0..1500))  # -> OutputFloorCurves, OutputMassingBreps, OutputTextPanelTotalFSRGFAAchieved, NumberOfFloors, ExcludedCrv
preview_33 = CustomPreview(Geometry=brep_32, Material=ColourSwatch(SwatchColor=RGB(255, 4, 6)))
geo_33 = Geometry(staggered_mass_4.OutputMassingBreps)
brep_33 = Brep(geo_33)
preview_34 = CustomPreview(Geometry=brep_33, Material=ColourSwatch(SwatchColor=RGB(249, 150, 0)))

crv_58 = Curve(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)  # disabled
crv_59 = Curve([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])  # disabled
site_partition_circulation_3 = SitePartitionCirculation(
    SiteCurve=crv_58,
    CirculationCurve=crv_59,
    CirculationDepth=Slider(32, range=0..50),
    MinimumAreaPartition=Slider(0, range=0..50))  # -> DebugText, CirculationCurves, PartitionCurves; disabled
crv_60 = Curve(site_partition_circulation_3.PartitionCurves)  # disabled
item = ListItem(List=crv_60, Index=Slider(5, range=0..7), Wrap=True)
item_2 = ListItem(List=crv_60, Index=Slider(4, range=0..7), Wrap=True)
item_3 = ListItem(List=crv_60, Index=Slider(6, range=0..7), Wrap=True)
item_4 = ListItem(List=crv_60, Index=Slider(3, range=0..7), Wrap=True)
item_5 = ListItem(List=crv_60, Index=Slider(2, range=0..7), Wrap=True)
item_6 = ListItem(List=crv_60, Index=Slider(0, range=0..7), Wrap=True)
crv_61 = Curve(item)  # disabled
crv_62 = Curve(item_2)  # disabled
item_7 = ListItem(List=crv_60, Index=Slider(1, range=0..7), Wrap=True)
crv_63 = Curve(item_3)  # disabled
crv_64 = Curve(item_4)  # disabled
crv_65 = Curve(item_5)  # disabled
crv_66 = Curve(item_6)  # disabled
crv_67 = Curve(item_7)  # disabled
number_slider_15 = Slider(3, range=2..10)
number_slider_16 = Slider(2, range=2..10)

Z_17 = UnitZ(Factor=Slider(21.907, range=0.999..100))
brep_34 = Brep()
extr_17 = Extrude(Base=crv_60, Direction=Z_17)
preview_35 = CustomPreview(Geometry=extr_17, Material=ColourSwatch(SwatchColor=RGB(0, 0, 0)))

number_slider_17 = Slider(5, range=2..10)
number_slider_18 = Slider(5, range=2..10)
python_12 = GhPythonScript(x=crv_61)  # -> out, num_x, num_y
# ---------- python_12: Python ----------
__author__ = "Nirvik Saha"
__version__ = "2020.01.25"

import rhinoscriptsyntax as rs
import random

num_x=random.randint(2,6)
num_y=random.randint(2,6)
# ---------- end python_12 ----------
path_3 = FilePath("C:\nir_dev\MegaSavageLevel\DotsProjRh6\DotsProj\DotsProj\SourceCode\TEST_SCRIPTS\dots_workflow\inputs\gridSA.csv")
grid_solver_2 = GridAllocationSolver(
    InpFilePath=path_3,
    SiteCurve=crv_61,
    NumberXAxis=python_12.num_x,
    NumberYAxis=python_12.num_y,
    CirculationDepth=Slider(2, range=0..50),
    NumberOfIterations=Slider(2, range=0..50),
    MinimumAreaOfCurve=Slider(32, range=0..50))  # -> CrvNamesColor, ListOfFsr, Curve
python_nums_4 = GhPythonScript()  # -> out, a, b
# ---------- python_nums_4: Python ----------
__author__ = "Nirvik Saha"
__version__ = "2020.01.25"

import rhinoscriptsyntax as rs
import random

a=random.randint(5,10)
b=random.randint(2,a)
# ---------- end python_nums_4 ----------
Z_18 = UnitZ(Factor=Slider(0.999, range=0.999..1))
brep_35 = Brep(grid_solver_2.Curve)
python_fsr_4 = GhPythonScript()  # -> out, base_fsr, tower_fsr
# ---------- python_fsr_4: Python ----------
__author__ = "Nirvik Saha"
__version__ = "2020.01.25"

import rhinoscriptsyntax as rs
import random

base_fsr=random.random()*3+1.5
tower_fsr=random.random()*7+5.5
# ---------- end python_fsr_4 ----------
python_13 = GhPythonScript(crv=crv_61, setback=Slider(2.798, range=0..5))  # -> out, setback, base_depth; inputs crv: Curve
# ---------- python_13: Python ----------
__author__ = "Nirvik Saha"
__version__ = "2020.01.25"

import rhinoscriptsyntax as rs
import random
p=rs.CurveAreaCentroid(crv)[0]
b=rs.BoundingBox(crv)
li=[b[0],b[1],b[2],b[3],b[0]]
A=rs.Distance(b[0],b[1])
B=rs.Distance(b[1],b[2])
dx=(random.random()*A/7)+A/10
dy=(random.random()*B/7)+B/10
base_depth=min(dx,dy)/6.6
# ---------- end python_13 ----------
extr_18 = Extrude(Base=brep_35, Direction=Z_18)
preview_36 = CustomPreview(Geometry=extr_18, Material=ColourSwatch(SwatchColor=RGB(126, 126, 126)))
staggered_courtyard_normal_6 = StaggeredCourtyardNormal(
    Site=grid_solver_2.Curve,
    Setback=Slider(20, range=0..20),
    BaseDepthOffset=Slider(46.031, range=0..50),
    NumOfTowerFootprintsBaseCrvSubdiv=python_nums_4.a,
    NumberOfTowers=python_nums_4.b,
    FloorFloorHeight=Slider(3, range=0..20),
    BaseFSRFAR=python_fsr_4.base_fsr,
    TowerFSRFAR=python_fsr_4.tower_fsr,
    MinimumAreaSiteCrv=Slider(0, range=0..1500),
    MinimumCourtyardArea=Slider(157.346, range=0..350))  # -> OffsetCurve, BaseFloorCurves, TowerFloorCurves, ExcludedSite, FinalBoundaryRepresentation, FsrVals
number_slider_19 = Slider(10.539, range=0..25)
brep_36 = Brep(staggered_courtyard_normal_6.OffsetCurve)
Z_19 = UnitZ(Factor=Slider(2, range=2..10))
extr_19 = Extrude(Base=brep_36, Direction=Z_19)
python_14 = GhPythonScript(fsr_li=staggered_courtyard_normal_6.FsrVals, site=crv_61)  # -> out, mean_fsr; inputs fsr_li: list, site: Curve
# ---------- python_14: Python ----------
__author__ = "Nirvik Saha"
__version__ = "2020.01.25"

import rhinoscriptsyntax as rs
import Rhino
import scriptcontext
import math

scriptcontext.doc=Rhino.RhinoDoc.ActiveDoc

sum_fsr=0
num_dev=0

for i in fsr_li:
    try:
        sum_fsr+=i
        num_dev+=1
    except:
        pass

mean_fsr=sum_fsr/num_dev
m=round(mean_fsr,2)
r="fsr : " +str(m)

i=0
b=rs.BoundingBox(site)
p=[(b[0][0] + b[2][0])*0.5, (b[0][1]+b[2][1])/2, 0]
rs.AddTextDot(r, p)

scriptcontext.doc=ghdoc
# ---------- end python_14 ----------
preview_37 = CustomPreview(Geometry=staggered_courtyard_normal_6.FinalBoundaryRepresentation, Material=ColourSwatch(SwatchColor=RGB(255, 58, 0)))
preview_38 = CustomPreview(Geometry=extr_19, Material=ColourSwatch(SwatchColor=RGB(0, 249, 0)))

number_slider_20 = Slider(3, range=2..10)
number_slider_21 = Slider(3, range=2..10)
python_15 = GhPythonScript(x=crv_62)  # -> out, num_x, num_y
# ---------- python_15: Python ----------
__author__ = "Nirvik Saha"
__version__ = "2020.01.25"

import rhinoscriptsyntax as rs
import random

num_x=random.randint(2,4)
num_y=random.randint(2,4)
# ---------- end python_15 ----------
path_4 = FilePath("C:\nir_dev\MegaSavageLevel\DotsProjRh6\DotsProj\DotsProj\SourceCode\TEST_SCRIPTS\dots_workflow\inputs\gridSA.csv")
grid_solver_3 = GridAllocationSolver(
    InpFilePath=path_4,
    SiteCurve=crv_62,
    NumberXAxis=python_15.num_x,
    NumberYAxis=python_15.num_y,
    CirculationDepth=Slider(2, range=0..50),
    NumberOfIterations=Slider(2, range=0..50),
    MinimumAreaOfCurve=Slider(32, range=0..50))  # -> CrvNamesColor, ListOfFsr, Curve
Z_20 = UnitZ(Factor=Slider(0.999, range=0.999..1))
python_nums_5 = GhPythonScript()  # -> out, a, b
# ---------- python_nums_5: Python ----------
__author__ = "Nirvik Saha"
__version__ = "2020.01.25"

import rhinoscriptsyntax as rs
import random

a=random.randint(2,10)
b=random.randint(2,a)
# ---------- end python_nums_5 ----------
brep_37 = Brep(grid_solver_3.Curve)
python_fsr_5 = GhPythonScript()  # -> out, base_fsr, tower_fsr
# ---------- python_fsr_5: Python ----------
__author__ = "Nirvik Saha"
__version__ = "2020.01.25"

import rhinoscriptsyntax as rs
import random

base_fsr=random.random()*3+1.5
tower_fsr=random.random()*7+8.5
# ---------- end python_fsr_5 ----------
python_16 = GhPythonScript(crv=crv_62, setback=Slider(2.798, range=0..5))  # -> out, setback, base_depth; inputs crv: Curve
# ---------- python_16: Python ----------
__author__ = "Nirvik Saha"
__version__ = "2020.01.25"

import rhinoscriptsyntax as rs
import random
p=rs.CurveAreaCentroid(crv)[0]
b=rs.BoundingBox(crv)
li=[b[0],b[1],b[2],b[3],b[0]]
A=rs.Distance(b[0],b[1])
B=rs.Distance(b[1],b[2])
dx=(random.random()*A/7)+A/8
dy=(random.random()*B/7)+B/8
base_depth=min(dx,dy)/4
# ---------- end python_16 ----------
extr_20 = Extrude(Base=brep_37, Direction=Z_20)
preview_39 = CustomPreview(Geometry=extr_20, Material=ColourSwatch(SwatchColor=RGB(126, 126, 126)))
staggered_courtyard_normal_7 = StaggeredCourtyardNormal(
    Site=grid_solver_3.Curve,
    Setback=Slider(20, range=0..20),
    BaseDepthOffset=Slider(45, range=0..45),
    NumOfTowerFootprintsBaseCrvSubdiv=python_nums_5.a,
    NumberOfTowers=python_nums_5.b,
    FloorFloorHeight=Slider(3, range=0..20),
    BaseFSRFAR=python_fsr_5.base_fsr,
    TowerFSRFAR=python_fsr_5.tower_fsr,
    MinimumAreaSiteCrv=Slider(0, range=0..1500),
    MinimumCourtyardArea=Slider(79.444, range=0..350))  # -> OffsetCurve, BaseFloorCurves, TowerFloorCurves, ExcludedSite, FinalBoundaryRepresentation, FsrVals
brep_38 = Brep(staggered_courtyard_normal_7.OffsetCurve)
Z_21 = UnitZ(Factor=Slider(2, range=2..10))
number_slider_22 = Slider(10.172, range=0..25)
python_17 = GhPythonScript(fsr_li=staggered_courtyard_normal_7.FsrVals, site=crv_62)  # -> out, mean_fsr; inputs fsr_li: list, site: Curve; same code as python_14
extr_21 = Extrude(Base=brep_38, Direction=Z_21)
preview_40 = CustomPreview(Geometry=staggered_courtyard_normal_7.FinalBoundaryRepresentation, Material=ColourSwatch(SwatchColor=RGB(245, 56, 0)))
preview_41 = CustomPreview(Geometry=extr_21, Material=ColourSwatch(SwatchColor=RGB(0, 249, 0)))

python_18 = GhPythonScript(x=crv_64)  # -> out, num_x, num_y
# ---------- python_18: Python ----------
__author__ = "Nirvik Saha"
__version__ = "2020.01.25"

import rhinoscriptsyntax as rs
import random

num_x=random.randint(2,3)
num_y=random.randint(2,3)
# ---------- end python_18 ----------
path_5 = FilePath("C:\nir_dev\MegaSavageLevel\DotsProjRh6\DotsProj\DotsProj\SourceCode\TEST_SCRIPTS\dots_workflow\inputs\gridSA.csv")
grid_solver_4 = GridAllocationSolver(
    InpFilePath=path_5,
    SiteCurve=crv_64,
    NumberXAxis=python_18.num_x,
    NumberYAxis=python_18.num_y,
    CirculationDepth=Slider(2, range=0..50),
    NumberOfIterations=Slider(2, range=0..50),
    MinimumAreaOfCurve=Slider(32, range=0..50))  # -> CrvNamesColor, ListOfFsr, Curve
Z_22 = UnitZ(Factor=Slider(0.999, range=0.999..1))
brep_39 = Brep(grid_solver_4.Curve)
python_fsr_6 = GhPythonScript()  # -> out, base_fsr, tower_fsr; same code as python_fsr_4
python_19 = GhPythonScript(crv=crv_64, setback=Slider(2.798, range=0..5))  # -> out, setback, base_depth; inputs crv: Curve
# ---------- python_19: Python ----------
__author__ = "Nirvik Saha"
__version__ = "2020.01.25"

import rhinoscriptsyntax as rs
import random
p=rs.CurveAreaCentroid(crv)[0]
b=rs.BoundingBox(crv)
li=[b[0],b[1],b[2],b[3],b[0]]
A=rs.Distance(b[0],b[1])
B=rs.Distance(b[1],b[2])
dx=(random.random()*A/7)+A/7
dy=(random.random()*B/7)+B/7
base_depth=min(dx,dy)/3
# ---------- end python_19 ----------
extr_22 = Extrude(Base=brep_39, Direction=Z_22)
python_nums_6 = GhPythonScript()  # -> out, a, b
# ---------- python_nums_6: Python ----------
__author__ = "Nirvik Saha"
__version__ = "2020.01.25"

import rhinoscriptsyntax as rs
import random

a=random.randint(7,10)
b=random.randint(2,a)
# ---------- end python_nums_6 ----------
preview_42 = CustomPreview(Geometry=extr_22, Material=ColourSwatch(SwatchColor=RGB(126, 126, 126)))
staggered_courtyard_normal_8 = StaggeredCourtyardNormal(
    Site=grid_solver_4.Curve,
    Setback=Slider(8.11, range=0..10),
    BaseDepthOffset=Slider(45, range=0..45),
    NumOfTowerFootprintsBaseCrvSubdiv=python_nums_6.a,
    NumberOfTowers=python_nums_6.b,
    FloorFloorHeight=Slider(3, range=0..20),
    BaseFSRFAR=python_fsr_6.base_fsr,
    TowerFSRFAR=python_fsr_6.tower_fsr,
    MinimumAreaSiteCrv=Slider(0, range=0..1500),
    MinimumCourtyardArea=Slider(1114.893, range=0..5000))  # -> OffsetCurve, BaseFloorCurves, TowerFloorCurves, ExcludedSite, FinalBoundaryRepresentation, FsrVals
brep_40 = Brep(staggered_courtyard_normal_8.OffsetCurve)
Z_23 = UnitZ(Factor=Slider(2, range=2..10))
number_slider_23 = Slider(10.835, range=0..25)
python_20 = GhPythonScript(fsr_li=staggered_courtyard_normal_8.FsrVals, site=crv_64)  # -> out, mean_fsr; inputs fsr_li: list, site: Curve; same code as python_14
extr_23 = Extrude(Base=brep_40, Direction=Z_23)
preview_43 = CustomPreview(Geometry=staggered_courtyard_normal_8.FinalBoundaryRepresentation, Material=ColourSwatch(SwatchColor=RGB(245, 39, 0)))
preview_44 = CustomPreview(Geometry=extr_23, Material=ColourSwatch(SwatchColor=RGB(0, 249, 0)))

number_slider_24 = Slider(3, range=2..10)
number_slider_25 = Slider(2, range=2..10)
python_21 = GhPythonScript(x=crv_65)  # -> out, num_x, num_y
# ---------- python_21: Python ----------
__author__ = "Nirvik Saha"
__version__ = "2020.01.25"

import rhinoscriptsyntax as rs
import random

num_x=random.randint(2,4)
num_y=random.randint(2,3)
# ---------- end python_21 ----------
path_6 = FilePath("C:\nir_dev\MegaSavageLevel\DotsProjRh6\DotsProj\DotsProj\SourceCode\TEST_SCRIPTS\dots_workflow\inputs\gridSA.csv")
grid_solver_5 = GridAllocationSolver(
    InpFilePath=path_6,
    SiteCurve=crv_65,
    NumberXAxis=python_21.num_x,
    NumberYAxis=python_21.num_y,
    CirculationDepth=Slider(2, range=0..50),
    NumberOfIterations=Slider(2, range=0..50),
    MinimumAreaOfCurve=Slider(32, range=0..50))  # -> CrvNamesColor, ListOfFsr, Curve
python_nums_7 = GhPythonScript()  # -> out, a, b; same code as python_nums_4
Z_24 = UnitZ(Factor=Slider(0.999, range=0.999..1))
brep_41 = Brep(grid_solver_5.Curve)
python_fsr_7 = GhPythonScript()  # -> out, base_fsr, tower_fsr
# ---------- python_fsr_7: Python ----------
__author__ = "Nirvik Saha"
__version__ = "2020.01.25"

import rhinoscriptsyntax as rs
import random

base_fsr=random.random()*3+1.5
tower_fsr=random.random()*5+7.5
# ---------- end python_fsr_7 ----------
python_22 = GhPythonScript(crv=crv_65, setback=Slider(2.798, range=0..5))  # -> out, setback, base_depth; inputs crv: Curve; same code as python_19
extr_24 = Extrude(Base=brep_41, Direction=Z_24)
preview_45 = CustomPreview(Geometry=extr_24, Material=ColourSwatch(SwatchColor=RGB(126, 126, 126)))
staggered_courtyard_normal_9 = StaggeredCourtyardNormal(
    Site=grid_solver_5.Curve,
    Setback=Slider(10, range=0..10),
    BaseDepthOffset=Slider(50, range=0..50),
    NumOfTowerFootprintsBaseCrvSubdiv=python_nums_7.a,
    NumberOfTowers=python_nums_7.b,
    FloorFloorHeight=Slider(3, range=0..20),
    BaseFSRFAR=python_fsr_7.base_fsr,
    TowerFSRFAR=python_fsr_7.tower_fsr,
    MinimumAreaSiteCrv=Slider(0, range=0..1500),
    MinimumCourtyardArea=Slider(79.444, range=0..350))  # -> OffsetCurve, BaseFloorCurves, TowerFloorCurves, ExcludedSite, FinalBoundaryRepresentation, FsrVals
number_slider_26 = Slider(10.477, range=0..25)
brep_42 = Brep(staggered_courtyard_normal_9.OffsetCurve)
Z_25 = UnitZ(Factor=Slider(2, range=2..10))
python_23 = GhPythonScript(fsr_li=staggered_courtyard_normal_9.FsrVals, site=crv_65)  # -> out, mean_fsr; inputs fsr_li: list, site: Curve; same code as python_14
preview_46 = CustomPreview(Geometry=staggered_courtyard_normal_9.FinalBoundaryRepresentation, Material=ColourSwatch(SwatchColor=RGB(245, 70, 0)))
extr_25 = Extrude(Base=brep_42, Direction=Z_25)
preview_47 = CustomPreview(Geometry=extr_25, Material=ColourSwatch(SwatchColor=RGB(0, 249, 0)))

number_slider_27 = Slider(3, range=2..10)
number_slider_28 = Slider(3, range=2..10)
python_24 = GhPythonScript(x=crv_63)  # -> out, num_x, num_y; same code as python_15
path_7 = FilePath("C:\nir_dev\MegaSavageLevel\DotsProjRh6\DotsProj\DotsProj\SourceCode\TEST_SCRIPTS\dots_workflow\inputs\gridSA.csv")
grid_solver_6 = GridAllocationSolver(
    InpFilePath=path_7,
    SiteCurve=crv_63,
    NumberXAxis=python_24.num_x,
    NumberYAxis=python_24.num_y,
    CirculationDepth=Slider(2, range=0..50),
    NumberOfIterations=Slider(2, range=0..50),
    MinimumAreaOfCurve=Slider(32, range=0..50))  # -> CrvNamesColor, ListOfFsr, Curve
python_nums_8 = GhPythonScript()  # -> out, a, b; same code as python_nums_5
Z_26 = UnitZ(Factor=Slider(0.999, range=0.999..1))
brep_43 = Brep(grid_solver_6.Curve)
python_fsr_8 = GhPythonScript()  # -> out, base_fsr, tower_fsr
# ---------- python_fsr_8: Python ----------
__author__ = "Nirvik Saha"
__version__ = "2020.01.25"

import rhinoscriptsyntax as rs
import random

base_fsr=random.random()*3+1.5
tower_fsr=random.random()*7+3.5
# ---------- end python_fsr_8 ----------
python_25 = GhPythonScript(crv=crv_63, setback=Slider(2.798, range=0..5))  # -> out, setback, base_depth; inputs crv: Curve
# ---------- python_25: Python ----------
__author__ = "Nirvik Saha"
__version__ = "2020.01.25"

import rhinoscriptsyntax as rs
import random
p=rs.CurveAreaCentroid(crv)[0]
b=rs.BoundingBox(crv)
li=[b[0],b[1],b[2],b[3],b[0]]
A=rs.Distance(b[0],b[1])
B=rs.Distance(b[1],b[2])
dx=(random.random()*A/7)+A/9
dy=(random.random()*B/7)+B/9
base_depth=min(dx,dy)/4.5
# ---------- end python_25 ----------
extr_26 = Extrude(Base=brep_43, Direction=Z_26)
preview_48 = CustomPreview(Geometry=extr_26, Material=ColourSwatch(SwatchColor=RGB(126, 126, 126)))
staggered_courtyard_normal_10 = StaggeredCourtyardNormal(
    Site=grid_solver_6.Curve,
    Setback=Slider(10, range=0..10),
    BaseDepthOffset=Slider(50, range=0..50),
    NumOfTowerFootprintsBaseCrvSubdiv=python_nums_8.a,
    NumberOfTowers=python_nums_8.b,
    FloorFloorHeight=Slider(3, range=0..20),
    BaseFSRFAR=python_fsr_8.base_fsr,
    TowerFSRFAR=python_fsr_8.tower_fsr,
    MinimumAreaSiteCrv=Slider(0, range=0..1500),
    MinimumCourtyardArea=Slider(70.311, range=0..350))  # -> OffsetCurve, BaseFloorCurves, TowerFloorCurves, ExcludedSite, FinalBoundaryRepresentation, FsrVals
number_slider_29 = Slider(9.128, range=0..25)
brep_44 = Brep(staggered_courtyard_normal_10.OffsetCurve)
Z_27 = UnitZ(Factor=Slider(2, range=2..10))
python_26 = GhPythonScript(fsr_li=staggered_courtyard_normal_10.FsrVals, site=crv_63)  # -> out, mean_fsr; inputs fsr_li: list, site: Curve; same code as python_14
extr_27 = Extrude(Base=brep_44, Direction=Z_27)
preview_49 = CustomPreview(Geometry=staggered_courtyard_normal_10.FinalBoundaryRepresentation, Material=ColourSwatch(SwatchColor=RGB(237, 12, 0)))
preview_50 = CustomPreview(Geometry=extr_27, Material=ColourSwatch(SwatchColor=RGB(0, 249, 0)))

number_slider_30 = Slider(2, range=2..10)
number_slider_31 = Slider(3, range=2..10)
python_27 = GhPythonScript(x=crv_66)  # -> out, num_x, num_y
# ---------- python_27: Python ----------
__author__ = "Nirvik Saha"
__version__ = "2020.01.25"

import rhinoscriptsyntax as rs
import random

num_x=random.randint(2,2)
num_y=random.randint(2,3)
# ---------- end python_27 ----------
path_8 = FilePath("C:\nir_dev\MegaSavageLevel\DotsProjRh6\DotsProj\DotsProj\SourceCode\TEST_SCRIPTS\dots_workflow\inputs\gridSA.csv")
grid_solver_7 = GridAllocationSolver(
    InpFilePath=path_8,
    SiteCurve=crv_66,
    NumberXAxis=python_27.num_x,
    NumberYAxis=python_27.num_y,
    CirculationDepth=Slider(2, range=0..50),
    NumberOfIterations=Slider(2, range=0..50),
    MinimumAreaOfCurve=Slider(32, range=0..50))  # -> CrvNamesColor, ListOfFsr, Curve
python_nums_9 = GhPythonScript()  # -> out, a, b; same code as python_nums_5
Z_28 = UnitZ(Factor=Slider(0.999, range=0.999..1))
brep_45 = Brep(grid_solver_7.Curve)
python_fsr_9 = GhPythonScript()  # -> out, base_fsr, tower_fsr
# ---------- python_fsr_9: Python ----------
__author__ = "Nirvik Saha"
__version__ = "2020.01.25"

import rhinoscriptsyntax as rs
import random

base_fsr=random.random()*3+1.5
tower_fsr=random.random()*10+4.5
# ---------- end python_fsr_9 ----------
python_28 = GhPythonScript(crv=crv_66, setback=Slider(2.798, range=0..5))  # -> out, setback, base_depth; inputs crv: Curve
# ---------- python_28: Python ----------
__author__ = "Nirvik Saha"
__version__ = "2020.01.25"

import rhinoscriptsyntax as rs
import random
p=rs.CurveAreaCentroid(crv)[0]
b=rs.BoundingBox(crv)
li=[b[0],b[1],b[2],b[3],b[0]]
A=rs.Distance(b[0],b[1])
B=rs.Distance(b[1],b[2])
dx=(random.random()*A/7)+A/7
dy=(random.random()*B/7)+B/7
base_depth=min(dx,dy)/3.5
# ---------- end python_28 ----------
extr_28 = Extrude(Base=brep_45, Direction=Z_28)
preview_51 = CustomPreview(Geometry=extr_28, Material=ColourSwatch(SwatchColor=RGB(126, 126, 126)))
staggered_courtyard_normal_11 = StaggeredCourtyardNormal(
    Site=grid_solver_7.Curve,
    Setback=Slider(10, range=0..10),
    BaseDepthOffset=Slider(41.002, range=0..50),
    NumOfTowerFootprintsBaseCrvSubdiv=python_nums_9.a,
    NumberOfTowers=python_nums_9.b,
    FloorFloorHeight=Slider(3, range=0..20),
    BaseFSRFAR=python_fsr_9.base_fsr,
    TowerFSRFAR=python_fsr_9.tower_fsr,
    MinimumAreaSiteCrv=Slider(0, range=0..1500),
    MinimumCourtyardArea=Slider(112.051, range=0..350))  # -> OffsetCurve, BaseFloorCurves, TowerFloorCurves, ExcludedSite, FinalBoundaryRepresentation, FsrVals
python_29 = GhPythonScript(fsr_li=staggered_courtyard_normal_11.FsrVals, site=crv_66)  # -> out, mean_fsr; inputs fsr_li: list, site: Curve; same code as python_14
preview_52 = CustomPreview(Geometry=staggered_courtyard_normal_11.FinalBoundaryRepresentation, Material=ColourSwatch(SwatchColor=RGB(206, 115, 0)))
brep_46 = Brep(staggered_courtyard_normal_11.OffsetCurve)
Z_29 = UnitZ(Factor=Slider(2, range=2..10))
number_slider_32 = Slider(10.385, range=0..25)
extr_29 = Extrude(Base=brep_46, Direction=Z_29)
preview_53 = CustomPreview(Geometry=extr_29, Material=ColourSwatch(SwatchColor=RGB(0, 249, 0)))

number_slider_33 = Slider(2, range=2..10)
number_slider_34 = Slider(2, range=2..10)
python_30 = GhPythonScript(x=crv_67)  # -> out, num_x, num_y; same code as python_15
path_9 = FilePath("C:\nir_dev\MegaSavageLevel\DotsProjRh6\DotsProj\DotsProj\SourceCode\TEST_SCRIPTS\dots_workflow\inputs\gridSA.csv")
grid_solver_8 = GridAllocationSolver(
    InpFilePath=path_9,
    SiteCurve=crv_67,
    NumberXAxis=python_30.num_x,
    NumberYAxis=python_30.num_y,
    CirculationDepth=Slider(2, range=0..50),
    NumberOfIterations=Slider(2, range=0..50),
    MinimumAreaOfCurve=Slider(32, range=0..50))  # -> CrvNamesColor, ListOfFsr, Curve
python_nums_10 = GhPythonScript()  # -> out, a, b
# ---------- python_nums_10: Python ----------
__author__ = "Nirvik Saha"
__version__ = "2020.01.25"

import rhinoscriptsyntax as rs
import random

a=random.randint(5,10)
b=random.randint(2,a)

print(a,b)
# ---------- end python_nums_10 ----------
Z_30 = UnitZ(Factor=Slider(0.999, range=0.999..1))
brep_47 = Brep(grid_solver_8.Curve)
python_fsr_10 = GhPythonScript()  # -> out, base_fsr, tower_fsr
# ---------- python_fsr_10: Python ----------
__author__ = "Nirvik Saha"
__version__ = "2020.01.25"

import rhinoscriptsyntax as rs
import random

base_fsr=random.random()*3+2.5
tower_fsr=random.random()*2+6.5
# ---------- end python_fsr_10 ----------
python_31 = GhPythonScript(crv=crv_67, setback=Slider(2.798, range=0..5))  # -> out, setback, base_depth; inputs crv: Curve; same code as python_19
extr_30 = Extrude(Base=brep_47, Direction=Z_30)
preview_54 = CustomPreview(Geometry=extr_30, Material=ColourSwatch(SwatchColor=RGB(126, 126, 126)))
staggered_courtyard_normal_12 = StaggeredCourtyardNormal(
    Site=grid_solver_8.Curve,
    Setback=Slider(8.111, range=0..10),
    BaseDepthOffset=Slider(49.478, range=0..50),
    NumOfTowerFootprintsBaseCrvSubdiv=python_nums_10.a,
    NumberOfTowers=python_nums_10.b,
    FloorFloorHeight=Slider(3, range=0..20),
    BaseFSRFAR=python_fsr_10.base_fsr,
    TowerFSRFAR=python_fsr_10.tower_fsr,
    MinimumAreaSiteCrv=Slider(0, range=0..1500),
    MinimumCourtyardArea=Slider(132.518, range=0..350))  # -> OffsetCurve, BaseFloorCurves, TowerFloorCurves, ExcludedSite, FinalBoundaryRepresentation, FsrVals
number_slider_35 = Slider(10.186, range=0..25)
brep_48 = Brep(staggered_courtyard_normal_12.OffsetCurve)
Z_31 = UnitZ(Factor=Slider(2, range=2..10))
python_32 = GhPythonScript(fsr_li=staggered_courtyard_normal_12.FsrVals, site=crv_67)  # -> out, mean_fsr; inputs fsr_li: list, site: Curve; same code as python_14
preview_55 = CustomPreview(Geometry=staggered_courtyard_normal_12.FinalBoundaryRepresentation, Material=ColourSwatch(SwatchColor=RGB(208, 117, 0)))
extr_31 = Extrude(Base=brep_48, Direction=Z_31)
preview_56 = CustomPreview(Geometry=extr_31, Material=ColourSwatch(SwatchColor=RGB(0, 249, 0)))

python_33 = GhPythonScript(crv=staggered_courtyard_normal_11.TowerFloorCurves)  # -> out, fsr; inputs crv: Curve
# ---------- python_33: Python ----------
__author__ = "Nirvik Saha"
__version__ = "2020.01.25"

import rhinoscriptsyntax as rs
import random
fsr=random.random()*15+2
# ---------- end python_33 ----------
python_34 = GhPythonScript(crv=staggered_courtyard_normal_6.TowerFloorCurves)  # -> out, fsr; inputs crv: Curve; same code as python_33
python_35 = GhPythonScript(crv=staggered_courtyard_normal_7.TowerFloorCurves)  # -> out, fsr; inputs crv: Curve; same code as python_33
python_36 = GhPythonScript(crv=staggered_courtyard_normal_10.TowerFloorCurves)  # -> out, fsr; inputs crv: Curve; same code as python_33
python_37 = GhPythonScript(crv=staggered_courtyard_normal_8.TowerFloorCurves)  # -> out, fsr; inputs crv: Curve; same code as python_33
python_38 = GhPythonScript(crv=staggered_courtyard_normal_9.TowerFloorCurves)  # -> out, fsr; inputs crv: Curve; same code as python_33
python_39 = GhPythonScript(crv=staggered_courtyard_normal_12.TowerFloorCurves)  # -> out, fsr; inputs crv: Curve; same code as python_33

block_8 = MassingExtrudeBlock(
    SiteCurve=staggered_courtyard_normal_6.ExcludedSite,
    Setback=Slider(8.111, range=0..10),
    FsrFar=python_34.fsr,
    FLRHT=Slider(3, range=0..3),
    MinCrvArea=Slider(1376.367, range=0..1500))  # -> OutputMassingBreps, OutputFloorCurves
brep_49 = Brep(block_8.OutputMassingBreps)
preview_57 = CustomPreview(Geometry=brep_49, Material=ColourSwatch(SwatchColor=RGB(72, 197, 251)))

block_9 = MassingExtrudeBlock(
    SiteCurve=staggered_courtyard_normal_7.ExcludedSite,
    Setback=Slider(8.111, range=0..10),
    FsrFar=python_35.fsr,
    FLRHT=Slider(3, range=0..3),
    MinCrvArea=Slider(1092.308, range=0..1500))  # -> OutputMassingBreps, OutputFloorCurves
brep_50 = Brep(block_9.OutputMassingBreps)
preview_58 = CustomPreview(Geometry=brep_50, Material=ColourSwatch(SwatchColor=RGB(72, 197, 251)))

block_10 = MassingExtrudeBlock(
    SiteCurve=staggered_courtyard_normal_10.ExcludedSite,
    Setback=Slider(8.111, range=0..10),
    FsrFar=python_36.fsr,
    FLRHT=Slider(3, range=0..3),
    MinCrvArea=Slider(1059.375, range=0..1500))  # -> OutputMassingBreps, OutputFloorCurves
brep_51 = Brep(block_10.OutputMassingBreps)
preview_59 = CustomPreview(Geometry=brep_51, Material=ColourSwatch(SwatchColor=RGB(72, 197, 251)))

block_11 = MassingExtrudeBlock(
    SiteCurve=staggered_courtyard_normal_9.ExcludedSite,
    Setback=Slider(8.111, range=0..10),
    FsrFar=python_38.fsr,
    FLRHT=Slider(3, range=0..3),
    MinCrvArea=Slider(1029.609, range=0..1500))  # -> OutputMassingBreps, OutputFloorCurves
brep_52 = Brep(block_11.OutputMassingBreps)
preview_60 = CustomPreview(Geometry=brep_52, Material=ColourSwatch(SwatchColor=RGB(72, 197, 251)))

block_12 = MassingExtrudeBlock(
    SiteCurve=staggered_courtyard_normal_8.ExcludedSite,
    Setback=Slider(8.111, range=0..10),
    FsrFar=python_37.fsr,
    FLRHT=Slider(3, range=0..3),
    MinCrvArea=Slider(858.589, range=0..1500))  # -> OutputMassingBreps, OutputFloorCurves
brep_53 = Brep(block_12.OutputMassingBreps)
preview_61 = CustomPreview(Geometry=brep_53, Material=ColourSwatch(SwatchColor=RGB(72, 197, 251)))

block_13 = MassingExtrudeBlock(
    SiteCurve=staggered_courtyard_normal_12.ExcludedSite,
    Setback=Slider(8.111, range=0..10),
    FsrFar=python_39.fsr,
    FLRHT=Slider(3, range=0..3),
    MinCrvArea=Slider(939.609, range=0..1500))  # -> OutputMassingBreps, OutputFloorCurves
brep_54 = Brep(block_13.OutputMassingBreps)
preview_62 = CustomPreview(Geometry=brep_54, Material=ColourSwatch(SwatchColor=RGB(72, 197, 251)))

block_14 = MassingExtrudeBlock(
    SiteCurve=staggered_courtyard_normal_11.ExcludedSite,
    Setback=Slider(5.534, range=0..10),
    FsrFar=python_33.fsr,
    FLRHT=Slider(3, range=0..3),
    MinCrvArea=Slider(947.959, range=0..1500))  # -> OutputMassingBreps, OutputFloorCurves
brep_55 = Brep(block_14.OutputMassingBreps)
preview_63 = CustomPreview(Geometry=brep_55, Material=ColourSwatch(SwatchColor=RGB(72, 197, 251)))
