# Grasshopper definition test.gh (Grasshopper 1.0.7)
# plug-ins: DotsProj

number_slider = Slider(18, range=0..30)
number_slider_2 = Slider(1, range=1..10)
number_slider_3 = Slider(2, range=1..10)
geomsample = FilePath("C:\nir_dev\MegaSavageLevel\DotsProjRh6\DotsProj\DotsProj\bin\dots_workflow\jh_inputs\geomSample.csv")
crv = Curve(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)  # disabled
# three-part solver
panel = Panel(geomsample)
gen_spaces_p = GenerateEqualPeripheralSpaces(
    InputGeometryFilePath=geomsample,
    InputSiteCurve=crv,
    FromSiteCurveOuterCirculationDepth=number_slider_2,
    FromOuterCirculationBayDepth=number_slider,
    FromBayDepthInnerCirculationDepth=number_slider_3)  # -> OutputCurves, OutputNames, DebugStr, OuterBayCrv, InnerBayCrv, InnerCirculationCrv
adjsample = FilePath("C:\nir_dev\MegaSavageLevel\DotsProjRh6\DotsProj\DotsProj\bin\dots_workflow\jh_inputs\adjSample.csv")
panel_2 = Panel(adjsample)
adj_solver = AdjSolver(
    InputAdjacencyFilePath=adjsample,
    ExistingCrvList=gen_spaces_p.OutputCurves,
    CorrespondingNameList=gen_spaces_p.OutputNames,
    NumberOfIterations=Slider(500, range=0..500),
    ClearPreviousValues=Toggle(True),
    RandomizeAdjRels=Toggle(False),
    RunSolver=Toggle(True))  # -> OutputCurves, OutputNames, MsgNumItrs
geom_solver_q = GeometrySolverPeripheral(
    InputGeometryFilePath=geomsample,
    InputSiteCurve=crv,
    CorrespondingNameList=adj_solver.OutputNames,
    FromSiteCurveOuterCirculationDepth=number_slider_2,
    FromOuterCirculationBayDepth=number_slider,
    FromBayDepthInnerCirculationDepth=number_slider_3,
    Sensitivity=Slider(473, range=0..500))  # -> OutputCurves, OutputNames, DebugStr, DebugOuter, DebugInner
colors = FilePath("C:\nir_dev\MegaSavageLevel\DotsProjRh6\DotsProj\DotsProj\bin\dots_workflow\jh_inputs\colors.csv")
color_input_parser = ColorInput(InpFilePath=colors, ListSpaceKeysNames=geom_solver_q.OutputNames, ListSpaceCrvs=geom_solver_q.OutputCurves)  # -> BrepFromCrvs, ColorStr
panel_3 = Panel(colors)
preview = CustomPreview(Geometry=color_input_parser.BrepFromCrvs, Material=color_input_parser.ColorStr)

combined_geom_adj = FilePath("C:\nir_dev\MegaSavageLevel\DotsProjRh6\DotsProj\DotsProj\bin\dots_workflow\jh_inputs\combined_geom_adj.csv")
crv_2 = Curve([<curve referenced from the Rhino model> x3])
panel_4 = Panel(combined_geom_adj)
crv_boundary = CrvBoundary(
    InpFilePath=combined_geom_adj,
    InpSiteCurve=crv_2,
    FromSiteOuterCirculationDepth=Slider(30, range=1..30),
    FromOuterCirculationBayDepth=Slider(195, range=0..500),
    FromBayDepthInnerCirculationDepth=Slider(43, range=0..500),
    SensitivityX100=Slider(9, range=0..1250),
    OptimizationItrs=Slider(150, range=0..150))  # -> OuterOffsetCrv, InnerOffsetCrv, RESULTSegGeom, CrvNamesColor
colors_2 = FilePath("C:\nir_dev\MegaSavageLevel\DotsProjRh6\DotsProj\DotsProj\bin\dots_workflow\jh_inputs\colors.csv")
color_input_parser_2 = ColorInput(InpFilePath=colors_2, ListSpaceKeysNames=crv_boundary.CrvNamesColor, ListSpaceCrvs=crv_boundary.RESULTSegGeom)  # -> BrepFromCrvs, ColorStr
panel_5 = Panel(colors_2)
preview_2 = CustomPreview(Geometry=color_input_parser_2.BrepFromCrvs, Material=color_input_parser_2.ColorStr)

# ----
# single component: High "sensitivity"
combined_geom_adj_2 = FilePath("C:\nir_dev\MegaSavageLevel\DotsProjRh6\DotsProj\DotsProj\bin\dots_workflow\jh_inputs\combined_geom_adj.csv")
crv_3 = Curve(<curve referenced from the Rhino model>)
panel_6 = Panel(combined_geom_adj_2)
crv_boundary_2 = CrvBoundary(
    InpFilePath=combined_geom_adj_2,
    InpSiteCurve=crv_3,
    FromSiteOuterCirculationDepth=Slider(30, range=1..30),
    FromOuterCirculationBayDepth=Slider(195, range=0..500),
    FromBayDepthInnerCirculationDepth=Slider(43, range=0..500),
    SensitivityX100=Slider(9, range=0..1250),
    OptimizationItrs=Slider(86, range=0..15000))  # -> OuterOffsetCrv, InnerOffsetCrv, RESULTSegGeom, CrvNamesColor
colors_3 = FilePath("C:\nir_dev\MegaSavageLevel\DotsProjRh6\DotsProj\DotsProj\bin\dots_workflow\jh_inputs\colors.csv")
color_input_parser_3 = ColorInput(InpFilePath=colors_3, ListSpaceKeysNames=crv_boundary_2.CrvNamesColor, ListSpaceCrvs=crv_boundary_2.RESULTSegGeom)  # -> BrepFromCrvs, ColorStr
panel_7 = Panel(colors_3)
preview_3 = CustomPreview(Geometry=color_input_parser_3.BrepFromCrvs, Material=color_input_parser_3.ColorStr)

combined_geom_adj_3 = FilePath("C:\nir_dev\MegaSavageLevel\DotsProjRh6\DotsProj\DotsProj\bin\dots_workflow\jh_inputs\combined_geom_adj.csv")
crv_4 = Curve([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])
panel_8 = Panel(combined_geom_adj_3)
crv_boundary_3 = CrvBoundary(
    InpFilePath=combined_geom_adj_3,
    InpSiteCurve=crv_4,
    FromSiteOuterCirculationDepth=Slider(30, range=1..30),
    FromOuterCirculationBayDepth=Slider(100, range=0..100),
    FromBayDepthInnerCirculationDepth=Slider(43, range=0..500),
    SensitivityX100=Slider(9, range=0..1250),
    OptimizationItrs=Slider(150, range=0..150))  # -> OuterOffsetCrv, InnerOffsetCrv, RESULTSegGeom, CrvNamesColor
colors_4 = FilePath("C:\nir_dev\MegaSavageLevel\DotsProjRh6\DotsProj\DotsProj\bin\dots_workflow\jh_inputs\colors.csv")
color_input_parser_4 = ColorInput(InpFilePath=colors_4, ListSpaceKeysNames=crv_boundary_3.CrvNamesColor, ListSpaceCrvs=crv_boundary_3.RESULTSegGeom)  # -> BrepFromCrvs, ColorStr
panel_9 = Panel(colors_4)
preview_4 = CustomPreview(Geometry=color_input_parser_4.BrepFromCrvs, Material=color_input_parser_4.ColorStr)

number_slider_4 = Slider(0, range=0..500)
crv_5 = Curve(<curve referenced from the Rhino model>)
combined_geom_adj_4 = FilePath("C:\nir_dev\MegaSavageLevel\DotsProjRh6\DotsProj\DotsProj\bin\dots_workflow\jh_inputs\combined_geom_adj.csv")
combined_geom_adj_5 = FilePath("C:\nir_dev\MegaSavageLevel\DotsProjRh6\DotsProj\DotsProj\bin\dots_workflow\jh_inputs\combined_geom_adj.csv")
cbsp = CbspIndependent(
    InputFilesCsv=combined_geom_adj_5,
    RotationInDegrees=Slider(57, range=1..100),
    RatioLengthWidth=Slider(1.059, range=0..2),
    RandomizedGenerations=Toggle(False),
    NumberOfOptimizationLoops=Slider(4, range=0..500))  # -> OuterBoundary, BspOutputCurves, PartitionLines, CrvNamesColor
oc_double = OpenCurveDouble(
    InpFilePath=combined_geom_adj_4,
    BayDepth=Slider(336, range=0..500),
    CorridorDepth=Slider(57, range=1..100),
    BaseCurve=crv_5,
    NumberOfIterations=Slider(8, range=0..500),
    SensitivityMin100=Slider(500, range=0..500))  # -> CrvNamesColor, SpacesGeom, CellsPoly, SpacesCrvs
crv_6 = Curve(oc_double.SpacesCrvs)
crv_7 = Curve(crv_boundary_2.InnerOffsetCrv)
crv_8 = Curve(crv_boundary_3.InnerOffsetCrv)
crv_9 = Curve(crv_boundary.InnerOffsetCrv)
colors_5 = FilePath("C:\nir_dev\MegaSavageLevel\DotsProjRh6\DotsProj\DotsProj\bin\dots_workflow\jh_inputs\colors.csv")
color_input_parser_5 = ColorInput(InpFilePath=colors_5, ListSpaceKeysNames=oc_double.CrvNamesColor, ListSpaceCrvs=oc_double.SpacesCrvs)  # -> BrepFromCrvs, ColorStr
preview_5 = CustomPreview(Geometry=color_input_parser_5.BrepFromCrvs, Material=color_input_parser_5.ColorStr)
