# Grasshopper definition CIRCLE_new_sol.gh (Grasshopper 1.0.7)
# plug-ins: DotsProj

rushgeomperipheralinput = FilePath("C:\nir_dev\MegaSavageLevel\DotsProjRh6\DotsProj\DotsProj\SourceCode\TEST_SCRIPTS\rush\core_solvers\rushGeomPeripheralInput.csv")
site_crv = Curve(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)
gen_spaces_p = GenerateEqualPeripheralSpaces(
    InputGeometryFilePath=rushgeomperipheralinput,
    InputSiteCurve=site_crv,
    FromSiteCurveOuterCirculationDepth=Slider(7, range=0..50),
    FromOuterCirculationBayDepth=Slider(28, range=0..50),
    FromBayDepthInnerCirculationDepth=Slider(7, range=0..50))  # -> OutputCurves, OutputNames, DebugStr, OuterBayCrv, InnerBayCrv, InnerCirculationCrv
python_bbx = GhPythonScript(x=site_crv)  # -> out, a
# ---------- python_bbx: Python ----------
__author__ = "Nirvik Saha"
__version__ = "2020.01.23"

import rhinoscriptsyntax as rs
b=rs.BoundingBox(x)
pts=[b[0],b[1],b[2],b[3],b[0]]
poly=rs.AddPolyline(pts)
a=poly
# ---------- end python_bbx ----------
crv = Curve(python_bbx.a)
crv_2 = Curve(gen_spaces_p.OutputCurves)
crv_3 = Curve(gen_spaces_p.InnerCirculationCrv)
rushadjperipheralinput = FilePath("C:\nir_dev\MegaSavageLevel\DotsProjRh6\DotsProj\DotsProj\SourceCode\TEST_SCRIPTS\rush\core_solvers\rushAdjPeripheralInput.csv")
adj_solver = AdjSolver(
    InputAdjacencyFilePath=rushadjperipheralinput,
    ExistingCrvList=crv_2,
    CorrespondingNameList=gen_spaces_p.OutputNames,
    NumberOfIterations=Slider(3, range=0..50),
    ClearPreviousValues=Toggle(False),
    RandomizeAdjRels=Toggle(True),
    RunSolver=Toggle(True))  # -> OutputCurves, OutputNames, MsgNumItrs
colors_rushperipheral = FilePath("C:\nir_dev\MegaSavageLevel\DotsProjRh6\DotsProj\DotsProj\SourceCode\TEST_SCRIPTS\rush\core_solvers\colors_rushPeripheral.csv")
color_input_parser = ColorInput(InpFilePath=colors_rushperipheral, ListSpaceKeysNames=adj_solver.OutputNames, ListSpaceCrvs=adj_solver.OutputCurves)  # -> BrepFromCrvs, ColorStr
python_check_missing_names = GhPythonScript()  # -> out, NotIncluded, SepNames; inputs solverCrvs: list, actualCrvs: list; disabled
# ---------- python_check_missing_names: Python ----------
__author__ = "Nirvik Saha"
__version__ = "2020.01.22"

import rhinoscriptsyntax as rs

ind_actual_crvs=[]
for j in actualCrvs:
    if(j not in ind_actual_crvs):
        ind_actual_crvs.append(j)

SepNames=ind_actual_crvs

li=[]
for i in SepNames:
    if(i not in solverCrvs):
        li.append(i)

NotIncluded=li
# ---------- end python_check_missing_names ----------
panel = Panel(python_check_missing_names.NotIncluded)
preview = CustomPreview(Geometry=color_input_parser.BrepFromCrvs, Material=color_input_parser.ColorStr)

timer = Timer(TimerInterval=1000)
bbox_python = GhPythonScript(x=crv_3)  # -> out, a; disabled
# ---------- bbox_python: Python ----------
__author__ = "Nirvik Saha"
__version__ = "2020.01.23"

import rhinoscriptsyntax as rs

b=rs.BoundingBox(x)
pts=[b[0], b[1], b[2],b[3], b[0]]
poly=rs.AddPolyline(pts)

a= poly
# ---------- end bbox_python ----------
crv_4 = Curve(bbox_python.a)
circulationcrv_intr = Curve([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])
site_partition_circulation = SitePartitionCirculation(
    SiteCurve=crv_3,
    CirculationCurve=circulationcrv_intr,
    CirculationDepth=Slider(2, range=0..2),
    MinimumAreaPartition=Slider(0, range=0..2))  # -> DebugText, CirculationCurves, PartitionCurves
crv_5 = Curve(site_partition_circulation.PartitionCurves)
item = ListItem(List=crv_5, Index=Slider(3, range=0..4), Wrap=True)
offset = OffsetCurve(Curve=item, Distance=Slider(2, range=-4..4), Plane=PlaneXY(0, 0, 0), Corners=1)
crv_6 = Curve(site_partition_circulation.PartitionCurves)
rushintermediatezoneinput = FilePath("C:\nir_dev\MegaSavageLevel\DotsProjRh6\DotsProj\DotsProj\SourceCode\TEST_SCRIPTS\rush\core_solvers\rushIntermediateZoneInput.csv")
number_slider = Slider(-2, range=-4..4)
radial_zone_core = RadialZoneCore(
    InputFilesCsv=rushintermediatezoneinput,
    InputSiteCrv=offset,
    CoreArea=Slider(3000, range=0..10000),
    MoveCoreHorizontal=Slider(0, range=0..50),
    MoveCoreVertical=Slider(0, range=0..50),
    CoreAspectRatio=Slider(1.505, range=0..2),
    RotationInDegrees=Slider(0, range=0..360))  # -> CoreCrv, ZoneCrvsRad, CrvNamesColor
crv_7 = Curve(radial_zone_core.ZoneCrvsRad)
item_2 = ListItem(List=crv_6, Index=Slider(4, range=0..4), Wrap=True)
offset_2 = OffsetCurve(Curve=item_2, Distance=Slider(-2, range=-4..4), Plane=PlaneXY(0, 0, 0), Corners=1)
item_3 = ListItem(List=crv_6, Index=Slider(2, range=0..4), Wrap=True)
item_4 = ListItem(List=crv_6, Index=Slider(1, range=0..4), Wrap=True)
offset_3 = OffsetCurve(Curve=item_3, Distance=Slider(-2, range=-4..4), Plane=PlaneXY(0, 0, 0), Corners=1)
item_5 = ListItem(List=crv_6, Index=Slider(0, range=0..4), Wrap=True)
offset_4 = OffsetCurve(Curve=item_4, Distance=Slider(-2, range=-4..4), Plane=PlaneXY(0, 0, 0), Corners=1)
offset_5 = OffsetCurve(Curve=item_5, Distance=Slider(-2, range=-4..4), Plane=PlaneXY(0, 0, 0), Corners=1)
item_6 = ListItem(List=radial_zone_core.CoreCrv, Index=Slider(0, range=0..4), Wrap=True)

corner_4 = Curve(offset_3)
corner_adj = FilePath("C:\nir_dev\MegaSavageLevel\DotsProjRh6\DotsProj\DotsProj\SourceCode\TEST_SCRIPTS\rush\core_solvers\rush_z1_CornerAdjInput.csv")
cor_geom = FilePath("C:\nir_dev\MegaSavageLevel\DotsProjRh6\DotsProj\DotsProj\SourceCode\TEST_SCRIPTS\rush\core_solvers\rush_z1_CornerGeomInput.csv")
bsp_solver = BSPSolver(
    InputADJACENCYFilePath=corner_adj,
    InputGEOMETRYFilePath=cor_geom,
    Site=corner_4,
    Sensitivity=Slider(0, range=0..360),
    RotationInDegrees=Slider(0, range=0..360),
    NumberOfIterations=Slider(0, range=0..20),
    ClearAllValues=Toggle(True),
    RunSolver=Toggle(True),
    RunSolver_2=Toggle(True))  # -> DebugStr, Curves, CrvNames, PartitionLines
circulation = GenerateCirculation(
    SiteCrvOuterBoundary=corner_4,
    CbspCrvs=bsp_solver.Curves,
    PartitionLines=bsp_solver.PartitionLines,
    CirculationDepth=Slider(2.225, range=0..5))  # -> _0PartitionLines, _1CirculationPoly, _2ResultantCbspCrv
z1_corner_color = FilePath("C:\nir_dev\MegaSavageLevel\DotsProjRh6\DotsProj\DotsProj\SourceCode\TEST_SCRIPTS\rush\core_solvers\rush_z1_corner_Colors.csv")
color_input_parser_2 = ColorInput(InpFilePath=z1_corner_color, ListSpaceKeysNames=bsp_solver.CrvNames, ListSpaceCrvs=circulation._2ResultantCbspCrv)  # -> BrepFromCrvs, ColorStr
preview_2 = CustomPreview(Geometry=color_input_parser_2.BrepFromCrvs, Material=color_input_parser_2.ColorStr)

corner_4_2 = Curve(offset_2)
corner_adj_2 = FilePath("C:\nir_dev\MegaSavageLevel\DotsProjRh6\DotsProj\DotsProj\SourceCode\TEST_SCRIPTS\rush\core_solvers\rush_z1_CornerAdjInput.csv")
cor_geom_2 = FilePath("C:\nir_dev\MegaSavageLevel\DotsProjRh6\DotsProj\DotsProj\SourceCode\TEST_SCRIPTS\rush\core_solvers\rush_z1_CornerGeomInput.csv")
bsp_solver_2 = BSPSolver(
    InputADJACENCYFilePath=corner_adj_2,
    InputGEOMETRYFilePath=cor_geom_2,
    Site=corner_4_2,
    Sensitivity=Slider(0, range=0..360),
    RotationInDegrees=Slider(0, range=0..360),
    NumberOfIterations=Slider(0, range=0..20),
    ClearAllValues=Toggle(True),
    RunSolver=Toggle(True),
    RunSolver_2=Toggle(True))  # -> DebugStr, Curves, CrvNames, PartitionLines
circulation_2 = GenerateCirculation(
    SiteCrvOuterBoundary=corner_4_2,
    CbspCrvs=bsp_solver_2.Curves,
    PartitionLines=bsp_solver_2.PartitionLines,
    CirculationDepth=Slider(2.225, range=0..5))  # -> _0PartitionLines, _1CirculationPoly, _2ResultantCbspCrv
z1_corner_color_2 = FilePath("C:\nir_dev\MegaSavageLevel\DotsProjRh6\DotsProj\DotsProj\SourceCode\TEST_SCRIPTS\rush\core_solvers\rush_z1_corner_Colors.csv")
color_input_parser_3 = ColorInput(InpFilePath=z1_corner_color_2, ListSpaceKeysNames=bsp_solver_2.CrvNames, ListSpaceCrvs=circulation_2._2ResultantCbspCrv)  # -> BrepFromCrvs, ColorStr
preview_3 = CustomPreview(Geometry=color_input_parser_3.BrepFromCrvs, Material=color_input_parser_3.ColorStr)

corner_4_3 = Curve(offset_5)
corner_adj_3 = FilePath("C:\nir_dev\MegaSavageLevel\DotsProjRh6\DotsProj\DotsProj\SourceCode\TEST_SCRIPTS\rush\core_solvers\rush_z1_CornerAdjInput.csv")
cor_geom_3 = FilePath("C:\nir_dev\MegaSavageLevel\DotsProjRh6\DotsProj\DotsProj\SourceCode\TEST_SCRIPTS\rush\core_solvers\rush_z1_CornerGeomInput.csv")
bsp_solver_3 = BSPSolver(
    InputADJACENCYFilePath=corner_adj_3,
    InputGEOMETRYFilePath=cor_geom_3,
    Site=corner_4_3,
    Sensitivity=Slider(0, range=0..360),
    RotationInDegrees=Slider(0, range=0..360),
    NumberOfIterations=Slider(0, range=0..20),
    ClearAllValues=Toggle(True),
    RunSolver=Toggle(True),
    RunSolver_2=Toggle(True))  # -> DebugStr, Curves, CrvNames, PartitionLines
circulation_3 = GenerateCirculation(
    SiteCrvOuterBoundary=corner_4_3,
    CbspCrvs=bsp_solver_3.Curves,
    PartitionLines=bsp_solver_3.PartitionLines,
    CirculationDepth=Slider(2.225, range=0..5))  # -> _0PartitionLines, _1CirculationPoly, _2ResultantCbspCrv
z1_corner_color_3 = FilePath("C:\nir_dev\MegaSavageLevel\DotsProjRh6\DotsProj\DotsProj\SourceCode\TEST_SCRIPTS\rush\core_solvers\rush_z1_corner_Colors.csv")
color_input_parser_4 = ColorInput(InpFilePath=z1_corner_color_3, ListSpaceKeysNames=bsp_solver_3.CrvNames, ListSpaceCrvs=circulation_3._2ResultantCbspCrv)  # -> BrepFromCrvs, ColorStr
preview_4 = CustomPreview(Geometry=color_input_parser_4.BrepFromCrvs, Material=color_input_parser_4.ColorStr)

corner_4_4 = Curve(offset_4)
corner_adj_4 = FilePath("C:\nir_dev\MegaSavageLevel\DotsProjRh6\DotsProj\DotsProj\SourceCode\TEST_SCRIPTS\rush\core_solvers\rush_z1_CornerAdjInput.csv")
cor_geom_4 = FilePath("C:\nir_dev\MegaSavageLevel\DotsProjRh6\DotsProj\DotsProj\SourceCode\TEST_SCRIPTS\rush\core_solvers\rush_z1_CornerGeomInput.csv")
bsp_solver_4 = BSPSolver(
    InputADJACENCYFilePath=corner_adj_4,
    InputGEOMETRYFilePath=cor_geom_4,
    Site=corner_4_4,
    Sensitivity=Slider(0, range=0..360),
    RotationInDegrees=Slider(0, range=0..360),
    NumberOfIterations=Slider(0, range=0..20),
    ClearAllValues=Toggle(True),
    RunSolver=Toggle(True),
    RunSolver_2=Toggle(True))  # -> DebugStr, Curves, CrvNames, PartitionLines
circulation_4 = GenerateCirculation(
    SiteCrvOuterBoundary=corner_4_4,
    CbspCrvs=bsp_solver_4.Curves,
    PartitionLines=bsp_solver_4.PartitionLines,
    CirculationDepth=Slider(2.225, range=0..5))  # -> _0PartitionLines, _1CirculationPoly, _2ResultantCbspCrv
z1_corner_color_4 = FilePath("C:\nir_dev\MegaSavageLevel\DotsProjRh6\DotsProj\DotsProj\SourceCode\TEST_SCRIPTS\rush\core_solvers\rush_z1_corner_Colors.csv")
color_input_parser_5 = ColorInput(InpFilePath=z1_corner_color_4, ListSpaceKeysNames=bsp_solver_4.CrvNames, ListSpaceCrvs=circulation_4._2ResultantCbspCrv)  # -> BrepFromCrvs, ColorStr
preview_5 = CustomPreview(Geometry=color_input_parser_5.BrepFromCrvs, Material=color_input_parser_5.ColorStr)

offset_6 = OffsetCurve(Curve=item_6, Distance=number_slider, Plane=PlaneXY(0, 0, 0), Corners=1)

rushcorezoneinput = FilePath("C:\nir_dev\MegaSavageLevel\DotsProjRh6\DotsProj\DotsProj\SourceCode\TEST_SCRIPTS\rush\core_solvers\rushCoreInput.csv")
crv_8 = Curve(offset_6)
radial_zone_core_2 = RadialZoneCore(
    InputFilesCsv=rushcorezoneinput,
    InputSiteCrv=crv_8,
    CoreArea=Slider(3788, range=0..10000),
    MoveCoreHorizontal=Slider(0, range=0..50),
    MoveCoreVertical=Slider(0, range=0..50),
    CoreAspectRatio=Slider(0.919, range=0..2),
    RotationInDegrees=Slider(0, range=0..360))  # -> CoreCrv, ZoneCrvsRad, CrvNamesColor
python = GhPythonScript(x=radial_zone_core_2.ZoneCrvsRad, y=radial_zone_core_2.CoreCrv)  # -> out, a; inputs x: list of Curve, y: list of Curve
# ---------- python: Python ----------
__author__ = "Nirvik Saha"
__version__ = "2020.01.23"

import rhinoscriptsyntax as rs
li=[]
for i in x:
    li.append(i)
for i in y:
    li.append(i)

a=li
# ---------- end python ----------
lift_colors = FilePath("C:\nir_dev\MegaSavageLevel\DotsProjRh6\DotsProj\DotsProj\SourceCode\TEST_SCRIPTS\rush\core_solvers\lift_colors.csv")
color_input_parser_6 = ColorInput(InpFilePath=lift_colors, ListSpaceKeysNames=radial_zone_core_2.CrvNamesColor, ListSpaceCrvs=python.a)  # -> BrepFromCrvs, ColorStr
preview_6 = CustomPreview(Geometry=color_input_parser_6.BrepFromCrvs, Material=color_input_parser_6.ColorStr)

item_7 = ListItem(List=crv_7, Index=Slider(0, range=0..4), Wrap=True)
item_8 = ListItem(List=crv_7, Index=Slider(1, range=0..4), Wrap=True)
item_9 = ListItem(List=crv_7, Index=Slider(3, range=0..4), Wrap=True)
offset_7 = OffsetCurve(Curve=item_8, Distance=number_slider, Plane=PlaneXY(0, 0, 0), Corners=1)
offset_8 = OffsetCurve(Curve=item_7, Distance=number_slider, Plane=PlaneXY(0, 0, 0), Corners=1)
offset_9 = OffsetCurve(Curve=item_9, Distance=Slider(-2, range=-4..4), Plane=PlaneXY(0, 0, 0), Corners=1)
item_10 = ListItem(List=crv_7, Index=Slider(2, range=0..4), Wrap=True)
offset_10 = OffsetCurve(Curve=item_10, Distance=number_slider, Plane=PlaneXY(0, 0, 0), Corners=1)

z4_top = Curve(offset_8)
z4_top_geom = FilePath("C:\nir_dev\MegaSavageLevel\DotsProjRh6\DotsProj\DotsProj\SourceCode\TEST_SCRIPTS\rush\core_solvers\rush_z4_TopGeomInput.csv")
z4_top_adj = FilePath("C:\nir_dev\MegaSavageLevel\DotsProjRh6\DotsProj\DotsProj\SourceCode\TEST_SCRIPTS\rush\core_solvers\rush_z4_TopAdjInput.csv")
bsp_solver_5 = BSPSolver(
    InputADJACENCYFilePath=z4_top_adj,
    InputGEOMETRYFilePath=z4_top_geom,
    Site=z4_top,
    Sensitivity=Slider(0, range=0..360),
    RotationInDegrees=Slider(0, range=0..360),
    NumberOfIterations=Slider(0, range=0..20),
    ClearAllValues=Toggle(True),
    RunSolver=Toggle(True),
    RunSolver_2=Toggle(True))  # -> DebugStr, Curves, CrvNames, PartitionLines
circulation_5 = GenerateCirculation(
    SiteCrvOuterBoundary=z4_top,
    CbspCrvs=bsp_solver_5.Curves,
    PartitionLines=bsp_solver_5.PartitionLines,
    CirculationDepth=Slider(2.225, range=0..5))  # -> _0PartitionLines, _1CirculationPoly, _2ResultantCbspCrv
z4_color = FilePath("C:\nir_dev\MegaSavageLevel\DotsProjRh6\DotsProj\DotsProj\SourceCode\TEST_SCRIPTS\rush\core_solvers\rush_z4_Colors.csv")
color_input_parser_7 = ColorInput(InpFilePath=z4_color, ListSpaceKeysNames=bsp_solver_5.CrvNames, ListSpaceCrvs=circulation_5._2ResultantCbspCrv)  # -> BrepFromCrvs, ColorStr
preview_7 = CustomPreview(Geometry=color_input_parser_7.BrepFromCrvs, Material=color_input_parser_7.ColorStr)

z4_bottom = Curve(offset_10)
rush_z2_adj_bottom = FilePath("C:\nir_dev\MegaSavageLevel\DotsProjRh6\DotsProj\DotsProj\SourceCode\TEST_SCRIPTS\rush\core_solvers\rush_z2_BottomAdjInput.csv")
rush_z2_geom_bottom = FilePath("C:\nir_dev\MegaSavageLevel\DotsProjRh6\DotsProj\DotsProj\SourceCode\TEST_SCRIPTS\rush\core_solvers\rush_z2_BottomGeomInput.csv")
bsp_solver_6 = BSPSolver(
    InputADJACENCYFilePath=rush_z2_adj_bottom,
    InputGEOMETRYFilePath=rush_z2_geom_bottom,
    Site=z4_bottom,
    Sensitivity=Slider(0, range=0..360),
    RotationInDegrees=Slider(0, range=0..360),
    NumberOfIterations=Slider(0, range=0..20),
    ClearAllValues=Toggle(True),
    RunSolver=Toggle(True),
    RunSolver_2=Toggle(True))  # -> DebugStr, Curves, CrvNames, PartitionLines
circulation_6 = GenerateCirculation(
    SiteCrvOuterBoundary=z4_bottom,
    CbspCrvs=bsp_solver_6.Curves,
    PartitionLines=bsp_solver_6.PartitionLines,
    CirculationDepth=Slider(0.931, range=0..5))  # -> _0PartitionLines, _1CirculationPoly, _2ResultantCbspCrv
path = FilePath("C:\nir_dev\MegaSavageLevel\DotsProjRh6\DotsProj\DotsProj\SourceCode\TEST_SCRIPTS\rush\core_solvers\rush_z2_Colors.csv")
color_input_parser_8 = ColorInput(InpFilePath=path, ListSpaceKeysNames=bsp_solver_6.CrvNames, ListSpaceCrvs=circulation_6._2ResultantCbspCrv)  # -> BrepFromCrvs, ColorStr
preview_8 = CustomPreview(Geometry=color_input_parser_8.BrepFromCrvs, Material=color_input_parser_8.ColorStr)

z3_top = Curve(offset_7)
z3_top_geom = FilePath("C:\nir_dev\MegaSavageLevel\DotsProjRh6\DotsProj\DotsProj\SourceCode\TEST_SCRIPTS\rush\core_solvers\rush_z3_TopGeomInput.csv")
z3_top_adj = FilePath("C:\nir_dev\MegaSavageLevel\DotsProjRh6\DotsProj\DotsProj\SourceCode\TEST_SCRIPTS\rush\core_solvers\rush_z3_TopAdjInput.csv")
bsp_solver_7 = BSPSolver(
    InputADJACENCYFilePath=z3_top_adj,
    InputGEOMETRYFilePath=z3_top_geom,
    Site=z3_top,
    Sensitivity=Slider(0, range=0..360),
    RotationInDegrees=Slider(0, range=0..360),
    NumberOfIterations=Slider(0, range=0..20),
    ClearAllValues=Toggle(True),
    RunSolver=Toggle(True),
    RunSolver_2=Toggle(True))  # -> DebugStr, Curves, CrvNames, PartitionLines
circulation_7 = GenerateCirculation(
    SiteCrvOuterBoundary=z3_top,
    CbspCrvs=bsp_solver_7.Curves,
    PartitionLines=bsp_solver_7.PartitionLines,
    CirculationDepth=Slider(2.225, range=0..5))  # -> _0PartitionLines, _1CirculationPoly, _2ResultantCbspCrv
z3_color = FilePath("C:\nir_dev\MegaSavageLevel\DotsProjRh6\DotsProj\DotsProj\SourceCode\TEST_SCRIPTS\rush\core_solvers\rush_z3_Colors.csv")
color_input_parser_9 = ColorInput(InpFilePath=z3_color, ListSpaceKeysNames=bsp_solver_7.CrvNames, ListSpaceCrvs=circulation_7._2ResultantCbspCrv)  # -> BrepFromCrvs, ColorStr
preview_9 = CustomPreview(Geometry=color_input_parser_9.BrepFromCrvs, Material=color_input_parser_9.ColorStr)

z4_bottom_2 = Curve(offset_9)
rush_z2_adj_bottom_2 = FilePath("C:\nir_dev\MegaSavageLevel\DotsProjRh6\DotsProj\DotsProj\SourceCode\TEST_SCRIPTS\rush\core_solvers\rush_z2_BottomAdjInput.csv")
rush_z2_geom_bottom_2 = FilePath("C:\nir_dev\MegaSavageLevel\DotsProjRh6\DotsProj\DotsProj\SourceCode\TEST_SCRIPTS\rush\core_solvers\rush_z2_BottomGeomInput.csv")
bsp_solver_8 = BSPSolver(
    InputADJACENCYFilePath=rush_z2_adj_bottom_2,
    InputGEOMETRYFilePath=rush_z2_geom_bottom_2,
    Site=z4_bottom_2,
    Sensitivity=Slider(0, range=0..360),
    RotationInDegrees=Slider(0, range=0..360),
    NumberOfIterations=Slider(0, range=0..20),
    ClearAllValues=Toggle(True),
    RunSolver=Toggle(True),
    RunSolver_2=Toggle(True))  # -> DebugStr, Curves, CrvNames, PartitionLines
circulation_8 = GenerateCirculation(
    SiteCrvOuterBoundary=z4_bottom_2,
    CbspCrvs=bsp_solver_8.Curves,
    PartitionLines=bsp_solver_8.PartitionLines,
    CirculationDepth=Slider(0.931, range=0..5))  # -> _0PartitionLines, _1CirculationPoly, _2ResultantCbspCrv
path_2 = FilePath("C:\nir_dev\MegaSavageLevel\DotsProjRh6\DotsProj\DotsProj\SourceCode\TEST_SCRIPTS\rush\core_solvers\rush_z2_Colors.csv")
color_input_parser_10 = ColorInput(InpFilePath=path_2, ListSpaceKeysNames=bsp_solver_8.CrvNames, ListSpaceCrvs=circulation_8._2ResultantCbspCrv)  # -> BrepFromCrvs, ColorStr
preview_10 = CustomPreview(Geometry=color_input_parser_10.BrepFromCrvs, Material=color_input_parser_10.ColorStr)
