# Grasshopper definition testFit.gh (Grasshopper 1.0.7)
# plug-ins: DotsProj

timer = Timer(TimerInterval=1000)  # disabled
python = GhPythonScript()  # -> out, a, b
# ---------- python: Python ----------
__author__ = "Nirvik Saha"
__version__ = "2020.03.02"

import rhinoscriptsyntax as rs
import random

a=10
b=random.randint(30,35)
# ---------- end python ----------
crv = Curve(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)
crv_2 = Curve(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)
number_slider = Slider(5, range=0..5)
number_slider_2 = Slider(7, range=1..100)
randomize = BooleanToggle(False)
sample2 = FilePath("C:\nir_dev\MegaSavageLevel\DotsProjRh6\DotsProj\DotsProj\SourceCode\TEST_SCRIPTS\dots_workflow\testfit_inputs\sample2.csv")
number_slider_3 = Slider(33, range=0..75)
cbsp_site = CbspSite(
    InputFilesCsv=sample2,
    InputSiteCrv=crv,
    RotationInDegrees=Slider(0, range=0..360),
    RandomizedGenerations=randomize,
    MinDev=Slider(100, range=1..100),
    NumberOfOptimizationLoops=python.a)  # -> SpatialCrv, CirculationLines, CrvNamesColor
sample1 = FilePath("C:\nir_dev\MegaSavageLevel\DotsProjRh6\DotsProj\DotsProj\SourceCode\TEST_SCRIPTS\dots_workflow\testfit_inputs\sample1.csv")
number_slider_4 = Slider(3, range=1..10)
number_slider_5 = Slider(5, range=0..5)
crv_skeleton = CrvSkeleton(
    InpFilePath=sample1,
    InpSiteCurve=crv_2,
    FromSiteOuterCirculationDepth=Slider(1, range=0..20),
    FromOuterCirculationBayDepth=python.b,
    FromBayDepthInnerCirculationDepth=Slider(1, range=0..20),
    SensitivityX100=python.a,
    OptimizationItrs=Slider(500, range=0..500))  # -> OuterOffsetCrv, InnerOffsetCrv, RESULTSegGeom, CrvNamesColor
geo = Geometry(cbsp_site.CirculationLines)
geo_2 = Geometry(cbsp_site.SpatialCrv)
python_2 = GhPythonScript(x=python.a)  # -> out, a, b
# ---------- python_2: Python ----------
__author__ = "Nirvik Saha"
__version__ = "2020.03.02"

import rhinoscriptsyntax as rs
import random

a=random.randint(3, 7)
b=int(a*1.25)
# ---------- end python_2 ----------
geo_3 = Geometry(crv_skeleton.OuterOffsetCrv)
geo_4 = Geometry(crv_skeleton.InnerOffsetCrv)
geo_5 = Geometry(crv_skeleton.RESULTSegGeom)
item = ListItem(List=geo_2, Index=Slider(3, range=1..3), Wrap=True)
python_3 = GhPythonScript(x=python.a)  # -> out, a, b
# ---------- python_3: Python ----------
__author__ = "Nirvik Saha"
__version__ = "2020.03.02"

import rhinoscriptsyntax as rs
import random

a=random.randint(3,5)
b=a
# ---------- end python_3 ----------
python_4 = GhPythonScript(x=python.a)  # -> out, a, b
# ---------- python_4: Python ----------
__author__ = "Nirvik Saha"
__version__ = "2020.03.02"

import rhinoscriptsyntax as rs
import random

a=random.randint(8, 10)
b=int(a/2)
# ---------- end python_4 ----------
item_2 = ListItem(List=geo_2, Index=Slider(2, range=1..3), Wrap=True)
number_slider_6 = Slider(4, range=1..10)
number_slider_7 = Slider(8, range=1..10)
item_3 = ListItem(List=geo_2, Index=Slider(1, range=1..3), Wrap=True)
crv_3 = Curve(item)
gridsa0 = FilePath("C:\nir_dev\MegaSavageLevel\DotsProjRh6\DotsProj\DotsProj\SourceCode\TEST_SCRIPTS\dots_workflow\testfit_inputs\gridSA2.csv")
path = FilePath("C:\nir_dev\MegaSavageLevel\DotsProjRh6\DotsProj\DotsProj\SourceCode\TEST_SCRIPTS\dots_workflow\inputs\colors.csv")
crv_4 = Curve(item_2)
number_slider_8 = Slider(1, range=1..10)
gridsa0_2 = FilePath("C:\nir_dev\MegaSavageLevel\DotsProjRh6\DotsProj\DotsProj\SourceCode\TEST_SCRIPTS\dots_workflow\testfit_inputs\gridSA1.csv")
number_slider_9 = Slider(6, range=1..10)
number_slider_10 = Slider(7, range=1..10)
number_slider_11 = Slider(7, range=1..10)
number_slider_12 = Slider(6, range=1..10)
color_input = ColorInput(InpFilePath=path, ListSpaceKeys=crv_skeleton.CrvNamesColor, ListSpaceCrvs=geo_5)  # -> BrepFromCrvs, ColorStr
crv_5 = Curve(item_3)
number_slider_13 = Slider(1, range=1..10)
gridsa0_3 = FilePath("C:\nir_dev\MegaSavageLevel\DotsProjRh6\DotsProj\DotsProj\SourceCode\TEST_SCRIPTS\dots_workflow\testfit_inputs\gridSA0.csv")
grid_solver = GridAllocationSolver(
    InpFilePath=gridsa0,
    SiteCurve=crv_3,
    NumberXAxis=python_2.a,
    NumberYAxis=python_2.b,
    CirculationDepth=number_slider_4,
    NumberOfIterations=Slider(1, range=1..10),
    MinimumAreaOfCurve=Slider(190, range=1..1000))  # -> CrvNamesColor, ListOfFsr, Curve
brep = Brep(geo_2)  # disabled
grid_solver_2 = GridAllocationSolver(
    InpFilePath=gridsa0_2,
    SiteCurve=crv_4,
    NumberXAxis=python_4.a,
    NumberYAxis=python_4.b,
    CirculationDepth=number_slider_4,
    NumberOfIterations=Slider(1, range=1..10),
    MinimumAreaOfCurve=Slider(1000, range=1..1000))  # -> CrvNamesColor, ListOfFsr, Curve
grid_solver_3 = GridAllocationSolver(
    InpFilePath=gridsa0_3,
    SiteCurve=crv_5,
    NumberXAxis=python_3.a,
    NumberYAxis=python_3.b,
    CirculationDepth=number_slider_4,
    NumberOfIterations=Slider(1, range=1..10),
    MinimumAreaOfCurve=Slider(190, range=1..1000))  # -> CrvNamesColor, ListOfFsr, Curve
brep_2 = Brep(grid_solver.Curve)
custom_preview = CustomPreview(Geometry=color_input.BrepFromCrvs, Material=color_input.ColorStr)
path_2 = FilePath("C:\nir_dev\MegaSavageLevel\DotsProjRh6\DotsProj\DotsProj\SourceCode\TEST_SCRIPTS\dots_workflow\inputs\colors.csv")
brep_3 = Brep(grid_solver_2.Curve)
color_input_parser = ColorInput(InpFilePath=path_2, ListSpaceKeysNames=cbsp_site.CrvNamesColor, ListSpaceCrvs=brep)  # -> BrepFromCrvs, ColorStr
item_4 = ListItem(List=grid_solver.CrvNamesColor, Index=0, Wrap=True)
brep_4 = Brep(grid_solver_3.Curve)
path_3 = FilePath("C:\nir_dev\MegaSavageLevel\DotsProjRh6\DotsProj\DotsProj\SourceCode\TEST_SCRIPTS\dots_workflow\inputs\colors.csv")
item_5 = ListItem(List=grid_solver_2.CrvNamesColor, Index=0, Wrap=True)
panel = Panel(item_4)
item_6 = ListItem(List=grid_solver_3.CrvNamesColor, Index=0, Wrap=True)
color_input_parser_2 = ColorInput(InpFilePath=path_3, ListSpaceKeysNames=grid_solver.CrvNamesColor, ListSpaceCrvs=brep_2)  # -> BrepFromCrvs, ColorStr
path_4 = FilePath("C:\nir_dev\MegaSavageLevel\DotsProjRh6\DotsProj\DotsProj\SourceCode\TEST_SCRIPTS\dots_workflow\inputs\colors.csv")
preview = CustomPreview(Geometry=color_input_parser.BrepFromCrvs, Material=color_input_parser.ColorStr)
panel_2 = Panel(item_5)
path_5 = FilePath("C:\nir_dev\MegaSavageLevel\DotsProjRh6\DotsProj\DotsProj\SourceCode\TEST_SCRIPTS\dots_workflow\inputs\colors.csv")
panel_3 = Panel(item_6)
color_input_parser_3 = ColorInput(InpFilePath=path_4, ListSpaceKeysNames=grid_solver_2.CrvNamesColor, ListSpaceCrvs=brep_3)  # -> BrepFromCrvs, ColorStr
color_input_parser_4 = ColorInput(InpFilePath=path_5, ListSpaceKeysNames=grid_solver_3.CrvNamesColor, ListSpaceCrvs=brep_4)  # -> BrepFromCrvs, ColorStr
preview_2 = CustomPreview(Geometry=color_input_parser_2.BrepFromCrvs, Material=color_input_parser_2.ColorStr)
preview_3 = CustomPreview(Geometry=color_input_parser_3.BrepFromCrvs, Material=color_input_parser_3.ColorStr)
preview_4 = CustomPreview(Geometry=color_input_parser_4.BrepFromCrvs, Material=color_input_parser_4.ColorStr)
