# Grasshopper definition nsUvicSol.gh (Grasshopper 1.0.7)
# plug-ins: DotsProj

timer = Timer(TimerInterval=1000, Target=python)  # disabled
python = GhPythonScript()  # -> out, a, b
# ---------- python: Python ----------
__author__ = "Nirvik Saha"
__version__ = "2020.02.20"

import rhinoscriptsyntax as rs
import random
x=random.randint(10, 30)
y=random.randint(1000,1100)

a=x
b=y
# ---------- end python ----------
crv = Curve([<curve referenced from the Rhino model> x2])
panel = Panel(python.b)
panel_2 = Panel(python.a)

crv_2 = Curve(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)
bsp_nsuvic_bsp_main_csv = FilePath("C:\nir_dev\MegaSavageLevel\DotsProjRh6\DotsProj\DotsProj\SourceCode\TEST_SCRIPTS\uvic\ns_inputs\bsp\nsUvic_bsp_Main.csv")
cbsp_site = CbspSite(
    InputFilesCsv=bsp_nsuvic_bsp_main_csv,
    InputSiteCrv=crv_2,
    RotationInDegrees=Slider(0, range=0..10),
    RandomizedGenerations=Toggle(False),
    MinDev=Toggle(True),
    NumberOfOptimizationLoops=python.a)  # -> SpatialCrv, CirculationLines, CrvNamesColor
panel_3 = Panel(bsp_nsuvic_bsp_main_csv)
circulation = GenerateCirculation(
    SiteCrvOuterBoundary=crv_2,
    CbspCrvs=cbsp_site.SpatialCrv,
    PartitionLines=cbsp_site.CirculationLines,
    CirculationDepth=Slider(0.559, range=0..10))  # -> _0PartitionLines, _1CirculationPoly, _2ResultantCbspCrv
brep = Brep(circulation._1CirculationPoly)
preview = CustomPreview(Geometry=brep, Material=ColourSwatch(SwatchColor=RGB(255, 255, 255)))
path = FilePath("C:\nir_dev\MegaSavageLevel\DotsProjRh6\DotsProj\DotsProj\SourceCode\TEST_SCRIPTS\uvic\ns_inputs\nsUvicColors.csv")
color_input_parser = ColorInput(InpFilePath=path, ListSpaceKeys=cbsp_site.CrvNamesColor, ListSpaceCrvs=circulation._2ResultantCbspCrv)  # -> BrepFromCrvs, ColorStr
preview_2 = CustomPreview(Geometry=color_input_parser.BrepFromCrvs, Material=color_input_parser.ColorStr)

number_slider = Slider(1000, range=0..1000)
dlc_nsuvicdlcmain_csv = FilePath("C:\nir_dev\MegaSavageLevel\DotsProjRh6\DotsProj\DotsProj\SourceCode\TEST_SCRIPTS\uvic\ns_inputs\dlc\nsUvicDLCMain.csv")
geo = Geometry(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)
oc_double = OpenCurveDouble(
    InpFilePath=dlc_nsuvicdlcmain_csv,
    BayDepth=Slider(15, range=0..30),
    CorridorDepth=Slider(1.689, range=0..10),
    BaseCurve=geo,
    NumberOfIterations=Slider(68, range=0..400),
    SensitivityMin100=python.b)  # -> CrvNamesColor, SpacesGeom, CellsPoly, SpacesCrvs
path_2 = FilePath("C:\nir_dev\MegaSavageLevel\DotsProjRh6\DotsProj\DotsProj\SourceCode\TEST_SCRIPTS\uvic\ns_inputs\nsUvicColors.csv")
color_input_parser_2 = ColorInput(InpFilePath=path_2, ListSpaceKeys=oc_double.CrvNamesColor, ListSpaceCrvs=oc_double.SpacesCrvs)  # -> BrepFromCrvs, ColorStr
preview_3 = CustomPreview(Geometry=color_input_parser_2.BrepFromCrvs, Material=color_input_parser_2.ColorStr)

panel_4 = Panel(dlc_nsuvicdlcmain_csv)
crv_3 = Curve(circulation._2ResultantCbspCrv)
crv_4 = Curve(oc_double.SpacesCrvs)
crv_name = CurveNameSelector(NameToExtract="a", NameKeyList=oc_double.CrvNamesColor, CrvList=crv_4)
crv_name_2 = CurveNameSelector(NameToExtract="b", NameKeyList=oc_double.CrvNamesColor, CrvList=crv_4)
crv_name_3 = CurveNameSelector(NameToExtract="h", NameKeyList=oc_double.CrvNamesColor, CrvList=crv_4)
crv_5 = Curve(crv_name)
crv_6 = Curve(crv_name_2)
Z = UnitZ(Factor=Slider(0.649, range=0..10))
Z_2 = UnitZ(Factor=Slider(0.649, range=0..10))
move = Move(Geometry=crv_5, Motion=Z)  # -> Geometry, Transform
crv_7 = Curve(crv_name_3)
Z_3 = UnitZ(Factor=Slider(0.649, range=0..10))
move_2 = Move(Geometry=crv_7, Motion=Z_3)  # -> Geometry, Transform
move_3 = Move(Geometry=crv_6, Motion=Z_2)  # -> Geometry, Transform

crv_name_4 = CurveNameSelector(NameToExtract="b", NameKeyList=cbsp_site.CrvNamesColor, CrvList=crv_3)
Z_4 = UnitZ(Factor=Slider(0.671, range=0..10))
move_4 = Move(Geometry=crv_name_4, Motion=Z_4)  # -> Geometry, Transform
dlc_nsuvic_dlc_bsp_wc_x_csv = FilePath("C:\nir_dev\MegaSavageLevel\DotsProjRh6\DotsProj\DotsProj\SourceCode\TEST_SCRIPTS\uvic\ns_inputs\bsp\nsUvic_wc_X.csv")
cbsp_site_2 = CbspSite(
    InputFilesCsv=dlc_nsuvic_dlc_bsp_wc_x_csv,
    InputSiteCrv=move_4.Geometry,
    RotationInDegrees=Slider(0, range=0..10),
    RandomizedGenerations=Toggle(False),
    MinDev=Toggle(True),
    NumberOfOptimizationLoops=Slider(10, range=0..100))  # -> SpatialCrv, CirculationLines, CrvNamesColor
panel_5 = Panel(dlc_nsuvic_dlc_bsp_wc_x_csv)
circulation_2 = GenerateCirculation(
    SiteCrvOuterBoundary=move_4.Geometry,
    CbspCrvs=cbsp_site_2.SpatialCrv,
    PartitionLines=cbsp_site_2.CirculationLines,
    CirculationDepth=Slider(0.41, range=0..10))  # -> _0PartitionLines, _1CirculationPoly, _2ResultantCbspCrv
brep_2 = Brep(circulation_2._1CirculationPoly)
path_3 = FilePath("C:\nir_dev\MegaSavageLevel\DotsProjRh6\DotsProj\DotsProj\SourceCode\TEST_SCRIPTS\uvic\ns_inputs\nsUvicColors.csv")
preview_4 = CustomPreview(Geometry=brep_2, Material=ColourSwatch(SwatchColor=RGB(255, 255, 255)))
color_input_parser_3 = ColorInput(InpFilePath=path_3, ListSpaceKeys=cbsp_site_2.CrvNamesColor, ListSpaceCrvs=circulation_2._2ResultantCbspCrv)  # -> BrepFromCrvs, ColorStr
preview_5 = CustomPreview(Geometry=color_input_parser_3.BrepFromCrvs, Material=color_input_parser_3.ColorStr)

crv_name_5 = CurveNameSelector(NameToExtract="c", NameKeyList=cbsp_site.CrvNamesColor, CrvList=crv_3)
Z_5 = UnitZ(Factor=Slider(0.671, range=0..10))
move_5 = Move(Geometry=crv_name_5, Motion=Z_5)  # -> Geometry, Transform
bsp_ns_uvic_services_x_csv = FilePath("C:\nir_dev\MegaSavageLevel\DotsProjRh6\DotsProj\DotsProj\SourceCode\TEST_SCRIPTS\uvic\ns_inputs\bsp\ns_Uvic_services_X.csv")
cbsp_site_3 = CbspSite(
    InputFilesCsv=bsp_ns_uvic_services_x_csv,
    InputSiteCrv=move_5.Geometry,
    RotationInDegrees=Slider(0, range=0..10),
    RandomizedGenerations=Toggle(False),
    MinDev=Toggle(False),
    NumberOfOptimizationLoops=Slider(10, range=0..100))  # -> SpatialCrv, CirculationLines, CrvNamesColor
panel_6 = Panel(bsp_ns_uvic_services_x_csv)
circulation_3 = GenerateCirculation(
    SiteCrvOuterBoundary=move_5.Geometry,
    CbspCrvs=cbsp_site_3.SpatialCrv,
    PartitionLines=cbsp_site_3.CirculationLines,
    CirculationDepth=Slider(0.082, range=0..10))  # -> _0PartitionLines, _1CirculationPoly, _2ResultantCbspCrv
brep_3 = Brep(circulation_3._1CirculationPoly)
path_4 = FilePath("C:\nir_dev\MegaSavageLevel\DotsProjRh6\DotsProj\DotsProj\SourceCode\TEST_SCRIPTS\uvic\ns_inputs\nsUvicColors.csv")
preview_6 = CustomPreview(Geometry=brep_3, Material=ColourSwatch(SwatchColor=RGB(255, 255, 255)))
color_input_parser_4 = ColorInput(InpFilePath=path_4, ListSpaceKeys=cbsp_site_3.CrvNamesColor, ListSpaceCrvs=circulation_3._2ResultantCbspCrv)  # -> BrepFromCrvs, ColorStr
preview_7 = CustomPreview(Geometry=color_input_parser_4.BrepFromCrvs, Material=color_input_parser_4.ColorStr)

dlc_nsuvic_dlc_bsp_lockers_x_csv = FilePath("C:\nir_dev\MegaSavageLevel\DotsProjRh6\DotsProj\DotsProj\SourceCode\TEST_SCRIPTS\uvic\ns_inputs\dlc\nsUvic_dlc_bsp_lockers_X.csv")
cbsp_site_4 = CbspSite(
    InputFilesCsv=dlc_nsuvic_dlc_bsp_lockers_x_csv,
    InputSiteCrv=move_3.Geometry,
    RotationInDegrees=Slider(0, range=0..10),
    RandomizedGenerations=Toggle(False),
    MinDev=Toggle(True),
    NumberOfOptimizationLoops=Slider(10, range=0..100))  # -> SpatialCrv, CirculationLines, CrvNamesColor
panel_7 = Panel(dlc_nsuvic_dlc_bsp_lockers_x_csv)
circulation_4 = GenerateCirculation(
    SiteCrvOuterBoundary=move_3.Geometry,
    CbspCrvs=cbsp_site_4.SpatialCrv,
    PartitionLines=cbsp_site_4.CirculationLines,
    CirculationDepth=Slider(0.477, range=0..10))  # -> _0PartitionLines, _1CirculationPoly, _2ResultantCbspCrv
brep_4 = Brep(circulation_4._1CirculationPoly)
path_5 = FilePath("C:\nir_dev\MegaSavageLevel\DotsProjRh6\DotsProj\DotsProj\SourceCode\TEST_SCRIPTS\uvic\ns_inputs\nsUvicColors.csv")
preview_8 = CustomPreview(Geometry=brep_4, Material=ColourSwatch(SwatchColor=RGB(255, 255, 255)))
color_input_parser_5 = ColorInput(InpFilePath=path_5, ListSpaceKeys=cbsp_site_4.CrvNamesColor, ListSpaceCrvs=circulation_4._2ResultantCbspCrv)  # -> BrepFromCrvs, ColorStr
preview_9 = CustomPreview(Geometry=color_input_parser_5.BrepFromCrvs, Material=color_input_parser_5.ColorStr)

dlc_nsuvic_dlc_bsp_kitchen_x_csv = FilePath("C:\nir_dev\MegaSavageLevel\DotsProjRh6\DotsProj\DotsProj\SourceCode\TEST_SCRIPTS\uvic\ns_inputs\dlc\nsUvic_dlc_bsp_kitchen_X.csv")
cbsp_site_5 = CbspSite(
    InputFilesCsv=dlc_nsuvic_dlc_bsp_kitchen_x_csv,
    InputSiteCrv=move.Geometry,
    RotationInDegrees=Slider(0, range=0..10),
    RandomizedGenerations=Toggle(False),
    MinDev=Toggle(True),
    NumberOfOptimizationLoops=Slider(10, range=0..100))  # -> SpatialCrv, CirculationLines, CrvNamesColor
panel_8 = Panel(dlc_nsuvic_dlc_bsp_kitchen_x_csv)
circulation_5 = GenerateCirculation(
    SiteCrvOuterBoundary=move.Geometry,
    CbspCrvs=cbsp_site_5.SpatialCrv,
    PartitionLines=cbsp_site_5.CirculationLines,
    CirculationDepth=Slider(0.477, range=0..10))  # -> _0PartitionLines, _1CirculationPoly, _2ResultantCbspCrv
brep_5 = Brep(circulation_5._1CirculationPoly)
path_6 = FilePath("C:\nir_dev\MegaSavageLevel\DotsProjRh6\DotsProj\DotsProj\SourceCode\TEST_SCRIPTS\uvic\ns_inputs\nsUvicColors.csv")
preview_10 = CustomPreview(Geometry=brep_5, Material=ColourSwatch(SwatchColor=RGB(255, 255, 255)))
color_input_parser_6 = ColorInput(InpFilePath=path_6, ListSpaceKeys=cbsp_site_5.CrvNamesColor, ListSpaceCrvs=circulation_5._2ResultantCbspCrv)  # -> BrepFromCrvs, ColorStr
preview_11 = CustomPreview(Geometry=color_input_parser_6.BrepFromCrvs, Material=color_input_parser_6.ColorStr)

dlc_nsuvic_dlc_bsp_office_x_csv = FilePath("C:\nir_dev\MegaSavageLevel\DotsProjRh6\DotsProj\DotsProj\SourceCode\TEST_SCRIPTS\uvic\ns_inputs\dlc\nsUvic_dlc_office_X.csv")
cbsp_site_6 = CbspSite(
    InputFilesCsv=dlc_nsuvic_dlc_bsp_office_x_csv,
    InputSiteCrv=move_2.Geometry,
    RotationInDegrees=Slider(0, range=0..10),
    RandomizedGenerations=Toggle(False),
    MinDev=Toggle(True),
    NumberOfOptimizationLoops=Slider(10, range=0..100))  # -> SpatialCrv, CirculationLines, CrvNamesColor
panel_9 = Panel(dlc_nsuvic_dlc_bsp_office_x_csv)
circulation_6 = GenerateCirculation(
    SiteCrvOuterBoundary=move_2.Geometry,
    CbspCrvs=cbsp_site_6.SpatialCrv,
    PartitionLines=cbsp_site_6.CirculationLines,
    CirculationDepth=Slider(0.477, range=0..10))  # -> _0PartitionLines, _1CirculationPoly, _2ResultantCbspCrv
brep_6 = Brep(circulation_6._1CirculationPoly)
preview_12 = CustomPreview(Geometry=brep_6, Material=ColourSwatch(SwatchColor=RGB(255, 255, 255)))
path_7 = FilePath("C:\nir_dev\MegaSavageLevel\DotsProjRh6\DotsProj\DotsProj\SourceCode\TEST_SCRIPTS\uvic\ns_inputs\nsUvicColors.csv")
color_input_parser_7 = ColorInput(InpFilePath=path_7, ListSpaceKeys=cbsp_site_6.CrvNamesColor, ListSpaceCrvs=circulation_6._2ResultantCbspCrv)  # -> BrepFromCrvs, ColorStr
preview_13 = CustomPreview(Geometry=color_input_parser_7.BrepFromCrvs, Material=color_input_parser_7.ColorStr)

crv_8 = Curve([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])
crv_9 = Curve([color_input_parser_6.BrepFromCrvs, color_input_parser_5.BrepFromCrvs, color_input_parser_7.BrepFromCrvs, color_input_parser_2.BrepFromCrvs, color_input_parser_3.BrepFromCrvs, color_input_parser_4.BrepFromCrvs, circulation._2ResultantCbspCrv, crv_8])
Z_6 = UnitZ(Factor=Slider(0.641, range=0..10))
extr = Extrude(Base=crv_9, Direction=Z_6)
preview_14 = CustomPreview(Geometry=extr, Material=ColourSwatch(SwatchColor=RGB(0, 0, 0)))
