# Grasshopper definition combined.gh (Grasshopper 1.0.7)
# plug-ins: DotsProj

curve = Curve(<curve referenced from the Rhino model>)
unit_z = UnitZ(Factor=Slider(-1, range=-1..0))
brep = Brep(curve)
move = Move(Geometry=brep, Motion=unit_z)  # -> Geometry, Transform
peripheral_subdivision_parcels = PeripheralSubdivisionParcels(
    SiteCurve=curve,
    SetbackDimensionFromSite=Slider(5.3, range=0.1..50),
    BayDepthFromSetback=Slider(50, range=0.1..50),
    InnerCrv0ffsetFromBay=Slider(6.8, range=0.1..50),
    NumDiv=Slider(44, range=1..50))  # -> Setback, Bay, InnerCrv, ParcelCrv, SiteCrvType
min_ar_extrusion = Slider(1303.5, range=0.1..10000)
flr_ht = Slider(4.3, range=0.1..10)
unit_z_2 = UnitZ(Factor=Slider(1, range=-1..1))
brep_2 = Brep(peripheral_subdivision_parcels.InnerCrv)
parcels_by_subdivision = ParcelsBySubdivision(
    InputSite=peripheral_subdivision_parcels.InnerCrv,
    NumberParcels=Slider(10, range=1..10),
    DevDim01=0,
    AngleAlignmentDegrees0360=0,
    ShowThisIterations=0,
    ResetAllValues=True,
    Generate=True)  # -> LowestDeviationOfParcelSolution, StreetCenterLines, OutputParcelFromRequiredIteration, OutputStreetFromRequiredIteration, NumberOfResults
massing_extrude_block = MassingExtrudeBlock(
    SiteCurve=peripheral_subdivision_parcels.ParcelCrv,
    Setback=Slider(1.6, range=0.1..3),
    FSR=Slider(3, range=0.1..3),
    FLRHT=flr_ht,
    MinCrvArea=min_ar_extrusion,
    NameOptional="dots")  # -> OutputMassingBreps, OutputFloorCurves, Name
move_2 = Move(Geometry=brep_2, Motion=unit_z_2)  # -> Geometry, Transform
geometry = Geometry(massing_extrude_block.OutputMassingBreps)
generatecirculation = GenerateCirculation(
    SiteCrvOuterBoundary=peripheral_subdivision_parcels.InnerCrv,
    CbspCrvs=parcels_by_subdivision.OutputParcelFromRequiredIteration,
    PartitionLines=parcels_by_subdivision.StreetCenterLines,
    CirculationDepth=Slider(4.5, range=0.1..10))  # -> PartitionLines, CirculationPoly, ResultantCbspCrv
massing_extrude_block_2 = MassingExtrudeBlock(
    SiteCurve=generatecirculation.ResultantCbspCrv,
    Setback=Slider(3, range=0.1..3),
    FSR=Slider(4.5, range=0.1..10),
    FLRHT=flr_ht,
    MinCrvArea=min_ar_extrusion,
    NameOptional="dots")  # -> OutputMassingBreps, OutputFloorCurves, Name
geometry_2 = Geometry(flatten(massing_extrude_block_2.OutputFloorCurves))
list_item = ListItem(List=geometry_2, Index=Slider(50, range=0..54), Wrap=True)
peripheral_subdivision_parcels_2 = PeripheralSubdivisionParcels(
    SiteCurve=list_item,
    SetbackDimensionFromSite=Slider(0.1, range=0.1..10),
    BayDepthFromSetback=Slider(12.9, range=0.1..25),
    InnerCrv0ffsetFromBay=Slider(3.4, range=0.1..10),
    NumDiv=Slider(10, range=0..10))  # -> Setback, Bay, InnerCrv, ParcelCrv, SiteCrvType
unit_z_3 = UnitZ(Factor=Slider(3.4, range=0.1..10))
file_path = FilePath("C:\nir_dev\MegaSavageLevel\DOTS\DotsProj\bin\example_Files\inputs\sample1.csv")
cbsp_site = CbspSite(
    InputFilePath=file_path,
    InputSiteCrv=peripheral_subdivision_parcels_2.InnerCrv,
    RotationInDegrees=Slider(1, range=1..10),
    RandomizedGenerations=Toggle(False),
    MinDev=Slider(0, range=0..1),
    NumberOfOptimizationLoops=Slider(1, range=0..1),
    LayerName="a")  # -> SpatialCrv, CirculationLines, CrvNamesColor
generatecirculation_2 = GenerateCirculation(
    SiteCrvOuterBoundary=peripheral_subdivision_parcels_2.InnerCrv,
    CbspCrvs=cbsp_site.SpatialCrv,
    PartitionLines=cbsp_site.CirculationLines,
    CirculationDepth=Slider(2.6, range=0.1..10))  # -> PartitionLines, CirculationPoly, ResultantCbspCrv

# ----
# SITE
colour_swatch = ColourSwatch(SwatchColor=RGBA(46, 215, 96, 131))
custom_preview = CustomPreview(Geometry=move.Geometry, Material=colour_swatch)
# interior
colour_swatch_2 = ColourSwatch(SwatchColor=RGBA(255, 234, 96, 144))
custom_preview_2 = CustomPreview(Geometry=move_2.Geometry, Material=colour_swatch_2)
# peripheral
# mass
colour_swatch_3 = ColourSwatch(SwatchColor=RGBA(240, 173, 255, 57))
# peripheral
# parcels
geometry_3 = Geometry(peripheral_subdivision_parcels.ParcelCrv)
custom_preview_3 = CustomPreview(Geometry=geometry, Material=colour_swatch_3)
# floors
geometry_4 = Geometry(massing_extrude_block.OutputFloorCurves)
# floors
geometry_5 = Geometry(massing_extrude_block_2.OutputFloorCurves)
# inner
# parcels
# no circ.
geometry_6 = Geometry(parcels_by_subdivision.OutputParcelFromRequiredIteration)
# inner
# parcels
# with circ.
geometry_7 = Geometry(generatecirculation.ResultantCbspCrv)
# inner
# mass
# with circ
custom_preview_4 = CustomPreview(Geometry=massing_extrude_block_2.OutputMassingBreps, Material=ColourSwatch(SwatchColor=RGBA(240, 173, 255, 65)))
# peri
# floor
# spaces
extrude = Extrude(Base=peripheral_subdivision_parcels_2.ParcelCrv, Direction=unit_z_3)
brep_3 = Brep(list_item)
# base of
# floor plan
custom_preview_5 = CustomPreview(Geometry=brep_3, Material=ColourSwatch(SwatchColor=RGBA(229, 190, 0, 36)))
# inner
# floor
# spaces
extrude_2 = Extrude(Base=cbsp_site.SpatialCrv, Direction=unit_z_3)
# after
# circulaiton
extrude_3 = Extrude(Base=generatecirculation_2.ResultantCbspCrv, Direction=unit_z_3)
