# Grasshopper definition MasssingGFA.gh (Grasshopper 1.0.7)
# plug-ins: DotsProj

curve = Curve(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)
parcels_by_subdivision = ParcelsBySubdivision(
    InputSite=curve,
    NumberParcels=Slider(25, range=5..25),
    DevDim01=0,
    AngleAlignmentDegrees0360=0,
    ShowThisIterations=0,
    ResetAllValues=True,
    Generate=True)  # -> LowestDeviationOfParcelSolution, StreetCenterLines, OutputParcelFromRequiredIteration, OutputStreetFromRequiredIteration, NumberOfResults
gfa_massing = GFAMassing(
    InputParcels=parcels_by_subdivision.LowestDeviationOfParcelSolution,
    OverallFAR=1,
    FloorFloorHeight=3,
    LengthsOfEachTypeSeparatedByCommas="10,8,12",
    WidthsOfEachTypeSeparatedByCommas="10,8,12")
unit_z = UnitZ(Factor=1)
move = Move(Geometry=gfa_massing, Motion=unit_z)  # -> Geometry, Transform
