# Grasshopper definition Voxels.gh (Grasshopper 1.0.7)
# plug-ins: DotsProj

number_slider = Slider(3, range=1..10)
generate_indices = GenerateIndices(
    MinimumXIndexValue=Slider(0, range=0..10),
    MaximumXIndexValue=Slider(4, range=1..10),
    MinimumYIndexValue=Slider(0, range=0..10),
    MaximumYIndexValue=Slider(9, range=1..10),
    MiimumZIndexValue=Slider(0, range=0..10),
    MaximumZIndexValue=Slider(3, range=1..10),
    NumberOfIndices=Slider(100, range=1..100))  # -> XIndicesList, YIndicesList, ZIndicesList
_3d_grid = _3dGrid(
    XNumber=number_slider,
    YNumber=number_slider,
    ZNumber=number_slider,
    XDimension=Slider(10, range=1..10),
    YDimension=10,
    ZDimension=10)  # -> PointList, VoxelList, VoxelObjectWithDataStructure
selectvoxel = SelectVoxel(
    ListOfVoxelObjectWithDataStructure=_3d_grid.VoxelObjectWithDataStructure,
    XIndex=generate_indices.XIndicesList,
    YIndex=generate_indices.YIndicesList,
    ZIndex=generate_indices.ZIndicesList,
    Reset=Toggle(False))  # -> PointList, VoxelList, ListOfVoxelDataStructure, Debug
geometry = Geometry(_3d_grid.VoxelList)
custom_preview = CustomPreview(Geometry=geometry, Material=ColourSwatch(SwatchColor=RGBA(255, 255, 255, 160)))
panel = Panel(selectvoxel.Debug)
