# Grasshopper definition attractor.gh (Grasshopper 1.0.7)
# plug-ins: DotsProj

curve = Curve(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)
parcels_by_subdivision = ParcelsBySubdivision(
    InputSite=curve,
    NumberParcels=Slider(83, range=5..100),
    DevDim01=0,
    AngleAlignmentDegrees0360=0,
    ShowThisIterations=0,
    ResetAllValues=True,
    Generate=True)  # -> LowestDeviationOfParcelSolution, StreetCenterLines, OutputParcelFromRequiredIteration, OutputStreetFromRequiredIteration, NumberOfResults
point = Point([Point(-108.1281014, 254.5178088, 0), Point(114.915453, -315.0211815, 0)])
ghpython_script = GhPythonScript(x="Default")  # -> out, a, b
# ---------- ghpython_script: Python ----------
__author__ = "Nirvik Saha"
__version__ = "2020.11.19"

import rhinoscriptsyntax as rs
import scriptcontext as sc
import Rhino as rh
b = []
ar=0
if x:
    sc.doc = rh.RhinoDoc.ActiveDoc
    layer_name = sc.doc.Layers
    for layer in layer_name:
        if not layer.IsDeleted:
            b.append(layer)
    crvs=rs.ObjectsByLayer(x)
    for i in crvs:
        r=rs.CurveArea(crvs)[0]
        ar+=r
    print(ar)
a = layer_name
b= ar
# ---------- end ghpython_script ----------
gen_hts_from_pts = GenHtsFromPts(
    InputParcelList=parcels_by_subdivision.LowestDeviationOfParcelSolution,
    InputPointList=point,
    MultiplierCoefficient=1,
    OPTTrueHighIfCloseFalseLowIfClose=Toggle(False),
    MinValForInterpolation=Slider(0.324, range=0.1..2),
    MaxValForInterpolation=Slider(35.611, range=0.1..100))
panel = Panel(ghpython_script.b)
massing_extrude_block = MassingExtrudeBlock(
    SiteCurve=parcels_by_subdivision.LowestDeviationOfParcelSolution,
    Setback=Slider(7.025, range=2.999..10),
    FSR=gen_hts_from_pts,
    FLRHT=3,
    MinCrvArea=Slider(369.288, range=2.999..500),
    NameOptional="dots")  # -> OutputMassingBreps, OutputFloorCurves, Name
custom_preview = CustomPreview(Geometry=massing_extrude_block.OutputMassingBreps, Material=ColourSwatch(SwatchColor=RGB(255, 147, 255)))
