# Grasshopper definition db.gh (Grasshopper 1.0.7)
# plug-ins: DotsProj

# ----
# independent module
# for space allocation
number_slider = Slider(59, range=0..360)
path = FilePath("C:\nir_dev\MegaSavageLevel\DotsProjRh6\DotsProj\DotsProj\bin\example_Files\inputs\sample1.csv")  # disabled
cbsp = CbspIndependent(
    InputFilesCsv=path,
    RotationInDegrees=number_slider,
    RatioLengthWidth=Slider(0.738, range=0..3),
    RandomizedGenerations=Toggle(False),
    NumberOfOptimizationLoops=Slider(28, range=0..250))  # -> OuterBoundary, BspOutputCurves, PartitionLines, CrvNamesColor; disabled
crv = Curve(cbsp.OuterBoundary)

# ----
# constructs floor plan within a given curve
path_2 = FilePath("C:\nir_dev\dots_tutorial\inputs\sample3.csv")
crv_2 = Curve(<curve referenced from the Rhino model>)
cbsp_site = CbspSite(
    InputFilesCsv=path_2,
    InputSiteCrv=crv_2,
    RotationInDegrees=Slider(0, range=0..360),
    RandomizedGenerations=Toggle(False),
    MinDev=Slider(0.62, range=0..3),
    NumberOfOptimizationLoops=Slider(0.62, range=0..3),
    LayerName="a")  # -> SpatialCrv, CirculationLines, CrvNamesColor

# ----
# circulation
number_slider_2 = Slider(0.07, range=0..1)
circulation = GenerateCirculation(
    SiteCrvOuterBoundary=cbsp.OuterBoundary,
    CbspCrvs=cbsp.BspOutputCurves,
    PartitionLines=cbsp.PartitionLines,
    CirculationDepth=number_slider_2)  # -> _0PartitionLines, _1CirculationPoly, _2ResultantCbspCrv

circulation_2 = GenerateCirculation(
    SiteCrvOuterBoundary=crv_2,
    CbspCrvs=cbsp_site.SpatialCrv,
    PartitionLines=cbsp_site.CirculationLines,
    CirculationDepth=Slider(0.342, range=0..1))  # -> _0PartitionLines, _1CirculationPoly, _2ResultantCbspCrv

python = GhPythonScript()  # -> out, a
# ---------- python: Python ----------
__author__ = "Nirvik Saha"
__version__ = "2020.04.16"

import rhinoscriptsyntax as rs

a=['a','b','c']
# ---------- end python ----------
crv_3 = Curve([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])  # disabled

path_3 = FilePath("C:\nir_dev\dots_tutorial\inputs\colors.csv")
color_input_parser = ColorInput(InpFilePath=path_3, ListSpaceKeysNames=cbsp_site.CrvNamesColor, ListSpaceCrvs=circulation_2._2ResultantCbspCrv)  # -> BrepFromCrvs, ColorStr
Z = UnitZ(Factor=Slider(0.015, range=0..1))
extr = Extrude(Base=color_input_parser.BrepFromCrvs, Direction=Z)
preview = CustomPreview(Geometry=extr, Material=color_input_parser.ColorStr)

# ----
# color
path_4 = FilePath("C:\nir_dev\MegaSavageLevel\DotsProjRh6\DotsProj\DotsProj\bin\example_Files\inputs\colors.csv")
color_input_parser_2 = ColorInput(InpFilePath=path_4, ListSpaceKeysNames=cbsp.CrvNamesColor, ListSpaceCrvs=circulation._2ResultantCbspCrv)  # -> BrepFromCrvs, ColorStr
Z_2 = UnitZ(Factor=Slider(0.013, range=0..1))
extr_2 = Extrude(Base=color_input_parser_2.BrepFromCrvs, Direction=Z_2)
preview_2 = CustomPreview(Geometry=extr_2, Material=color_input_parser_2.ColorStr)

send_db = DotsDBProj(
    InputCurves=circulation._2ResultantCbspCrv,
    NameOfTheCollection="test35",
    KeyName=cbsp.CrvNamesColor,
    WriteToDbTF=Toggle(False))  # -> DebugStr, SendInfoToDB
panel = Panel(send_db.DebugStr)
panel_2 = Panel(send_db.SendInfoToDB)
crv_4 = Curve([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])  # disabled
python_2 = GhPythonScript()  # -> out, a; same code as python
send_db_2 = DotsDBProj(
    InputCurves=circulation_2._2ResultantCbspCrv,
    NameOfTheCollection="test35",
    KeyName=cbsp_site.CrvNamesColor,
    WriteToDbTF=Toggle(False))  # -> DebugStr, SendInfoToDB
panel_3 = Panel(send_db_2.DebugStr)
panel_4 = Panel(send_db_2.SendInfoToDB)
