# Grasshopper definition dots_00_SA_basic.gh (Grasshopper 1.0.7)
# plug-ins: DotsProj, DotsDBProj

# ----
# fit spaces along a curve - periphery
# for space allocation
number_slider = Slider(0.287, range=0..2)
# constructs floor plan around periphery of a given curve
path = FilePath("C:\nir_dev\dots_tutorial\inputs\sample1.csv")
crv = Curve(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)  # disabled
crv_boundary = CrvBoundary(
    InpFilePath=path,
    InpSiteCurve=crv,
    FromSiteOuterCirculationDepth=Slider(0.087, range=0..1),
    FromOuterCirculationBayDepth=Slider(1.521, range=0..2),
    FromBayDepthInnerCirculationDepth=number_slider,
    SensitivityX100=Slider(1, range=0..10),
    OptimizationItrs=Slider(0, range=0..100))  # -> OuterOffsetCrv, InnerOffsetCrv, RESULTSegGeom, CrvNamesColor

# ----
# independent module
# for space allocation
number_slider_2 = Slider(40, range=0..360)
# Generates a rectangle at origin and
# constructs floor plan within that rectangle
path_2 = FilePath("C:\nir_dev\MegaSavageLevel\DotsProjRh6\DotsProj\DotsProj\bin\example_Files\inputs\sample1.csv")
cbsp = CbspIndependent(
    InputFilesCsv=path_2,
    RotationInDegrees=number_slider_2,
    RatioLengthWidth=Slider(0.425, range=0..3),
    RandomizedGenerations=Toggle(False),
    NumberOfOptimizationLoops=Slider(28, range=0..250))  # -> OuterBoundary, BspOutputCurves, PartitionLines, CrvNamesColor
crv_2 = Curve(cbsp.OuterBoundary)

# ----
# constructs floor plan within a given curve
# fit spaces inside a curve
# for space allocation
path_3 = FilePath("C:\nir_dev\dots_tutorial\inputs\sample3.csv")
crv_3 = Curve(<curve referenced from the Rhino model>)
cbsp_site = CbspSite(
    InputFilesCsv=path_3,
    InputSiteCrv=crv_3,
    RotationInDegrees=Slider(0, range=0..360),
    RandomizedGenerations=Toggle(False),
    MinDev=Slider(0.62, range=0..3),
    NumberOfOptimizationLoops=Slider(0.62, range=0..3),
    LayerName="a")  # -> SpatialCrv, CirculationLines, CrvNamesColor

# ----
# spaces along the periphery
number_slider_3 = Slider(0.212, range=0..2)
# Combined: (i) constructs floor plan around periphery of a given curve (ii) Internal subdivision
path_4 = FilePath("C:\nir_dev\dots_tutorial\inputs\sample1.csv")
crv_4 = Curve(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)  # disabled
crv_boundary_2 = CrvBoundary(
    InpFilePath=path_4,
    InpSiteCurve=crv_4,
    FromSiteOuterCirculationDepth=Slider(0.087, range=0..1),
    FromOuterCirculationBayDepth=Slider(0.654, range=0..2),
    FromBayDepthInnerCirculationDepth=number_slider_3,
    SensitivityX100=Slider(1, range=0..10),
    OptimizationItrs=Slider(0, range=0..100))  # -> OuterOffsetCrv, InnerOffsetCrv, RESULTSegGeom, CrvNamesColor

# ----
# circulation
number_slider_4 = Slider(0.07, range=0..1)
circulation = GenerateCirculation(
    SiteCrvOuterBoundary=cbsp.OuterBoundary,
    CbspCrvs=cbsp.BspOutputCurves,
    PartitionLines=cbsp.PartitionLines,
    CirculationDepth=number_slider_4)  # -> _0PartitionLines, _1CirculationPoly, _2ResultantCbspCrv

# ----
# circulation
number_slider_5 = Slider(0.342, range=0..1)
circulation_2 = GenerateCirculation(
    SiteCrvOuterBoundary=crv_3,
    CbspCrvs=cbsp_site.SpatialCrv,
    PartitionLines=cbsp_site.CirculationLines,
    CirculationDepth=number_slider_5)  # -> _0PartitionLines, _1CirculationPoly, _2ResultantCbspCrv

# ----
# spaces inside the inner curve
path_5 = FilePath("C:\nir_dev\dots_tutorial\inputs\sample3.csv")
cbsp_site_2 = CbspSite(
    InputFilesCsv=path_5,
    InputSiteCrv=crv_boundary_2.InnerOffsetCrv,
    RotationInDegrees=Slider(0, range=0..360),
    RandomizedGenerations=Toggle(False),
    MinDev=Slider(0.62, range=0..3),
    NumberOfOptimizationLoops=Slider(0.62, range=0..3),
    LayerName="a")  # -> SpatialCrv, CirculationLines, CrvNamesColor

# ----
# color - peripheral
path_6 = FilePath("C:\nir_dev\dots_tutorial\inputs\colors.csv")
color_input_parser = ColorInput(InpFilePath=path_6, ListSpaceKeysNames=crv_boundary_2.CrvNamesColor, ListSpaceCrvs=crv_boundary_2.RESULTSegGeom)  # -> BrepFromCrvs, ColorStr
Z = UnitZ(Factor=Slider(0.053, range=0..1))
extr = Extrude(Base=color_input_parser.BrepFromCrvs, Direction=Z)
preview = CustomPreview(Geometry=extr, Material=color_input_parser.ColorStr)

# ----
# color
path_7 = FilePath("C:\nir_dev\dots_tutorial\inputs\colors.csv")
color_input_parser_2 = ColorInput(InpFilePath=path_7, ListSpaceKeysNames=cbsp_site.CrvNamesColor, ListSpaceCrvs=circulation_2._2ResultantCbspCrv)  # -> BrepFromCrvs, ColorStr
Z_2 = UnitZ(Factor=Slider(0.015, range=0..1))
extr_2 = Extrude(Base=color_input_parser_2.BrepFromCrvs, Direction=Z_2)
preview_2 = CustomPreview(Geometry=extr_2, Material=color_input_parser_2.ColorStr)

# ----
# color
path_8 = FilePath("C:\nir_dev\dots_tutorial\inputs\colors.csv")
color_input_parser_3 = ColorInput(InpFilePath=path_8, ListSpaceKeysNames=crv_boundary.CrvNamesColor, ListSpaceCrvs=crv_boundary.RESULTSegGeom)  # -> BrepFromCrvs, ColorStr
Z_3 = UnitZ(Factor=Slider(0.038, range=0..1))
extr_3 = Extrude(Base=color_input_parser_3.BrepFromCrvs, Direction=Z_3)
preview_3 = CustomPreview(Geometry=extr_3, Material=color_input_parser_3.ColorStr)

# ----
# color
path_9 = FilePath("C:\nir_dev\MegaSavageLevel\DotsProjRh6\DotsProj\DotsProj\bin\example_Files\inputs\colors.csv")
color_input_parser_4 = ColorInput(InpFilePath=path_9, ListSpaceKeysNames=cbsp.CrvNamesColor, ListSpaceCrvs=circulation._2ResultantCbspCrv)  # -> BrepFromCrvs, ColorStr
Z_4 = UnitZ(Factor=Slider(0.013, range=0..1))
extr_4 = Extrude(Base=color_input_parser_4.BrepFromCrvs, Direction=Z_4)
preview_4 = CustomPreview(Geometry=extr_4, Material=color_input_parser_4.ColorStr)

# ----
# circulation
number_slider_6 = Slider(0.07, range=0..1)
circulation_3 = GenerateCirculation(
    SiteCrvOuterBoundary=crv_boundary_2.InnerOffsetCrv,
    CbspCrvs=cbsp_site_2.SpatialCrv,
    PartitionLines=cbsp_site_2.CirculationLines,
    CirculationDepth=number_slider_6)  # -> _0PartitionLines, _1CirculationPoly, _2ResultantCbspCrv

panel = Panel(cbsp.CrvNamesColor)
send_db = DotsDBProj(InputCurves=circulation._2ResultantCbspCrv, NameOfTheCollection="testIbsp", KeyName=panel, WriteToDbTF=Toggle(True))  # -> DebugStr, SendInfoToDB

# ----
# color
path_10 = FilePath("C:\nir_dev\dots_tutorial\inputs\colors.csv")
color_input_parser_5 = ColorInput(InpFilePath=path_10, ListSpaceKeysNames=cbsp_site_2.CrvNamesColor, ListSpaceCrvs=circulation_3._2ResultantCbspCrv)  # -> BrepFromCrvs, ColorStr
Z_5 = UnitZ(Factor=Slider(0.053, range=0..1))
extr_5 = Extrude(Base=color_input_parser_5.BrepFromCrvs, Direction=Z_5)
preview_5 = CustomPreview(Geometry=extr_5, Material=color_input_parser_5.ColorStr)
