# Grasshopper definition dots_01_SA_combined.gh (Grasshopper 1.0.7)
# plug-ins: DotsProj

# ----
# Part 1/3
# takes the geometry-boundary,
# creates the space object.
# generate tentative geometry.
number_slider = Slider(6.642, range=0..20)
number_slider_2 = Slider(55.435, range=0..75)
number_slider_3 = Slider(10.224, range=0..20)
# Three-part solvers
path = FilePath("C:\nir_dev\MegaSavageLevel\DOTS\DotsProj\bin\example_Files\inputs_separated\massGeomSample.csv")
crv = Curve(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)
gen_spaces_p = GenerateEqualPeripheralSpaces(
    InputGeometryFilePath=path,
    InputSiteCurve=crv,
    FromSiteCurveOuterCirculationDepth=number_slider,
    FromOuterCirculationBayDepth=number_slider_2,
    FromBayDepthInnerCirculationDepth=number_slider_3)  # -> OutputCurves, OutputNames, DebugStr, OuterBayCrv, InnerBayCrv, InnerCirculationCrv

# ----
# Part 2/3
# resolve adjacencies: get the
# correct order of string- crv names
number_slider_4 = Slider(15, range=0..20)
path_2 = FilePath("C:\nir_dev\MegaSavageLevel\DOTS\DotsProj\bin\example_Files\inputs_separated\massAdjSample.csv")
adj_solver = AdjSolver(
    InputAdjacencyFilePath=path_2,
    ExistingCrvList=gen_spaces_p.OutputCurves,
    CorrespondingNameList=gen_spaces_p.OutputNames,
    NumberOfIterations=number_slider_4,
    ClearPreviousValues=Toggle(True),
    RandomizeAdjRels=Toggle(False),
    RunSolver=Toggle(True))  # -> OutputCurves, OutputNames, MsgNumItrs

# ----
# Part 3/3
# - takes the resolved adjacencies- names
# - take the outer boundary and geonerate the correct geometry
number_slider_5 = Slider(500, range=0..500)
geom_solver_q = GeometrySolverPeripheral(
    InputGeometryFilePath=path,
    InputSiteCurve=crv,
    CorrespondingNameList=adj_solver.OutputNames,
    FromSiteCurveOuterCirculationDepth=number_slider,
    FromOuterCirculationBayDepth=number_slider_2,
    FromBayDepthInnerCirculationDepth=number_slider_3,
    Sensitivity=number_slider_5)  # -> OutputCurves, OutputNames, DebugStr, DebugOuter, DebugInner

# ----
# internal space allocation
# binary partition:
# - separated geometry and adjacency inputs
path_3 = FilePath("C:\nir_dev\MegaSavageLevel\DOTS\DotsProj\bin\example_Files\inputs_separated\massGeomSample.csv")
path_4 = FilePath("C:\nir_dev\MegaSavageLevel\DOTS\DotsProj\bin\example_Files\inputs_separated\massAdjSample2.csv")
bsp_solver = CBSPSiteSolver2(
    InputADJACENCYFilePath=path_4,
    InputGEOMETRYFilePath=path_3,
    Site=gen_spaces_p.InnerCirculationCrv,
    Sensitivity=Slider(273, range=0..500),
    RotationInDegrees=Slider(198, range=0..360),
    NumberOfIterations=Slider(0.62, range=0..3),
    ClearAllValues=Toggle(True),
    RandomizeAdjRels=Toggle(False),
    RunSolver=Toggle(True))  # -> DebugStr, Curves, CrvNames, PartitionLines

# ----
# circulation
number_slider_6 = Slider(6.948, range=0..50)
circulation = GenerateCirculation(
    SiteCrvOuterBoundary=gen_spaces_p.InnerCirculationCrv,
    CbspCrvs=bsp_solver.Curves,
    PartitionLines=bsp_solver.PartitionLines,
    CirculationDepth=number_slider_6)  # -> _0PartitionLines, _1CirculationPoly, _2ResultantCbspCrv

Z = UnitZ(Factor=1)

# ----
# color spaces
path_5 = FilePath("C:\nir_dev\MegaSavageLevel\DOTS\DotsProj\bin\example_Files\inputs\colors.csv")
color_input_parser = ColorInput(InpFilePath=path_5, ListSpaceKeysNames=bsp_solver.CrvNames, ListSpaceCrvs=circulation._2ResultantCbspCrv)  # -> BrepFromCrvs, ColorStr
preview = CustomPreview(Geometry=color_input_parser.BrepFromCrvs, Material=color_input_parser.ColorStr)

# ----
# color  the spaces from:
# space-names
# space-geometry
path_6 = FilePath("C:\nir_dev\MegaSavageLevel\DOTS\DotsProj\bin\example_Files\inputs\colors.csv")
color_input_parser_2 = ColorInput(InpFilePath=path_6, ListSpaceKeysNames=geom_solver_q.OutputNames, ListSpaceCrvs=geom_solver_q.OutputCurves)  # -> BrepFromCrvs, ColorStr

extr = Extrude(Base=color_input_parser_2.BrepFromCrvs, Direction=Z)

preview_2 = CustomPreview(Geometry=extr, Material=color_input_parser_2.ColorStr)
