# Grasshopper definition dots_02_SA_open_crv.gh (Grasshopper 1.0.7)
# plug-ins: DotsProj

# ----
# open curve space allocation
number_slider = Slider(3, range=0..3)
path = FilePath("C:\nir_dev\MegaSavageLevel\DOTS\DotsProj\bin\example_Files\inputs\sample1.csv")
crv = Curve(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)
oc_linear = OpenCurveLinear(
    InpFilePath=path,
    BaseCurve=crv,
    OffsetDistance=Slider(21.744, range=0..30),
    BayDepth=Slider(25.871, range=0..100),
    NumberIterations=Slider(25, range=0..100),
    CenterSide1Side2=Slider(1, range=0..2),
    Sensitivity_AreaX100=number_slider,
    LayerName="a",
    InterpolatedOrNormalSegmentsTF=Toggle(True))  # -> CrvNamesColor, SpacesGeom, DebugCrvs

# ----
# open curve space allocation
number_slider_2 = Slider(3, range=0..3)
# places space-activities along a curve - outside
path_2 = FilePath("C:\nir_dev\MegaSavageLevel\DOTS\DotsProj\bin\example_Files\inputs\sample2.csv")
crv_2 = Curve(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)
oc_linear_2 = OpenCurveLinear(
    InpFilePath=path_2,
    BaseCurve=crv_2,
    OffsetDistance=Slider(21.744, range=0..30),
    BayDepth=Slider(25.871, range=0..100),
    NumberIterations=Slider(25, range=0..100),
    CenterSide1Side2=Slider(2, range=0..2),
    Sensitivity_AreaX100=number_slider_2,
    LayerName="b",
    InterpolatedOrNormalSegmentsTF=Toggle(False))  # -> CrvNamesColor, SpacesGeom, DebugCrvs

# ----
# places space-activities along a curve - inside
crv_3 = Curve([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])

# ----
# color spaces
path_3 = FilePath("C:\nir_dev\MegaSavageLevel\DOTS\DotsProj\bin\example_Files\inputs\colors.csv")
color_input_parser = ColorInput(InpFilePath=path_3, ListSpaceKeysNames=oc_linear.CrvNamesColor, ListSpaceCrvs=oc_linear.SpacesGeom)  # -> BrepFromCrvs, ColorStr
preview = CustomPreview(Geometry=color_input_parser.BrepFromCrvs, Material=color_input_parser.ColorStr)

# ----
# color spaces
path_4 = FilePath("C:\nir_dev\MegaSavageLevel\DOTS\DotsProj\bin\example_Files\inputs\colors.csv")
color_input_parser_2 = ColorInput(InpFilePath=path_4, ListSpaceKeysNames=oc_linear_2.CrvNamesColor, ListSpaceCrvs=oc_linear_2.SpacesGeom)  # -> BrepFromCrvs, ColorStr
preview_2 = CustomPreview(Geometry=color_input_parser_2.BrepFromCrvs, Material=color_input_parser_2.ColorStr)
