# Grasshopper definition dots_05_util.gh (Grasshopper 1.0.7)
# plug-ins: DotsProj

# ----
# fit spaces along a curve - periphery
# for space allocation
number_slider = Slider(0.287, range=0..2)
path = FilePath("C:\nir_dev\MegaSavageLevel\DOTS\DotsProj\bin\example_Files\inputs\sample1.csv")
crv = Curve(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)
crv_boundary = CrvBoundary(
    InpFilePath=path,
    InpSiteCurve=crv,
    FromSiteOuterCirculationDepth=Slider(0.811, range=0..1),
    FromOuterCirculationBayDepth=Slider(3, range=0..3),
    FromBayDepthInnerCirculationDepth=number_slider,
    SensitivityX100=Slider(1, range=0..10),
    OptimizationItrs=Slider(0, range=0..100))  # -> OuterOffsetCrv, InnerOffsetCrv, RESULTSegGeom, CrvNamesColor

crvs_from_names = ExtractCrvsFromNames(
    AllTheNamesOfTheCurves=crv_boundary.CrvNamesColor,
    AllTheCurvesToExtract=crv_boundary.RESULTSegGeom,
    StringCommaSeparatedNamesToExtractCurve="a")  # -> NamesExtractedCurves, CurvesExtracted

# ----
# color
path_2 = FilePath("C:\nir_dev\dots_tutorial\inputs\colors.csv")
color_input_parser = ColorInput(InpFilePath=path_2, ListSpaceKeysNames=crv_boundary.CrvNamesColor, ListSpaceCrvs=crv_boundary.RESULTSegGeom)  # -> BrepFromCrvs, ColorStr
Z = UnitZ(Factor=Slider(0.038, range=0..1))
extr = Extrude(Base=color_input_parser.BrepFromCrvs, Direction=Z)
preview = CustomPreview(Geometry=extr, Material=color_input_parser.ColorStr)

Z_2 = UnitZ(Factor=1)
move = Move(Geometry=crvs_from_names.CurvesExtracted, Motion=Z_2)  # -> Geometry, Transform
item = ListItem(List=move.Geometry, Index=Slider(1, range=0..5), Wrap=True)
item_2 = ListItem(List=move.Geometry, Index=Slider(0, range=0..5), Wrap=True)

# ----
# fit spaces inside a curve
# for space allocation
path_3 = FilePath("C:\nir_dev\MegaSavageLevel\DOTS\DotsProj\bin\example_Files\inputs\sample1.csv")
crv_2 = Curve(item_2)
cbsp_site = CbspSite(
    InputFilesCsv=path_3,
    InputSiteCrv=crv_2,
    RotationInDegrees=Slider(0, range=0..360),
    RandomizedGenerations=Toggle(False),
    MinDev=Slider(0, range=0..3),
    NumberOfOptimizationLoops=Slider(0.62, range=0..3),
    LayerName="cd")  # -> SpatialCrv, CirculationLines, CrvNamesColor

# ----
# fit spaces inside a curve
# for space allocation
path_4 = FilePath("C:\nir_dev\MegaSavageLevel\DOTS\DotsProj\bin\example_Files\inputs\sample2.csv")
crv_3 = Curve(item)
cbsp_site_2 = CbspSite(
    InputFilesCsv=path_4,
    InputSiteCrv=crv_3,
    RotationInDegrees=Slider(0, range=0..360),
    RandomizedGenerations=Toggle(False),
    MinDev=Slider(0, range=0..3),
    NumberOfOptimizationLoops=Slider(0.62, range=0..3),
    LayerName="ce")  # -> SpatialCrv, CirculationLines, CrvNamesColor

# ----
# circulation
number_slider_2 = Slider(0, range=0..1)
circulation = GenerateCirculation(
    SiteCrvOuterBoundary=crv_2,
    CbspCrvs=cbsp_site.SpatialCrv,
    PartitionLines=cbsp_site.CirculationLines,
    CirculationDepth=number_slider_2)  # -> _0PartitionLines, _1CirculationPoly, _2ResultantCbspCrv

# ----
# circulation
number_slider_3 = Slider(0, range=0..1)
circulation_2 = GenerateCirculation(
    SiteCrvOuterBoundary=crv_3,
    CbspCrvs=cbsp_site_2.SpatialCrv,
    PartitionLines=cbsp_site_2.CirculationLines,
    CirculationDepth=number_slider_3)  # -> _0PartitionLines, _1CirculationPoly, _2ResultantCbspCrv

# ----
# color
path_5 = FilePath("C:\nir_dev\dots_tutorial\inputs\colors.csv")
color_input_parser_2 = ColorInput(InpFilePath=path_5, ListSpaceKeysNames=cbsp_site.CrvNamesColor, ListSpaceCrvs=circulation._2ResultantCbspCrv)  # -> BrepFromCrvs, ColorStr
Z_3 = UnitZ(Factor=Slider(0.015, range=0..1))
extr_2 = Extrude(Base=color_input_parser_2.BrepFromCrvs, Direction=Z_3)
preview_2 = CustomPreview(Geometry=extr_2, Material=color_input_parser_2.ColorStr)

# ----
# color
path_6 = FilePath("C:\nir_dev\dots_tutorial\inputs\colors.csv")
color_input_parser_3 = ColorInput(InpFilePath=path_6, ListSpaceKeysNames=cbsp_site_2.CrvNamesColor, ListSpaceCrvs=circulation_2._2ResultantCbspCrv)  # -> BrepFromCrvs, ColorStr
Z_4 = UnitZ(Factor=Slider(0.015, range=0..1))
extr_3 = Extrude(Base=color_input_parser_3.BrepFromCrvs, Direction=Z_4)
preview_3 = CustomPreview(Geometry=extr_3, Material=color_input_parser_3.ColorStr)
