# Grasshopper definition dots_06_util.gh (Grasshopper 1.0.7)
# plug-ins: DotsProj

# ----
# parcel- binary partition
number_slider = Slider(0, range=0..360)
crv = Curve(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)
parcel_subdiv = ParcelsBySubdivision(
    InputSite=crv,
    NumOfParcels=Slider(100, range=0..100),
    DevMean01=Slider(0.149, range=0..1),
    AngleAlignmentDegrees0360=number_slider,
    ShowThisIterations=Slider(0, range=0..360),
    ResetAllValues=Toggle(True),
    Generate=Toggle(True))  # -> LowestDeviationOfParcelSolution, StreetCenterLines, OutputParcelFromRequiredIteration, OutputStreetFromRequiredIteration, NumberOfResults
geo = Geometry(parcel_subdiv.LowestDeviationOfParcelSolution)

# ----
# parcel- binary partition
number_slider_2 = Slider(0, range=0..360)
crv_2 = Curve(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)
parcel_subdiv_2 = ParcelsBySubdivision(
    InputSite=crv_2,
    NumOfParcels=Slider(100, range=0..100),
    DevMean01=Slider(0.149, range=0..1),
    AngleAlignmentDegrees0360=number_slider_2,
    ShowThisIterations=Slider(0, range=0..360),
    ResetAllValues=Toggle(True),
    Generate=Toggle(True))  # -> LowestDeviationOfParcelSolution, StreetCenterLines, OutputParcelFromRequiredIteration, OutputStreetFromRequiredIteration, NumberOfResults
geo_2 = Geometry(parcel_subdiv_2.LowestDeviationOfParcelSolution)

# ----
# separate parcels by collective area
number_slider_3 = Slider(95.08, range=0..100)
crv_select = CurveSelector(
    InputSiteCrv=crv_2,
    Parcels=parcel_subdiv_2.LowestDeviationOfParcelSolution,
    CentralizeOrDisperse=Toggle(True),
    AreaOfCurvesToSplitListInto=number_slider_3)  # -> OutputListOfParcels1, OutputListOfParcels2
brep = Brep(crv_select.OutputListOfParcels1)
brep_2 = Brep(crv_select.OutputListOfParcels2)  # disabled
preview = CustomPreview(Geometry=brep_2, Material=ColourSwatch(SwatchColor=RGB(16, 232, 255)))
preview_2 = CustomPreview(Geometry=brep, Material=ColourSwatch(SwatchColor=RGB(230, 37, 255)))

# ----
# separate parcels by area
number_slider_4 = Slider(335.154, range=0..1000)
min_area_separator = CurveAreaSeparator(CrvList=parcel_subdiv.LowestDeviationOfParcelSolution, MinimumAreaSplit=number_slider_4)  # -> CrvAreaMinArea, CrvAreaMinArea_2
brep_3 = Brep(min_area_separator.CrvAreaMinArea)
brep_4 = Brep(min_area_separator.CrvAreaMinArea_2)
preview_3 = CustomPreview(Geometry=brep_4, Material=ColourSwatch(SwatchColor=RGB(16, 232, 255)))
preview_4 = CustomPreview(Geometry=brep_3, Material=ColourSwatch(SwatchColor=RGB(230, 37, 255)))

# ----
# block massing
number_slider_5 = Slider(5.86, range=0..25)
staggered_mass = StaggeredMassing(
    SiteCurve=crv_select.OutputListOfParcels2,
    FloorHeightRequired=number_slider_5,
    SetbackStepbacksForMassing="2,4,7",
    HeightsCorrespondingToStepbacks="10,15,20",
    MinArea=Slider(0, range=0..5000),
    NameOptional="v")  # -> OutputFloorCurves, OutputMassingBreps, OutputTextPanelTotalFSRGFAAchieved, NumberOfFloors, ExcludedCrv, Name, Debug

# ----
# stepped massing
number_slider_6 = Slider(5.336, range=0..25)
block = MassingExtrudeBlock(
    SiteCurve=crv_select.OutputListOfParcels1,
    Setback=number_slider_6,
    FsrFar=Slider(3, range=0..25),
    FLRHT=Slider(5, range=0..5),
    MinCrvArea=Slider(50, range=0..50),
    NameOptional="a")  # -> OutputMassingBreps, OutputFloorCurves, Name

# ----
# block massing
number_slider_7 = Slider(1.599, range=0..25)
block_2 = MassingExtrudeBlock(
    SiteCurve=min_area_separator.CrvAreaMinArea_2,
    Setback=number_slider_7,
    FsrFar=Slider(3, range=0..25),
    FLRHT=Slider(5, range=0..5),
    MinCrvArea=Slider(43, range=0..50),
    NameOptional="a")  # -> OutputMassingBreps, OutputFloorCurves, Name

# ----
# stepped massing
number_slider_8 = Slider(5.86, range=0..25)
staggered_mass_2 = StaggeredMassing(
    SiteCurve=min_area_separator.CrvAreaMinArea,
    FloorHeightRequired=number_slider_8,
    SetbackStepbacksForMassing="2,4,7",
    HeightsCorrespondingToStepbacks="10,15,20",
    MinArea=Slider(0, range=0..5000),
    NameOptional="v")  # -> OutputFloorCurves, OutputMassingBreps, OutputTextPanelTotalFSRGFAAchieved, NumberOfFloors, ExcludedCrv, Name, Debug

preview_5 = CustomPreview(Geometry=staggered_mass.OutputMassingBreps, Material=ColourSwatch(SwatchColor=RGB(237, 58, 17)))
preview_6 = CustomPreview(Geometry=staggered_mass_2.OutputMassingBreps, Material=ColourSwatch(SwatchColor=RGB(237, 58, 17)))
preview_7 = CustomPreview(Geometry=block_2.OutputMassingBreps, Material=ColourSwatch(SwatchColor=RGB(41, 169, 17)))
preview_8 = CustomPreview(Geometry=block.OutputMassingBreps, Material=ColourSwatch(SwatchColor=RGB(41, 169, 17)))
