# Grasshopper definition dots_07_parcel_alloc_massing_types.gh (Grasshopper 1.0.7)
# plug-ins: DotsProj

number_slider = Slider(284.1, range=0..360)
curve = Curve(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)
grids2d = Grids2d(
    SiteCurve=curve,
    NumInXDirection=Slider(4, range=1..5),
    NumInYDirection=Slider(3, range=1..5),
    RotationInDegrees=number_slider)  # -> OutputParcels, OutputVertices
geometry = Geometry(grids2d.OutputVertices)
curve_2 = Curve(grids2d.OutputParcels)
parcelallocatormain = ParcelAllocatorMain(
    InputParcels=curve_2,
    EachTypeOfSpaceSeparatedByCommas="a,b,c",
    FSROfEachTypeOfSpaceSeparatedByCommas="0.1,0.2,0.3",
    NumberOfEachTypeOfSpaceSeparatedByCommas="4,3,2")  # -> SystemMessage, SequenceOfParcels, SequenceOfFSRS, SequenceOfNames
panel = Panel(parcelallocatormain.SystemMessage)
extract_crvs_from_names = ExtractCrvsFromNames(
    AllTheNamesOfTheCurves=parcelallocatormain.SequenceOfNames,
    AllTheCurvesToExtract=parcelallocatormain.SequenceOfParcels,
    StringCommaSeparatedNamesToExtractCurve="c")  # -> NamesExtractedCurves, CurvesExtracted
extract_crvs_from_names_2 = ExtractCrvsFromNames(
    AllTheNamesOfTheCurves=parcelallocatormain.SequenceOfNames,
    AllTheCurvesToExtract=parcelallocatormain.SequenceOfParcels,
    StringCommaSeparatedNamesToExtractCurve="b")  # -> NamesExtractedCurves, CurvesExtracted
extract_crvs_from_names_3 = ExtractCrvsFromNames(
    AllTheNamesOfTheCurves=parcelallocatormain.SequenceOfNames,
    AllTheCurvesToExtract=parcelallocatormain.SequenceOfParcels,
    StringCommaSeparatedNamesToExtractCurve="a")  # -> NamesExtractedCurves, CurvesExtracted
panel_2 = Panel(extract_crvs_from_names.CurvesExtracted)
massfromlwf = MassFromLWF(
    SiteCurve=curve,
    InputParcels=extract_crvs_from_names.CurvesExtracted,
    FSROfSite=Slider(0.58, range=0.25..4.5),
    FLRHTOfBuilding=Slider(0.89, range=0.25..4.5),
    FootprintLengthOfBuilding=Slider(5.07, range=0.25..20),
    FootprintWidthOfBuilding=Slider(9.53, range=0.25..20),
    RotationInDegrees=number_slider,
    TestIfBeyondCurveTF=Toggle(True))  # -> SystemMessage, OutputFootprint, BuildingFloorplates, OutputMass
panel_3 = Panel(extract_crvs_from_names_2.CurvesExtracted)
panel_4 = Panel(extract_crvs_from_names_3.CurvesExtracted)
massfromlwf_2 = MassFromLWF(
    SiteCurve=curve,
    InputParcels=extract_crvs_from_names_2.CurvesExtracted,
    FSROfSite=Slider(0.58, range=0.25..4.5),
    FLRHTOfBuilding=Slider(2.28, range=0.25..4.5),
    FootprintLengthOfBuilding=Slider(6.74, range=0.25..20),
    FootprintWidthOfBuilding=Slider(5.97, range=0.25..20),
    RotationInDegrees=number_slider,
    TestIfBeyondCurveTF=Toggle(True))  # -> SystemMessage, OutputFootprint, BuildingFloorplates, OutputMass
massfromlwf_3 = MassFromLWF(
    SiteCurve=curve,
    InputParcels=extract_crvs_from_names_3.CurvesExtracted,
    FSROfSite=Slider(0.58, range=0.25..4.5),
    FLRHTOfBuilding=Slider(1.54, range=0.25..4.5),
    FootprintLengthOfBuilding=Slider(6.27, range=0.25..20),
    FootprintWidthOfBuilding=Slider(5.73, range=0.25..20),
    RotationInDegrees=number_slider,
    TestIfBeyondCurveTF=Toggle(True))  # -> SystemMessage, OutputFootprint, BuildingFloorplates, OutputMass
panel_5 = Panel(massfromlwf.SystemMessage)
panel_6 = Panel(massfromlwf_2.SystemMessage)
panel_7 = Panel(massfromlwf_3.SystemMessage)
