# Grasshopper definition dots_08_grids_parcels_massing.gh (Grasshopper 1.0.7)
# plug-ins: DotsProj

curve = Curve(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)
curve_2 = Curve(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)
site_partition_circulation = SitePartitionCirculation(SiteCurve=curve_2, CirculationCurve=curve, CirculationDepth=1, MinimumAreaPartition=1)  # -> CirculationCurves, PartitionCurves, CirculaitonClosedCurves
list_item = ListItem(List=site_partition_circulation.PartitionCurves, Index=Slider(0, range=0..2), Wrap=True)
list_item_2 = ListItem(List=site_partition_circulation.PartitionCurves, Index=Slider(1, range=0..2), Wrap=True)
grids2d = Grids2d(
    SiteCurve=list_item,
    NumInXDirection=Slider(6, range=0..10),
    NumInYDirection=Slider(6, range=0..10),
    RotationInDegrees=Slider(259, range=0..360))  # -> OutputParcels, OutputVertices
grids2d_2 = Grids2d(
    SiteCurve=list_item_2,
    NumInXDirection=Slider(3, range=0..10),
    NumInYDirection=Slider(8, range=0..10),
    RotationInDegrees=Slider(220, range=0..360))  # -> OutputParcels, OutputVertices
courtyard_massing = CourtyardMassing(
    SiteCurve=grids2d.OutputParcels,
    FSRFAR=1,
    FloorHeight=3,
    Setback=1,
    BayDepth=Slider(2, range=0..10),
    MinFloorArea=0.1,
    MinCourtyardArea=0.1,
    NameOptional="Dots_courtyard_massing")  # -> OutputFloorCurves, OutputMassingBreps, ExcludedCrv, CrvFsr, Name
courtyard_massing_2 = CourtyardMassing(
    SiteCurve=grids2d_2.OutputParcels,
    FSRFAR=1,
    FloorHeight=3,
    Setback=1,
    BayDepth=Slider(2, range=0..10),
    MinFloorArea=0.1,
    MinCourtyardArea=0.1,
    NameOptional="Dots_courtyard_massing")  # -> OutputFloorCurves, OutputMassingBreps, ExcludedCrv, CrvFsr, Name
massing_extrude_block = MassingExtrudeBlock(
    SiteCurve=courtyard_massing.ExcludedCrv,
    Setback=1,
    FSR=4,
    FLRHT=3,
    MinCrvArea=Slider(17, range=0..250),
    NameOptional="dots")  # -> OutputMassingBreps, OutputFloorCurves, Name
massing_extrude_block_2 = MassingExtrudeBlock(
    SiteCurve=courtyard_massing_2.ExcludedCrv,
    Setback=1,
    FSR=4,
    FLRHT=3,
    MinCrvArea=Slider(10, range=0..250),
    NameOptional="dots")  # -> OutputMassingBreps, OutputFloorCurves, Name
