# Grasshopper definition dots_massing.gh (Grasshopper 1.0.7)
# plug-ins: DotsProj

crv = Curve(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)
crv_2 = Curve(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)
parcel_subdiv_diff = ParcelsBySubdivisionWithSubtraction(
    InputSite=crv,
    InternalCrv=crv_2,
    NumOfParcels=Slider(20, range=1..20),
    DevMean01=Slider(0, range=0..1),
    AngleAlignmentDegrees0360=Slider(128, range=1..360),
    ShowThisIterations=Slider(0, range=0..360),
    ResetAllValues=Toggle(True),
    Generate=Toggle(True))  # -> LowestDeviationOfParcelSolution, StreetCenterLines, OutputParcelFromRequiredIteration, OutputStreetFromRequiredIteration, NumberOfResults

# ----
# binary partition
number_slider = Slider(162, range=1..360)
crv_3 = Curve(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)
parcel_subdiv = ParcelsBySubdivision(
    InputSite=crv_3,
    NumOfParcels=Slider(12, range=1..20),
    DevMean01=Slider(0, range=0..1),
    AngleAlignmentDegrees0360=number_slider,
    ShowThisIterations=Slider(0, range=0..360),
    ResetAllValues=Toggle(True),
    Generate=Toggle(True))  # -> LowestDeviationOfParcelSolution, StreetCenterLines, OutputParcelFromRequiredIteration, OutputStreetFromRequiredIteration, NumberOfResults

crv_4 = Curve(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)
crv_5 = Curve([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])
site_partition_circulation = SitePartitionCirculation(
    SiteCurve=crv_4,
    CirculationCurve=crv_5,
    CirculationDepth=Slider(2.582, range=0..5),
    MinimumAreaPartition=Slider(2.582, range=0..5))  # -> DebugText, CirculationCurves, PartitionCurves

crv_6 = Curve(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)
crv_7 = Curve(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)
parcel_int_poly = ParcelsFromInternalPoly(InputSiteCurve=crv_6, InternalPolyine=crv_7)  # -> OutputParcels, OutputStreets

# ----
# circulation
number_slider_2 = Slider(2.332, range=0..20)
circulation = GenerateCirculation(
    SiteCrvOuterBoundary=crv,
    CbspCrvs=parcel_subdiv_diff.LowestDeviationOfParcelSolution,
    PartitionLines=parcel_subdiv_diff.StreetCenterLines,
    CirculationDepth=number_slider_2)  # -> _0PartitionLines, _1CirculationPoly, _2ResultantCbspCrv

brep = Brep(site_partition_circulation.PartitionCurves)
preview = CustomPreview(Geometry=brep, Material=ColourSwatch(SwatchColor=RGB(68, 152, 37)))

# ----
# circulation
number_slider_3 = Slider(2.332, range=0..20)
circulation_2 = GenerateCirculation(
    SiteCrvOuterBoundary=crv_6,
    CbspCrvs=parcel_int_poly.OutputParcels,
    PartitionLines=parcel_int_poly.OutputStreets,
    CirculationDepth=number_slider_3)  # -> _0PartitionLines, _1CirculationPoly, _2ResultantCbspCrv

# ----
# circulation
number_slider_4 = Slider(2.332, range=0..20)
circulation_3 = GenerateCirculation(
    SiteCrvOuterBoundary=crv_3,
    CbspCrvs=parcel_subdiv.LowestDeviationOfParcelSolution,
    PartitionLines=parcel_subdiv.StreetCenterLines,
    CirculationDepth=number_slider_4)  # -> _0PartitionLines, _1CirculationPoly, _2ResultantCbspCrv

preview_2 = CustomPreview(Material=ColourSwatch(SwatchColor=RGB(237, 58, 17)))

brep_2 = Brep(circulation._2ResultantCbspCrv)
preview_3 = CustomPreview(Geometry=brep_2, Material=ColourSwatch(SwatchColor=RGB(68, 152, 37)))

crv_union = Union(InputListOfCurvesA=circulation._1CirculationPoly)
brep_3 = Brep(crv_union)
preview_4 = CustomPreview(Geometry=brep_3, Material=ColourSwatch(SwatchColor=RGB(255, 0, 0)))

crv_union_2 = Union(InputListOfCurvesA=circulation_2._1CirculationPoly)
brep_4 = Brep(crv_union_2)
preview_5 = CustomPreview(Geometry=brep_4, Material=ColourSwatch(SwatchColor=RGB(255, 0, 0)))

block = MassingExtrudeBlock(
    SiteCurve=site_partition_circulation.PartitionCurves,
    Setback=Slider(3.806, range=0..20),
    FsrFar=Slider(5.165, range=0..20),
    FLRHT=Slider(2.332, range=0..20),
    MinCrvArea=Slider(0, range=0..1000),
    NameOptional="a")  # -> OutputMassingBreps, OutputFloorCurves, Name
geo = Geometry(block.OutputFloorCurves)

brep_5 = Brep(circulation_2._2ResultantCbspCrv)
preview_6 = CustomPreview(Geometry=brep_5, Material=ColourSwatch(SwatchColor=RGB(68, 152, 37)))

crv_union_3 = Union(InputListOfCurvesA=circulation_3._1CirculationPoly)
brep_6 = Brep(crv_union_3)
preview_7 = CustomPreview(Geometry=brep_6, Material=ColourSwatch(SwatchColor=RGB(255, 0, 0)))

brep_7 = Brep(circulation_3._2ResultantCbspCrv)
preview_8 = CustomPreview(Geometry=brep_7, Material=ColourSwatch(SwatchColor=RGB(68, 152, 37)))

brep_8 = Brep(block.OutputMassingBreps)
preview_9 = CustomPreview(Geometry=brep_8, Material=ColourSwatch(SwatchColor=RGB(195, 112, 125)))

staggered_mass = StaggeredMassing(
    SiteCurve=circulation_2._2ResultantCbspCrv,
    FloorHeightRequired=Slider(5.86, range=0..25),
    SetbackStepbacksForMassing="2,4,7",
    HeightsCorrespondingToStepbacks="2,5,10",
    MinArea=Slider(0, range=0..5000),
    NameOptional="v")  # -> OutputFloorCurves, OutputMassingBreps, OutputTextPanelTotalFSRGFAAchieved, NumberOfFloors, ExcludedCrv, Name
preview_10 = CustomPreview(Geometry=staggered_mass.OutputMassingBreps, Material=ColourSwatch(SwatchColor=RGB(237, 58, 17)))

simplify = SimplifyCurve(Curve=circulation_3._2ResultantCbspCrv)  # -> Curve, Simplified
split_parcel_uv = SplitParcelUV(
    SiteCurve=simplify.Curve,
    AngleCutter=Slider(0.122, range=0..3.142),
    BayDepth=Slider(7, range=0..7),
    AspectCutter01=Slider(0.387, range=0..1),
    CirDepth=Slider(2.087, range=0..5),
    Side1TF=Toggle(True),
    Side2TF=Toggle(False))  # -> BuildingFootprints, UVCuttersCirculation, Debug
crv_8 = Curve(split_parcel_uv.BuildingFootprints)
simplify_2 = SimplifyCurve(Curve=split_parcel_uv.BuildingFootprints)  # -> Curve, Simplified
block_2 = MassingExtrudeBlock(
    SiteCurve=simplify_2.Curve,
    Setback=Slider(0, range=0..25),
    FsrFar=Slider(3, range=0..25),
    FLRHT=Slider(5, range=0..5),
    MinCrvArea=Slider(0, range=0..5000),
    NameOptional="a")  # -> OutputMassingBreps, OutputFloorCurves, Name
geo_2 = Geometry(block_2.OutputMassingBreps)
geo_3 = Geometry(block_2.OutputFloorCurves)
preview_11 = CustomPreview(Geometry=geo_2, Material=ColourSwatch(SwatchColor=RGB(237, 58, 17)))

courtyard_mass = CourtyardMassing(
    SiteCurve=circulation._2ResultantCbspCrv,
    FSRFAR=Slider(3.806, range=0..20),
    FloorHeight=Slider(5.165, range=0..20),
    Setback=Slider(0.14, range=0..20),
    BayDepth=Slider(7.818, range=0..15),
    MinFloorArea=Slider(701.499, range=0..1000),
    NameOptional="a")  # -> OutputFloorCurves, OutputMassingBreps, ExcludedCrv, Name
geo_4 = Geometry(courtyard_mass.OutputFloorCurves)
preview_12 = CustomPreview(Geometry=courtyard_mass.OutputMassingBreps, Material=ColourSwatch(SwatchColor=RGB(237, 58, 17)))

simplify_3 = SimplifyCurve(Curve=courtyard_mass.ExcludedCrv)  # -> Curve, Simplified
block_3 = MassingExtrudeBlock(
    SiteCurve=simplify_3.Curve,
    Setback=Slider(4.114, range=0..25),
    FsrFar=Slider(3, range=0..25),
    FLRHT=Slider(5, range=0..5),
    MinCrvArea=Slider(52, range=0..5000),
    NameOptional="a")  # -> OutputMassingBreps, OutputFloorCurves, Name
geo_5 = Geometry(block_3.OutputMassingBreps)
geo_6 = Geometry(block_3.OutputFloorCurves)
preview_13 = CustomPreview(Geometry=geo_5, Material=ColourSwatch(SwatchColor=RGB(216, 156, 17)))
