# Grasshopper definition dots_parcellation.gh (Grasshopper 1.0.7)
# plug-ins: DotsProj

# ----
# binary partition
number_slider = Slider(162, range=1..360)
crv = Curve(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)
parcel_subdiv = ParcelsBySubdivision(
    InputSite=crv,
    NumOfParcels=Slider(20, range=1..20),
    DevMean01=Slider(0, range=0..1),
    AngleAlignmentDegrees0360=number_slider,
    ShowThisIterations=Slider(0, range=0..360),
    ResetAllValues=Toggle(True),
    Generate=Toggle(True))  # -> LowestDeviationOfParcelSolution, StreetCenterLines, OutputParcelFromRequiredIteration, OutputStreetFromRequiredIteration, NumberOfResults

crv_2 = Curve(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)
crv_3 = Curve(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)
parcel_subdiv_diff = ParcelsBySubdivisionWithSubtraction(
    InputSite=crv_2,
    InternalCrv=crv_3,
    NumOfParcels=Slider(20, range=1..20),
    DevMean01=Slider(0, range=0..1),
    AngleAlignmentDegrees0360=Slider(128, range=1..360),
    ShowThisIterations=Slider(0, range=0..360),
    ResetAllValues=Toggle(True),
    Generate=Toggle(True))  # -> LowestDeviationOfParcelSolution, StreetCenterLines, OutputParcelFromRequiredIteration, OutputStreetFromRequiredIteration, NumberOfResults

crv_4 = Curve(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)
crv_5 = Curve(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)
parcel_int_poly = ParcelsFromInternalPoly(InputSiteCurve=crv_4, InternalPolyine=crv_5)  # -> OutputParcels, OutputStreets

crv_6 = Curve(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)
crv_7 = Curve([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])
site_partition_circulation = SitePartitionCirculation(
    SiteCurve=crv_6,
    CirculationCurve=crv_7,
    CirculationDepth=Slider(2.582, range=0..5),
    MinimumAreaPartition=Slider(2.582, range=0..5))  # -> DebugText, CirculationCurves, PartitionCurves

# ----
# circulation
number_slider_2 = Slider(2.332, range=0..20)
circulation = GenerateCirculation(
    SiteCrvOuterBoundary=crv_4,
    CbspCrvs=parcel_int_poly.OutputParcels,
    PartitionLines=parcel_int_poly.OutputStreets,
    CirculationDepth=number_slider_2)  # -> _0PartitionLines, _1CirculationPoly, _2ResultantCbspCrv

# ----
# circulation
number_slider_3 = Slider(2.332, range=0..20)
circulation_2 = GenerateCirculation(
    SiteCrvOuterBoundary=crv_2,
    CbspCrvs=parcel_subdiv_diff.LowestDeviationOfParcelSolution,
    PartitionLines=parcel_subdiv_diff.StreetCenterLines,
    CirculationDepth=number_slider_3)  # -> _0PartitionLines, _1CirculationPoly, _2ResultantCbspCrv

brep = Brep(site_partition_circulation.PartitionCurves)
preview = CustomPreview(Geometry=brep, Material=ColourSwatch(SwatchColor=RGB(68, 152, 37)))

# ----
# circulation
number_slider_4 = Slider(2.332, range=0..20)
circulation_3 = GenerateCirculation(
    SiteCrvOuterBoundary=crv,
    CbspCrvs=parcel_subdiv.LowestDeviationOfParcelSolution,
    PartitionLines=parcel_subdiv.StreetCenterLines,
    CirculationDepth=number_slider_4)  # -> _0PartitionLines, _1CirculationPoly, _2ResultantCbspCrv

crv_union = Union(InputListOfCurvesA=circulation._1CirculationPoly)
brep_2 = Brep(crv_union)
preview_2 = CustomPreview(Geometry=brep_2, Material=ColourSwatch(SwatchColor=RGB(255, 0, 0)))

brep_3 = Brep(circulation_2._2ResultantCbspCrv)
preview_3 = CustomPreview(Geometry=brep_3, Material=ColourSwatch(SwatchColor=RGB(68, 152, 37)))

crv_union_2 = Union(InputListOfCurvesA=circulation_2._1CirculationPoly)
brep_4 = Brep(crv_union_2)
preview_4 = CustomPreview(Geometry=brep_4, Material=ColourSwatch(SwatchColor=RGB(255, 0, 0)))

brep_5 = Brep(circulation._2ResultantCbspCrv)
preview_5 = CustomPreview(Geometry=brep_5, Material=ColourSwatch(SwatchColor=RGB(68, 152, 37)))

brep_6 = Brep(circulation_3._2ResultantCbspCrv)
preview_6 = CustomPreview(Geometry=brep_6, Material=ColourSwatch(SwatchColor=RGB(68, 152, 37)))

crv_union_3 = Union(InputListOfCurvesA=circulation_3._1CirculationPoly)
brep_7 = Brep(crv_union_3)
preview_7 = CustomPreview(Geometry=brep_7, Material=ColourSwatch(SwatchColor=RGB(255, 0, 0)))
