# Grasshopper definition dots_util_00.gh (Grasshopper 1.0.7)
# plug-ins: DotsProj

# ----
# fit spaces along a curve - periphery
# for space allocation
number_slider = Slider(0.287, range=0..2)
path = FilePath("C:\nir_dev\dots_tutorial\inputs\sample1.csv")
crv = Curve(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)
crv_boundary = CrvBoundary(
    InpFilePath=path,
    InpSiteCurve=crv,
    FromSiteOuterCirculationDepth=Slider(0.811, range=0..1),
    FromOuterCirculationBayDepth=Slider(3, range=0..3),
    FromBayDepthInnerCirculationDepth=number_slider,
    SensitivityX100=Slider(1, range=0..10),
    OptimizationItrs=Slider(0, range=0..100))  # -> OuterOffsetCrv, InnerOffsetCrv, RESULTSegGeom, CrvNamesColor

crv_2 = Curve(<curve referenced from the Rhino model>)
parcel_subdiv = ParcelsBySubdivision(
    InputSite=crv_2,
    NumOfParcels=Slider(100, range=0..100),
    DevMean01=Slider(0.149, range=0..1),
    AngleAlignmentDegrees0360=Slider(0, range=0..360),
    ShowThisIterations=Slider(0, range=0..360),
    ResetAllValues=Toggle(True),
    Generate=Toggle(True))  # -> LowestDeviationOfParcelSolution, StreetCenterLines, OutputParcelFromRequiredIteration, OutputStreetFromRequiredIteration, NumberOfResults; disabled
geo = Geometry(parcel_subdiv.LowestDeviationOfParcelSolution)
crv_select = CurveSelector(
    InputSiteCrv=crv_2,
    Parcels=parcel_subdiv.LowestDeviationOfParcelSolution,
    CentralizeOrDisperse=Toggle(False),
    AreaOfCurvesToSplitListInto=Slider(53.405, range=0..100))  # -> OutputListOfParcels1, OutputListOfParcels2
brep = Brep(crv_select.OutputListOfParcels1)
brep_2 = Brep(crv_select.OutputListOfParcels2)
preview = CustomPreview(Geometry=brep_2, Material=ColourSwatch(SwatchColor=RGB(16, 232, 255)))
preview_2 = CustomPreview(Geometry=brep, Material=ColourSwatch(SwatchColor=RGB(230, 37, 255)))
staggered_mass = StaggeredMassing(
    SiteCurve=crv_select.OutputListOfParcels2,
    FloorHeightRequired=Slider(5.86, range=0..25),
    SetbackStepbacksForMassing="2",
    HeightsCorrespondingToStepbacks="20",
    MinArea=Slider(0, range=0..5000),
    NameOptional="v")  # -> OutputFloorCurves, OutputMassingBreps, OutputTextPanelTotalFSRGFAAchieved, NumberOfFloors, ExcludedCrv, Name
block = MassingExtrudeBlock(
    SiteCurve=crv_select.OutputListOfParcels1,
    Setback=Slider(5.336, range=0..25),
    FsrFar=Slider(3, range=0..25),
    FLRHT=Slider(5, range=0..5),
    MinCrvArea=Slider(50, range=0..50),
    NameOptional="a")  # -> OutputMassingBreps, OutputFloorCurves, Name
preview_3 = CustomPreview(Geometry=staggered_mass.OutputMassingBreps, Material=ColourSwatch(SwatchColor=RGB(237, 58, 17)))
preview_4 = CustomPreview(Geometry=block.OutputMassingBreps, Material=ColourSwatch(SwatchColor=RGB(41, 169, 17)))

crvs_from_names = ExtractCrvsFromNames(
    AllTheNamesOfTheCurves=crv_boundary.CrvNamesColor,
    AllTheCurvesToExtract=crv_boundary.RESULTSegGeom,
    StringCommaSeparatedNamesToExtractCurve="a")  # -> NamesExtractedCurves, CurvesExtracted
Z = UnitZ(Factor=1)
move = Move(Geometry=crvs_from_names.CurvesExtracted, Motion=Z)  # -> Geometry, Transform
item = ListItem(List=move.Geometry, Index=Slider(1, range=0..5), Wrap=True)
item_2 = ListItem(List=move.Geometry, Index=Slider(0, range=0..5), Wrap=True)

# ----
# color
path_2 = FilePath("C:\nir_dev\dots_tutorial\inputs\colors.csv")
color_input_parser = ColorInput(InpFilePath=path_2, ListSpaceKeysNames=crv_boundary.CrvNamesColor, ListSpaceCrvs=crv_boundary.RESULTSegGeom)  # -> BrepFromCrvs, ColorStr
Z_2 = UnitZ(Factor=Slider(0.038, range=0..1))
extr = Extrude(Base=color_input_parser.BrepFromCrvs, Direction=Z_2)
preview_5 = CustomPreview(Geometry=extr, Material=color_input_parser.ColorStr)

# ----
# fit spaces inside a curve
# for space allocation
path_3 = FilePath("C:\nir_dev\dots_tutorial\inputs\sample3.csv")
crv_3 = Curve(item_2)
cbsp_site = CbspSite(
    InputFilesCsv=path_3,
    InputSiteCrv=crv_3,
    RotationInDegrees=Slider(0, range=0..360),
    RandomizedGenerations=Toggle(False),
    MinDev=Slider(0, range=0..3),
    NumberOfOptimizationLoops=Slider(0.62, range=0..3),
    LayerName="cd")  # -> SpatialCrv, CirculationLines, CrvNamesColor

# ----
# fit spaces inside a curve
# for space allocation
path_4 = FilePath("C:\nir_dev\dots_tutorial\inputs\sample3.csv")
crv_4 = Curve(item)
cbsp_site_2 = CbspSite(
    InputFilesCsv=path_4,
    InputSiteCrv=crv_4,
    RotationInDegrees=Slider(0, range=0..360),
    RandomizedGenerations=Toggle(False),
    MinDev=Slider(0, range=0..3),
    NumberOfOptimizationLoops=Slider(0.62, range=0..3),
    LayerName="ce")  # -> SpatialCrv, CirculationLines, CrvNamesColor

# ----
# circulation
number_slider_2 = Slider(0, range=0..1)
circulation = GenerateCirculation(
    SiteCrvOuterBoundary=crv_3,
    CbspCrvs=cbsp_site.SpatialCrv,
    PartitionLines=cbsp_site.CirculationLines,
    CirculationDepth=number_slider_2)  # -> _0PartitionLines, _1CirculationPoly, _2ResultantCbspCrv

# ----
# circulation
number_slider_3 = Slider(0, range=0..1)
circulation_2 = GenerateCirculation(
    SiteCrvOuterBoundary=crv_4,
    CbspCrvs=cbsp_site_2.SpatialCrv,
    PartitionLines=cbsp_site_2.CirculationLines,
    CirculationDepth=number_slider_3)  # -> _0PartitionLines, _1CirculationPoly, _2ResultantCbspCrv

# ----
# color
path_5 = FilePath("C:\nir_dev\dots_tutorial\inputs\colors.csv")
color_input_parser_2 = ColorInput(InpFilePath=path_5, ListSpaceKeysNames=cbsp_site.CrvNamesColor, ListSpaceCrvs=circulation._2ResultantCbspCrv)  # -> BrepFromCrvs, ColorStr
Z_3 = UnitZ(Factor=Slider(0.015, range=0..1))
extr_2 = Extrude(Base=color_input_parser_2.BrepFromCrvs, Direction=Z_3)
preview_6 = CustomPreview(Geometry=extr_2, Material=color_input_parser_2.ColorStr)

# ----
# color
path_6 = FilePath("C:\nir_dev\dots_tutorial\inputs\colors.csv")
color_input_parser_3 = ColorInput(InpFilePath=path_6, ListSpaceKeysNames=cbsp_site_2.CrvNamesColor, ListSpaceCrvs=circulation_2._2ResultantCbspCrv)  # -> BrepFromCrvs, ColorStr
Z_4 = UnitZ(Factor=Slider(0.015, range=0..1))
extr_3 = Extrude(Base=color_input_parser_3.BrepFromCrvs, Direction=Z_4)
preview_7 = CustomPreview(Geometry=extr_3, Material=color_input_parser_3.ColorStr)
