# Grasshopper definition dots_util_01.gh (Grasshopper 1.0.7)
# plug-ins: DotsProj

crv = Curve(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)
parcel_subdiv = ParcelsBySubdivision(
    InputSite=crv,
    NumOfParcels=Slider(100, range=0..100),
    DevMean01=Slider(0.149, range=0..1),
    AngleAlignmentDegrees0360=Slider(0, range=0..360),
    ShowThisIterations=Slider(0, range=0..360),
    ResetAllValues=Toggle(True),
    Generate=Toggle(True))  # -> LowestDeviationOfParcelSolution, StreetCenterLines, OutputParcelFromRequiredIteration, OutputStreetFromRequiredIteration, NumberOfResults
geo = Geometry(parcel_subdiv.LowestDeviationOfParcelSolution)
toggle = BooleanToggle(False)
min_area_separator = CurveAreaSeparator(CrvList=parcel_subdiv.LowestDeviationOfParcelSolution, MinimumAreaSplit=Slider(465.065, range=0..1000))  # -> CrvAreaMinArea, CrvAreaMinArea_2
brep = Brep(min_area_separator.CrvAreaMinArea)
brep_2 = Brep(min_area_separator.CrvAreaMinArea_2)
preview = CustomPreview(Geometry=brep_2, Material=ColourSwatch(SwatchColor=RGB(16, 232, 255)))
preview_2 = CustomPreview(Geometry=brep, Material=ColourSwatch(SwatchColor=RGB(230, 37, 255)))
staggered_mass = StaggeredMassing(
    SiteCurve=min_area_separator.CrvAreaMinArea,
    FloorHeightRequired=Slider(5.86, range=0..25),
    SetbackStepbacksForMassing="2,4,7",
    HeightsCorrespondingToStepbacks="10,15,20",
    MinArea=Slider(0, range=0..5000),
    NameOptional="v")  # -> OutputFloorCurves, OutputMassingBreps, OutputTextPanelTotalFSRGFAAchieved, NumberOfFloors, ExcludedCrv, Name
block = MassingExtrudeBlock(
    SiteCurve=min_area_separator.CrvAreaMinArea_2,
    Setback=Slider(5.336, range=0..25),
    FsrFar=Slider(3, range=0..25),
    FLRHT=Slider(5, range=0..5),
    MinCrvArea=Slider(50, range=0..50),
    NameOptional="a")  # -> OutputMassingBreps, OutputFloorCurves, Name
preview_3 = CustomPreview(Geometry=staggered_mass.OutputMassingBreps, Material=ColourSwatch(SwatchColor=RGB(237, 58, 17)))
# color
preview_4 = CustomPreview(Geometry=block.OutputMassingBreps, Material=ColourSwatch(SwatchColor=RGB(41, 169, 17)))

crv_2 = Curve(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)
parcel_subdiv_2 = ParcelsBySubdivision(
    InputSite=crv_2,
    NumOfParcels=Slider(100, range=0..100),
    DevMean01=Slider(0.149, range=0..1),
    AngleAlignmentDegrees0360=Slider(0, range=0..360),
    ShowThisIterations=Slider(0, range=0..360),
    ResetAllValues=Toggle(True),
    Generate=Toggle(True))  # -> LowestDeviationOfParcelSolution, StreetCenterLines, OutputParcelFromRequiredIteration, OutputStreetFromRequiredIteration, NumberOfResults
geo_2 = Geometry(parcel_subdiv_2.LowestDeviationOfParcelSolution)
crv_select = CurveSelector(
    InputSiteCrv=crv_2,
    Parcels=parcel_subdiv_2.LowestDeviationOfParcelSolution,
    CentralizeOrDisperse=Toggle(False),
    AreaOfCurvesToSplitListInto=Slider(53.405, range=0..100))  # -> OutputListOfParcels1, OutputListOfParcels2
brep_3 = Brep(crv_select.OutputListOfParcels1)
brep_4 = Brep(crv_select.OutputListOfParcels2)
preview_5 = CustomPreview(Geometry=brep_4, Material=ColourSwatch(SwatchColor=RGB(16, 232, 255)))
preview_6 = CustomPreview(Geometry=brep_3, Material=ColourSwatch(SwatchColor=RGB(230, 37, 255)))
staggered_mass_2 = StaggeredMassing(
    SiteCurve=crv_select.OutputListOfParcels2,
    FloorHeightRequired=Slider(5.86, range=0..25),
    SetbackStepbacksForMassing="2,4,7",
    HeightsCorrespondingToStepbacks="10,15,20",
    MinArea=Slider(0, range=0..5000),
    NameOptional="v")  # -> OutputFloorCurves, OutputMassingBreps, OutputTextPanelTotalFSRGFAAchieved, NumberOfFloors, ExcludedCrv, Name
block_2 = MassingExtrudeBlock(
    SiteCurve=crv_select.OutputListOfParcels1,
    Setback=Slider(5.336, range=0..25),
    FsrFar=Slider(3, range=0..25),
    FLRHT=Slider(5, range=0..5),
    MinCrvArea=Slider(50, range=0..50),
    NameOptional="a")  # -> OutputMassingBreps, OutputFloorCurves, Name
preview_7 = CustomPreview(Geometry=staggered_mass_2.OutputMassingBreps, Material=ColourSwatch(SwatchColor=RGB(237, 58, 17)))
preview_8 = CustomPreview(Geometry=block_2.OutputMassingBreps, Material=ColourSwatch(SwatchColor=RGB(41, 169, 17)))
