# Grasshopper definition grids.gh (Grasshopper 1.0.7)
# plug-ins: DotsProj

curve = Curve(<curve referenced from the Rhino model>)
grids2d = Grids2d(SiteCurve=curve, NumInXDirection=3, NumInYDirection=3, RotationInDegrees=Slider(150, range=0..360))
courtyard_massing = CourtyardMassing(
    SiteCurve=grids2d,
    FSRFAR=1,
    FloorHeight=3,
    Setback=1,
    BayDepth=Slider(4, range=0..10),
    MinFloorArea=0.1,
    MinCourtyardArea=0.1,
    NameOptional="Dots_courtyard_massing")  # -> OutputFloorCurves, OutputMassingBreps, ExcludedCrv, CrvFsr, Name
massing_extrude_block = MassingExtrudeBlock(SiteCurve=courtyard_massing.ExcludedCrv, Setback=1, FSR=4, FLRHT=3, MinCrvArea=1, NameOptional="dots")  # -> OutputMassingBreps, OutputFloorCurves, Name
