# Grasshopper definition hand_drawn_parcels_mixed_use.gh (Grasshopper 1.0.7)
# plug-ins: DotsProj

curve = Curve([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])
ghpython_script = GhPythonScript(x=curve)  # -> out, a; inputs x: list
# ---------- ghpython_script: Python ----------
__author__ = "Nirvik Saha"
__version__ = "2020.12.08"

import rhinoscriptsyntax as rs
import random

li=["a","b","c"]
f_li=[]
for i in range(len(x)):
    x=random.choice(li)
    f_li.append(x)

a=f_li
# ---------- end ghpython_script ----------
file_path = FilePath("C:\nir_dev\MegaSavageLevel\DOTS\DotsProj\bin\example_Files\gh_workflows\hand_drawn_SF_3\massAdjSample.csv")
adj_solver = AdjSolver(
    InputAdjacencyFilePath=file_path,
    CurveList=curve,
    CorrespondingNameList=ghpython_script.a,
    NumberOfIterations=Slider(1, range=1..10),
    ClearPreviousValues=Toggle(True),
    RandomizeAdjRels=Toggle(True),
    RunSolver=Toggle(True))  # -> OutputCurves, OutputNames, MsgNumItrs
massing_extrude_block = MassingExtrudeBlock(
    SiteCurve=adj_solver.OutputCurves,
    Setback=Slider(20, range=1..20),
    FSR=Slider(7.5, range=1..20),
    FLRHT=Slider(4.2, range=3..7),
    MinCrvArea=Slider(100, range=3..100),
    NameOptional="dots")  # -> OutputMassingBreps, OutputFloorCurves, Name
file_path_2 = FilePath("C:\nir_dev\MegaSavageLevel\DOTS\DotsProj\bin\example_Files\gh_workflows\hand_drawn_SF_3\colorsBldg.csv")
unit_z = UnitZ(Factor=Slider(-1, range=-1..1))
color_input = ColorInput(InpFilePath=file_path_2, ListSpaceKeysNames=ghpython_script.a, ListSpaceCrvs=adj_solver.OutputCurves)  # -> BrepFromCrvs, ColorStr
move = Move(Geometry=color_input.BrepFromCrvs, Motion=unit_z)  # -> Geometry, Transform
curve_2 = Curve(flatten(massing_extrude_block.OutputFloorCurves))
custom_preview = CustomPreview(Geometry=move.Geometry, Material=color_input.ColorStr)
file_path_3 = FilePath("C:\nir_dev\MegaSavageLevel\DOTS\DotsProj\bin\example_Files\gh_workflows\hand_drawn_SF_3\siteFeasibility_activity.csv")
ghpython_script_2 = GhPythonScript(x=curve_2)  # -> out, a; inputs x: list
# ---------- ghpython_script_2: Python ----------
__author__ = "Nirvik Saha"
__version__ = "2020.12.08"

import rhinoscriptsyntax as rs
import random

li=["a","b","c","d"]
f_li=[]
for i in range(len(x)):
    x=random.choice(li)
    f_li.append(x)

a=f_li
# ---------- end ghpython_script_2 ----------
mixeduseallocator = MixedUseAllocator(InputProximityFilePath=file_path_3, BuildingFootprintCurves=curve_2, NameParent=ghpython_script_2.a)  # -> OutputCurves, NameOutputCrv, Debug
file_path_4 = FilePath("C:\nir_dev\MegaSavageLevel\DOTS\DotsProj\bin\example_Files\gh_workflows\site_Feasibility_2\colorsActivity.csv")
color_input_2 = ColorInput(
    InpFilePath=file_path_4,
    ListSpaceKeysNames=mixeduseallocator.NameOutputCrv,
    ListSpaceCrvs=mixeduseallocator.OutputCurves)  # -> BrepFromCrvs, ColorStr
custom_preview_2 = CustomPreview(Geometry=color_input_2.BrepFromCrvs, Material=color_input_2.ColorStr)
