# Grasshopper definition morphing.gh (Grasshopper 1.0.7)
# plug-ins: DotsProj

curve = Curve([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])
curve_2 = Curve([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])
curve_3 = Curve(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)
curve_4 = Curve([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])
curve_5 = Curve(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)
curve_6 = Curve([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])
map_extend_uv = MapExtendUV(InputCrvFrom=curve_5, InputCrvTo=curve_2, ShapesToMap=curve_6)
map_extend_uv_2 = MapExtendUV(InputCrvFrom=curve_3, InputCrvTo=curve, ShapesToMap=curve_4)
massing_extrude_block = MassingExtrudeBlock(SiteCurve=map_extend_uv, Setback=1, FSR=4, FLRHT=3, MinCrvArea=1, NameOptional="dots")  # -> OutputMassingBreps, OutputFloorCurves, Name
massing_extrude_block_2 = MassingExtrudeBlock(
    SiteCurve=map_extend_uv_2,
    Setback=Slider(1.4, range=1..20),
    FSR=Slider(3.4, range=3..7),
    FLRHT=Slider(3.5, range=3..7),
    MinCrvArea=1,
    NameOptional="dots")  # -> OutputMassingBreps, OutputFloorCurves, Name
