# Grasshopper definition siteFeasibility.gh (Grasshopper 1.0.7)
# plug-ins: DotsProj

number_slider = Slider(3, range=0..5)
path = FilePath("C:\nir_dev\MegaSavageLevel\MegaSavageLevel\DOTS\DotsProjRh6\DotsProj\DotsProj\bin\example_Files\siteFeasibilityInputs\siteFeasibility_building.csv")
crv = Curve([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])
crv_2 = Curve(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)
Z = UnitZ(Factor=Slider(-2, range=-2..1))
Z_2 = UnitZ(Factor=Slider(-0.514, range=-2..1))
brep = Brep(crv)
brep_2 = Brep(crv_2)
timer = Timer(TimerInterval=1000)  # disabled
dist_solver = DistSolverMain(
    InputProximityFilePath=path,
    InputCurve=crv_2,
    InputCurveListForExclusion=crv,
    FloorHeight=number_slider,
    InputGridNumber=Slider(266, range=0..500),
    MaxIterationsToTry=Slider(500, range=0..500),
    Randomize=Toggle(False))  # -> OutputLocationsOfMassing, OutputSiteSequenceForMassing, KeySequence, FlrCurves, FootprintCurves, Debug
move = Move(Geometry=brep_2, Motion=Z)  # -> Geometry, Transform
move_2 = Move(Geometry=brep, Motion=Z_2)  # -> Geometry, Transform
preview = CustomPreview(Geometry=move.Geometry, Material=ColourSwatch(SwatchColor=RGB(224, 95, 49)))
preview_2 = CustomPreview(Geometry=move_2.Geometry, Material=ColourSwatch(SwatchColor=RGB(19, 53, 6)))
Z_3 = UnitZ(Factor=Slider(-0.514, range=-2..1))
brep_3 = Brep(dist_solver.FootprintCurves)
move_3 = Move(Geometry=brep_3, Motion=Z_3)  # -> Geometry, Transform
path_2 = FilePath("C:\nir_dev\MegaSavageLevel\MegaSavageLevel\DOTS\DotsProjRh6\DotsProj\DotsProj\bin\example_Files\siteFeasibilityInputs\siteFeasibility_activity.csv")
path_3 = FilePath("C:\nir_dev\MegaSavageLevel\MegaSavageLevel\DOTS\DotsProjRh6\DotsProj\DotsProj\bin\example_Files\siteFeasibilityInputs\colorsBldg.csv")
m_u_alloc = MixedUseAllocator(InputProximityFilePath=path_2, InputCurve=dist_solver.FlrCurves, NameParent=dist_solver.KeySequence)  # -> OutputCurves, NameOutputCrv, Debug
color_input_parser = ColorInput(InpFilePath=path_3, ListSpaceKeysNames=dist_solver.Debug, ListSpaceCrvs=move_3.Geometry)  # -> BrepFromCrvs, ColorStr
preview_3 = CustomPreview(Geometry=color_input_parser.BrepFromCrvs, Material=color_input_parser.ColorStr)
brep_4 = Brep(m_u_alloc.OutputCurves)
path_4 = FilePath("C:\nir_dev\MegaSavageLevel\MegaSavageLevel\DOTS\DotsProjRh6\DotsProj\DotsProj\bin\example_Files\siteFeasibilityInputs\colorsActivity.csv")
geometry = Geometry(m_u_alloc.OutputCurves)
panel = Panel(m_u_alloc.NameOutputCrv)
unit_z = UnitZ(Factor=number_slider)
color_input_parser_2 = ColorInput(InpFilePath=path_4, ListSpaceKeysNames=m_u_alloc.NameOutputCrv, ListSpaceCrvs=geometry)  # -> BrepFromCrvs, ColorStr
extrude = Extrude(Base=color_input_parser_2.BrepFromCrvs, Direction=unit_z)
preview_4 = CustomPreview(Geometry=color_input_parser_2.BrepFromCrvs, Material=color_input_parser_2.ColorStr)
preview_5 = CustomPreview(Geometry=extrude, Material=color_input_parser_2.ColorStr)
