# Grasshopper definition siteFeasibility2.gh (Grasshopper 1.0.7)
# plug-ins: DotsProj

# ----
# FILE PATHS
massadjsample_csv = FilePath("C:\nir_dev\MegaSavageLevel\dots_tutorial\site_Feasibility_2\massAdjSample.csv")
sitefeasibility_activity_csv = FilePath("C:\nir_dev\MegaSavageLevel\dots_tutorial\site_Feasibility_2\siteFeasibility_activity.csv")
colorsactivity_csv = FilePath("C:\nir_dev\MegaSavageLevel\dots_tutorial\site_Feasibility_2\colorsActivity.csv")
colorsbldg_csv = FilePath("C:\nir_dev\MegaSavageLevel\dots_tutorial\site_Feasibility_2\colorsBldg.csv")

gridssa = FilePath("C:\nir_dev\MegaSavageLevel\dots_tutorial\site_Feasibility_2\gridSA.csv")
curve = Curve(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)
parcels_by_subdivision = ParcelsBySubdivision(
    InputSite=curve,
    NumberParcels=Slider(100, range=1..100),
    DevDim01=0,
    AngleAlignmentDegrees0360=0,
    ShowThisIterations=0,
    ResetAllValues=True,
    Generate=True)  # -> LowestDeviationOfParcelSolution, StreetCenterLines, OutputParcelFromRequiredIteration, OutputStreetFromRequiredIteration, NumberOfResults
unit_z = UnitZ(Factor=Slider(-1.5, range=-2..1))
brep = Brep(curve)
site_partition_circulation = SitePartitionCirculation(
    SiteCurve=curve,
    CirculationCurve=parcels_by_subdivision.StreetCenterLines,
    CirculationDepth=Slider(2.348, range=1..10),
    MinimumAreaPartition=1)  # -> CirculationCurves, PartitionCurves, CirculaitonClosedCurves
move = Move(Geometry=brep, Motion=unit_z)  # -> Geometry, Transform
custom_preview = CustomPreview(Geometry=move.Geometry, Material=ColourSwatch(SwatchColor=RGB(210, 255, 131)))
curve_2 = Curve(site_partition_circulation.PartitionCurves)
number_slider = Slider(200, range=0.1..200)
ghpython_script = GhPythonScript(x=curve_2)  # -> out, a; inputs x: list
# ---------- ghpython_script: Python ----------
__author__ = "Nirvik Saha"
__version__ = "2020.12.08"

import rhinoscriptsyntax as rs
import random

li=["a","b","c"]
f_li=[]
for i in range(len(x)):
    x=random.choice(li)
    f_li.append(x)

a=f_li
# ---------- end ghpython_script ----------
point = Point(Point(-2.599193058, -3.024359397, 0))
circle_cnr = CircleCNR(Center=point, Normal=Vector(0, 0, 1), Radius=number_slider)
adj_solver = AdjSolver(
    InputAdjacencyFilePath=massadjsample_csv,
    CurveList=curve_2,
    CorrespondingNameList=ghpython_script.a,
    NumberOfIterations=Slider(1, range=1..10),
    ClearPreviousValues=Toggle(True),
    RandomizeAdjRels=Toggle(True),
    RunSolver=Toggle(True))  # -> OutputCurves, OutputNames, MsgNumItrs
gen_hts_from_pts = GenHtsFromPts(
    InputParcelList=curve_2,
    InputPointList=point,
    NearRadiusOfInfluence=Slider(0.1, range=0.1..100),
    FarRadiusOfInfluence=number_slider,
    ConstantValueWhenNotInRange=Slider(0.7, range=0.1..3),
    OPTTrueLowIfCloseFalseHighIfClose=Toggle(False),
    MinValForInterpolation=Slider(0.6, range=0.1..7),
    MaxValForInterpolation=Slider(20, range=0.1..20))
panel = Panel(ghpython_script.a)
color_input = ColorInput(InpFilePath=colorsbldg_csv, ListSpaceKeysNames=adj_solver.OutputNames, ListSpaceCrvs=adj_solver.OutputCurves)  # -> BrepFromCrvs, ColorStr
unit_z_2 = UnitZ(Factor=Slider(-1, range=-1..1))
move_2 = Move(Geometry=color_input.BrepFromCrvs, Motion=unit_z_2)  # -> Geometry, Transform
massing_extrude_block = MassingExtrudeBlock(
    SiteCurve=adj_solver.OutputCurves,
    Setback=Slider(7.5, range=1..20),
    FSR=gen_hts_from_pts,
    FLRHT=Slider(4.2, range=3..7),
    MinCrvArea=Slider(100, range=3..100),
    NameOptional="dots")  # -> OutputMassingBreps, OutputFloorCurves, Name
custom_preview_2 = CustomPreview(Geometry=move_2.Geometry, Material=color_input.ColorStr)
curve_3 = Curve(flatten(massing_extrude_block.OutputFloorCurves))
ghpython_script_2 = GhPythonScript(x=curve_3)  # -> out, a; inputs x: list
# ---------- ghpython_script_2: Python ----------
__author__ = "Nirvik Saha"
__version__ = "2020.12.08"

import rhinoscriptsyntax as rs
import random

li=["a","b","c","d"]
f_li=[]
for i in range(len(x)):
    x=random.choice(li)
    f_li.append(x)

a=f_li
# ---------- end ghpython_script_2 ----------
mixeduseallocator = MixedUseAllocator(InputProximityFilePath=sitefeasibility_activity_csv, BuildingFootprintCurves=curve_3, NameParent=ghpython_script_2.a)  # -> OutputCurves, NameOutputCrv, Debug
panel_2 = Panel(mixeduseallocator.NameOutputCrv)
color_input_2 = ColorInput(
    InpFilePath=colorsactivity_csv,
    ListSpaceKeysNames=mixeduseallocator.NameOutputCrv,
    ListSpaceCrvs=mixeduseallocator.OutputCurves)  # -> BrepFromCrvs, ColorStr
custom_preview_3 = CustomPreview(Geometry=color_input_2.BrepFromCrvs, Material=color_input_2.ColorStr)
