# Grasshopper definition staggerred_courtyard.gh (Grasshopper 1.0.7)
# plug-ins: DotsProj

curve = Curve(<curve referenced from the Rhino model>)
curve_2 = Curve([<curve referenced from the Rhino model> x2])
site_partition_circulation = SitePartitionCirculation(
    SiteCurve=curve,
    CirculationCurve=curve_2,
    CirculationDepth=Slider(2, range=1..10),
    MinimumAreaPartition=Slider(12, range=5..20))  # -> DebugText, CirculationCurves, PartitionCurves
simplify_curve = SimplifyCurve(Curve=site_partition_circulation.PartitionCurves)  # -> Curve, Simplified
parcels_by_subdivision = ParcelsBySubdivision(
    InputSite=simplify(simplify_curve.Curve),
    NumberParcels=Slider(12, range=5..20),
    DevDim01=0,
    AngleAlignmentDegrees0360=0,
    ShowThisIterations=0,
    ResetAllValues=True,
    Generate=True)  # -> LowestDeviationOfParcelSolution, StreetCenterLines, OutputParcelFromRequiredIteration, OutputStreetFromRequiredIteration, NumberOfResults
staggered_courtyard_normal = StaggeredCourtyardNormal(
    Site=parcels_by_subdivision.OutputParcelFromRequiredIteration,
    Setback=Slider(2, range=1..10),
    BaseDepthOffset=Slider(4, range=1..10),
    NumOfTowerFootprintsBaseCrvSubdiv=Slider(7, range=5..20),
    NumberOfTowers=Slider(6, range=5..20),
    FloorHt=Slider(2, range=1..10),
    BaseFSRFAR=Slider(2, range=1..10),
    TowerFSRFAR=Slider(2, range=1..10),
    MinimumAreaSiteCrv=Slider(2, range=1..10),
    MinimumCourtyardArea=Slider(2, range=1..10),
    NameOptional="a")  # -> Offsetcrv, BaseFloorCurves, TowerFloorCurves, ExcludedSite, FinalBoundaryRepresentation, FsrVals, Name
brep = Brep(staggered_courtyard_normal.FinalBoundaryRepresentation)
custom_preview = CustomPreview(Geometry=staggered_courtyard_normal.FinalBoundaryRepresentation, Material=ColourSwatch(SwatchColor=RGB(143, 183, 255)))
