# Grasshopper definition test.gh (Grasshopper 1.0.7)
# plug-ins: DotsProj

panel = Panel("example_Files\inputs\gridSA.csv")
path = FilePath("C:\nir_dev\MegaSavageLevel\DotsProjRh6\DotsProj\DotsProj\bin\example_Files\grids\gridSA.csv")
crv = Curve(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)
grid_solver = GridAllocationSolver(
    InpFilePath=path,
    SiteCurve=crv,
    NumberXAxis=Slider(5, range=1..5),
    NumberYAxis=Slider(5, range=1..5),
    CirculationDepth=Slider(4, range=1..5),
    NumberOfIterations=Slider(1, range=1..5),
    MinimumAreaOfCurve=Slider(20, range=0..20))  # -> CrvNamesColor, ListOfFsr, Curve
path_2 = FilePath("C:\nir_dev\MegaSavageLevel\DotsProjRh6\DotsProj\DotsProj\bin\example_Files\grids\colors.csv")
panel_2 = Panel("a")
color_input_parser = ColorInput(InpFilePath=path_2, ListSpaceKeysNames=grid_solver.CrvNamesColor, ListSpaceCrvs=grid_solver.Curve)  # -> BrepFromCrvs, ColorStr
block = MassingExtrudeBlock(
    SiteCurve=grid_solver.Curve,
    Setback=Slider(2, range=1..5),
    FsrFar=grid_solver.ListOfFsr,
    FLRHT=Slider(5, range=1..5),
    MinCrvArea=Slider(5, range=1..5),
    NameOptional=grid_solver.CrvNamesColor)  # -> OutputMassingBreps, OutputFloorCurves, Name
preview = CustomPreview(Geometry=color_input_parser.BrepFromCrvs, Material=color_input_parser.ColorStr)
