# Grasshopper definition SiteCirculation.gh (Grasshopper 1.0.7)
# plug-ins: DotsProj

crv = Curve([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])
crv_2 = Curve([<curve referenced from the Rhino model> x16])
dots = DesignOptimizationToolSet()
ext_setbacks = UrbanMassingFromSiteFsrSetbacksStreets(
    InputSiteCurves=crv_2,
    StreetLayerNames="street1, street2, street3",
    CorrespondingStreetSetbacks="5,5,23",
    InputFSR=Slider(3.1, range=0..5),
    FloorHT=Slider(5, range=0..5))  # -> OutputSolidGeometry, OutputSITENumbers
ext_setbacks_2 = UrbanMassingFromSiteFsrSetbacksStreets(
    InputSiteCurves=crv,
    StreetLayerNames="street1, street2, street3",
    CorrespondingStreetSetbacks="10,5,40",
    InputFSR=Slider(12, range=0..12),
    FloorHT=Slider(4.824, range=0..5))  # -> OutputSolidGeometry, OutputSITENumbers
panel = Panel(dots)
panel_2 = Panel(ext_setbacks_2.OutputSITENumbers)
geo = Geometry(ext_setbacks_2.OutputSolidGeometry)
panel_3 = Panel(ext_setbacks.OutputSITENumbers)
geo_2 = Geometry(ext_setbacks.OutputSolidGeometry)
