# Grasshopper definition test.gh (Grasshopper 1.0.7)
# plug-ins: DotsProj

panel = Panel("https://apipw2.azurewebsites.net/api/get/partitions")
flr_ht = Slider(3, range=1..5)
number_of_partitions = Slider(1, range=1..10)
number_courtyard_blocks = Slider(3, range=0..5)
setback = Slider(5, range=1..5)
panel_2 = Panel("http://127.0.0.1:5000/api/get/partitions")
panel_4 = Panel("http://127.0.0.1:5000/api/post/peripheral")
flr_ht_2 = Slider(4, range=1..5)
setback_2 = Slider(9, range=1..50)
peripheral_depth = Slider(10, range=1..25)
fsr = Slider(5, range=1..5)
courtyard_block_depth = Slider(15, range=1..15)
run_or_not = BooleanToggle(False)
peripheral_depth_2 = Slider(46, range=1..100)
fsr_2 = Slider(3, range=1..5)
run_or_not_2 = BooleanToggle(True)
flr_ht_3 = Slider(4, range=1..5)
setback_3 = Slider(9, range=1..50)
number_slider = Slider(4, range=1..10)  # disabled
flr_ht_4 = Slider(3, range=1..5)  # disabled
curve = Curve(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)
fsr_3 = Slider(3, range=1..5)  # disabled
peripheral_depth_3 = Slider(49, range=1..100)  # disabled
num_partitions = Slider(8, range=1..10)
setback_4 = Slider(2.414, range=1..7)  # disabled
fsr_4 = Slider(5, range=1..5)
run_or_not_3 = BooleanToggle(True)  # disabled
curve_2 = Curve(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)  # disabled
curve_3 = Curve(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)
run_or_not_4 = BooleanToggle(True)
curve_4 = Curve(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)
partitionsysmain = PartitionSysMain(
    SiteCurve=curve,
    Url="http://127.0.0.1:5000/api/post/partitions",
    FloorSpaceRatio=fsr,
    FloorHeight=flr_ht_2,
    NumberOfPartitions=peripheral_depth,
    Setback=setback_2,
    Randomize=Slider(0, range=0..1),
    RunOrNot=run_or_not_2)  # -> DataSentInputs, DataObj, Parcels, Footprints, BuildingMassBlock, BuildingMassCourtyard; disabled
curve_5 = Curve(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)
typologysystem = TypologySystem(
    SiteCurve=curve_4,
    Type="L",
    Fsr=Slider(2.131, range=1..5),
    FloorHeight=Slider(5, range=1..5),
    Length=Slider(100, range=1..100),
    Width=Slider(100, range=1..100),
    Dist=Slider(13, range=1..100),
    AngleOfRotation0360=Slider(89, range=1..100),
    RotateFromCenter=Toggle(True),
    RunOrNot=Toggle(True))  # -> DataSentInputs, Site, TypologyFootprints, FloorCurves, Mass
peripheralpartitions = PeripheralPartitions(
    SiteCurve=curve_3,
    Url="https://apipw2.azurewebsites.net/api/get/partitions",
    NumberOfPartitions=number_of_partitions,
    FloorSpaceRatio=fsr_2,
    FloorHeight=flr_ht,
    PeripheralDepth=peripheral_depth_2,
    Setback=setback,
    CourtyardBlockDepth=courtyard_block_depth,
    NumberOfCourtyardBlocks=number_courtyard_blocks,
    RunOrNot=run_or_not)  # -> Debug, DataObj, Parcels, Footprints, BuildingMassBlock, BuildingMassCourtyard; disabled
ghpython_script = GhPythonScript(crv=curve_2, di=number_slider)  # -> out, a; inputs crv: Curve; disabled
# ---------- ghpython_script: Python ----------
__author__ = "Nirvik Saha"
__version__ = "2021.05.27"

import rhinoscriptsyntax as rs
p=rs.CurveAreaCentroid(crv)[0]
c2=rs.OffsetCurve(crv, p, di)
a=c2
# ---------- end ghpython_script ----------
partitionsysmain_2 = PartitionSysMain(
    SiteCurve=curve_5,
    Url="http://127.0.0.1:5000/api/post/partitions",
    FloorSpaceRatio=fsr_4,
    FloorHeight=flr_ht_3,
    NumberOfPartitions=num_partitions,
    Setback=setback_3,
    Randomize=Slider(0.6, range=0..1),
    RunOrNot=run_or_not_4)  # -> DataSentInputs, DataObj, Parcels, Footprints, BuildingMassBlock, BuildingMassCourtyard; disabled
peripheralsysmain = PeripheralSysMain(
    SiteCurve=ghpython_script.a,
    FloorSpaceRatio=fsr_3,
    FloorHeight=flr_ht_4,
    PeripheralDepth=peripheral_depth_3,
    Setback=setback_4,
    RunOrNot=run_or_not_3)  # -> DataSentInputs, DataObj, Parcels, Footprints, BuildingMassBlock, FloorCurves, InnerCurve; disabled
geometry = Geometry(typologysystem.Site)
geometry_2 = Geometry(typologysystem.TypologyFootprints)
geometry_3 = Geometry(typologysystem.Mass)
geometry_4 = Geometry(typologysystem.FloorCurves)
panel_6 = Panel(typologysystem.DataSentInputs)
panel_7 = Panel(peripheralpartitions.Debug)
panel_8 = Panel(peripheralpartitions.DataObj)
geometry_5 = Geometry(peripheralpartitions.Parcels)
geometry_6 = Geometry(peripheralpartitions.Footprints)
peripheral_subdivision_parcels = PeripheralSubdivisionParcels(
    SiteCurve=partitionsysmain.Parcels,
    SetbackDimensionFromSite=Slider(1, range=1..10),
    BayDepthFromSetback=Slider(32, range=1..50),
    InnerCrv0ffsetFromBay=Slider(1, range=1..10),
    NumDiv=Slider(6, range=1..10))  # -> Setback, Bay, InnerCrv, ParcelCrv, SiteCrvType
geometry_7 = Geometry(peripheralpartitions.BuildingMassCourtyard)
geometry_8 = Geometry(peripheralpartitions.BuildingMassBlock)
massing_extrude_block = MassingExtrudeBlock(
    SiteCurve=peripheral_subdivision_parcels.ParcelCrv,
    Setback=Slider(5.51, range=1..10),
    FSR=4,
    FLRHT=3,
    MinCrvArea=Slider(660.34, range=1..1000),
    NameOptional="dots")  # -> OutputMassingBreps, OutputFloorCurves, Name
