# Grasshopper definition 3important_source_code_gh_c3.gh (Grasshopper 1.0.7)

# ---- group: curve intersection
geo = Geometry(<curve referenced from the Rhino model>)
geo_2 = Geometry(<curve referenced from the Rhino model>)
c_script = CSharpScript(x=geo_2, y=geo)  # -> out, A; inputs x: Curve, y: Curve; disabled
# ---------- c_script: C# ----------
    Curve crv = x;
    Curve[] crvs = Rhino.Geometry.Curve.CreateBooleanDifference(crv, y);
    Print(crvs.Length.ToString());
    crv = crvs[0];
    A = crv;
# ---------- end c_script ----------
Z = UnitZ(Factor=Slider(90.7, range=0..100))
move = Move(Geometry=c_script.A, Motion=Z)  # -> Geometry, Transform
panel = Panel(c_script.out)

# ---- group: crv split params
crv = Curve(<curve referenced from the Rhino model>)  # disabled
c_script_2 = CSharpScript(innerCrv=crv, num=Slider(11, range=0..11))  # -> out, A, B, C; inputs innerCrv: Curve, num: Int32; disabled
# ---------- c_script_2: C# ----------
    string MSG = "";
    Point3d p0 = innerCrv.PointAtStart;
    Point3d p1 = innerCrv.PointAtEnd;
    double e0 = double.NaN;
    double e1 = double.NaN;
    var t0 = innerCrv.ClosestPoint(p0, out e0);
    var t1 = innerCrv.ClosestPoint(p1, out e1);
    double[] innerParamArr = new double[num];
    int k = 0;
    for (double i = 0.0; i < 1.0; i += (1.0 / num))
    {
      innerParamArr[k] = e0 + (e1 - e0) * i;
      MSG += innerParamArr[k].ToString() + ", ";
      k++;
    }

    List<Point3d> PtLi = new List<Point3d>();
    Curve[] innerCrvSplit = innerCrv.Split(innerParamArr);
    for (int i = 0; i < innerCrvSplit.Length; i++)
    {
      Point3d a = innerCrvSplit[i].PointAtStart;
      PtLi.Add(a);
    }
    A = MSG;
    B = PtLi;
# ---------- end c_script_2 ----------
panel_2 = Panel(c_script_2.A)
item = ListItem(List=c_script_2.C, Index=Slider(0, range=0..11), Wrap=True)
Z_2 = UnitZ(Factor=Slider(100, range=0..100))
extr = Extrude(Base=item, Direction=Z_2)

# ---- group: line line intersection
geo_3 = Geometry(<curve referenced from the Rhino model>)
geo_4 = Geometry(<curve referenced from the Rhino model>)
c_script_3 = CSharpScript(x=geo_4, y=geo_3)  # -> out, A; inputs x: Line, y: Line; disabled
# ---------- c_script_3: C# ----------
    double a = double.NaN;
    double b = double.NaN;

    bool t = Rhino.Geometry.Intersect.Intersection.LineLine(x, y, out a, out b, 0.01, true);
    A = t;
# ---------- end c_script_3 ----------
panel_3 = Panel(c_script_3.A)

# ----
crv_2 = Curve(<curve referenced from the Rhino model>)
crv_3 = Curve(<curve referenced from the Rhino model>)
c_script_4 = CSharpScript(crv1=crv_3, crv2=crv_2)  # -> out, A, B, C; inputs crv1: Curve, crv2: Curve; disabled
# ---------- c_script_4: C# ----------
    Curve[] crvs = Curve.CreateBooleanIntersection(crv1, crv2);
    if(crvs.Length == 0){
      Print("no intersectiom");
    }else{
      Print("intersection");
    }
    A = crvs;
# ---------- end c_script_4 ----------
panel_4 = Panel(c_script_4.out)
geo_5 = Geometry(c_script_4.A)

crv_4 = Curve([<curve referenced from the Rhino model> x4])
c_script_5 = CSharpScript(crvLi=crv_4)  # -> out, A; inputs crvLi: list of Curve
# ---------- c_script_5: C# usings ----------
using System.Linq;
# ---------- c_script_5: C# ----------
    Dictionary<int, double> crvIndexDict = new Dictionary<int, double>();
    for(int i = 0; i < crvLi.Count; i++){
      Curve c = crvLi[i];
      double ar = AreaMassProperties.Compute(c).Area;
      crvIndexDict.Add(i, ar);
    }
    var sol = from ele in crvIndexDict orderby ele.Value ascending select ele;
    List<Curve> nCrvLi = new List<Curve>();
    foreach(KeyValuePair<int, double> kvp in sol)
    {
      Print("sol key-value pair = {0}, {1}", kvp.Key, kvp.Value);
      int k = kvp.Key;
      double v = kvp.Value;
      nCrvLi.Add(crvLi[k]);
    }
    A = nCrvLi;
# ---------- end c_script_5 ----------
Z_3 = UnitZ(Factor=Slider(4, range=0..4))
item_2 = ListItem(List=c_script_5.A, Index=Slider(0, range=0..4), Wrap=True)
extr_2 = Extrude(Base=item_2, Direction=Z_3)

# ---- group: CURVE COMAIN
crv_5 = Curve(<curve referenced from the Rhino model>)  # disabled
c_script_6 = CSharpScript(crv=crv_5)  # -> out, A, B, C; inputs crv: Curve; disabled
# ---------- c_script_6: C# ----------
    double u = crv.Domain[0];
    double v = crv.Domain[1];
    double m=(v-u)/10;
    
    List<Point3d> ptLi = new List<Point3d>();
    for(double i = u; i < v; i += m){
      ptLi.Add(crv.PointAt(i));
    }
    A = ptLi;
# ---------- end c_script_6 ----------

# ---- group: offset crv
number_slider = Slider(100, range=0..100)
crv_6 = Curve(<curve referenced from the Rhino model>)
number_slider_2 = Slider(19, range=0..19)
c_script_7 = CSharpScript(outerCrv=crv_6, offset=Slider(39, range=0..100), numDiv=number_slider)  # -> out, A, B; inputs outerCrv: Curve, offset: Double, numDiv: Int32; disabled
# ---------- c_script_7: C# ----------
    Polyline poly = new Polyline();
    bool t = outerCrv.TryGetPolyline(out poly);
    
    Point3d cen = AreaMassProperties.Compute(outerCrv).Centroid;
    Curve[] crvs = outerCrv.Offset(cen, Vector3d.ZAxis, offset, 0.01, CurveOffsetCornerStyle.Sharp);
    Curve innerCrv = crvs[0];
    
    A = t;
    B = innerCrv;
    /*
    Point3d cen = AreaMassProperties.Compute(outerCrv).Centroid;
    Curve[] crvs = outerCrv.Offset(cen, Vector3d.ZAxis, offset, 0.01, CurveOffsetCornerStyle.Sharp);
    Curve innerCrv = crvs[0];
    double[] innerParams = innerCrv.DivideByCount(100, true);

    List<Point3d> ptLi = new List<Point3d>();
    List<LineCurve> segLi = new List<LineCurve>();

    for(int i = 0; i < innerParams.Length; i++){
      Point3d p = innerCrv.PointAt(innerParams[i]);
      double outerP = double.NaN;
      var t = outerCrv.ClosestPoint(p, out outerP);
      Point3d q = outerCrv.PointAt(outerP);
      LineCurve seg = new LineCurve(p, q);
      segLi.Add(seg);
      ptLi.Add(p);
    }
    A = segLi;
    B = innerCrv;
  */
# ---------- end c_script_7 ----------
panel_5 = Panel(c_script_7.A)
item_3 = ListItem(Index=number_slider, Wrap=True)
Z_4 = UnitZ(Factor=Slider(23, range=0..100))
move_2 = Move(Geometry=item_3, Motion=Z_4)  # -> Geometry, Transform

# ----
crv_7 = Curve(<curve referenced from the Rhino model>)
crv_8 = Curve(<curve referenced from the Rhino model>)
c_script_8 = CSharpScript(innerCrv=crv_7, outerCrv=crv_8, num=Slider(13, range=0..124))  # -> out, A, B; inputs innerCrv: Curve, outerCrv: Curve, num: Int32
# ---------- c_script_8: C# ----------
    List<Curve> globalTowerCrvLi = new List<Curve>();

    double[] innerCrvParams = innerCrv.DivideByCount(num, true);
    double[] outerCrvParams = outerCrv.DivideByCount(num, true);

    Curve dupInnerCrv = innerCrv.DuplicateCurve();
    Curve dupOuterCrv = outerCrv.DuplicateCurve();

    Curve[] innerCrvSplit = dupInnerCrv.Split(innerCrvParams);
    Curve[] outerCrvSplit = dupOuterCrv.Split(outerCrvParams);

    for(int i = 0; i < innerCrvSplit.Length; i++)
    {
      Point3d a = innerCrvSplit[i].PointAtStart;
      Point3d b = innerCrvSplit[i].PointAtEnd;
      Point3d c = outerCrvSplit[i].PointAtStart;
      Point3d d = outerCrvSplit[i].PointAtEnd;

      LineCurve lineBA = new LineCurve(c, a);
      Curve crv0 = (Curve) lineBA;

      LineCurve lineCD = new LineCurve(b, d);
      Curve crv1 = (Curve) lineCD;
      
      List<Curve> crvLi = new List<Curve> { crv0, innerCrvSplit[i], crv1, outerCrvSplit[i] };
      Curve[] e = Rhino.Geometry.Curve.JoinCurves(crvLi);
      globalTowerCrvLi.Add(e[0]);
    }

    B = globalTowerCrvLi;
# ---------- end c_script_8 ----------
Z_5 = UnitZ(Factor=Slider(20, range=0..124))
item_4 = ListItem(List=c_script_8.B, Index=Slider(6, range=0..124), Wrap=True)
move_3 = Move(Geometry=item_4, Motion=Z_5)  # -> Geometry, Transform

# ---- group: PERFECT _ OFFSET
crv_9 = Curve([<curve referenced from the Rhino model> x4])  # disabled
c_script_9 = CSharpScript(site_crv=crv_9, offDist=Slider(34.065, range=0.5..100))  # -> out, A; inputs site_crv: Curve, offDist: Double; disabled
# ---------- c_script_9: C# ----------
    Point3d cen = AreaMassProperties.Compute(site_crv).Centroid;
    Curve[] crvArr = site_crv.Offset(cen, Vector3d.ZAxis, offDist, 0.01, CurveOffsetCornerStyle.Sharp);
    Point3d p0 = crvArr[0].PointAt(0.0);
    PointContainment cont = crvArr[0].Contains(p0);
    if (cont.Equals(PointContainment.Unset) == true)
    {
      crvArr = site_crv.Offset(cen, -Vector3d.ZAxis, offDist, 0.01, CurveOffsetCornerStyle.Sharp);
    }
    else if (cont.Equals(PointContainment.Outside) == true)
    {
      crvArr = site_crv.Offset(cen, -Vector3d.ZAxis, offDist, 0.01, CurveOffsetCornerStyle.Sharp);
    }
    else if (cont.Equals(PointContainment.Coincident) == true)
    {
      crvArr = site_crv.Offset(cen, Vector3d.ZAxis, offDist, 0.01, CurveOffsetCornerStyle.Sharp);
    }
    else
    {
      // Print("Inside");
    }
    A = crvArr[0];
# ---------- end c_script_9 ----------
crv_10 = Curve(c_script_9.A)
panel_6 = Panel(c_script_9.out)

# ---- group: pointcontainment
pt = Point(Point(-81.77583052, -153.772644, 0))  # disabled
crv_11 = Curve(<curve referenced from the Rhino model>)
c_script_10 = CSharpScript(pt=pt, crv=crv_11)  # -> out, A; inputs pt: Point3d, crv: Curve; disabled
# ---------- c_script_10: C# ----------
    PointContainment t = crv.Contains(pt, Plane.WorldXY, Rhino.RhinoDoc.ActiveDoc.ModelAbsoluteTolerance);
    if(t.Equals(PointContainment.Outside) == true || t.Equals(PointContainment.Unset) == true){
      Print("outside");
    }else{
       Print("Inside");
    }
# ---------- end c_script_10 ----------

# ---- group: pts bbx
geo_6 = Geometry([<point referenced from the Rhino model> x12])
c_script_11 = CSharpScript(a=geo_6)  # -> out, A; inputs a: list of Point3d
# ---------- c_script_11: C# ----------
    
    Point3d[] ptArr = new Point3d[a.Count];
    for(int i = 0; i < a.Count; i++){
      ptArr[i] = a[i];
    }
    BoundingBox bbx= new BoundingBox(ptArr);
    Point3d[] PtArr = bbx.GetCorners();

    Point3d p = PtArr[0];
    Point3d q = PtArr[1];
    Point3d r = PtArr[2];
    Point3d s = PtArr[3];
    
    List<Point3d> ptLi = new List<Point3d>{p,q,r,s,p};
    Polyline poly = new Polyline(ptLi);
    A = poly;
# ---------- end c_script_11 ----------
Z_6 = UnitZ(Factor=Slider(0.25, range=0..1))
crv_12 = Curve(c_script_11.A)
move_4 = Move(Geometry=crv_12, Motion=Z_6)  # -> Geometry, Transform

# ----
panel_7 = Panel(c_script_10.out)

# ---- group: CURVEOFFSET
crv_13 = Curve(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)  # disabled
c_script_12 = CSharpScript(curve=crv_13)  # -> out, A; inputs curve: Curve; disabled
# ---------- c_script_12: C# ----------
    Point3d point = Rhino.Geometry.AreaMassProperties.Compute(curve).Centroid;
    var curves = curve.Offset(point, Vector3d.ZAxis, 10.0,
      doc.ModelAbsoluteTolerance, CurveOffsetCornerStyle.None);
    A = curves;
# ---------- end c_script_12 ----------

# ---- group: LAYERS
c_script_13 = CSharpScript(x="streetA, streetB")  # -> out, A; disabled
# ---------- c_script_13: C# ----------
    List<LineCurve> lineLi = new List<LineCurve>();
    string Str = x.ToString().ToUpper();
    string[] Y = Str.Split(',');
    for(int j = 0; j < Y.Length; j++){
      string X = Y[j].Trim().ToUpper();
      Rhino.DocObjects.RhinoObject[] rhobjs = Rhino.RhinoDoc.ActiveDoc.Objects.FindByLayer(X);
      List<LineCurve> li = new List<LineCurve>();
      for (int i = 0; i < rhobjs.Length; i++){
        //Print(rhobjs[i].Geometry.GetType().ToString());
        LineCurve line = (LineCurve) rhobjs[i].Geometry;
        li.Add(line);
        lineLi.Add(line);
      }
      //lineLi.Add(li);
    }



    A = lineLi;
    //Print(rhobjs.ToString());
# ---------- end c_script_13 ----------
Z_7 = UnitZ(Factor=Slider(1000, range=0..1000))
panel_8 = Panel(c_script_13.out)
move_5 = Move(Geometry=c_script_13.A, Motion=Z_7)  # -> Geometry, Transform; disabled

# ---- group: SHOOT RAYS AND INTERTSECTION WITH SITES
magnitude = Slider(732.846, range=0..1000)
number_of_rays = Slider(8, range=1..360)
istreets1 = Curve([<curve referenced from the Rhino model> x3])
istreets0 = Curve([<curve referenced from the Rhino model> x17])
site_crv_0 = Curve([<curve referenced from the Rhino model> x9])
c_script_14 = CSharpScript(iSites=site_crv_0, NumberOfRays=number_of_rays, Magnitude=magnitude, iStreets0=istreets0, iStreets1=istreets1)  # -> out, oSites, oRayIntx, intxPts; inputs iSites: list of Curve, NumberOfRays: Int32, Magnitude: Double, iStreets0: list of Line, iStreets1: list of Line; disabled
# ---------- c_script_14: C# ----------
    List <Line> lineLi = new List<Line>();
    List<Point3d> ptLi = new List<Point3d>();
    for(int i = 0; i < iSites.Count; i++){
      Curve crv = iSites[i];
      try{
        Point3d p = Rhino.Geometry.AreaMassProperties.Compute(crv).Centroid;
        Point3d q = new Point3d(p.X + 10.0, p.Y, p.Z);
        int n = NumberOfRays;
        double angle = (360 / n) * Math.PI / 180;
        for(double j = 0; j < 2 * Math.PI ; j += angle){
          double x = p.X + (Magnitude * Math.Cos(j) - Magnitude * Math.Sin(j));
          double y = p.Y + (Magnitude * Math.Sin(j) + Magnitude * Math.Cos(j));
          Point3d r = new Point3d(x, y, 0);
          Line l = new Line(p, r);
          Point3d intx = GetIntx(l, iStreets0);
          Point3d intx2 = GetIntx(l, iStreets1);
          if(intx.X != 0 && intx.Y != 0){
            ptLi.Add(intx);
          }
          if(intx2.X != 0 && intx2.Y != 0){
            ptLi.Add(intx2);
          }
          lineLi.Add(l);
        }
      }catch(Exception){}
    }
    oSites = iSites;
    oRayIntx = lineLi;
    intxPts = ptLi;
# ---------- c_script_14: C# additional code ----------
  public Point3d GetIntx(Line lineA, List<Line>streets){
    int count = 0;
    Point3d P = new Point3d(0, 0, 0);
    for(int i = 0; i < streets.Count; i++){
      Point3d p = lineA.PointAt(0.0);
      Point3d q = lineA.PointAt(1.0);
      double diA = lineA.Length;

      Line lineB = streets[i];
      Point3d r = lineB.PointAt(0.0);
      Point3d s = lineB.PointAt(1.0);
      double diB = lineB.Length;

      double a = 0.0;
      double b = 0.0;
      var t = Rhino.Geometry.Intersect.Intersection.LineLine(lineA, lineB, out a, out b);
      if(t == true){
        Point3d p2 = lineA.PointAt(a);
        Point3d q2 = lineB.PointAt(b);
        double pp2 = p.DistanceTo(p2);
        double qp2 = q.DistanceTo(p2);
        double rq2 = r.DistanceTo(q2);
        double sq2 = s.DistanceTo(q2);
        //Print((Math.Abs(pp2 + qp2 - diA).ToString()));
        if((Math.Abs(pp2 + qp2 - diA) < 1.1) && (Math.Abs(rq2 + sq2 - diB) < 1.1)){
          P = p2;
          count++;
        }
      }
    }
    Print(count.ToString());
    return P;
  }
# ---------- end c_script_14 ----------
geo_7 = Geometry(c_script_14.intxPts)

# ---- group: SPLIT CURVE PARAMS
crv_14 = Curve(<curve referenced from the Rhino model>)  # disabled
c_script_15 = CSharpScript(crv=crv_14)  # -> out, A, B, C; inputs crv: Curve; disabled
# ---------- c_script_15: C# ----------
    double[] paramArr = {10.5,50.0};
    Point3d a = crv.PointAt(0.0);
    Point3d b = crv.PointAt(50.0);
    A = a;
    B = b;
    Curve[] crv2 = crv.Split(paramArr);
    C = crv2;
# ---------- end c_script_15 ----------
Z_8 = UnitZ(Factor=Slider(40.2, range=0..100))
item_5 = ListItem(List=c_script_15.C, Index=Slider(1, range=0..3), Wrap=True)
move_6 = Move(Geometry=item_5, Motion=Z_8)  # -> Geometry, Transform

# ---- group: GET THE DISTANCE FROM EACH SITE
crv1 = Curve([<curve referenced from the Rhino model> x17])
crv0 = Curve([<curve referenced from the Rhino model> x3])
poly = Curve([<curve referenced from the Rhino model> x366])
c_script_16 = CSharpScript(crv0=crv0, crv1=crv1, poly=poly)  # -> out, A, B, C; inputs crv0: list of Curve, crv1: list of Curve, poly: list of Curve; disabled
# ---------- c_script_16: C# ----------
    List<Curve> crvLi = new List<Curve>();
    List<Point3d> pointLi = new List<Point3d>();
    List<Line> segLi = new List<Line>();
    List<Circle> cirLi = new List<Circle>();

    for(int i = 0; i < poly.Count; i++){
      Curve c0 = poly[i].DuplicateCurve();

      Polyline poly2 = new Polyline();
      var t = c0.TryGetPolyline(out poly2);
      
      //check line segments
      Line[] seg = poly2.GetSegments();
      for(int j = 0; j < seg.Length; j++){
        var xform = Transform.Translation(0, 0, 10);
        seg[j].Transform(xform);
        segLi.Add(seg[j]);
      }

      // check points from site poly
      List<Point3d> ptLi = new List<Point3d>();
      IEnumerator<Point3d> pts = poly2.GetEnumerator();
      while(pts.MoveNext()){
        ptLi.Add(pts.Current); //for this site
        pointLi.Add(pts.Current); // global
      }
      
      // DO not use global :- pointLi
      for(int j = 0; j < ptLi.Count; j++){
        Circle cir = new Circle(ptLi[j], 10);
        cirLi.Add(cir);
      }
      
      // check site poly
      poly[i].Translate(new Vector3d(0, 0, 10));
      crvLi.Add(poly[i]);
      for(int j = 0; j < crv0.Count; j++){
        Curve c1 = crv0[j];
      }
    }
    A = crvLi;
    B = segLi;
    C = cirLi;
# ---------- end c_script_16 ----------
geo_8 = Geometry(c_script_16.B)

# ---- group: CURVE-OFFSET-EXTRUSION
crv_15 = Curve([<curve referenced from the Rhino model> x364])
c_script_17 = CSharpScript(SITES=crv_15, DIST=Slider(2.381, range=0..10), TOLERANCE=Slider(6.021, range=0..15))  # -> out, A, B; inputs SITES: list of Curve, DIST: Double, TOLERANCE: Double
# ---------- c_script_17: C# ----------
    List<Curve> crvLi = new List<Curve>();
    for(int i = 0; i < SITES.Count; i++){
      try{
        Curve curve = SITES[i];
        Point3d point = Rhino.Geometry.AreaMassProperties.Compute(curve).Centroid;
        var curves = curve.Offset(point, Vector3d.ZAxis, DIST,
          doc.ModelAbsoluteTolerance, CurveOffsetCornerStyle.Sharp);
        crvLi.Add(curves[0]);
      }catch(Exception){
      }
    }
    A = crvLi;
    List<Extrusion> extLi = new List<Extrusion>();
    for(int i = 0; i < crvLi.Count; i++){
      Curve crv = crvLi[i];
      Extrusion extr = Extrusion.Create(crv, 10, true);
      extLi.Add(extr);
    }
    B = extLi;
# ---------- end c_script_17 ----------
Z_9 = UnitZ(Factor=Slider(0, range=0..100))
panel_9 = Panel(c_script_17.out)
move_7 = Move(Geometry=c_script_17.B, Motion=Z_9)  # -> Geometry, Transform
Z_10 = UnitZ(Factor=Slider(0, range=0..100))
move_8 = Move(Geometry=c_script_17.A, Motion=Z_10)  # -> Geometry, Transform

# ---- group: Random Generator
c_random_gen = CSharpScript(seed=Slider(7, range=0..10))  # -> out, A; inputs seed: Int32; disabled
# ---------- c_random_gen: C# ----------
    Random myRndGen = new Random(seed);
    double myRndDbl = myRndGen.NextDouble();
    Print(myRndDbl.ToString());

    int myRndInt = myRndGen.Next();
    Print(myRndInt.ToString());

    int myRndInt2 = myRndGen.Next(10, 20);
    Print(myRndInt2.ToString());


    for(int i = 0; i < 10; i++){
      Print(myRndGen.Next(0, 100).ToString());
    }

    List<Point3d> ptList = new List<Point3d>();
    double max = 200;
    for(int i = 0; i < 200; i++){
      double x = (myRndGen.NextDouble() * 2*max - max);
      double y = (myRndGen.NextDouble() * 2*max - max);
      double z = (myRndGen.NextDouble() * 2*max - max);
      Point3d pts = new Point3d(x, y, z);
      ptList.Add(pts);
    }

    A = ptList;
# ---------- end c_random_gen ----------
panel_10 = Panel(c_random_gen.out)

# ---- group: Loop circle relaxation
c_script_18 = CSharpScript(iCount=Slider(200, range=0..200), rad=Slider(2.048, range=0..100))  # -> out, A; inputs iCount: Int32, rad: Double
# ---------- c_script_18: C# ----------
    List<Point3d> ptLi = new List<Point3d>();
    for(int i = 0; i < iCount; i++){
      double x = rnd.NextDouble() * 2*rad - rad;
      double y = rnd.NextDouble() * 2*rad - rad;
      ptLi.Add(new Point3d(x, y, 0));
    }
    A = ptLi;
# ---------- c_script_18: C# additional code ----------
  Random rnd = new Random();
# ---------- end c_script_18 ----------
c_circle_relaxation = CSharpScript(iStartingPositions=c_script_18.A, iReset=Toggle(False), iterationCount=Slider(1000, range=0..1000))  # -> out, outputGeometry; inputs iStartingPositions: list of Point3d, iterationCount: Int32; disabled
# ---------- c_circle_relaxation: C# ----------
    List<Point3d> centers = new List<Point3d>(iStartingPositions); //copy the list of initial points
    Print(centers.Count.ToString());

    for(int iteration = 0; iteration < iterationCount; iteration++){ //main for loop
      List<Vector3d> totalMoves = new List<Vector3d>();
      List<double> collisionCounts = new List<double>();

      double collisionDistance = 2.0;
      
      for(int i = 0; i < centers.Count; i++){ // 2nd for loop
        totalMoves.Add(new Vector3d(0, 0, 0));
        collisionCounts.Add(0.0);
      }
      
      for(int i = 0; i < centers.Count; i++){ // 2nd for loop
        for(int j = i + 1; j < centers.Count; j++){
          double d = centers[i].DistanceTo(centers[j]);
          if(d > collisionDistance) {
            continue;
          }
          Vector3d move = centers[i] - centers[j];
          move.Unitize();
          move *= (0.5 * (collisionDistance - d));
          totalMoves[i] += move;
          totalMoves[j] -= move;
          collisionCounts[i] += 1.0;
          collisionCounts[j] += 1.0;
        }
      }
      for(int i = 0; i < centers.Count; i++){//2nd for loop
        if(collisionCounts[i] != 0){
          Vector3d avgMove = totalMoves[i] / collisionCounts[i];
          centers[i] += avgMove;
        }
      }
    }
    outputGeometry = centers;
# ---------- end c_circle_relaxation ----------
panel_11 = Panel(c_circle_relaxation.out)
cir = Circle(Plane=c_circle_relaxation.outputGeometry, Radius=1)

# ----
crv_16 = Curve(<curve referenced from the Rhino model>)

# ---- group: concept of persistent data
timer = Timer(TimerInterval=20, Target=c_persistent_var)  # disabled
c_persistent_var = CSharpScript(iReset=Toggle(True))  # -> out, A; inputs iReset: Boolean; disabled
# ---------- c_persistent_var: C# ----------
    if(iReset == true) n = 0;
    else n += 1;
    
    A = new Point3d(n, n, 0);
    Print(n.ToString());
# ---------- c_persistent_var: C# additional code ----------
  int n = 0;
# ---------- end c_persistent_var ----------
panel_12 = Panel(c_persistent_var.out)

# ----
c_script_19 = CSharpScript(crv=crv_16)  # -> out, A; inputs crv: Curve
# ---------- c_script_19: C# ----------
    Curve[] crvs = crv.Explode();
    List<Point3d> ptLi = new List<Point3d>();
    Polyline poly = new Polyline();
    bool t = crv.TryGetPolyline(out poly);
    if(t == true){
      IEnumerator<Point3d> ptArr = poly.GetEnumerator();
      while(ptArr.MoveNext()){
        ptLi.Add(ptArr.Current);
      }
    }
    else{
      double[] T = crv.DivideByCount(10, true);
      for(int i = 0; i < T.Length; i++){
        ptLi.Add(crv.PointAt(T[i]));
      }
    }
    A = ptLi;
# ---------- end c_script_19 ----------

# ---- group: point animated movement
vec = VectorXYZ(XComponent=Slider(0.495, range=0..1), YComponent=Slider(0.702, range=0..1), ZComponent=0)  # -> Vector, Length
timer_2 = Timer(TimerInterval=20, Target=c_persistent_point)  # disabled
c_persistent_point = CSharpScript(iReset=Toggle(True))  # -> out, A; inputs iReset: Boolean, iVelocity: Vector3d; disabled
# ---------- c_persistent_point: C# ----------
    if(iReset){
      pos = new Point3d(0, 0, 0);
      posLi = new List<Point3d>();

      for(int i = 0; i < 10; i++){
        posLi.Add(new Point3d(0, 0, 0));
      }
    }
    else{
      double x = rnd.NextDouble() - 0.5;
      double y = rnd.NextDouble() - 0.5;
      pos += new Vector3d(x, y, 0);
      posLi.Add(pos);
      posLi.RemoveAt(0);
    }
    A = posLi;
    //Print(position.X.ToString() + "," + position.Y.ToString());
# ---------- c_persistent_point: C# additional code ----------
  // global vars
  // common methods
  Point3d pos = new Point3d(0, 0, 0);
  Random rnd = new Random();

  List<Point3d> posLi = new List<Point3d>();
# ---------- end c_persistent_point ----------
panel_13 = Panel(c_persistent_point.A)
pline = PolyLine(Vertices=c_persistent_point.A, Closed=False)

# ---- group: curve to polyline decasteljsu
crv_17 = Curve(reparameterize(<curve referenced from the Rhino model>))  # disabled
c_subdiv_crv_poly = CSharpScript(curve=crv_17, tolerance=Slider(0.01, range=0.01..10))  # -> out, A; inputs curve: Curve, tolerance: Double; disabled
# ---------- c_subdiv_crv_poly: C# ----------
    List<LineCurve> segments = new List<LineCurve>();
    divideCurve(curve, 0.0, 1.0, tolerance, segments);
    A = segments;
# ---------- c_subdiv_crv_poly: C# additional code ----------
  void divideCurve(Curve crv, double tStart, double tEnd, double tolerance, List<LineCurve> segments){
    Point3d startPt = crv.PointAt(tStart);
    Point3d endPt = crv.PointAt(tEnd);
    Point3d midPt = 0.5 * (startPt + endPt);

    double tClosest;
    crv.ClosestPoint(midPt, out tClosest); // out => tClosest is automatically updated

    double di = crv.PointAt(tClosest).DistanceTo(midPt);
    if(di < tolerance){
      Print("counter-0");
      segments.Add(new LineCurve(startPt, endPt));
    }else{
      Print("counter-1");
      double tMid = 0.5 * (tStart + tEnd);
      divideCurve(crv, tStart, tMid, tolerance, segments);
      divideCurve(crv, tMid, tEnd, tolerance, segments);
    }
  }
# ---------- end c_subdiv_crv_poly ----------
Z_11 = UnitZ(Factor=Slider(1.5, range=0..10))
move_9 = Move(Geometry=c_subdiv_crv_poly.A, Motion=Z_11)  # -> Geometry, Transform
panel_14 = Panel(c_subdiv_crv_poly.out)

# ---- group: animated circle relaxation
c_script_20 = CSharpScript(iCount=Slider(191, range=0..200), rad=Slider(2.048, range=0..100))  # -> out, A; inputs iCount: Int32, rad: Double; same code as c_script_18
c_circle_relaxation_persistent = CSharpScript(iStartingPositions=c_script_20.A, iReset=Toggle(False))  # -> out, outputGeometry; inputs iStartingPositions: list of Point3d, iReset: Boolean; disabled
# ---------- c_circle_relaxation_persistent: C# ----------
   
    if(iReset){
      centers = new List<Point3d>(iStartingPositions); //copy the list of initial points
    }
    
    //for(int iteration = 0; iteration < iterationCount; iteration++){ //main for loop
      List<Vector3d> totalMoves = new List<Vector3d>();
      List<double> collisionCounts = new List<double>();

      double collisionDistance = 2.0;

      for(int i = 0; i < centers.Count; i++){ // 2nd for loop
        totalMoves.Add(new Vector3d(0, 0, 0));
        collisionCounts.Add(0.0);
      }

      for(int i = 0; i < centers.Count; i++){ // 2nd for loop
        for(int j = i + 1; j < centers.Count; j++){
          double d = centers[i].DistanceTo(centers[j]);
          if(d > collisionDistance) {
            continue;
          }
          Vector3d move = centers[i] - centers[j];
          move.Unitize();
          move *= (0.5 * (collisionDistance - d));
          totalMoves[i] += move;
          totalMoves[j] -= move;
          collisionCounts[i] += 1.0;
          collisionCounts[j] += 1.0;
        }
      }
      for(int i = 0; i < centers.Count; i++){//2nd for loop
        if(collisionCounts[i] != 0){
          Vector3d avgMove = totalMoves[i] / collisionCounts[i];
          centers[i] += avgMove;
        }
      }
    //}
    outputGeometry = centers;
# ---------- c_circle_relaxation_persistent: C# additional code ----------
 
  List<Point3d> centers=new List<Point3d>();//persistent centers at blank
# ---------- end c_circle_relaxation_persistent ----------
timer_3 = Timer(TimerInterval=20, Target=c_circle_relaxation_persistent)  # disabled
cir_2 = Circle(Plane=c_circle_relaxation_persistent.outputGeometry, Radius=1)
panel_15 = Panel(c_circle_relaxation_persistent.out)

# ---- group: polyline
c_script_21 = CSharpScript()  # -> out, A; disabled
# ---------- c_script_21: C# ----------
    Point3d a = new Point3d(0, 0, 0);
    Point3d b = new Point3d(50, 0, 0);
    Point3d c = new Point3d(50, 50, 0);
    Point3d d = new Point3d(0, 50, 0);
    List<Point3d> pts = new List<Point3d>();
    pts.Add(a);
    pts.Add(b);
    pts.Add(c);
    pts.Add(d);
    pts.Add(a);
    Polyline poly = new Polyline(pts);
    A = poly;
# ---------- end c_script_21 ----------
move_10 = Move(Geometry=c_script_21.A, Motion=Vector(0, 0, 10))  # -> Geometry, Transform

# ---- group: BREP.SWEEP
crv_18 = Curve(<curve referenced from the Rhino model>)  # disabled
c_script_22 = CSharpScript(x=crv_18, y=Slider(5.983, range=0..10))  # -> out, oCrv, P, Q, PolyX, PolyY, RAIL, SHAPE, oBrep; inputs x: Curve, y: Double; disabled
# ---------- c_script_22: C# ----------
    Curve crv0 = x.DuplicateCurve();
    bool t = x.Translate(0, 0, y);
    Curve crv1 = x.DuplicateCurve();
    Print(t.ToString());
    oCrv = crv1;
    Point3d p0 = new Point3d(crv0.PointAt(0.0));
    Point3d p1 = new Point3d(crv1.PointAt(0.0));
    P = p0;
    Q = p1;

    Polyline poly0 = new Polyline();
    var t2 = crv0.TryGetPolyline(out poly0);
    PolyX = poly0;
    Line[] poly0seg = poly0.GetSegments();

    Polyline poly1 = new Polyline();
    var t3 = crv1.TryGetPolyline(out poly1);
    PolyY = poly1;
    Line[] poly1seg = poly1.GetSegments();

    Curve rail2 = new LineCurve(p0, p1);
    List<Brep> brepli = new List<Brep>();
    int count = 0;
    for(int i = 0; i < poly0seg.Length; i++){
      Curve shape = new LineCurve(poly0seg[i].PointAt(0.0), poly0seg[i].PointAt(1.0));
      Brep[] brep = Brep.CreateFromSweep(rail2, shape, true, 1.0);
      brepli.Add(brep[0]);
      count++;
    }

    Curve topshape = new LineCurve(poly1seg[0].PointAt(0.0), poly1seg[0].PointAt(1.0));
    Curve toprail = new LineCurve(poly1seg[1].PointAt(0.0), poly1seg[1].PointAt(1.0));
    RAIL = toprail;
    SHAPE = topshape;
    try{
      Brep[] topFace = Brep.CreateFromSweep(toprail, topshape, false, 1.0);
      brepli.Add(topFace[0]);
    }catch(Exception){
    }

    Curve bottomshape = new LineCurve(poly0seg[0].PointAt(0.0), poly0seg[0].PointAt(1.0));
    Curve bottomrail = new LineCurve(poly0seg[1].PointAt(0.0), poly0seg[1].PointAt(1.0));
    try{
      Brep[] bottomFace = Brep.CreateFromSweep(bottomrail, bottomshape, false, 1.0);
      brepli.Add(bottomFace[0]);
    }catch(Exception){
    }

    Brep[] fBrep = Brep.JoinBreps(brepli.ToArray(), 0.0);
    Brep[] B = Brep.CreateSolid(brepli.ToArray(),0.0);
    oBrep = B;
# ---------- c_script_22: C# additional code ----------
  /// <summary>
  /// This method will be called once every solution, before any calls to RunScript.
  /// </summary>
  public override void BeforeRunScript()
  { }
  /// <summary>
  /// This method will be called once every solution, after any calls to RunScript.
  /// </summary>
  public override void AfterRunScript()
  { }
# ---------- end c_script_22 ----------
brep = Brep(c_script_22.oBrep)
panel_16 = Panel(c_script_22.out)
crv_19 = Curve(c_script_22.oCrv)
crv_20 = Curve(c_script_22.PolyY)
crv_21 = Curve(c_script_22.PolyX)
crv_22 = Curve(c_script_22.SHAPE)
crv_23 = Curve(c_script_22.RAIL)
Z_12 = UnitZ(Factor=Slider(5.983, range=0..10))
move_11 = Move(Geometry=crv_23, Motion=Z_12)  # -> Geometry, Transform
move_12 = Move(Geometry=crv_22, Motion=Z_12)  # -> Geometry, Transform

# ---- group: OOP
c_script_23 = CSharpScript()  # -> out, A
# ---------- c_script_23: C# ----------
    Pyramid pyr = new Pyramid();
    pyr.BasePlane = Plane.WorldXY;
    pyr.Length = 1.2;
    pyr.Width = 3.4;
    pyr.Height = 5.6;

    Pyramid pyr2 = new Pyramid(Plane.WorldYZ, 2.2, 1.4, 2.7);
    Print(pyr2.ComputeVol().ToString());
# ---------- c_script_23: C# additional code ----------
  class Pyramid{
    public Plane BasePlane;
    public double Length;
    public double Width;
    public double Height;
    public Pyramid(){}
    public Pyramid(Plane plane, double l, double w, double h){
      BasePlane = plane;
      Length = l;
      Width = w;
      Height = h;
    }
    public double ComputeVol(){
      return 0.333 * Length * Width * Height;
    }
  }
# ---------- end c_script_23 ----------

# ---- group: tapered brep
c_script_24 = CSharpScript()  # -> out, A, B; disabled
# ---------- c_script_24: C# ----------
    Point3d p0 = new Point3d(0, 0, 0);
    Point3d p1 = new Point3d(10, 0, 0);
    Point3d p2 = new Point3d(10, 10, 0);
    Point3d p3 = new Point3d(0, 10, 0);

    A = Brep.CreateFromCornerPoints(p0, p1, p2, p3, 0.0);
    Vector3d vec = new Vector3d(0, 0, 1);
    
    Point3d[] pts = {p0,p1,p2,p3,p0};
    PolylineCurve poly = new PolylineCurve(pts);
    
    B = Brep.CreateFromTaperedExtrude(poly, 10,vec,p0, RhinoMath.ToRadians(0.1) , ExtrudeCornerType.Sharp);
# ---------- c_script_24: C# additional code ----------
  /// <summary>
  /// This method will be called once every solution, before any calls to RunScript.
  /// </summary>
  public override void BeforeRunScript()
  { }
  /// <summary>
  /// This method will be called once every solution, after any calls to RunScript.
  /// </summary>
  public override void AfterRunScript()
  { }
# ---------- end c_script_24 ----------
geo_9 = Geometry(c_script_24.B)

# ---- group: RC with python xform translate
geo_10 = Geometry(<brep referenced from the Rhino model>)
python = PythonScript(x=geo_10)  # -> out, a; inputs x: Brep
# ---------- python: Python ----------
import Rhino
import Rhino.Geometry.Transform
import scriptcontext


obj_id = x
if obj_id != None:
    print "The object's unique id is {0}".format(obj_id)

y=x.Translate(18,-18,0)


a=obj_id
# ---------- end python ----------
panel_17 = Panel(python.out)

# ---- group: Needs to completed - brain curve
crv_24 = Curve(reparameterize(<curve referenced from the Rhino model>))
rad = Slider(5.494, range=0..10)
c_subdiv_crv_poly_2 = CSharpScript(curve=crv_24, rad=rad, tolerance=Slider(0.569, range=0.01..10))  # -> out, outputSegments, outputCenPts, outputCircles; inputs curve: Curve, rad: Double, tolerance: Double; disabled
# ---------- c_subdiv_crv_poly_2: C# ----------
    List<LineCurve> segments = new List<LineCurve>();
    divideCurve(curve, 0.0, 1.0, tolerance, segments);
    List < Point3d > cenPts = new List<Point3d>();
    List<Circle> circles = new List<Circle>();

    for(int i = 0; i < segments.Count; i++){
      Point3d p = 0.5 * (segments[i].PointAt(0.0) + segments[i].PointAt(1.0));
      cenPts.Add(p);
      Circle c = new Circle(p, rad);
      circles.Add(c);
    }

    outputSegments = segments;
    outputCenPts = cenPts;
    outputCircles = circles;
# ---------- c_subdiv_crv_poly_2: C# additional code ----------
  void divideCurve(Curve crv, double tStart, double tEnd, double tolerance, List<LineCurve> segments){
    Point3d startPt = crv.PointAt(tStart);
    Point3d endPt = crv.PointAt(tEnd);
    Point3d midPt = 0.5 * (startPt + endPt);

    double tClosest;
    crv.ClosestPoint(midPt, out tClosest); // out => tClosest is automatically updated

    double di = crv.PointAt(tClosest).DistanceTo(midPt);
    if(di < tolerance){
      Print("counter-0");
      segments.Add(new LineCurve(startPt, endPt));
    }else{
      Print("counter-1");
      double tMid = 0.5 * (tStart + tEnd);
      divideCurve(crv, tStart, tMid, tolerance, segments);
      divideCurve(crv, tMid, tEnd, tolerance, segments);
    }
  }
# ---------- end c_subdiv_crv_poly_2 ----------
Z_13 = UnitZ(Factor=Slider(5.863, range=0..10))
panel_18 = Panel(c_subdiv_crv_poly_2.out)
move_13 = Move(
    Geometry=[c_subdiv_crv_poly_2.outputCenPts, c_subdiv_crv_poly_2.outputSegments, c_subdiv_crv_poly_2.outputCircles],
    Motion=Z_13)  # -> Geometry, Transform; disabled

# ---- group: perfectBox
c_script_25 = CSharpScript(x=Slider(52.67, range=0..100), y=Slider(49.383, range=0..100), z=Slider(4.737, range=0..100))  # -> out, A; disabled
# ---------- c_script_25: C# ----------
    double a = (double)x;
    double b = (double)y;
    double c = (double)z;
    List<Point3d> pts = new List<Point3d>();
    pts.Add(new Point3d(0, 0, 0));
    pts.Add(new Point3d(a, 0, 0));
    pts.Add(new Point3d(a, b, 0));
    pts.Add(new Point3d(0, b, 0));
    pts.Add(new Point3d(0, 0, c));
    pts.Add(new Point3d(a, 0, c));
    pts.Add(new Point3d(a, b, c));
    pts.Add(new Point3d(0, b, c));
    Box box = new Box(Plane.WorldXY, pts.ToArray());
    A = box;
# ---------- end c_script_25 ----------

# ----
c_read_string_get_layername_get_geometry = CSharpScript(x="PW19Van_street_0")  # -> out, A; disabled
# ---------- c_read_string_get_layername_get_geometry: C# ----------
    List<LineCurve> lineLi = new List<LineCurve>();
    string X = x.ToString();
    Rhino.DocObjects.RhinoObject[] rhobjs = doc.Objects.FindByLayer(X);
    for (int i = 0; i < rhobjs.Length; i++){
      //if(rhobjs[i].Geometry is Rhino.Geometry.Line){
      Print(rhobjs[i].Geometry.GetType().ToString());
      LineCurve line = (LineCurve)rhobjs[i].Geometry;
      lineLi.Add(line);
      //}
    }
      
      
    A = lineLi;
    Print(rhobjs.ToString());
# ---------- end c_read_string_get_layername_get_geometry ----------
Z_14 = UnitZ(Factor=Slider(123, range=0..123))
panel_19 = Panel(c_read_string_get_layername_get_geometry.out)
move_14 = Move(Geometry=c_read_string_get_layername_get_geometry.A, Motion=Z_14)  # -> Geometry, Transform

magnitude_2 = Slider(732.846, range=0..1000)
number_of_rays_2 = Slider(8, range=1..360)
istreets1_2 = Curve([<curve referenced from the Rhino model> x3])
istreets0_2 = Curve([<curve referenced from the Rhino model> x17])
site_crv_0_2 = Curve([<curve referenced from the Rhino model> x9])  # disabled
c_rays_intersections = CSharpScript(iSites=site_crv_0_2, NumberOfRays=number_of_rays_2, Magnitude=magnitude_2, iStreets0=istreets0_2, iStreets1=istreets1_2)  # -> out, oSites, oRayIntx, intxPts; inputs iSites: list of Curve, NumberOfRays: Int32, Magnitude: Double, iStreets0: list of Line, iStreets1: list of Line; disabled; same code as c_script_14
geo_11 = Geometry(c_rays_intersections.intxPts)  # disabled

crv_25 = Curve(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)  # disabled
crv_26 = Curve(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)  # disabled
Z_15 = UnitZ(Factor=Slider(70, range=0..1000))
c_boolean_ops = CSharpScript(x=crv_26, y=crv_25)  # -> out, UnionOutput, IntxOutput, DiffOutput; inputs x: Curve, y: Curve; disabled
# ---------- c_boolean_ops: C# ----------
    Curve[] crvs = {x,y};
    Curve[] crv_union = Curve.CreateBooleanUnion(crvs);
    UnionOutput = crv_union;

    Curve[] intx = Curve.CreateBooleanIntersection(x, y);
    IntxOutput = intx;

    Curve[] diff = Curve.CreateBooleanDifference(x, y);
    DiffOutput = diff;
# ---------- end c_boolean_ops ----------
Z_16 = UnitZ(Factor=Slider(330, range=0..1000))
Z_17 = UnitZ(Factor=Slider(170, range=0..1000))
move_15 = Move(Geometry=c_boolean_ops.UnionOutput, Motion=Z_15)  # -> Geometry, Transform
move_16 = Move(Geometry=c_boolean_ops.DiffOutput, Motion=Z_16)  # -> Geometry, Transform
move_17 = Move(Geometry=c_boolean_ops.IntxOutput, Motion=Z_17)  # -> Geometry, Transform

# ---- group: CURVE-OFFSET-EXTRUSION
crv_27 = Curve([<curve referenced from the Rhino model> x364])  # disabled
c_offset_extrude = CSharpScript(SITES=crv_27, DIST=Slider(9.237, range=0..123), TOLERANCE=Slider(6.021, range=0..15))  # -> out, A, B; inputs SITES: list of Curve, DIST: Double, TOLERANCE: Double; disabled
# ---------- c_offset_extrude: C# ----------
    List<Curve> crvLi = new List<Curve>();
    for(int i = 0; i < SITES.Count; i++){
      try{
        Curve curve = SITES[i];
        Point3d point = Rhino.Geometry.AreaMassProperties.Compute(curve).Centroid;
        var curves = curve.Offset(point, Vector3d.ZAxis, DIST,
          doc.ModelAbsoluteTolerance, CurveOffsetCornerStyle.Sharp);
        crvLi.Add(curves[0]);
      }catch(Exception){
      }
    }
    A = crvLi;
    List<Extrusion> extLi = new List<Extrusion>();
    for(int i = 0; i < crvLi.Count; i++){
      Curve crv=crvLi[i];
      Extrusion extr = Extrusion.Create(crv, 10, true);
      extLi.Add(extr);
    }
    B = extLi;
# ---------- end c_offset_extrude ----------
Z_18 = UnitZ(Factor=Slider(0, range=0..100))
panel_20 = Panel(c_offset_extrude.out)
move_18 = Move(Geometry=c_offset_extrude.B, Motion=Z_18)  # -> Geometry, Transform
Z_19 = UnitZ(Factor=Slider(0, range=0..100))
move_19 = Move(Geometry=c_offset_extrude.A, Motion=Z_19)  # -> Geometry, Transform

# ---- group: GET THE DISTANCE FROM EACH SITE
crv1_2 = Curve([<curve referenced from the Rhino model> x17])
crv0_2 = Curve([<curve referenced from the Rhino model> x3])
poly_2 = Curve([<curve referenced from the Rhino model> x366])
c_duplicate_xform_transform_dist = CSharpScript(crv0=crv0_2, crv1=crv1_2, poly=poly_2)  # -> out, A, B, C; inputs crv0: list of Curve, crv1: list of Curve, poly: list of Curve; disabled
# ---------- c_duplicate_xform_transform_dist: C# ----------
    List<Curve> crvLi = new List<Curve>();
    List<Point3d> pointLi = new List<Point3d>();
    List<Line> segLi = new List<Line>();
    List<Circle> cirLi = new List<Circle>();

    for(int i = 0; i < poly.Count; i++){
      Curve c0 = poly[i].DuplicateCurve();

      Polyline poly2 = new Polyline();
      var t = c0.TryGetPolyline(out poly2);

      //check line segments
      Line[] seg = poly2.GetSegments();
      for(int j = 0; j < seg.Length; j++){
        var xform = Transform.Translation(0, 0, 10);
        seg[j].Transform(xform);
        segLi.Add(seg[j]);
      }

      // check points from site poly
      List<Point3d> ptLi = new List<Point3d>();
      IEnumerator<Point3d> pts = poly2.GetEnumerator();
      while(pts.MoveNext()){
        ptLi.Add(pts.Current); //for this site
        pointLi.Add(pts.Current); // global
      }

      // DO not use global :- pointLi
      for(int j = 0; j < ptLi.Count; j++){
        Circle cir = new Circle(ptLi[j], 10);
        cirLi.Add(cir);
      }

      // check site poly
      poly[i].Translate(new Vector3d(0, 0, 10));
      crvLi.Add(poly[i]);
      for(int j = 0; j < crv0.Count; j++){
        Curve c1 = crv0[j];
      }
    }
    A = crvLi;
    B = segLi;
    C = cirLi;
# ---------- end c_duplicate_xform_transform_dist ----------
geo_12 = Geometry(c_duplicate_xform_transform_dist.B)

# ---- group: Boolean OPS
crv_28 = Curve(<curve referenced from the Rhino model>)
crv_29 = Curve(<curve referenced from the Rhino model>)
Z_20 = UnitZ(Factor=Slider(100, range=0..100))
c_script_26 = CSharpScript(x=crv_28, y=crv_29)  # -> out, UNION, DIFF, INTX; inputs x: Curve, y: Curve
# ---------- c_script_26: C# ----------
    Curve[] un = new Curve[2];
    un[0] = x;
    un[1] = y;
    Curve[] union = Curve.CreateBooleanUnion(un);
    UNION = union;
    INTX = Curve.CreateBooleanIntersection(x, y);
    DIFF = Curve.CreateBooleanDifference(x, y);
# ---------- end c_script_26 ----------
Z_21 = UnitZ(Factor=Slider(72.04, range=0..100))
Z_22 = UnitZ(Factor=Slider(39.228, range=0..100))
move_20 = Move(Geometry=c_script_26.UNION, Motion=Z_20)  # -> Geometry, Transform
move_21 = Move(Geometry=c_script_26.DIFF, Motion=Z_21)  # -> Geometry, Transform
move_22 = Move(Geometry=c_script_26.INTX, Motion=Z_22)  # -> Geometry, Transform

# ---- group: CURVEOFFSET
crv_30 = Curve(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)  # disabled
c_offset = CSharpScript(curve=crv_30)  # -> out, A; inputs curve: Curve; disabled; same code as c_script_12

# ----
c_script_27 = CSharpScript(ROTATION=Slider(0, range=0..360), RATIO=Slider(0.598, range=0..2))  # -> out, A; inputs ROTATION: Double, RATIO: Double; disabled
# ---------- c_script_27: C# ----------
    Point3d p = new Point3d(0, 0, 0);
    List<Point3d> pts=customrect(p, 10, 10);
    A = new PolylineCurve(pts);
# ---------- c_script_27: C# additional code ----------
  public List<Point3d> customrect(Point3d p, double ux, double uy){
    
    Point3d a = new Point3d(p.X, p.Y, 0);
    Point3d b = new Point3d(p.X + ux, p.Y, 0);
    Point3d c = new Point3d(p.X + ux, p.Y + uy, 0);
    Point3d d = new Point3d(p.X, p.Y + uy, 0);
    List < Point3d > pts = new List<Point3d>{a,b,c,d,a};
    return pts;
  }
# ---------- end c_script_27 ----------

# ---- group: BSP-INT-POLY
crv_31 = Curve(<curve referenced from the Rhino model>)
crv_32 = Curve(<curve referenced from the Rhino model>)
c_script_28 = CSharpScript(SITE_CRV=crv_31, INT_CRV=crv_32)  # -> out, A; inputs SITE_CRV: Curve, INT_CRV: Curve
# ---------- c_script_28: C# ----------
    List<Curve> BSP_TREE = GenHalfPlanes(SITE_CRV, INT_CRV);
    A=RemovePoly(BSP_TREE, INT_CRV);
# ---------- c_script_28: C# additional code ----------
  public List<Curve> GenHalfPlanes(Curve site_crv, Curve int_crv){
    //main bsp-tree
    List<Curve> bsp_tree = new List<Curve>();
    List<Curve> ray_bbox = new List<Curve>();

    //bounding box of site-crv
    var t = site_crv.GetBoundingBox(true);
    Point3d A = t.Min;
    Point3d C = t.Max;
    Point3d B = new Point3d(C.X, A.Y, 0);
    Point3d D = new Point3d(A.X, C.Y, 0);
    Point3d[] pts = {A,B,C,D,A};

    PolylineCurve polyBB = new PolylineCurve(pts);// polylinecurve of site
    double diagB = 2 * A.DistanceTo(C);
    List<Line> rays = new List<Line>();

    //internal-polyline points
    Polyline intPolyPts = new Polyline();
    var t1 = int_crv.TryGetPolyline(out intPolyPts);
    IEnumerator<Point3d> ptRator = intPolyPts.GetEnumerator();
    List<Point3d> int_pts = new List<Point3d>();
    while(ptRator.MoveNext()){
      int_pts.Add(ptRator.Current);
    }

    bsp_tree.Add(site_crv);
    for(int i = 0; i < int_pts.Count - 1; i++){
      Point3d a = int_pts[i];
      Point3d b = int_pts[i + 1];
      Point3d m = new Point3d((a.X + b.X) / 2, (a.Y + b.Y) / 2, 0);
      double normMA = m.DistanceTo(a);
      double normMB = m.DistanceTo(b);

      Point3d p = new Point3d(m.X + (a.X - m.X) * diagB / normMA, m.Y + (a.Y - m.Y) * diagB / normMA, 0);
      Point3d q = new Point3d(m.X + (b.X - m.X) * diagB / normMB, m.Y + (b.Y - m.Y) * diagB / normMB, 0);
      Point3d u = new Point3d(q.X - p.X, q.Y - p.Y, 0);
      Point3d v = new Point3d(-u.Y, u.X, 0);
      Point3d r = new Point3d(p.X + v.X, p.Y + v.Y, 0);
      Point3d s = new Point3d(q.X + v.X, q.Y + v.Y, 0);
      Point3d w = new Point3d(u.Y, -u.X, 0);
      Point3d R = new Point3d(p.X + w.X, p.Y + w.Y, 0);
      Point3d S = new Point3d(q.X + w.X, q.Y + w.Y, 0);

      Point3d[] ptsA = {p,q,s,r,p};
      PolylineCurve polyA = new PolylineCurve(ptsA);
      Point3d[] ptsB = {p,q,S,R,p};
      PolylineCurve polyB = new PolylineCurve(ptsB);

      List<Curve> used_crv = new List<Curve>();
      List<Curve> new_crv = new List<Curve>();
      for(int j = 0; j < bsp_tree.Count; j++){
        int sum = 0;
        try
        {
          Curve[] crvA = Curve.CreateBooleanIntersection(bsp_tree[j], polyA);
          for(int k = 0; k < crvA.Length; k++){
            new_crv.Add(crvA[k]);
            sum++;
          }
        }
        catch(Exception){}
        try
        {
          Curve[] crvB = Curve.CreateBooleanIntersection(bsp_tree[j], polyB);
          for(int k = 0; k < crvB.Length; k++){
            new_crv.Add(crvB[k]);
            sum++;
          }
        }
        catch(Exception){}
        if(sum > 0){ used_crv.Add(bsp_tree[j]); }
      }
      for(int j = 0; j < new_crv.Count; j++){ bsp_tree.Add(new_crv[j]); }
      for(int j = 0; j < used_crv.Count; j++){ bsp_tree.Remove(used_crv[j]);}
    }
    return bsp_tree;
  }

  public List<Curve> RemovePoly(List<Curve> bsp_tree, Curve int_crv){
    List<Curve> del_crv = new List<Curve>();
    List<Curve> used_crv = new List<Curve>();
    for(int i = 0; i < bsp_tree.Count; i++){
      try{
        Point3d cen = AreaMassProperties.Compute(bsp_tree[i]).Centroid;
        var t = bsp_tree[i].Contains(cen);
        if(t.ToString().Equals("Inside")){
          del_crv.Add(bsp_tree[i]);
        }
      }catch(Exception){}

      for(int j = 0; j < del_crv.Count; j++){
        bsp_tree.Remove(del_crv[j]);
      }
    }
    return bsp_tree;
  }
# ---------- end c_script_28 ----------
crv_33 = Curve(c_script_28.A)

# ---- group: POINT CONTAINMENT
crv_34 = Curve(<curve referenced from the Rhino model>)
pt_2 = Point(Point(182.9267327, -149.790204, 0))
c_script_29 = CSharpScript(x=crv_34, y=pt_2)  # -> out, A; inputs x: Curve, y: Point3d
# ---------- c_script_29: C# ----------
    var t = x.Contains(y);
    Print(t.ToString());
    A = t;
# ---------- end c_script_29 ----------
panel_21 = Panel(c_script_29.A)
panel_22 = Panel(c_script_29.out)

# ---- group: BSP-SITE_PLAN
crv_35 = Curve(<curve referenced from the Rhino model>)
c_script_30 = CSharpScript(x=crv_35)  # -> out, A; inputs x: Curve
# ---------- c_script_30: C# ----------
    BSP bsp = new BSP(x);
    A = bsp.recSplit();
# ---------- c_script_30: C# additional code ----------
  class BSP{
    Curve siteCrv;
    Point3d centerPt;
    public BSP(Curve crv){
      siteCrv = crv;
      Point3d centerPt = Rhino.Geometry.AreaMassProperties.Compute(siteCrv).Centroid;
    }
    public Point3d getCentroid(){
      return centerPt;
    }
    public Point3d[] recSplit(){
      Plane plane = Rhino.Geometry.Plane.WorldXY;
      var bb = siteCrv.GetBoundingBox(true);
      Point3d a = bb.Min;
      Point3d c = bb.Max;
      Point3d b = new Point3d(c.X, a.Y, 0);
      Point3d d = new Point3d(a.X, c.Y, 0);
      Point3d[] pts = {a,b,c,d,a};
      //Polyline poly = new Polyline(pts);
      return pts;
    }
  }
# ---------- end c_script_30 ----------
