# Grasshopper definition dotsTest.gh (Grasshopper 1.0.7)
# plug-ins: DOTS

# ---- group: Partition by subdivision
crv = Curve(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)  # disabled
parcel_gen_1a = ParcelsBySubdivision(
    InputSite=crv,
    NumOfParcels=Slider(14.714, range=0..20),
    DevMean01=Slider(0, range=0..1),
    AngleAlignmentDegrees0360=Slider(3.183, range=0..20),
    ShowThisIterations=Slider(0, range=0..20000),
    ResetAllValues=Toggle(True))  # -> LowestDeviationSolution, OutputFromRequiredIteration; disabled
crv_2 = Curve(parcel_gen_1a.OutputFromRequiredIteration)  # disabled
crv_3 = Curve(parcel_gen_1a.LowestDeviationSolution)  # disabled

# ---- group: Partition by subdivision & subtraction
crv_4 = Curve(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)  # disabled
crv_5 = Curve(<curve referenced from the Rhino model>)  # disabled
parcel_gen_1b = ParcelsBySubdivisionWithSubtraction(
    InputSite=crv_4,
    InternalCrv=crv_5,
    NumOfParcels=Slider(14.714, range=0..20),
    DevMean01=Slider(0, range=0..1),
    AngleAlignmentDegrees0360=Slider(3.183, range=0..20),
    ShowThisIterations=Slider(0, range=0..20000),
    ResetAllValues=Toggle(True))  # -> LowestDeviationSolution, OutputFromRequiredIteration; disabled
crv_6 = Curve(parcel_gen_1b.LowestDeviationSolution)
crv_7 = Curve(parcel_gen_1b.OutputFromRequiredIteration)

# ---- group: Complex Massing streets, setbacks, FSR
crv_8 = Curve([<curve referenced from the Rhino model> x351])  # disabled
ext_setbacks = UrbanMassingFromSiteFsrSetbacksStreets(
    InputSiteCurves=crv_8,
    StreetLayerNames="streeta, streetb",
    CorrespondingStreetSetbacks="10.5, 15.0",
    InputFSR=Slider(4.09, range=0..15))  # -> OutputSolidGeometry, OutputSITENumbers; disabled
geo = Geometry(ext_setbacks.OutputSolidGeometry)
panel = Panel(ext_setbacks.OutputSITENumbers)

# ---- group: Partition from int poly
crv_9 = Curve(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)  # disabled
crv_10 = Curve(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)  # disabled
parcel_gen_2 = ParcelsFromInternalPoly(InputSiteCurve=crv_9, InternalPolyine=crv_10)  # disabled
crv_11 = Curve(parcel_gen_2)

# ---- group: Staggered Courtyard
number_slider = Slider(7.2, range=0..150)
number_slider_2 = Slider(86.714, range=0..200)
number_slider_3 = Slider(92.158, range=0..2000)
number_slider_4 = Slider(3.037, range=0..20)
number_slider_5 = Slider(3.41, range=0..20)
number_slider_6 = Slider(12.05, range=0..20)
number_slider_7 = Slider(10.377, range=0..20)
number_slider_8 = Slider(2000, range=0..2000)
number_slider_9 = Slider(5.92, range=0..20)
crv_12 = Curve(<curve referenced from the Rhino model>)  # disabled
geo_2 = Geometry()
geo_3 = Geometry()
geo_4 = Geometry()
geo_5 = Geometry()

# ---- group: Extrude Block
crv_13 = Curve(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)  # disabled
block = ExtrudeBlock(
    SiteCurve=crv_13,
    Setback=Slider(14.714, range=0..20),
    FsrFar=Slider(11.857, range=0..20),
    FLRHT=Slider(3.183, range=0..20),
    MinCrvArea=Slider(0, range=0..20000),
    HtArea1Flr=Slider(0, range=0..1))  # -> OutputExtrudedMass, FloorCurves; disabled
geo_6 = Geometry(block.OutputExtrudedMass)
geo_7 = Geometry(block.FloorCurves)

# ---- group: Staggered Massing
crv_14 = Curve(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)  # disabled
stagerred_mass = StagerredMassing(
    SiteCurve=crv_14,
    FloorHeightRequired=Slider(3.023, range=0..20),
    SetbackStepbacksForMassing="10,20,30,45",
    HeightsCorrespondingToStepbacks="10,20,30,45",
    MinArea=Slider(0, range=0..20000))  # -> OutputFloorCurves, OutputMassingBreps, OutputTextPanelTotalFSRGFAAchieved, DebugText; disabled
geo_8 = Geometry(stagerred_mass.OutputFloorCurves)
geo_9 = Geometry(stagerred_mass.OutputMassingBreps)

# ---- group: Courtyard Massing
crv_15 = Curve(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)  # disabled
courtyard_mass = CourtyardMassing(
    SiteCurve=crv_15,
    FSRFAR=Slider(3.023, range=0..20),
    FloorHeight=Slider(6.223, range=0..20),
    Setback=Slider(20, range=0..20),
    BayDepth=Slider(20, range=0..20),
    MaxHtFloorArea=Slider(0, range=0..20000))  # -> OutputFloorCurves, OutputMassingBreps; disabled
geo_10 = Geometry(courtyard_mass.OutputFloorCurves)
geo_11 = Geometry(courtyard_mass.OutputMassingBreps)

# ----
staggered_courtyard_interp = StaggeredCourtyardInterpolated(
    Site=crv_12,
    Setback=number_slider_9,
    OFFSET_INP=number_slider_2,
    NumberOfDivisionsPerSegPolyOverallSmoothCurves=number_slider,
    NumberOfTowers=number_slider_4,
    FloorFloorHeight=number_slider_5,
    BaseFSRFAR=number_slider_6,
    TowerFSRFAR=number_slider_7,
    MinimumAreaSiteCrv=number_slider_8,
    MinimumAreaTowerCrv=number_slider_3)  # -> OffsetCurve, BaseFloorCurves, TowerFloorCurves, PolyFromSubDivOfCrvs, Debug, FinalBoundaryRepresentation; disabled
about = WipDotsProject()
panel_2 = Panel(about)

path = FilePath("C:\Users\saha_admin\Documents\MegaSavageLevel\Dots\DotsProj\DotsProj\SourceCode\test_scripts\inputs Mcmc.csv")  # disabled
crv_16 = Curve(<curve referenced from the Rhino model>)  # disabled
curve_skeleton = CrvSkeleton(
    InpFilePath=path,
    InpSiteCurve=crv_16,
    FromSiteOuterCirculationDepth=Slider(14.062, range=0..50),
    FromOuterCirculationBayDepth=Slider(21.381, range=0..50),
    FromBayDepthInnerCirculationDepth=Slider(6.657, range=0..50),
    SensitivityX100=Slider(2, range=0..5),
    OptimizationItrs=Slider(1000, range=0..1000))  # -> DebugString, DebugAdjString, DebugGeomString
geo_12 = Geometry()
geo_13 = Geometry()

path_2 = FilePath("C:\Users\saha_admin\Documents\MegaSavageLevel\Dots\DotsProj\DotsProj\SourceCode\test_scripts\inputs Mcmc.csv")  # disabled
crv_17 = Curve(<curve referenced from the Rhino model>)  # disabled
curve_skeleton_2 = CrvSkeleton(
    InpFilePath=path_2,
    InpSiteCurve=crv_17,
    FromSiteOuterCirculationDepth=Slider(18, range=0..20),
    FromOuterCirculationBayDepth=Slider(50, range=0..50),
    FromBayDepthInnerCirculationDepth=Slider(5, range=0..20),
    SensitivityX100=Slider(2, range=0..5),
    OptimizationItrs=Slider(445, range=0..500))  # -> DebugString, DebugAdjString, DebugGeomString
geo_14 = Geometry()
geo_15 = Geometry()
geo_16 = Geometry()

# ---- group: constrained BSP
number_slider_10 = Slider(202, range=0..1000)
number_slider_11 = Slider(1.33, range=0.5..5)
number_slider_12 = Slider(0, range=0..360)
randomize = BooleanToggle(False)
path_3 = FilePath("C:\Users\saha_admin\Documents\MegaSavageLevel\Dots\DotsProj\DotsProj\SourceCode\test_scripts\inputsBsp.csv")  # disabled

# ----
Z = UnitZ(Factor=Slider(50, range=0..50))
item = ListItem(Index=Slider(18, range=0..50), Wrap=True)  # disabled
extr = Extrude(Base=geo_13, Direction=Z)

cbsp = CbspIndependent(
    InputFilesCsv=path_3,
    RotationInDegrees=number_slider_12,
    RatioLengthWidth=number_slider_11,
    RandomizedGenerations=randomize,
    NumberOfOptimizationLoops=number_slider_10)  # -> DebugOutputAdjacency, DebugGeomInputToBSP, OuterBoundary; disabled
timer = Timer(TimerInterval=20, Target=cbsp)  # disabled

circulation = GenerateCirculation(
    SiteCrvOuterBoundary=cbsp.DebugOutputAdjacency,
    CbspCrvs=cbsp.DebugGeomInputToBSP,
    PartitionLines=cbsp.OuterBoundary,
    CirculationDepth=Slider(1.156, range=0..15))  # -> _0PartitionLines, _1CirculationPoly, _2ResultantCbspCrv
geo_17 = Geometry(circulation._2ResultantCbspCrv)
Z_2 = UnitZ(Factor=Slider(4.186, range=0..10))
extr_2 = Extrude(Base=geo_17, Direction=Z_2)
geo_18 = Geometry(circulation._1CirculationPoly)
Z_3 = UnitZ(Factor=Slider(10, range=0..10))
extr_3 = Extrude(Base=geo_18, Direction=Z_3)

number_slider_13 = Slider(0, range=0..5)
reset_gen = BooleanToggle(False)
save_gen = BooleanToggle(False)
randomize_2 = BooleanToggle(True)
number_slider_14 = Slider(0, range=0..5)
path_4 = FilePath("C:\nir_dev\MegaSavageLevel\DOTS\DotsProj\DotsProj\SourceCode\test_scripts\inputsBsp.csv")
timer_2 = Timer(TimerInterval=20, Target=input_cbsp)  # disabled
randomize_3 = BooleanToggle(False)
reset_gen_2 = BooleanToggle(False)
save_gen_2 = BooleanToggle(False)
input_cbsp = Cbsp(
    InputFilesCsv=path_4,
    RotationInDegrees=Slider(0, range=0..360),
    RatioLengthWidth=Slider(0.649, range=0.5..5),
    CirculationDepth=Slider(9, range=0..10),
    RandomizedGenerations=randomize_2)  # -> OutputAdjacency, GeomInputToBSP, OuterBoundary; disabled
path_5 = FilePath("C:\nir_dev\MegaSavageLevel\DOTS\DotsProj\DotsProj\SourceCode\test_scripts\inputsBsp.csv")  # disabled
geo_19 = Geometry(<curve referenced from the Rhino model>)  # disabled
timer_3 = Timer(TimerInterval=20)  # disabled
input_cbsp_2 = Cbsp(
    InputFilesCsv=path_5,
    InputSiteCrv=geo_19,
    RotationInDegrees=Slider(254.477, range=0..360),
    CirculationDepth=Slider(3, range=0..10),
    RandomizedGenerations=randomize_3)  # -> OuterCurve, ReconstructedSpatialObjects; disabled
geo_20 = Geometry()
geo_21 = Geometry(input_cbsp.OuterBoundary)
geo_22 = Geometry()
geo_23 = Geometry()
geo_24 = Geometry(input_cbsp_2.OuterCurve)
geo_25 = Geometry(input_cbsp_2.ReconstructedSpatialObjects)
panel_3 = Panel(input_cbsp.GeomInputToBSP)
panel_4 = Panel(input_cbsp.OutputAdjacency)
Z_4 = UnitZ(Factor=Slider(14.271, range=0..360))
Z_5 = UnitZ(Factor=Slider(0, range=0..360))
extr_4 = Extrude(Base=geo_22, Direction=Z_4)
extr_5 = Extrude(Base=geo_20, Direction=Z_5)

Z_6 = UnitZ(Factor=Slider(0.424, range=0..360))
geo_26 = Geometry()
move = Move(Geometry=geo_26, Motion=Z_6)  # -> Geometry, Transform

path_6 = FilePath("C:\nir_dev\MegaSavageLevel\DOTS\DotsProj\DotsProj\SourceCode\test_scripts\inputs Mcmc.csv")
timer_4 = Timer(TimerInterval=1000, Target=exploratory_mcmc)  # disabled
exploratory_mcmc = EMcMC(InpFilePath=path_6, Rotation=Slider(25, range=0..360), Rotation_2=Slider(0.25, range=0..2))  # disabled
panel_5 = Panel(exploratory_mcmc)

number_slider_15 = Slider(0, range=0..5)
randomize_4 = BooleanToggle(False)
reset_gen_3 = BooleanToggle(False)
save_gen_3 = BooleanToggle(False)
geo_27 = Geometry(<curve referenced from the Rhino model>)
path_7 = FilePath("C:\Users\saha_admin\Documents\MegaSavageLevel\Dots\DotsProj\DotsProj\SourceCode\test_scripts\inputsBsp.csv")  # disabled
cbsp_site = CbspSite(
    InputFilesCsv=path_7,
    InputSiteCrv=geo_27,
    RotationInDegrees=Slider(193.17, range=0..360),
    CirculationDepth=Slider(0, range=0..10),
    RandomizedGenerations=randomize_4)  # -> OuterCurve, ReconstructedSpatialObjects
geo_28 = Geometry()  # disabled
geo_29 = Geometry(cbsp_site.OuterCurve)
geo_30 = Geometry(cbsp_site.ReconstructedSpatialObjects)
geo_31 = Geometry()

timer_5 = Timer(TimerInterval=1000, Target=cbsp_site)  # disabled

circulation_2 = GenerateCirculation(SiteCrvOuterBoundary=geo_27, CirculationDepth=Slider(7.32, range=0..15))  # -> _0PartitionLines, _1CirculationPoly, _2ResultantCbspCrv; disabled
geo_32 = Geometry(circulation_2._2ResultantCbspCrv)
Z_7 = UnitZ(Factor=Slider(10.694, range=0..50))
extr_6 = Extrude(Base=geo_32, Direction=Z_7)
geo_33 = Geometry(circulation_2._1CirculationPoly)
Z_8 = UnitZ(Factor=Slider(35.74, range=0..50))
extr_7 = Extrude(Base=geo_33, Direction=Z_8)

Z_9 = UnitZ(Factor=Slider(103.55, range=0..360))
item_2 = ListItem(List=geo_31, Index=Slider(10, range=0..10), Wrap=True)  # disabled
extr_8 = Extrude(Base=geo_31, Direction=Z_9)

# ---- group: Staggered Courtyard
number_slider_16 = Slider(31.8, range=0..150)
number_slider_17 = Slider(59.705, range=0..200)
number_slider_18 = Slider(92.158, range=0..2000)
number_slider_19 = Slider(0, range=0..2000)
number_slider_20 = Slider(6.646, range=0..20)
number_slider_21 = Slider(3.213, range=0..20)
number_slider_22 = Slider(3.233, range=0..20)
number_slider_23 = Slider(13.87, range=0..20)
number_slider_24 = Slider(11.96, range=0..20)
crv_18 = Curve(<curve referenced from the Rhino model>)  # disabled
geo_34 = Geometry()
geo_35 = Geometry()
geo_36 = Geometry()

# ----
staggered_courtyard_normal = StaggeredCourtyardNormal(
    Site=crv_18,
    Setback=number_slider_24,
    OFFSET_INP=number_slider_17,
    NumberOfDivisionsPerSegPolyOverallSmoothCurves=number_slider_16,
    NumberOfTowers=number_slider_20,
    FloorFloorHeight=number_slider_21,
    BaseFSRFAR=number_slider_22,
    TowerFSRFAR=number_slider_23,
    MinimumAreaSiteCrv=number_slider_19,
    MinimumAreaTowerCrv=number_slider_18)  # -> OffsetCurve, BaseFloorCurves, TowerFloorCurves, PolyFromSubDivOfCrvs, Debug, FinalBoundaryRepresentation; disabled

# ---- group: Staggered Courtyard (continued)
geo_37 = Geometry(staggered_courtyard_normal.TowerFloorCurves)

# ---- group: curve-oriented cBSP
number_slider_25 = Slider(3, range=0..5)
number_slider_26 = Slider(50.4, range=0..360)
randomize_5 = BooleanToggle(True)
geo_38 = Geometry(<curve referenced from the Rhino model>)
path_8 = FilePath("C:\Users\saha_admin\Documents\MegaSavageLevel\Dots\DotsProj\DotsProj\SourceCode\test_scripts\inputsFpa.csv")
geo_39 = Geometry()
geo_40 = Geometry()  # disabled
geo_41 = Geometry()

# ----
cbsp_site_2 = CbspSite(
    InputFilesCsv=path_8,
    InputSiteCrv=geo_38,
    RotationInDegrees=number_slider_26,
    RandomizedGenerations=randomize_5,
    NumberOfOptimizationLoops=number_slider_25)  # -> SpatialCrv, CirculationLines

# ---- group: curve-oriented cBSP (continued)
geo_42 = Geometry(cbsp_site_2.CirculationLines)

# ----
Z_10 = UnitZ(Factor=Slider(103.55, range=0..360))
item_3 = ListItem(List=geo_41, Index=Slider(10, range=0..10), Wrap=True)  # disabled
extr_9 = Extrude(Base=geo_41, Direction=Z_10)

circulation_3 = GenerateCirculation(SiteCrvOuterBoundary=geo_38, CirculationDepth=Slider(13.294, range=0..15))  # -> _0PartitionLines, _1CirculationPoly, _2ResultantCbspCrv; disabled
geo_43 = Geometry(circulation_3._2ResultantCbspCrv)
Z_11 = UnitZ(Factor=Slider(3.203, range=0..10))
extr_10 = Extrude(Base=geo_43, Direction=Z_11)
geo_44 = Geometry(circulation_3._1CirculationPoly)
Z_12 = UnitZ(Factor=Slider(10, range=0..10))
extr_11 = Extrude(Base=geo_44, Direction=Z_12)
